# Grasshopper definition ACORN-shell.gh (Grasshopper 1.0.7)
# plug-ins: HAL for Grasshopper, karambaGH

sessionsettings = SessionSettings()
rectangle = Rectangle(Plane=PlaneXY(0, 0, 0), XSize="-3 to 3", YSize="-3 to 3", Radius=0)  # -> Rectangle, Length
rectangle_2 = Rectangle(Plane=PlaneXY(0, 0, 0), XSize="-3.9 to 3.9", YSize="-3.6 to 3.6", Radius=0)  # -> Rectangle, Length
make_plan = GhPythonScript(outline=rectangle_2.Rectangle, corner_radius=Slider(0.2, range=0..1))  # -> plan, corners, edges; inputs outline: Curve
# ---------- make_plan: Python ----------
import sys

sys.path.insert(1, 'Z:/Documents/ACORN-shells/src')

from acorn_shell.generate import make_2d_plan
plan, corners, edges = make_2d_plan(outline, corner_radius)
# ---------- end make_plan ----------
python = GhPythonScript()  # -> a
# ---------- python: Python ----------
from ghpythonlib.componentbase import executingcomponent as component
import Grasshopper, GhPython
import System
import Rhino
import rhinoscriptsyntax as rs

class MyComponent(component):
    
    def RunScript(self, x, y):
        """Provides a scripting component.
            Inputs:
                x: The x script variable
                y: The y script variable
            Output:
                a: The a output variable"""
        
        __author__ = "Mishael Nuh"
        __version__ = "2021.01.20"
        
        import rhinoscriptsyntax as rs
        
        # return outputs if you have them; here I try it for you:
        return a
# ---------- end python ----------
brep = Brep(make_plan.plan)
form_find = GhPythonScript(plan_surface=brep, corners=make_plan.corners, height=Slider(0.8, range=0..1), run=Toggle(True))  # -> form_found_surface, kiwi_errors; inputs plan_surface: Brep, corners: list of Curve, run: Boolean
#   port plan_surface: Surface to be form found
# ---------- form_find: Python ----------
import sys

sys.path.insert(1, 'Z:/Documents/ACORN-shells/src')

import acorn_shell
acorn_shell = reload(acorn_shell)
import acorn_shell.generate
acorn_shell.generate = reload(acorn_shell.generate)
from acorn_shell.generate import form_find
form_found_surface, kiwi_errors = form_find(plan_surface, corners, height, run)
# ---------- end form_find ----------
srf = Surface(form_find.form_found_surface)
mesh_breps = MeshBrepsKaramba3D(
    Brep=srf,
    MeshResolution=Slider(0.095, range=0..1),
    EdgeRefinementFactor=0.67,
    PointReduction=Toggle(False),
    SmoothingStepSize=Slider(1, range=0..1),
    SmoothingIterations=Slider(1, range=0..10))  # -> Mesh, Info
build_shell_model = GhPythonScript(mesh=mesh_breps.Mesh, corners=make_plan.corners, thickness=Slider(0.06, range=0..0.1))  # -> out, k3d_model; inputs mesh: Mesh, corners: list of Curve
# ---------- build_shell_model: Python ----------
import sys

sys.path.insert(1, 'Z:/Documents/ACORN-shells/src')

import acorn_shell
acorn_shell = reload(acorn_shell)
import acorn_shell.karamba
acorn_shell.karamba = reload(acorn_shell.karamba)
from acorn_shell.karamba import build_shell_model

_,k3d_model = build_shell_model(mesh, corners, thickness)
# ---------- end build_shell_model ----------
analyze = AnalyzeKaramba3D(Model=build_shell_model.k3d_model)  # -> CalculatedModel, MaximumDisplacement_cm, ResultingForceOfGravity_kN, ElasticEnergy_kNm
stress_lines = GhPythonScript(
    k3d_model=analyze.CalculatedModel,
    surface=srf,
    corners=make_plan.corners,
    edges=make_plan.edges,
    keystone_width=Slider(1.6, range=0..10),
    cornerstone_width=Slider(1.5, range=0..10),
    length_param_1=Slider(2, range=0..10),
    length_param_2=Slider(2, range=0..10))  # -> out, stress_lines_1, stress_lines_2, cable_profiles_1, cable_profiles_2; inputs surface: Brep, corners: list of Curve, edges: list of Curve
# ---------- stress_lines: Python ----------
import sys

sys.path.insert(1, 'Z:/Documents/ACORN-shells/src')

import acorn_shell
acorn_shell.generate = reload(acorn_shell.generate)
from acorn_shell.generate import stress_lines
acorn_shell = reload(acorn_shell)
import acorn_shell.karamba
acorn_shell.karamba = reload(acorn_shell.karamba)
from acorn_shell.karamba import principal_stress_line

stress_lines_1, stress_lines_2, cable_profiles_1, cable_profiles_2 = stress_lines(
    k3d_model, surface, corners, edges, keystone_width,
    cornerstone_width, length_param_1, length_param_2)
# ---------- end stress_lines ----------
crv = Curve([stress_lines.cable_profiles_1, stress_lines.cable_profiles_2])
segment = GhPythonScript(surface=srf, stress_lines_1=stress_lines.stress_lines_1, stress_lines_2=stress_lines.stress_lines_2)  # -> out, segments; inputs surface: Brep, stress_lines_1: list of Curve, stress_lines_2: list of Curve
# ---------- segment: Python ----------
import sys

sys.path.insert(1, 'Z:/Documents/ACORN-shells/src')

import acorn_shell
acorn_shell.generate = reload(acorn_shell.generate)
from acorn_shell.generate import segment
acorn_shell = reload(acorn_shell)

segments = segment(surface, stress_lines_1, stress_lines_2)
# ---------- end segment ----------
brep_2 = Brep(segment.segments)
