# Grasshopper definition ACORN_master_ALL_K200_3x1.gh (Grasshopper 1.0.7)
# plug-ins: Kiwi3d, karambaGH

number_slider = Slider(0.25, range=0..1)
concrete_weight_kn_m3 = Slider(24, range=0..100)
merge = Merge(Data1=Slider(8, range=5..10), Data2=Slider(0.8, range=0..1), Data3=Slider(0.06, range=0.02..0.12))
item = ListItem(List=merge, Index=0, Wrap=True)  # -> Item, Item1, Item2
concrete_weight_kn_m3_2 = Number(concrete_weight_kn_m3)
span_m = Number(item.Item)
height_m = Number(item.Item1)
thickness_m = Number(item.Item2)
division = Division(A=Slider(6, range=0..10), B=2)
division_2 = Division(A=span_m, B=2)
neg = Negative(Value=division)
neg_2 = Negative(Value=division_2)
pt = Point([Point(0, 0, 0), Point(8, 0, 0), Point(6, 6, 0), Point(0, 6, 0)])
pt_2 = Point([Point(-2.65739868, 2.586695785, 0), Point(2.522828173, 2.363083722, 0), Point(4.069487342, -3.772482641, 0), Point(-1.375177545, -2.361354304, 0)])
dom = ConstructDomain(DomainStart=neg, DomainEnd=division)
dom_2 = ConstructDomain(DomainStart=neg_2, DomainEnd=division_2)
vec = VectorXYZ(XComponent="-4", YComponent="-4", ZComponent=0)  # -> Vector, Length
pline = PolyLine(Vertices=pt, Closed=True)
rectangle = Rectangle(Plane=PlaneXY(0, 0, 0), XSize=dom_2, YSize=dom, Radius=0)  # -> Rectangle, Length
polygon = Polygon(Plane=PlaneXY(0, 0, 0), Radius=3, Segments=Slider(5, range=3..6), FilletRadius=0)  # -> Polygon, Length
flip = FlipCurve(Curve=pline)  # -> Curve, Flag
move = Move(Geometry=pline, Motion=vec.Vector)  # -> Geometry, Transform
regular_quad = Curve(rectangle.Rectangle)
regular_polygon = Curve(polygon.Polygon)
irregular_quad = Curve(move.Geometry)

# ---- group: normalize shape
target_area = Number(Slider(36, range=0..100))
main_shape = Curve(regular_polygon)
area = Area(Geometry=main_shape)  # -> Area, Centroid
division_3 = Division(A=target_area, B=area.Area)
sqrt = SquareRoot(Value=division_3)
scale = Scale(Geometry=main_shape, Center=Point(0, 0, 0), Factor=sqrt)  # -> Geometry, Transform

# ----
image = ImageSampler(Filter="Colour", Interpolate=False, Umax=1, Umin=0, Vmax=1, Vmin=0, Wrap=1)
number_slider_2 = Slider(6, range=0..10)

# ---- group: normalize shape / just because of squares
pi = Pi(Factor=".25")
rotate = Rotate(Geometry=scale.Geometry, Angle=pi, Plane=PlaneXY(0, 0, 0))  # -> Geometry, Transform

# ----
division_4 = Division(A=Slider(7.8, range=0..10), B=2)
division_5 = Division(A=Slider(7.2, range=0..10), B=2)
neg_3 = Negative(Value=division_4)
neg_4 = Negative(Value=division_5)
dom_3 = ConstructDomain(DomainStart=neg_3, DomainEnd=division_4)
dom_4 = ConstructDomain(DomainStart=neg_4, DomainEnd=division_5)
corner_width = Number(Slider(0.2, range=0..1))
rectangle_2 = Rectangle(Plane=PlaneXY(0, 0, 0), XSize=dom_3, YSize=dom_4, Radius=0)  # -> Rectangle, Length
regular_quad_2 = Curve(rectangle_2.Rectangle)
base_shape = BaseShape(normalized_shape=regular_quad_2, corner_width=corner_width)  # -> whole_shape_2, corners_2, edges_3
cables_per_support = Slider(5, range=3..10)
cables_per_edge = Slider(4, range=1..21)
corners = Curve(base_shape.corners_2)
corner_cables = CornerCables(corners=corners, cables=cables_per_support, tanscale=Slider(1, range=0..2))  # -> cables_6, cables_5
edge_cables = EdgeCables(edges=base_shape.edges_3, cables_per_edge=cables_per_edge, trim=Slider(0.252, range=0..1))
divide = DivideCurve(Curve=corners, Count=expr("x-1", corner_cables.cables_5), Kinks=False)  # -> Points, Tangents, Parameters
edge_cables_2 = Curve(edge_cables)
corner_cables_2 = Curve(corner_cables.cables_6)
pline_2 = PolyLine(Vertices=divide.Points, Closed=False)
entwine = Entwine(Branch00=corner_cables_2, Branch01=edge_cables_2, FlattenInputs=True)  # -> simplify(Result)
flatten = FlattenTree(Tree=pline_2, Path="{0}")
cables = Curve(entwine)
corner_polys = Curve(flatten)
srf = Surface(base_shape.whole_shape_2)
intersectcables = IntersectCables(cables=cables)
corners_2 = Curve(base_shape.corners_2)
cables_2 = Curve(cables)
subdivide_subcables = SubdivideSubcables(C=intersectcables)  # disabled
find_border_cables = FindBorderCables(edges=base_shape.edges_3, poly_cables=intersectcables)
poly_cables = Curve(intersectcables)

# ---- group: Kiwi simple (unclusterable)
corners_3 = Curve(corners_2)
cables_3 = Curve(cables_2)
srf_2 = Surface(srf)
srf_3 = Surface(srf_2)
number_slider_3 = Slider(10, range=0..10)
list = ValueList({"STEEL": 1, "WOOD": 2, "GFRP": 3, "ETFE (Membrane)": 4, "CONCRETE": 5, "ALUMINIUM": 6}, selected="STEEL")
list_2 = ValueList({"STEEL": 1, "WOOD": 2, "GFRP": 3, "ETFE (Membrane)": 4, "CONCRETE": 5, "ALUMINIUM": 6}, selected="CONCRETE")
untrim = Untrim(Surface=srf_3)
crvref = CurveRefinement(PDeg=3, ElementRefU=number_slider_3, IsKnotApproxElementSize=False, IsKnotSubdivision=True)
list_3 = ValueList({"DEAD": 1, "SNOW": 2, "PRES": 3, "PRES_FL": 4}, selected="DEAD")
matdef = MaterialDefaults(Type=list, IsNmm2=False, IskNcm2=False, IskNm2=True, mUnit=1)  # -> Material, YoungsModulus, AlphaT, Nue, Density, Strength
srfref = SurfaceRefinement(
    PDeg=3,
    QDeg=3,
    MinElementsU=number_slider_3,
    MinElementsV=number_slider_3,
    IsKnotApproxElementSize=False,
    IsKnotSubdivision=True)
matdef_2 = MaterialDefaults(Type=list_2, IsNmm2=False, IskNcm2=False, IskNm2=True, mUnit=1)  # -> Material, YoungsModulus, AlphaT, Nue, Density, Strength
Z = UnitZ(Factor=1)
shell = ShellElement(Brep=srf_3, Material=matdef_2.Material, Thickness=0.1, Refinement=srfref, HingeCoupling=False)
supcrv = SupportCurve(Crv=corners_3, DispX=True, DispY=True, DispZ=True, Rot=Toggle(False))
srfload = SurfaceLoad(Brep=srf_3, Loadtype=list_3, Direction=Z, Value=Slider(100, range=0..500), LoadCase=1)
cable = CableElement(
    Curve=cables_3,
    Material=matdef.Material,
    Diameter=0.01,
    Prestress="240",
    PrestressControl=False,
    CurveRefinement=crvref,
    Formfinding=True)  # -> simplify(StructuralCableElement); disabled
list_4 = ValueList({"Displacements": 1, "Stresses": 2, "SupportForces": 3}, selected=["Displacements", "Stresses", "SupportForces"])
flatten_2 = FlattenTree(Tree=shell, Path="0")
path_mapper = PathMapper(cable, source="{n}", target="{n+1}")
merge_2 = Merge(Data1=flatten_2, Data2=path_mapper)
lina = LinearAnalysis(Name="MyAnalysis", OutputSetting=list_4)
amodel = AnalysisModel(
    Analysis=lina,
    StructuralElements=merge_2,
    Supports=supcrv,
    Loads=srfload,
    IntersectionTolerance=0.001,
    IsCarat=True,
    IsKratos=False,
    PenaltyFac=10000000,
    ShowCouplingIDs=False,
    ShowEdgeIDs=False,
    ShowGeo=True,
    ShowPatchIDs=True,
    ShowPrePro=True,
    ShowRef=False)
run_analysis = IGASolver(AnalysisModel=amodel, Run=Button(), antiFreeze=False, showWindow=True)  # -> ResultModel, ErrorReport
defmod = DeformedModel(Model=run_analysis.ResultModel, ScaleFactor=Slider(0.395, range=0..30), FlyingNodeLimit=100000)  # -> Model, Geo, DeformedStructuralElements
bbox = BoundingBox(Content=defmod.Geo, Plane=PlaneXY(0, 0, 0))  # -> Box, Box_2
unflatten = UnflattenTree(Tree=defmod.Geo, Guide=merge_2)
boxsize = BoxSize(box=bbox.Box)  # -> X_2, Y_2, Z_2, A_2, V_2
bang = ExplodeTree(Data=unflatten)  # -> Branch0, Branch1, Branch2
panel = Panel(boxsize.Z_2)
corner_cables_3 = Curve(bang.Branch1)
shell_2 = Surface(bang.Branch0)
edge_cables_3 = Curve(bang.Branch2)
kiwi_model = Data(defmod.Model)

# ----
shell_3 = Surface(shell_2)  # disabled
number_slider_4 = Slider(100, range=0..100)  # disabled
corner_polys_2 = Curve(corner_polys)
cables_4 = Curve(cables)
segmentation = Segmentation(corner_polys=corner_polys_2, cables=cables_4, border_corner_cables=find_border_cables)  # -> cable_paths_2, segments_2
# internalised from Analysis so I don't have to run it everytime I open the doc
data = Data("Grasshopper.Kernel.Types.GH_ObjectWrapper")
lor_7_8x7_2 = Surface(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)
_6x6 = Surface(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)
segment_feasibility_2x2_4x1 = SegmentFeasibility2x24x1(srf=segmentation.segments_2)  # disabled
segment_feasibility_3x1 = SegmentFeasibility3x1(srf=segmentation.segments_2)  # disabled
bbox_2 = BoundingBox(Content=shell_2, Plane=PlaneXY(0, 0, 0))  # -> Box, Box_2
merge_3 = Merge(Data1=corner_cables_3, Data2=edge_cables_3)

# ---- group: exploring kinks in curvature
shell_4 = Surface(shell_3)  # disabled
plan = Curve(base_shape.whole_shape_2)  # disabled
formfound_cables = Curve(merge_3)  # disabled
horizontal_cables = Curve(cables_3)  # disabled
number_slider_5 = Slider(105, range=0..105)  # disabled
project = Project(Curve=horizontal_cables, Brep=shell_4, Direction=Vector(0, 0, 1))  # disabled
projected_cables = Curve(project)  # disabled
number_slider_6 = Slider(5, range=0..10)  # disabled
entwine_2 = Entwine(Branch00=horizontal_cables, Branch01=projected_cables, Branch02=formfound_cables, FlattenInputs=True)  # -> simplify(Result); disabled
item_2 = ListItem(List=entwine_2, Index=number_slider_6, Wrap=True)  # disabled
bang_2 = ExplodeTree(Data=item_2)  # -> Branch0, Branch1, Branch2; disabled
wip_curvature_at_cable_intersections = WIPCurvatureAtCableIntersections(crv=formfound_cables)  # disabled
number_slider_7 = Slider(1, range=0..10)  # disabled
formfound_cable = Curve(bang_2.Branch2)  # disabled
projected_cable = Curve(bang_2.Branch1)  # disabled
horizontal_cable = Curve(bang_2.Branch0)  # disabled
wip_visualize_surf_curvature = WIPVisualizeSurfCurvature(srf=shell_4)  # disabled
wip_surf_curvature_along_line = WIPSurfCurvatureAlongLine(shell=shell_4, crv=formfound_cable, int=number_slider_7)  # disabled
crvgraph = CurvatureGraph(Curve=horizontal_cable, Density=5, Scale=number_slider_5)  # disabled
crvgraph_2 = CurvatureGraph(Curve=projected_cable, Density=5, Scale=number_slider_5)  # disabled
crvgraph_3 = CurvatureGraph(Curve=formfound_cable, Density=5, Scale=number_slider_5)  # disabled

# ----
height_m_2 = Number(height_m)
shell_5 = Surface(shell_3)  # disabled

# ---- group: other curves?
item_3 = ListItem(List=flatten(cables_3), Index=0, Wrap=True)  # disabled
horizontal_cables_2 = Curve(item_3)  # disabled
crv = Curve(<curve referenced from the Rhino model>)  # disabled
project_2 = Project(Curve=crv, Brep=shell_5, Direction=Vector(0, 0, 1))  # disabled
cpoly = ControlPolygon(Curve=horizontal_cables_2)  # -> Polygon, Points; disabled
project_3 = Project(Curve=horizontal_cables_2, Brep=shell_5, Direction=Vector(0, 0, 1))  # disabled
number_slider_8 = Slider(12, range=0..100)  # disabled
number_slider_9 = Slider(50, range=20..50)  # disabled
trim = TrimTree(Tree=project_2, Depth=1)  # disabled
trim_2 = TrimTree(Tree=project_3, Depth=1)  # disabled
corner_cables_nurbs = Curve(merge_3)  # disabled
projected_cables_2 = Curve(trim)  # disabled
reb = RebuildCurve(Curve=trim_2, Count=number_slider_8, Tangents=True)  # disabled
discretization = Integer(number_slider_9)  # disabled
projected_cables_3 = Curve(reb)  # disabled
discretization_2 = Integer(number_slider_9)  # disabled
discretization_3 = Integer(number_slider_9)  # disabled
cpoly_2 = ControlPolygon(Curve=corner_cables_nurbs)  # -> Polygon, Points; disabled
range = Range(Domain=corner_cables_nurbs, Steps=discretization)  # disabled
range_2 = Range(Domain=projected_cables_2, Steps=discretization_2)  # disabled
cpoly_3 = ControlPolygon(Curve=reb)  # -> Polygon, Points; disabled
range_3 = Range(Domain=projected_cables_3, Steps=discretization_3)  # disabled
number_slider_10 = Slider(16.618, range=0..100)  # disabled
eval = EvaluateCurve(Curve=graft(corner_cables_nurbs), Parameter=range)  # -> Point, Tangent, Angle; disabled
eval_2 = EvaluateCurve(Curve=graft(projected_cables_2), Parameter=range_2)  # -> Point, Tangent, Angle; disabled
eval_3 = EvaluateCurve(Curve=graft(projected_cables_3), Parameter=range_3)  # -> Point, Tangent, Angle; disabled
pline_3 = PolyLine(Vertices=eval.Point, Closed=False)  # -> flatten(Polyline); disabled
pline_4 = PolyLine(Vertices=eval_2.Point, Closed=False)  # -> flatten(Polyline); disabled
pline_5 = PolyLine(Vertices=eval_3.Point, Closed=False)  # -> flatten(Polyline); disabled
pt_forces_polys = PTForcesPolys(pt_force=number_slider_10, cables=pline_4)  # -> pt_intersection_nodes_3, vec_pt_force_4, vec_end_force_2; disabled
pt_forces_polys_2 = PTForcesPolys(pt_force=number_slider_10, cables=pline_5)  # -> pt_intersection_nodes_3, vec_pt_force_4, vec_end_force_2; disabled
pt_forces_polys_3 = PTForcesPolys(pt_force=number_slider_10, cables=pline_3)  # -> pt_intersection_nodes_3, vec_pt_force_4, vec_end_force_2; disabled

# ----
boxsize_2 = BoxSize(box=bbox_2.Box)  # -> X_2, Y_2, Z_2, A_2, V_2
division_6 = Division(A=height_m_2, B=boxsize_2.Z_2)
alternative_mesh = AlternativeMesh(shell=shell_2)
geodesic_cables = GeodesicCables(srf=shell_2, cables=merge_3)
panel_2 = Panel(division_6)

# ---- group: split shell KIWI - working great!!
segments_proj = Surface(segmentation.segments_2)  # disabled
shell_6 = Surface(shell_2)  # disabled
project_4 = Project(Curve=segments_proj, Brep=shell_6, Direction=Vector(0, 0, 1))  # -> simplify(Curve); disabled
srfsplit = SurfaceSplit(Surface=shell_6, Curves=project_4)  # -> simplify(Fragments); disabled
area_2 = Area(Geometry=srfsplit)  # -> Area, Centroid; disabled
sort = SortList(Keys=area_2.Area, ValuesA=srfsplit)  # -> Keys, ValuesA; disabled
number_slider_11 = Slider(0.2, range=0.2..1)  # disabled
item_4 = ListItem(List=sort.ValuesA, Index=0, Wrap=True)  # disabled
panel_3 = Panel(".150")  # disabled
panel_4 = Panel(".312")  # disabled
number_slider_12 = Slider(0.67, range=0..1)  # disabled
division_7 = Division(A=panel_4, B=2)  # disabled
panel_5 = Panel(item_4)  # disabled
number_slider_13 = Slider(22, range=0..100)  # disabled
mesh_breps = MeshBrepsKaramba3D(
    Brep=item_4,
    MeshResolution=division_7,
    EdgeRefinementFactor=number_slider_12,
    PointReduction=False,
    SmoothingStepSize=0,
    SmoothingIterations=5)  # -> simplify(Mesh), Info; disabled
edges = BrepEdges(Brep=item_4)  # -> Naked, Interior, NonManifold; disabled
item_5 = ListItem(List=flatten(item_4), Index=number_slider_13, Wrap=True)  # disabled
item_6 = ListItem(List=flatten(mesh_breps.Mesh), Index=number_slider_13, Wrap=True)  # disabled
shell_7 = Surface(shell_6)  # disabled
mesh = Mesh(mesh_breps.Mesh)  # disabled
srf_4 = Surface(item_4)  # disabled

# ----
number_slider_14 = Slider(0.1, range=0..0.1)  # disabled
mesh_with_cables = MeshWithCables(mesh_res=number_slider_14, srf=srf_4, formfound_cables=merge_3, path=segmentation.cable_paths_2)  # disabled

# ---- group: PT in mesh for Karamba
number_slider_15 = Slider(25, range=0..100)  # disabled
mesh_2 = Mesh(simplify(mesh_with_cables))  # disabled
formfound_cables_2 = Curve(merge_3)  # disabled
path = DataPath(segmentation.cable_paths_2)  # disabled
branch = TreeBranch(Tree=mesh_2, Path=number_slider_15, MaintainPaths=True)  # disabled
path_mapper_2 = PathMapper(formfound_cables_2, source="{a}", target="{a-1}")  # disabled
mesh_3 = Mesh(simplify(mesh_2))  # disabled
path_2 = DataPath(path)  # disabled
number_slider_16 = Slider(0.01, range=0..0.1)  # disabled
item_7 = TreeItem(Tree=graft(path_mapper_2), Path=path_2, Index=0, Wrap=True)  # disabled
crossref = CrossReference(ListA=mesh_3, ListB=item_7, CrossMode=1)  # -> ListA, ListB; disabled
curveclosestmeshvert = CurveClosestMeshVert(mesh=crossref.ListA, curve=crossref.ListB, tol=number_slider_16)  # -> simplify(polyline_2); disabled
number_slider_17 = Slider(16.618, range=0..100)  # disabled
pt_forces_polys_4 = PTForcesPolys(pt_force=number_slider_17, cables=curveclosestmeshvert)  # -> simplify(pt_intersection_nodes_3), vec_pt_force_4, vec_end_force_2; disabled

# ----
lor_7_8x7_2_2 = Surface(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)
_6x6_2 = Surface(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)
matselect = MaterialSelectionKaramba3D(menu=[dropdown(3), dropdown(1)])
list_5 = ValueList({"STEEL": 1, "WOOD": 2, "GFRP": 3, "ETFE (Membrane)": 4, "CONCRETE": 5, "ALUMINIUM": 6}, selected="CONCRETE")
disassemble = DisassembleMaterialKaramba3D(Material=matselect)  # -> Material, TypeOfMaterial, FamilyNameOfMaterial, NameOfMaterial, ElemIdentifiers, Color, YoungsModulusKNCm2Dir12, InPlaneShearModulus_kN_cm2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
matdef_3 = MaterialDefaults(Type=list_5, IsNmm2=False, IskNcm2=False, IskNm2=True, mUnit=1)  # -> Material, YoungsModulus, AlphaT, Nue, Density, Strength
division_8 = Division(A=matdef_3.YoungsModulus, B="1e4")
division_9 = Division(A=matdef_3.Strength, B="1e4")
karamba_segmented_shell = KarambaSegmentedShell(mesh=mesh, thickness_m=thickness_m, corner_polys=corner_polys, shell=shell_7, segment_breps=srf_4)  # disabled
matprops = MaterialPropertiesKaramba3D(
    FamilyOfMaterial=disassemble.FamilyNameOfMaterial,
    Name="kiwi3d",
    YoungsModulus_kN_cm2=division_8,
    InPlaneShearModulus_kN_cm2=disassemble.InPlaneShearModulus_kN_cm2,
    TransverseShearModulus_kN_cm2=disassemble.TransverseShearModulusKNCm2Dir12,
    SpecificWeight_kN_m3=disassemble.SpecificWeight_kN_m3,
    CoefficientOfThermalExpansion_1_C=disassemble.CoefficientOfThermalExpansion1CDir12,
    YieldStrength_kN_cm2=division_9,
    mode="Isotrop")
concrete_weight_kn_m3_3 = Number(concrete_weight_kn_m3_2)
thickness_m_2 = Number(thickness_m)
multiplication = Multiplication(A=thickness_m_2, B="100")
cross_section = CrossSectionKaramba3D(
    FamilyNameOfCrossSection="DefaultCroSec",
    Material=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,
    Height_cm=multiplication,
    mode="Shell - Const")
manualopt02_1_4 = Curve([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])
manualopt01 = Curve([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])
xz = XZPlane(Origin=Point(0, 0, 0))
crv_2 = Curve(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)
lor_segments = Surface([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])
geo = Geometry(manualopt02_1_4)
mirror = Mirror(Geometry=geo, Plane=xz)  # -> Geometry, Transform
edges_2 = BrepEdges(Brep=lor_segments)  # -> Naked, Interior, NonManifold
merge_4 = Merge(Data1=geo, Data2=mirror.Geometry)
yz = YZPlane(Origin=Point(0, 0, 0))
join = JoinCurves(Curves=edges_2.Naked, Preserve=False)
mirror_2 = Mirror(Geometry=merge_4, Plane=yz)  # -> Geometry, Transform
merge_5 = Merge(Data1=merge_4, Data2=mirror_2.Geometry, Data3=crv_2)
boundary = BoundarySurfaces(Edges=merge_5)
segments = Surface(boundary)
geo_2 = Geometry(segments)
panel_6 = Panel("""7
8""")  # disabled
lng = ListLength(List=geo_2)
bbox_3 = BoundingBox(Content=geo_2, Plane=PlaneXY(0, 0, 0), UnionBox=True)  # -> Box, Box_2
volume = Volume(Geometry=bbox_3.Box)  # -> Volume, Centroid
tag = TextTag(Location=volume.Centroid, Text=lng)
segments_2 = Surface(segments)  # disabled
int = Integer(panel_6)  # disabled
cull_i = CullIndex(List=segments_2, Indices=int, Wrap=True)  # disabled
item_8 = ListItem(List=segments_2, Index=int, Wrap=True)  # disabled
join_2 = BrepJoin(Breps=item_8)  # -> Breps, Closed; disabled
merge_6 = Merge(Data1=cull_i, Data2=join_2.Breps)  # -> flatten(Result); disabled
number_slider_18 = Slider(20, range=0..100)  # disabled
rotating_caliper = RotatingCaliper_2(geo=merge_6)  # -> box_2, area_4; disabled
rotating_caliper_2 = RotatingCaliper_2(geo=segments)  # -> box_2, area_4
box = Box(simplify(rotating_caliper.box_2))  # disabled
branch_2 = TreeBranch(Tree=box, Path=number_slider_18, MaintainPaths=True)  # disabled
box_2 = Box(simplify(rotating_caliper_2.box_2))
branch_3 = TreeBranch(Tree=box_2, Path=Slider(20, range=0..100), MaintainPaths=True)

# ---- group: divide segments into modules + merging / tolerance for input integer numbers
number_slider_19 = Slider(10, range=0..10)  # disabled
lot = Integer(number_slider_19)  # disabled
neg_5 = Negative(Value=lot)  # disabled
_10º = PowerOf10(Value=neg_5)  # disabled

# ---- group: divide segments into modules + merging
box_3 = Box(simplify(box))  # disabled
boxsize_3 = BoxSize(box=box_3)  # -> X_2, Y_2, Z_2, A_2, V_2; disabled
subtraction = Subtraction(A=boxsize_3.Y_2, B=_10º)  # disabled
subtraction_2 = Subtraction(A=boxsize_3.X_2, B=_10º)  # disabled
pln = Plane(box_3)  # disabled
round = Round(Number=subtraction_2)  # -> Nearest, Floor, Ceiling; disabled
round_2 = Round(Number=subtraction)  # -> Nearest, Floor, Ceiling; disabled
number_slider_20 = Slider(1, range=0..1)  # disabled
panel_7 = Panel("1")  # disabled
sqgrid = Square(Plane=pln, Size=panel_7, ExtentX=round.Ceiling, ExtentY=round_2.Ceiling)  # -> Cells, Points; disabled
trim_3 = TrimTree(Tree=sqgrid.Cells, Depth=number_slider_20)  # -> simplify(Tree); disabled
bbox_4 = BoundingBox(Content=trim_3, Plane=pln, UnionBox=True)  # -> Box, Box_2; disabled
area_3 = Area(Geometry=bbox_4.Box)  # -> Area, Centroid; disabled
area_4 = Area(Geometry=box_3)  # -> Area, Centroid; disabled
vec2pt = Vector2Pt(PointA=area_3.Centroid, PointB=area_4.Centroid, Unitize=False)  # -> Vector, Length; disabled
modulesiny = Integer(round_2.Ceiling)  # disabled
modulesinx = Integer(round.Ceiling)  # disabled
move_2 = Move(Geometry=trim_3, Motion=vec2pt.Vector)  # -> Geometry, Transform; disabled
unflatten_2 = UnflattenTree(Tree=move_2.Geometry, Guide=sqgrid.Cells)  # -> simplify(Tree); disabled
modules = Rectangle(move_2.Geometry)  # disabled

# ---- group: divide segments into modules / tolerance for input integer numbers
lot_2 = Integer(Slider(10, range=0..10))
neg_6 = Negative(Value=lot_2)
_10º_2 = PowerOf10(Value=neg_6)

# ---- group: divide segments into modules
box_4 = Box(simplify(box_2))
boxsize_4 = BoxSize(box=box_4)  # -> X_2, Y_2, Z_2, A_2, V_2
subtraction_3 = Subtraction(A=boxsize_4.Y_2, B=_10º_2)
subtraction_4 = Subtraction(A=boxsize_4.X_2, B=_10º_2)
pln_2 = Plane(box_4)
round_3 = Round(Number=subtraction_4)  # -> Nearest, Floor, Ceiling
round_4 = Round(Number=subtraction_3)  # -> Nearest, Floor, Ceiling
sqgrid_2 = Square(Plane=pln_2, Size="1", ExtentX=round_3.Ceiling, ExtentY=round_4.Ceiling)  # -> Cells, Points
trim_4 = TrimTree(Tree=sqgrid_2.Cells, Depth=Slider(1, range=0..1))  # -> simplify(Tree)
bbox_5 = BoundingBox(Content=trim_4, Plane=pln_2, UnionBox=True)  # -> Box, Box_2
area_5 = Area(Geometry=bbox_5.Box)  # -> Area, Centroid
area_6 = Area(Geometry=box_4)  # -> Area, Centroid
vec2pt_2 = Vector2Pt(PointA=area_5.Centroid, PointB=area_6.Centroid, Unitize=False)  # -> Vector, Length
modulesiny_2 = Integer(round_4.Ceiling)
modulesinx_2 = Integer(round_3.Ceiling)
move_3 = Move(Geometry=trim_4, Motion=vec2pt_2.Vector)  # -> Geometry, Transform
unflatten_3 = UnflattenTree(Tree=move_3.Geometry, Guide=sqgrid_2.Cells)  # -> simplify(Tree)
modules_2 = Rectangle(move_3.Geometry)

# ----
number_slider_21 = Slider(0.1, range=0..0.1)  # disabled
boxdim = BoxDim(B=box_3, S=number_slider_21)  # disabled
boxdim_2 = BoxDim(B=box_4, S=Slider(0.1, range=0..0.1))  # disabled
number_slider_22 = Slider(8, range=0..10)  # disabled

# ---- group: GALAPAGOS fitness function
number_slider_23 = Slider(5, range=0..10)  # disabled
segments_3 = Surface(simplify(graft(merge_6)))  # disabled
data_2 = Data(unflatten_2)  # disabled
boundary_2 = BoundarySurfaces(Edges=data_2)  # disabled
trim_5 = TrimTree(Tree=data_2, Depth=1)  # disabled
Z_2 = UnitZ(Factor=number_slider_23)  # disabled
lng_2 = ListLength(List=trim_5)  # disabled
runion = RegionUnion(Curves=trim_5)  # -> simplify(Result); disabled
move_4 = Move(Geometry=boundary_2, Motion=Z_2)  # -> Geometry, Transform; disabled
modules_segment = Integer(lng_2)  # disabled
area_7 = Area(Geometry=segments_3)  # -> Area, Centroid; disabled
area_8 = Area(Geometry=runion)  # -> Area, Centroid; disabled
division_10 = Division(A=area_7.Area, B=area_8.Area)  # disabled
area_efficiency = Number(simplify(division_10))  # disabled
avr = Average(Input=flatten(area_efficiency))  # disabled
panel_8 = Panel(avr)  # disabled
avr_efficiency = Number(avr)  # disabled

number_slider_24 = Slider(5, range=0..10)  # disabled
segments_4 = Surface(simplify(graft(segments)))  # disabled
data_3 = Data(unflatten_3)  # disabled
boundary_3 = BoundarySurfaces(Edges=data_3)  # disabled
trim_6 = TrimTree(Tree=data_3, Depth=1)  # disabled
Z_3 = UnitZ(Factor=number_slider_24)  # disabled
lng_3 = ListLength(List=trim_6)  # disabled
runion_2 = RegionUnion(Curves=trim_6)  # -> simplify(Result); disabled
move_5 = Move(Geometry=boundary_3, Motion=Z_3)  # -> Geometry, Transform; disabled
modules_segment_2 = Integer(lng_3)  # disabled
area_9 = Area(Geometry=segments_4)  # -> Area, Centroid; disabled
area_10 = Area(Geometry=runion_2)  # -> Area, Centroid; disabled
division_11 = Division(A=area_9.Area, B=area_10.Area)  # disabled
area_efficiency_2 = Number(simplify(division_11))  # disabled
avr_2 = Average(Input=flatten(area_efficiency_2))  # disabled
panel_9 = Panel(avr_2)  # disabled
avr_efficiency_2 = Number(avr_2)  # disabled

# ----
number_slider_25 = Slider(0, range=0..10)  # disabled
panel_10 = Panel("""7
8""")  # disabled
panel_11 = Panel("""7
8""")  # disabled
panel_12 = Panel("""7
8""")  # disabled
boundary_4 = BoundarySurfaces(Edges=runion)  # disabled
boundary_5 = BoundarySurfaces(Edges=runion_2)  # disabled
int_2 = Integer(number_slider_25)  # disabled
int_3 = Integer(panel_11)  # disabled
int_4 = Integer(panel_12)  # disabled
split_to_corner = Slider(0.646, range=0..1)  # disabled
split_to_edge = Slider(0.5, range=0..1)
branch_4 = TreeBranch(Tree=boundary_4, Path=int_2, MaintainPaths=True)  # disabled
branch_5 = TreeBranch(Tree=segments_3, Path=int_2, MaintainPaths=True)  # disabled
branch_6 = TreeBranch(Tree=boundary_5, Path=int_3, MaintainPaths=True)  # disabled
branch_7 = TreeBranch(Tree=segments_4, Path=int_3, MaintainPaths=True)  # disabled
join_3 = BrepJoin(Breps=flatten(branch_5))  # -> Breps, Closed; disabled
join_4 = BrepJoin(Breps=flatten(branch_7))  # -> Breps, Closed; disabled
branch_8 = TreeBranch(Tree=area_efficiency, Path=int_2, MaintainPaths=True)  # disabled
branch_9 = TreeBranch(Tree=area_efficiency_2, Path=int_3, MaintainPaths=True)  # disabled
num = Number(split_to_corner)
merge_7 = Merge(Data1="0", Data2=num, Data3="1")
panel_13 = Panel(branch_8)  # disabled
panel_14 = Panel(branch_9)  # disabled
galapagos = Galapagos(fitness=avr_efficiency_2, gene=[genes_for_r, genes_for_phi])
unflattened_modules = Rectangle(unflatten_3)
independent_module_height = BooleanToggle(False)
panel_15 = Panel("""0
1
3
10""")
segment = Integer(Slider(8, range=0..20))
segments_5 = Geometry(segments)
item_9 = ListItem(List=segments_5, Index=segment, Wrap=True)

# ---- group: 3x1s
number_slider_26 = Slider(0.06, range=0.02..0.12)  # disabled
number_slider_27 = Slider(0.8, range=0..1)  # disabled
number_slider_28 = Slider(8, range=5..10)  # disabled
number_slider_29 = Slider(0.25, range=0..1)  # disabled
crv_3 = Curve([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])  # disabled
concrete_weight_kn_m3_4 = Slider(24, range=0..100)  # disabled
merge_8 = Merge(Data1=number_slider_28, Data2=number_slider_27, Data3=number_slider_26)  # disabled
item_10 = ListItem(List=merge_8, Index=0, Wrap=True)  # -> Item, Item1, Item2; disabled
concrete_weight_kn_m3_5 = Number(concrete_weight_kn_m3_4)  # disabled
number_slider_30 = Slider(6, range=0..10)  # disabled
span_m_2 = Number(item_10.Item)  # disabled
height_m_3 = Number(item_10.Item1)  # disabled
thickness_m_3 = Number(item_10.Item2)  # disabled
division_12 = Division(A=number_slider_30, B=2)  # disabled
division_13 = Division(A=span_m_2, B=2)  # disabled
neg_7 = Negative(Value=division_12)  # disabled
neg_8 = Negative(Value=division_13)  # disabled
number_slider_31 = Slider(4, range=3..6)  # disabled
pt_3 = Point([Point(0, 0, 0), Point(8, 0, 0), Point(6, 6, 0), Point(0, 6, 0)])  # disabled
pt_4 = Point([Point(-2.65739868, 2.586695785, 0), Point(2.522828173, 2.363083722, 0), Point(4.069487342, -3.772482641, 0), Point(-1.375177545, -2.361354304, 0)])  # disabled
panel_16 = Panel("-4")  # disabled
dom_5 = ConstructDomain(DomainStart=neg_7, DomainEnd=division_12)  # disabled
dom_6 = ConstructDomain(DomainStart=neg_8, DomainEnd=division_13)  # disabled
vec_2 = VectorXYZ(XComponent=panel_16, YComponent=panel_16, ZComponent=0)  # -> Vector, Length; disabled
pline_6 = PolyLine(Vertices=pt_3, Closed=True)  # disabled
rectangle_3 = Rectangle(Plane=PlaneXY(0, 0, 0), XSize=dom_6, YSize=dom_5, Radius=0)  # -> Rectangle, Length; disabled
polygon_2 = Polygon(Plane=PlaneXY(0, 0, 0), Radius=3, Segments=number_slider_31, FilletRadius=0)  # -> Polygon, Length; disabled
flip_2 = FlipCurve(Curve=pline_6)  # -> Curve, Flag; disabled
move_6 = Move(Geometry=pline_6, Motion=vec_2.Vector)  # -> Geometry, Transform; disabled
number_slider_32 = Slider(7, range=4..8)  # disabled
regular_quad_3 = Curve(rectangle_3.Rectangle)  # disabled
regular_polygon_2 = Curve(polygon_2.Polygon)  # disabled
irregular_quad_2 = Curve(move_6.Geometry)  # disabled
division_14 = Division(A=number_slider_32, B=2)  # disabled
division_15 = Division(A=number_slider_32, B=2)  # disabled
number_slider_33 = Slider(0.8, range=0..1)  # disabled
neg_9 = Negative(Value=division_14)  # disabled
neg_10 = Negative(Value=division_15)  # disabled
number_slider_34 = Slider(64, range=0..100)  # disabled
dom_7 = ConstructDomain(DomainStart=neg_9, DomainEnd=division_14)  # disabled
dom_8 = ConstructDomain(DomainStart=neg_10, DomainEnd=division_15)  # disabled
corner_width_2 = Number(number_slider_33)  # disabled
rectangle_4 = Rectangle(Plane=PlaneXY(0, 0, 0), XSize=dom_8, YSize=dom_7, Radius=0)  # -> Rectangle, Length; disabled
regular_quad_4 = Curve(rectangle_4.Rectangle)  # disabled
base_shape_2 = BaseShape(normalized_shape=regular_quad_4, corner_width=corner_width_2)  # -> whole_shape_2, corners_2, edges_3; disabled
cables_per_support_2 = Slider(8, range=3..10)  # disabled
number_slider_35 = Slider(0.525, range=0..2)  # disabled
cables_per_edge_2 = Slider(10, range=1..21)  # disabled
number_slider_36 = Slider(0.236, range=0..1)  # disabled
corners_4 = Curve(base_shape_2.corners_2)  # disabled
corner_cables_4 = CornerCables(corners=corners_4, cables=cables_per_support_2, tanscale=number_slider_35)  # -> cables_6, cables_5; disabled
edge_cables_4 = EdgeCables(edges=base_shape_2.edges_3, cables_per_edge=cables_per_edge_2, trim=number_slider_36)  # disabled
divide_2 = DivideCurve(Curve=corners_4, Count=expr("x-1", corner_cables_4.cables_5), Kinks=False)  # -> Points, Tangents, Parameters; disabled
edge_cables_5 = Curve(edge_cables_4)  # disabled
corner_cables_5 = Curve(corner_cables_4.cables_6)  # disabled
pline_7 = PolyLine(Vertices=divide_2.Points, Closed=False)  # disabled
entwine_3 = Entwine(Branch00=corner_cables_5, Branch01=edge_cables_5, FlattenInputs=True)  # -> simplify(Result); disabled
flatten_3 = FlattenTree(Tree=pline_7, Path="{0}")  # disabled
subdivide_subcables_2 = SubdivideSubcables(C=corner_cables_5)  # disabled
cables_5 = Curve(entwine_3)  # disabled
intersectcables_2 = IntersectCables(cables=cables_5)  # disabled
subdivide_subcables_3 = SubdivideSubcables(C=intersectcables_2)  # disabled
find_border_cables_2 = FindBorderCables(edges=base_shape_2.edges_3, poly_cables=intersectcables_2)  # disabled
poly_cables_2 = Curve(intersectcables_2)  # disabled
corner_polys_3 = Curve(flatten_3)  # disabled
corner_polys_4 = Curve(corner_polys_3)  # disabled
cables_6 = Curve(cables_5)  # disabled
segmentation_2 = Segmentation(corner_polys=corner_polys_4, cables=cables_6, border_corner_cables=find_border_cables_2)  # -> cable_paths_2, segments_2; disabled
panel_17 = Panel("""0
2
3
4""")  # disabled
srf_5 = Surface(segmentation_2.segments_2)  # disabled
item_11 = ListItem(List=srf_5, Index=panel_17, Wrap=True)  # disabled
crv_4 = Curve(srf_5)  # disabled
rotating_caliper_3 = RotatingCaliper(crv=crv_4)  # -> box_2, area_4; disabled
panel_18 = Panel("1")  # disabled
segments_6 = Curve(simplify(graft(crv_4)))  # disabled
boundary_6 = BoundarySurfaces(Edges=segments_6)  # disabled

# ---- group: 3x1s / sort segments per pinbed configuration
box_5 = Box(simplify(rotating_caliper_3.box_2))  # disabled
panel_19 = Panel("3")  # disabled
number_slider_37 = Slider(0.354, range=0..1)  # disabled
boxfit = BoxFit(box=box_5, dim_1=panel_19, dim_2=panel_18)  # -> fit_2, unfit_2; disabled
swatch = ColourSwatch(SwatchColor=RGB(65, 156, 0))  # disabled
box_2x2s = Box(boxfit.fit_2)  # disabled
swatch_2 = ColourSwatch(SwatchColor=RGB(255, 69, 69))  # disabled
unfeasible = Box(boxfit.unfit_2)  # disabled
tstat = TreeStatistics(Tree=box_2x2s)  # -> Paths, Length, Count; disabled
ahsl = SplitAHSL(Colour=swatch)  # -> Alpha, Hue, Saturation, Luminance; disabled
ahsl_2 = SplitAHSL(Colour=swatch_2)  # -> Alpha, Hue, Saturation, Luminance; disabled
tstat_2 = TreeStatistics(Tree=unfeasible)  # -> Paths, Length, Count; disabled
number_slider_38 = Slider(0.089, range=0..1)  # disabled
branch_10 = TreeBranch(Tree=simplify(boundary_6), Path=tstat.Paths, MaintainPaths=True)  # disabled
hsl = ColourHSL(Alpha=number_slider_37, Hue=ahsl.Hue, Saturation=ahsl.Saturation, Luminance=ahsl.Luminance)  # disabled
branch_11 = TreeBranch(Tree=simplify(boundary_6), Path=tstat_2.Paths, MaintainPaths=True)  # disabled
hsl_2 = ColourHSL(Alpha=number_slider_37, Hue=ahsl_2.Hue, Saturation=ahsl_2.Saturation, Luminance=ahsl_2.Luminance)  # disabled
preview = CustomPreview(Geometry=branch_10, Material=hsl)  # disabled
preview_2 = CustomPreview(Geometry=branch_11, Material=hsl_2)  # disabled
boxdim_3 = BoxDim(B=unfeasible, S=number_slider_38)  # disabled

# ---- group: 3x1s (continued)
boxdim_4 = BoxDim(B=box_2x2s, S=number_slider_38)  # disabled

# ----
# FORM FINDING KANGAROO
concrete_weight_kn_m3_6 = Number(concrete_weight_kn_m3_2)  # disabled
thickness_m_4 = Number(thickness_m)  # disabled
space = Curve(base_shape.whole_shape_2)  # disabled
kangaroo = KANGAROO(
    concrete_weight_kn_m3=concrete_weight_kn_m3_6,
    thickness_m=thickness_m_4,
    space=space,
    border_cables=find_border_cables,
    poly_cables=poly_cables)  # -> bb_height_2, ff_cables_2; disabled
panel_20 = Panel(kangaroo.bb_height_2)  # disabled
ff_cables = Geometry(kangaroo.ff_cables_2)  # disabled
corner_polys_5 = Curve(corner_polys)  # disabled
ff_cables_2 = Geometry(kangaroo.ff_cables_2)  # disabled
merge_9 = Merge(Data1=flatten(corner_polys_5), Data2=flatten(ff_cables_2))  # disabled
mesh_from_cables = MeshFromCables(cable_polys=merge_9)  # disabled
number_slider_39 = Slider(4, range=0..10)  # disabled
number_slider_40 = Slider(0, range=0..2)  # disabled
bang_3 = ExplodeTree(Data=ff_cables)  # -> Branch0, Branch1; disabled
mesh_4 = Mesh(mesh_from_cables)  # disabled
corner_cables_6 = Geometry(bang_3.Branch0)  # disabled
edge_cables_6 = Geometry(bang_3.Branch1)  # disabled
m_catmull_clark = WeightedCatmullClarkSubdivision(M=mesh_4, L=number_slider_39, E=number_slider_40, DF=0, TE=1, TV=1)  # -> out, A; inputs M: Mesh, DF: list, TE: list, TV: list; disabled; same code as m_catmull_clark
m_loop = WeightedLoopSubdivision(M=mesh_4, L=number_slider_39, E=number_slider_40, TE=1, TV=1)  # -> out, A; inputs M: Mesh, TE: list, TV: list; disabled; same code as m_loop
m_root_3 = WeightedRoot3Subdivision(M=mesh_4, L=number_slider_39, E=number_slider_40, DF=0, TV=1)  # -> out, A; inputs M: Mesh, DF: list, TV: list; disabled; same code as m_root_3
split_shell_mesh = SplitShellMesh(mesh=m_root_3.A, segments_proj=segmentation.segments_2)  # disabled
thickness_m_5 = Number(thickness_m)  # disabled
mesh_5 = Mesh(m_root_3.A)  # disabled
ff_cables_3 = Geometry(kangaroo.ff_cables_2)  # disabled
bang_4 = ExplodeTree(Data=ff_cables_3)  # -> Branch0, Branch1; disabled
corner_cables_7 = Geometry(bang_4.Branch0)  # disabled
edge_cables_7 = Geometry(bang_4.Branch1)  # disabled

# ---- group: WIP manipulate individual PT forces
number_slider_41 = Slider(3.895, range=0..5)  # disabled
number_slider_42 = Slider(2.42, range=0..5)  # disabled
number_slider_43 = Slider(1, range=0..1)  # disabled
number_slider_44 = Slider(1, range=0..1)  # disabled
pt_corner_cables = Number(number_slider_42)  # disabled
pt_edge_cables = Number(number_slider_41)  # disabled
multiplication_2 = Multiplication(A=pt_corner_cables, B=number_slider_43)  # disabled
multiplication_3 = Multiplication(A=pt_edge_cables, B=number_slider_44)  # disabled
dom_9 = ConstructDomain(DomainStart=multiplication_2, DomainEnd=pt_corner_cables)  # disabled
dom_10 = ConstructDomain(DomainStart=multiplication_3, DomainEnd=pt_edge_cables)  # disabled
entwine_4 = Entwine(Branch00=dom_9, Branch01=dom_10, FlattenInputs=True)  # -> simplify(Result); disabled
corner_cables_8 = Curve(ff_cables)  # disabled
end = EndPoints(Curve=corner_cables_8)  # -> Start, End; disabled
vlen = VectorLength(Vector=end.Start)  # disabled
sqr = Square(Value=vlen)  # disabled
number_slider_45 = Slider(0.032, range=0..0.1)  # disabled
num_2 = Number(vlen)  # disabled
bnd = Bounds(Numbers=num_2)  # disabled
remap = RemapNumbers(Value=num_2, Source=bnd, Target=entwine_4)  # -> Mapped, Clipped; disabled
multiplication_4 = Multiplication(A=remap.Mapped, B=number_slider_45)  # disabled
pipe = Pipe(Curve=corner_cables_8, Radius=multiplication_4, Caps=0)  # disabled
pt_force = Number(remap.Mapped)  # disabled
panel_21 = Panel(remap.Mapped)  # disabled

number_slider_46 = Slider(3.895, range=0..5)  # disabled
number_slider_47 = Slider(2.42, range=0..5)  # disabled
number_slider_48 = Slider(1, range=0..1)  # disabled
number_slider_49 = Slider(1, range=0..1)  # disabled
pt_corner_cables_2 = Number(number_slider_47)  # disabled
pt_edge_cables_2 = Number(number_slider_46)  # disabled
multiplication_5 = Multiplication(A=pt_corner_cables_2, B=number_slider_48)  # disabled
multiplication_6 = Multiplication(A=pt_edge_cables_2, B=number_slider_49)  # disabled
dom_11 = ConstructDomain(DomainStart=multiplication_5, DomainEnd=pt_corner_cables_2)  # disabled
dom_12 = ConstructDomain(DomainStart=multiplication_6, DomainEnd=pt_edge_cables_2)  # disabled
entwine_5 = Entwine(Branch00=dom_11, Branch01=dom_12, FlattenInputs=True)  # -> simplify(Result); disabled
corner_cables_9 = Curve(ff_cables_3)  # disabled
end_2 = EndPoints(Curve=corner_cables_9)  # -> Start, End; disabled
vlen_2 = VectorLength(Vector=end_2.Start)  # disabled
sqr_2 = Square(Value=vlen_2)  # disabled
number_slider_50 = Slider(0.032, range=0..0.1)  # disabled
num_3 = Number(vlen_2)  # disabled
bnd_2 = Bounds(Numbers=num_3)  # disabled
remap_2 = RemapNumbers(Value=num_3, Source=bnd_2, Target=entwine_5)  # -> Mapped, Clipped; disabled
multiplication_7 = Multiplication(A=remap_2.Mapped, B=number_slider_50)  # disabled
pipe_2 = Pipe(Curve=corner_cables_9, Radius=multiplication_7, Caps=0)  # disabled
pt_force_2 = Number(remap_2.Mapped)  # disabled
panel_22 = Panel(remap_2.Mapped)  # disabled

# ----
bang_5 = ExplodeTree(Data=pt_force)  # -> Branch0, Branch1; disabled
pt_forces_polys_5 = PTForcesPolys(pt_force=bang_5.Branch1, cables=edge_cables_6)  # -> pt_intersection_nodes_3, vec_pt_force_4, vec_end_force_2; disabled
pt_forces_polys_6 = PTForcesPolys(pt_force=bang_5.Branch0, cables=corner_cables_6)  # -> pt_intersection_nodes_3, vec_pt_force_4, vec_end_force_2; disabled
loads = LoadsKaramba3D(
    ForceVector=pt_forces_polys_6.vec_pt_force_4,
    Local=False,
    PosInd=pt_forces_polys_6.pt_intersection_nodes_3,
    mode="Point")  # disabled
karamba_simple = KarambaSimple(mesh=mesh_5, thickness_m=thickness_m_5, pt_loads=loads)  # disabled
bang_6 = ExplodeTree(Data=pt_force_2)  # -> Branch0, Branch1; disabled
pt_forces_polys_7 = PTForcesPolys(pt_force=bang_6.Branch1, cables=edge_cables_7)  # -> pt_intersection_nodes_3, vec_pt_force_4, vec_end_force_2; disabled
pt_forces_polys_8 = PTForcesPolys(pt_force=bang_6.Branch0, cables=corner_cables_7)  # -> pt_intersection_nodes_3, vec_pt_force_4, vec_end_force_2; disabled

# ---- group: experimenting PT with curvature
number_slider_51 = Slider(5, range=0..10)  # disabled
item_12 = ListItem(List=flatten(merge_3), Index=number_slider_51, Wrap=True)  # disabled
number_slider_52 = Slider(50, range=20..50)  # disabled
number_slider_53 = Slider(2, range=0..10)  # disabled
discretization_4 = Integer(number_slider_52)  # disabled
number_slider_54 = Slider(16.618, range=0..100)  # disabled
ptforce = Number(number_slider_54)  # disabled
number_slider_55 = Slider(0.07, range=0..1)  # disabled

number_slider_56 = Slider(100, range=0..100)  # disabled
corner_cables_nurbs_2 = Curve(item_12)  # disabled
range_4 = Range(Domain=corner_cables_nurbs_2, Steps=discretization_4)  # disabled
eval_4 = EvaluateCurve(Curve=reparameterize(graft(corner_cables_nurbs_2)), Parameter=range_4)  # -> Point, Tangent, Angle; disabled
number_slider_57 = Slider(105, range=0..105)  # disabled
pline_8 = PolyLine(Vertices=eval_4.Point, Closed=False)  # -> flatten(Polyline); disabled
crvgraph_4 = CurvatureGraph(Curve=corner_cables_nurbs_2, Density=5, Scale=number_slider_57)  # disabled
pt_forces_polys_9 = PTForcesPolys(pt_force=number_slider_54, cables=pline_8)  # -> pt_intersection_nodes_3, vec_pt_force_4, vec_end_force_2; disabled
mycrvgraph = MyCrvGraph(crv=corner_cables_nurbs_2, density=discretization_4, scale=number_slider_54)  # -> pt_2, vec_forces_2; disabled

division_16 = Division(A=mycrvgraph.vec_forces_2, B=discretization_4)  # disabled
corner_cables_nurbs_3 = Curve(corner_cables_nurbs_2)  # disabled
corner_cables_nurbs_4 = Curve(corner_cables_nurbs_2)  # disabled
vec_poly = Vector(pt_forces_polys_9.vec_pt_force_4)  # disabled
pt_poly = Point(mycrvgraph.pt_2)  # disabled
vec_crv = Vector(mycrvgraph.vec_forces_2)  # disabled
pt_crv = Point(mycrvgraph.pt_2)  # disabled
ma = MassAddition(Input=pt_forces_polys_9.vec_pt_force_4)  # -> Result, PartialResults; disabled
bang_7 = ExplodeTree(Data=simplify(graft(pt_forces_polys_9.vec_end_force_2)))  # -> Branch0, Branch1; disabled
midpt = CurveMiddle(Curve=corner_cables_nurbs_4)  # disabled
midpt_2 = CurveMiddle(Curve=corner_cables_nurbs_4)  # disabled
move_7 = Move(Geometry=midpt, Motion=bang_7.Branch0)  # -> Geometry, Transform; disabled
vlen_3 = VectorLength(Vector=vec_crv)  # disabled
vdis = VectorDisplay(Anchor=midpt, Vector=ma.Result)  # disabled
ma_2 = MassAddition(Input=vec_crv)  # -> Result, PartialResults; disabled
vdis_2 = VectorDisplay(Anchor=midpt, Vector=bang_7.Branch0)  # disabled
line = LineSDL(Start=pt_crv, Direction=vec_crv, Length=vlen_3)  # disabled
vdis_3 = VectorDisplay(Anchor=move_7.Geometry, Vector=bang_7.Branch1)  # disabled
panel_23 = Panel(pt_forces_polys_9.vec_pt_force_4)  # disabled
vlen_4 = VectorLength(Vector=ma.Result)  # disabled
loft = Loft(Curves=line, Options={Adjust=False, Closed=False, LoftEnds=0, LoftSimp=0, LoftType=3, Rebuild=10, Refit=0.01})  # disabled
vdis_4 = VectorDisplay(Anchor=midpt_2, Vector=ma_2.Result)  # disabled
area_11 = Area(Geometry=loft)  # -> Area, Centroid; disabled
panel_24 = Panel(vlen_4)  # disabled
amp = Amplitude(Vector=ma_2.Result, Amplitude=area_11.Area)  # disabled
vdis_5 = VectorDisplay(Anchor=midpt_2, Vector=amp)  # disabled
division_17 = Division(A=area_11.Area, B=ptforce)  # disabled
panel_25 = Panel(area_11.Area)  # disabled
panel_26 = Panel(division_17)  # disabled
one_over_x = OneOverX(Value=division_17)  # disabled
panel_27 = Panel(one_over_x)  # disabled
entwine_6 = Entwine(Branch00=ptforce, Branch01=panel_27, FlattenInputs=True)  # -> simplify(Result); disabled
rec = DataRecorder(entwine_6, DataLimit=-10, RecordData=True)  # disabled
bang_8 = ExplodeTree(Data=rec)  # -> Branch0, Branch1; disabled
pt_5 = ConstructPoint(XCoordinate=bang_8.Branch0, YCoordinate=bang_8.Branch1, ZCoordinate=0)  # disabled
concat = Concatenate(FragmentB=bang_8.Branch0)  # disabled
scale_nu = ScaleNU(Geometry=pt_5, Plane=PlaneXY(0, 0, 0), ScaleX=number_slider_55, ScaleY=1, ScaleZ=1)  # -> Geometry, Transform; disabled
tag_2 = TextTag(Location=scale_nu.Geometry, Text=bang_8.Branch0)  # disabled
pline_9 = PolyLine(Vertices=scale_nu.Geometry, Closed=False)  # disabled

# verifying that curvature is 1/radius
item_13 = ListItem(List=corner_cables_nurbs_3, Index=0, Wrap=True)  # disabled
number_slider_58 = Slider(0.324, range=0..1)  # disabled
curvature = Curvature(Curve=item_13, Parameter=number_slider_58)  # -> P, K, C; disabled
vdis_6 = VectorDisplay(Anchor=curvature.P, Vector=curvature.K)  # disabled
darc = DeconstructArc(Arc=curvature.C)  # -> BasePlane, Radius, Angle; disabled
vlen_5 = VectorLength(Vector=curvature.K)  # disabled
one_over_x_2 = OneOverX(Value=vlen_5)  # disabled
panel_28 = Panel(darc.Radius)  # disabled
panel_29 = Panel(vlen_5)  # disabled
panel_30 = Panel(one_over_x_2)  # disabled
pt_6 = Point(darc.BasePlane)  # disabled

# testing convergence if using scaling factor
vec_to_match = Vector(pt_forces_polys_9.vec_pt_force_4)  # disabled
vlen_6 = VectorLength(Vector=mycrvgraph.vec_forces_2)  # disabled
vlen_7 = VectorLength(Vector=vec_to_match)  # disabled
sort_2 = SortList(Keys=vlen_7)  # -> reverse(Keys), ValuesA; disabled
sort_3 = SortList(Keys=vlen_6)  # -> reverse(Keys), ValuesA; disabled
item_14 = ListItem(List=sort_2.Keys, Index=0, Wrap=True)  # disabled
item_15 = ListItem(List=sort_3.Keys, Index=0, Wrap=True)  # disabled
division_18 = Division(A=item_14, B=item_15)  # disabled
panel_31 = Panel("scaling factor =")  # disabled
multiplication_8 = Multiplication(A=division_18, B=mycrvgraph.vec_forces_2)  # disabled
panel_32 = Panel(division_18)  # disabled
number_slider_59 = Slider(0.1, range=0..0.1)  # disabled
vec_scaled = Vector(multiplication_8)  # disabled
move_8 = Move(Geometry=mycrvgraph.pt_2, Motion=vec_scaled)  # -> Geometry, Transform; disabled
pline_10 = PolyLine(Vertices=move_8.Geometry, Closed=False)  # disabled
concat_2 = Concatenate(FragmentA=panel_31, FragmentB=division_18)  # disabled
pt_7 = Point(Point(1.006703509, -3.876692597, 0))  # disabled
rec_2 = DataRecorder(division_18, DataLimit=-10, RecordData=True)  # disabled
vdis_7 = VectorDisplay(Anchor=mycrvgraph.pt_2, Vector=vec_scaled)  # disabled
tag_3 = TextTag3D(Location=pt_7, Text=concat_2, Size=number_slider_59, Justification=7)  # disabled
panel_33 = Panel(rec_2)  # disabled
graph = QuickGraph(rec_2, SortOrder=0)  # disabled
explode = Explode(Curve=pline_10, Recursive=True)  # -> Segments, Vertices; disabled
one_over_x_3 = OneOverX(Value=rec_2)  # disabled
graph_2 = QuickGraph(one_over_x_3, SortOrder=0)  # disabled
len = Length(Curve=explode.Segments)  # disabled
discretization_5 = Integer(discretization_4)  # disabled
division_19 = Division(A=rec_2, B=discretization_5)  # disabled
panel_34 = Panel(len)  # disabled
graph_3 = QuickGraph(division_19, SortOrder=0)  # disabled
panel_35 = Panel(division_19)  # disabled

# ---- group: preliminary analysis for layout
# IPts not working on trimmed surface
brep = Brep(lor_7_8x7_2_2)
number_slider_60 = Slider(0.333, range=0..1)
mesh_breps_2 = MeshBrepsKaramba3D(
    Brep=brep,
    MeshResolution=Slider(0.095, range=0..1),
    EdgeRefinementFactor=0.67,
    PointReduction=Toggle(False),
    SmoothingStepSize=Slider(1, range=0..1),
    SmoothingIterations=Slider(1, range=0..10))  # -> Mesh, Info
mesh_6 = Mesh(mesh_breps_2.Mesh)
bottompoints = BottomPoints(mesh=mesh_6, ltol=Slider(2, range=0..10))
supp = SupportKaramba3D(PosInd=flatten(bottompoints), menu=[buttons(on, on, on, on, on, on)])
loads_2 = LoadsKaramba3D(Vector=Vector(0, 0, -1), mode="Gravity")

# ----
brep_2 = Brep(brep)
edges_3 = BrepEdges(Brep=brep_2)  # -> Naked, Interior, NonManifold
project_5 = Project(Geometry=edges_3.Naked, Plane=PlaneXY(0, 0, 0))  # -> Geometry, Transform
join_5 = JoinCurves(Curves=project_5.Geometry, Preserve=False)
crv_5 = Curve(join_5)

# ---- group: segment dimensions
# using input shape, use geodesics on brep instead?
# using input shape, use geodesics on brep instead?
crv_6 = Curve(crv_5)
brep_3 = Brep(brep_2)
crv_7 = Curve(crv_6)
crv_8 = Curve(crv_6)
area_12 = Area(Geometry=crv_7)  # -> Area, Centroid
explode_2 = Explode(Curve=crv_7, Recursive=True)  # -> Segments, Vertices
area_13 = Area(Geometry=crv_8)  # -> Area, Centroid
explode_3 = Explode(Curve=crv_8, Recursive=True)  # -> Segments, Vertices
culln = CullNth(List=explode_2.Segments, CullFrequency=2)
culln_2 = CullNth(List=reverse(explode_3.Segments), CullFrequency=2)
midpt_3 = CurveMiddle(Curve=culln)
cornerstone_width = Slider(1.5, range=0..2)
keystone_width = Slider(2, range=0..2)
midpt_4 = CurveMiddle(Curve=culln_2)
ln = Line(StartPoint=area_12.Centroid, EndPoint=midpt_3)
cornerstone_width_2 = Number(cornerstone_width)
keystone_width_2 = Number(keystone_width)
ln_2 = Line(StartPoint=area_13.Centroid, EndPoint=midpt_4)
keystone_width_3 = Number(keystone_width)
module_combination_length_short_side = Number(Slider(2.6, range=0..3))
module_combination_length_long_side = Number(Slider(2.7, range=0..3))
division_20 = Division(A=keystone_width_2, B=2)
sqrt_2 = SquareRoot(Value=keystone_width_3)
crv_9 = Curve(ln)
crv_10 = Curve(ln_2)
neg_11 = Negative(Value=division_20)
neg_12 = Negative(Value=cornerstone_width_2)
neg_13 = Negative(Value=sqrt_2)
ext = ExtendCurve(Curve=crv_10, Type=0, Start=neg_13, End="0")
ext_2 = ExtendCurve(Curve=crv_9, Type=0, Start=neg_11, End=neg_12)
divint = DivInt(crv=ext, num=module_combination_length_short_side)
divint_2 = DivInt(crv=ext_2, num=module_combination_length_long_side)
cull_i_2 = CullIndex(List=reverse(divint), Indices="0", Wrap=True)
Z_4 = UnitZ(Factor=1)
cull_i_3 = CullIndex(List=divint_2, Indices="0", Wrap=True)
Z_5 = UnitZ(Factor=1)
project_6 = ProjectPoint(Point=cull_i_2, Direction=Z_4, Geometry=brep_3)  # -> simplify(Point), Index
project_7 = ProjectPoint(Point=cull_i_3, Direction=Z_5, Geometry=brep_3)  # -> simplify(Point), Index

# ----
meshtoshell = MeshToShellKaramba3D(Mesh=mesh_6, LimitDistance_m=0.005)  # -> Element, Points, Info

# ---- group: preliminary analysis for layout (continued)
assemble = AssembleModelKaramba3D(
    Elem=meshtoshell.Element,
    Support=supp,
    Load=loads_2,
    CrossSection=cross_section,
    Material=matprops,
    LimitDistance_m=0.005)  # -> Model, Info, Mass_kg, CenterOfGravity
analyze = AnalyzeKaramba3D(Model=assemble.Model)  # -> CalculatedModel, MaximumDisplacement_cm, ResultingForceOfGravity_kN, ElasticEnergy_kNm

# ----
modelview = ModelViewKaramba3D(Model=analyze.CalculatedModel, ResultFactors=1, ResultCase=-1)  # -> Model, DeformedMesh, DeformedAxes, DeformedModel
react = ReactionForcesKaramba3D(AnalyzedModel=modelview.Model)  # -> AnalyzedModel, ReactionForces_kN, ReactionMoments_kNm, SupportPosition, SumOfReactionForces_kN, SumOfReactionMoments_kNm
shellview = ShellViewKaramba3D(Model=modelview.Model, IndexOfLayer=0)  # -> Model, MeshesOfRenderedShells, LegendColors, LegendTags
panel_36 = Panel(react.SumOfReactionForces_kN)
crv_11 = Curve(crv_5)

# ---- group: get stress lines
# using input shape, use geodesics on brep instead?
number_slider_61 = Slider(0, range=-1..1)
model = ModelKaramba3D(analyze.CalculatedModel)
shelllineresults = LineResultsOnShellsKaramba3D(
    AnalyzedModel=model,
    LayerPosition=number_slider_61,
    ListOfSourcesOfPrincipalStressLinesLinesPoints=project_6.Point,
    SegmentLength_m=0.5,
    DA_deg=5,
    mode="PrincStress")  # -> AnalyzedModel, Lines1, Lines2
shelllineresults_2 = LineResultsOnShellsKaramba3D(
    AnalyzedModel=model,
    LayerPosition=number_slider_61,
    ListOfSourcesOfPrincipalStressLinesLinesPoints=project_7.Point,
    SegmentLength_m=0.5,
    DA_deg=5,
    mode="PrincStress")  # -> AnalyzedModel, Lines1, Lines2
crv_12 = Curve(shelllineresults.Lines2)
crv_13 = Curve(shelllineresults_2.Lines1)
crv_14 = Curve(crv_11)
trim_7 = TrimTree(Tree=simplify(crv_12), Depth=1)
trim_8 = TrimTree(Tree=simplify(crv_13), Depth=1)
area_14 = Area(Geometry=crv_14)  # -> Area, Centroid
explode_4 = Explode(Curve=crv_14, Recursive=True)  # -> Segments, Vertices
crv_15 = Curve(crv_11)
join_6 = JoinCurves(Curves=trim_8, Preserve=False)
join_7 = JoinCurves(Curves=trim_7, Preserve=False)
culln_3 = CullNth(List=reverse(explode_4.Segments), CullFrequency=2)
explode_5 = Explode(Curve=crv_15, Recursive=True)  # -> Segments, Vertices
project_8 = Project(Geometry=join_7, Plane=PlaneXY(0, 0, 0))  # -> Geometry, Transform
midpt_5 = CurveMiddle(Curve=culln_3)
culln_4 = CullNth(List=reverse(explode_5.Segments), CullFrequency=2)
project_9 = Project(Geometry=join_6, Plane=PlaneXY(0, 0, 0))  # -> Geometry, Transform
ln_3 = Line(StartPoint=area_14.Centroid, EndPoint=midpt_5)
merge_10 = Merge(Data1=culln_4, Data2=project_8.Geometry)
merge_11 = Merge(Data1=project_9.Geometry, Data2=ln_3)
entwine_7 = Entwine(Branch00=merge_10, Branch01=merge_11, FlattenInputs=True)  # -> simplify(Result)

# ----
legend = Legend(Colour=shellview.LegendColors, Tags=shellview.LegendTags, LegendType=1)
crv_16 = Curve(crv_11)

# ---- group: [OBSOLETE] intersect and polygonize
bang_9 = ExplodeTree(Data=entwine_7)  # -> Branch0, Branch1
edge_cables_8 = Curve(bang_9.Branch1)
corner_cables_10 = Curve(bang_9.Branch0)
ccx = CurveCurve(CurveA=simplify(graft(corner_cables_10)), CurveB=edge_cables_8)  # -> Points, ParamsA, ParamsB
ccx_2 = CurveCurve(CurveA=corner_cables_10, CurveB=simplify(graft(edge_cables_8)))  # -> Points, ParamsA, ParamsB
trim_9 = TrimTree(Tree=ccx.Points, Depth=1)
trim_10 = TrimTree(Tree=ccx_2.Points, Depth=1)
alongcrv = SortAlongCurve(Points=trim_9, Curve=graft(corner_cables_10))  # -> Points, Indices
alongcrv_2 = SortAlongCurve(Points=trim_10, Curve=graft(edge_cables_8))  # -> Points, Indices
pline_11 = PolyLine(Vertices=alongcrv.Points, Closed=False)
pline_12 = PolyLine(Vertices=alongcrv_2.Points, Closed=False)
merge_12 = Merge(Data1=pline_11, Data2=pline_12)  # -> simplify(Result)
trim_11 = TrimTree(Tree=merge_12, Depth=1)
poly_cables_3 = Curve(flatten(trim_11))

# ----
explode_6 = Explode(Curve=crv_16, Recursive=True)  # -> Segments, Vertices
lng_4 = ListLength(List=explode_6.Segments)
division_21 = Division(A=lng_4, B=2)
shell_8 = Surface(brep_2)

# ---- group: extended sub-segments for pin heights
# segments are extended for
# covering whole pinbed module,
# for shape continuity
modules_3 = Rectangle(unflattened_modules)
srf_6 = Surface(shell_8)
project_10 = Project(Curve=modules_3, Brep=srf_6, Direction=Vector(0, 0, 1))
trim_12 = TrimTree(Tree=project_10, Depth=1)
crossref_2 = CrossReference(ListA=srf_6, ListB=trim_12, CrossMode=1)  # -> ListA, ListB
bbox_6 = BoundingBox(Content=crossref_2.ListB, Plane=PlaneXY(0, 0, 0))  # -> simplify(graft(Box)), Box_2
srfsplit_2 = SurfaceSplit(Surface=crossref_2.ListA, Curves=crossref_2.ListB)  # -> simplify(Fragments)
area_15 = Area(Geometry=bbox_6.Box)  # -> Area, Centroid
area_16 = Area(Geometry=srfsplit_2)  # -> Area, Centroid
dist = Distance(PointA=area_16.Centroid, PointB=area_15.Centroid)
sort_4 = SortList(Keys=dist, ValuesA=srfsplit_2)  # -> Keys, ValuesA
item_16 = ListItem(List=sort_4.ValuesA, Index=0, Wrap=True)
extended_sub_segments = Surface(item_16)

# ---- group: intersect and polygonize (independent points)
bang_10 = ExplodeTree(Data=entwine_7)  # -> Branch0, Branch1
edge_cables_9 = Curve(bang_10.Branch1)
corner_cables_11 = Curve(bang_10.Branch0)
crossref_3 = CrossReference(ListA=corner_cables_11, ListB=edge_cables_9, CrossMode=1)  # -> ListA, ListB
ccx_3 = CurveCurve(CurveA=crossref_3.ListA, CurveB=crossref_3.ListB)  # -> Points, ParamsA, ParamsB
pt_8 = Point(flatten(ccx_3.Points))
lot_3 = Integer(Slider(0, range=0..10))
crv_cp = CurveClosestPoint(Point=pt_8, Curve=graft(corner_cables_11))  # -> Point, Parameter, Distance
neg_14 = Negative(Value=lot_3)
crv_cp_2 = CurveClosestPoint(Point=pt_8, Curve=graft(edge_cables_9))  # -> Point, Parameter, Distance
_10º_3 = PowerOf10(Value=neg_14)

# ---- group: keystone
brep_4 = Brep(crv_16)
area_17 = Area(Geometry=brep_4)  # -> Area, Centroid
center = Point(area_17.Centroid)
cps = ClosestPoints(Point=center, Cloud=flatten(pt_8), Count=division_21)  # -> ClosestPoint, CPIndex, Distance
cir = Circle(Plane=center, Radius=1)
alongcrv_3 = SortAlongCurve(Points=cps.ClosestPoint, Curve=cir)  # -> Points, Indices
pline_13 = PolyLine(Vertices=alongcrv_3.Points, Closed=Toggle(True))

# ---- group: GALAPAGOS gene generation
pt_9 = Point(flatten(ccx_3.Points))
pt_10 = Point(simplify(graft(pt_9)))
crv_17 = Curve(crv_16)
lot_4 = Integer(Slider(2, range=0..10))
neg_15 = Negative(Value=lot_4)
crv_cp_3 = CurveClosestPoint(Point=pt_10, Curve=crv_17)  # -> Point, Parameter, Distance
_10º_4 = PowerOf10(Value=neg_15)
smaller = SmallerThan(FirstNumber=crv_cp_3.Distance, SecondNumber=_10º_4)  # -> SmallerThan, OrEqualTo
genes_for_r = GenePool(
    Decimals=3,
    Maximum=1,
    Minimum=0,
    Value=[0.728, 0.278, 0.433, 0.626, 0.372, 0.386, 0.577, 0.602, 0.355, 0.402, 0.734, 0.343, 0.433, 0.4, 0.584, 0.602, 0.546, 0.339, 0.419, 0.149, 0.301, 0.008, 0.324, 0.386])
genes_for_phi = GenePool(
    Decimals=3,
    Maximum=2,
    Minimum=0,
    Value=[0.427, 1.627, 0.784, 1.454, 1.468, 0.46, 1.011, 0.388, 0.825, 1.223, 1.146, 1.007, 0.773, 1.539, 1.505, 0.869, 0.424, 1.086, 1.514, 0.679, 1.331, 1.248, 1.135, 0.331])
pt_11 = Point(pt_10)
dispatch = Dispatch(List=pt_10, DispatchPattern=smaller.SmallerThan)  # -> simplify(ListA), simplify(ListB)
bbox_7 = BoundingBox(Content=flatten(pt_11), Plane=PlaneXY(0, 0, 0), UnionBox=True)  # -> Box, Box_2
edges_4 = BrepEdges(Brep=bbox_7.Box)  # -> Naked, Interior, NonManifold
phi = Slider(1.687, range=0..2)
pt_on_curve = Point(dispatch.ListA)
pt_off_curve = Point(dispatch.ListB)
max_r = Slider(0.26, range=0..1)
end_3 = EndPoints(Curve=edges_4.Naked)  # -> Start, End
phi_2 = Number(graft(genes_for_phi))
toggle = BooleanToggle(False)
cp = ClosestPoint(Point=pt_11, Cloud=end_3.Start)  # -> ClosestPoint, CPIndex, Distance
r = Slider(1, range=0..1)
max_phi = Slider(1, range=1..2)
round_5 = Round(Number=phi_2)  # -> Nearest, Floor, Ceiling
cir_2 = Circle(Plane=pt_10, Radius=max_r)
Z_6 = UnitZ(Factor=1)
vec2pt_3 = Vector2Pt(PointA=pt_11, PointB=cp.ClosestPoint, Unitize=toggle)  # -> Vector, Length
crossref_4 = CrossReference(ListA=pt_off_curve, ListB=round_5.Nearest, CrossMode=3)  # -> ListA, ListB
crossref_5 = CrossReference(ListA=pt_on_curve, ListB=phi_2, CrossMode=3)  # -> ListA, ListB
radius = Number(graft(genes_for_r))
xprod = CrossProduct(VectorA=vec2pt_3.Vector, VectorB=Z_6, Unitize=toggle)  # -> Vector, Length
merge_13 = Merge(Data1=crossref_5.ListB, Data2=crossref_4.ListB)
pi_2 = Pi(Factor=max_phi)
pl = ConstructPlane(Origin=pt_11, XAxis=vec2pt_3.Vector, YAxis=xprod.Vector)
remap_3 = RemapNumbers(Value=merge_13, Source=Domain(0, 1), Target=pi_2)  # -> Mapped, Clipped
remap_4 = RemapNumbers(Value=radius, Source=Domain(0, 1), Target=max_r)  # -> Mapped, Clipped
pt_12 = PointPolar(BasePlane=pl, XYAngle=remap_3.Mapped, ZAngle=0, Offset=remap_4.Mapped)

# ---- group: intersect and polygonize (independent points) (continued)
tolerance = Number(max_r)
smaller_2 = SmallerThan(FirstNumber=crv_cp.Distance, SecondNumber=tolerance)  # -> SmallerThan, OrEqualTo
smaller_3 = SmallerThan(FirstNumber=crv_cp_2.Distance, SecondNumber=tolerance)  # -> SmallerThan, OrEqualTo
dispatch_2 = Dispatch(List=pt_8, DispatchPattern=smaller_3.SmallerThan)  # -> ListA, ListB
dispatch_3 = Dispatch(List=pt_8, DispatchPattern=simplify(smaller_2.SmallerThan))  # -> ListA, ListB
pt_on_curve_2 = Point(simplify(dispatch_3.ListA))
pt_on_curve_3 = Point(simplify(dispatch_2.ListA))
alongcrv_4 = SortAlongCurve(Points=pt_on_curve_2, Curve=simplify(graft(corner_cables_11)))  # -> simplify(Points), Indices
alongcrv_5 = SortAlongCurve(Points=pt_on_curve_3, Curve=simplify(graft(edge_cables_9)))  # -> simplify(Points), Indices
pline_14 = PolyLine(Vertices=alongcrv_4.Points, Closed=False)
pline_15 = PolyLine(Vertices=alongcrv_5.Points, Closed=False)
entwine_8 = Entwine(Branch00=pline_14, Branch01=pline_15, FlattenInputs=True)  # -> simplify(Result)

# ----
poly_cables_4 = Curve(flatten(entwine_8))
merge_14 = Merge(Data1=pline_13, Data2=poly_cables_4)  # -> flatten(Result)
srfsplit_3 = SurfaceSplit(Surface=brep_4, Curves=merge_14)
join_8 = BrepJoin(Breps=srfsplit_3)  # -> Breps, Closed
topology = BrepTopology(Brep=join_8.Breps, PerspectiveOnly=False)  # -> FaceFaceAdjacency, FaceEdgeAdjacency, EdgeFaceAdjacency
bang_11 = ExplodeTree(Data=entwine_8)  # -> Branch0, Branch1
item_17 = ListItem(List=bang_11.Branch0, Index=Slider(10, range=0..10), Wrap=True)
ps_segmentation = Geometry(srfsplit_3)
srf_7 = Surface(ps_segmentation)

srf_8 = Surface(srf_7)
bbox_8 = BoundingBox(Content=srf_8, Plane=PlaneXY(0, 0, 0), UnionBox=True)  # -> Box, Box_2
area_18 = Area(Geometry=bbox_8.Box)  # -> Area, Centroid
box_corners = BoxCorners(Box=bbox_8.Box)  # -> CornerA, CornerB, CornerC, CornerD, CornerE, CornerF, CornerG, CornerH
panel_37 = Panel("exclude keystone + cornerstones")
merge_15 = Merge(Data1=box_corners.CornerA, Data2=box_corners.CornerB, Data3=box_corners.CornerC, Data4=box_corners.CornerD)
area_19 = Area(Geometry=srf_8)  # -> Area, Centroid
merge_16 = Merge(Data1=area_18.Centroid, Data2=merge_15)
cp_2 = ClosestPoint(Point=merge_16, Cloud=area_19.Centroid)  # -> ClosestPoint, CPIndex, Distance
cull_i_4 = CullIndex(List=srf_8, Indices=cp_2.CPIndex, Wrap=True)

item_18 = ListItem(List=cull_i_4, Index=Slider(7, range=0..10), Wrap=True)

# ----
# rebuild segment surfaces with appropriate UV space
srf_9 = Surface(simplify(graft(cull_i_4)))
crv_18 = Curve(srf_9)
bbox_9 = BoundingBox(Content=flatten(crv_18), Plane=PlaneXY(0, 0, 0), UnionBox=True)  # -> Box, Box_2
area_20 = Area(Geometry=crv_18)  # -> Area, Centroid
volume_2 = Volume(Geometry=bbox_9.Box)  # -> Volume, Centroid
vec2pt_4 = Vector2Pt(PointA=area_20.Centroid, PointB=volume_2.Centroid, Unitize=False)  # -> Vector, Length
explode_7 = Explode(Curve=crv_18, Recursive=True)  # -> simplify(Segments), Vertices
cull_i_5 = CullIndex(List=explode_7.Vertices, Indices="0", Wrap=True)
loft_opt = LoftOptions(Closed=False, Adjust=Toggle(True), Rebuild=0, Refit=0, Type=0)

# ---- group: to which support should each segment look at
# get support points
# (temporary, only works for rectangles)
# determine edge closest to support
srf_10 = Surface(srf_9)
bbox_10 = BoundingBox(Content=flatten(srf_10), Plane=PlaneXY(0, 0, 0), UnionBox=True)  # -> Box, Box_2
box_corners_2 = BoxCorners(Box=bbox_10.Box)  # -> CornerA, CornerB, CornerC, CornerD, CornerE, CornerF, CornerG, CornerH
merge_17 = Merge(Data1=box_corners_2.CornerA, Data2=box_corners_2.CornerB, Data3=box_corners_2.CornerC, Data4=box_corners_2.CornerD)
area_21 = Area(Geometry=srf_10)  # -> Area, Centroid
cp_3 = ClosestPoint(Point=area_21.Centroid, Cloud=merge_17)  # -> ClosestPoint, CPIndex, Distance

# ----
vec2pt_5 = Vector2Pt(PointA=area_20.Centroid, PointB=cp_3.ClosestPoint, Unitize=False)  # -> Vector, Length
pl_2 = ConstructPlane(Origin=area_20.Centroid, XAxis=vec2pt_5.Vector, YAxis=vec2pt_4.Vector)
cir_3 = Circle(Plane=pl_2, Radius="0.2")
alongcrv_6 = SortAlongCurve(Points=cull_i_5, Curve=cir_3)  # -> Points, Indices
item_19 = ListItem(List=alongcrv_6.Points, Index=0, Wrap=True)  # -> Item, Item1, Item2, Item3
ln_4 = Line(StartPoint=item_19.Item3, EndPoint=item_19.Item2)
ln_5 = Line(StartPoint=item_19.Item, EndPoint=item_19.Item1)
merge_18 = Merge(Data1=ln_5, Data2=ln_4)  # -> simplify(Result)
loft_2 = Loft(Curves=merge_18, Options=loft_opt)

# ---- group: number points in closed polyline
pt_13 = Point(simplify(alongcrv_6.Points))
pline_16 = PolyLine(Vertices=pt_13, Closed="True")
area_22 = Area(Geometry=pline_16)  # -> Area, simplify(Centroid)
vec2pt_6 = Vector2Pt(PointA=pt_13, PointB=area_22.Centroid, Unitize="True")  # -> Vector, Length
lng_5 = ListLength(List=pt_13)
multiplication_9 = Multiplication(A=vec2pt_6.Vector, B=Slider(0.312, range=0..1))
move_9 = Move(Geometry=pt_13, Motion=multiplication_9)  # -> Geometry, Transform
series = Series(Start=0, Step=1, Count=lng_5)
tag_4 = TextTag(Location=move_9.Geometry, Text=series)

# ---- group: split using PSlines
md_slider = MDSlider(SliderMode=0, slider_value=Point(0.5, 0.5, 0.5), x_domain=Domain(0, 1), y_domain=Domain(0, 1), z_domain=Domain(0, 1))
srf_11 = Surface(loft_2)
evalsrf = EvaluateSurface(Surface=reparameterize(srf_11), Point=md_slider)  # -> Point, Normal, UDirection, VDirection, Frame
Z_7 = UnitZ(Factor=1)
shell_9 = Surface(brep_2)
project_11 = ProjectPoint(Point=evalsrf.Point, Direction=Z_7, Geometry=shell_9)  # -> Point, Index
model_2 = ModelKaramba3D(analyze.CalculatedModel)
shelllineresults_3 = LineResultsOnShellsKaramba3D(
    AnalyzedModel=model_2,
    LayerPosition=Slider(0, range=-1..1),
    ListOfSourcesOfPrincipalStressLinesLinesPoints=project_11.Point,
    SegmentLength_m=0.5,
    DA_deg=5,
    mode="PrincStress")  # -> AnalyzedModel, Lines1, Lines2
crv_19 = Curve(shelllineresults_3.Lines2)
crv_20 = Curve(shelllineresults_3.Lines1)
trim_13 = TrimTree(Tree=simplify(crv_20), Depth=1)
trim_14 = TrimTree(Tree=simplify(crv_19), Depth=1)
join_9 = JoinCurves(Curves=trim_13, Preserve=False)
join_10 = JoinCurves(Curves=trim_14, Preserve=False)
project_12 = Project(Geometry=join_9, Plane=PlaneXY(0, 0, 0))  # -> simplify(Geometry), Transform
project_13 = Project(Geometry=join_10, Plane=PlaneXY(0, 0, 0))  # -> simplify(Geometry), Transform
list_6 = ValueList({"Split to edge": 0, "Split to corner": 1}, selected="Split to corner")
merge_19 = Merge(Data1=project_12.Geometry, Data2=project_13.Geometry)
crv_21 = Curve(srf_11)
item_20 = ListItem(List=merge_19, Index=list_6, Wrap=True)
ccx_4 = CurveCurve(CurveA=crv_21, CurveB=item_20)  # -> Points, ParamsA, ParamsB
toggle_2 = BooleanToggle(False)
pline_17 = PolyLine(Vertices=ccx_4.Points, Closed=False)
srfsplit_4 = SurfaceSplit(Surface=srf_11, Curves=pline_17)

# ---- group: split to edge
srf_12 = Surface(loft_2)
divide_3 = DivideDomain²(Domain=srf_12, UCount=Slider(1, range=1..2), VCount=Slider(2, range=1..2))
subsrf = Isotrim(Surface=srf_12, Domain=divide_3)

# ---- group: split to both
num_4 = Number(split_to_edge)
srf_13 = Surface(loft_2)
merge_20 = Merge(Data1="0", Data2=num_4, Data3="1")
panel_38 = Panel("False")
consec = ConsecutiveDomains(Numbers=merge_20, Additive=panel_38)

# ----
consec_2 = ConsecutiveDomains(Numbers=merge_7, Additive=panel_38)
crossref_6 = CrossReference(ListA=consec, ListB=consec_2, CrossMode=1)  # -> ListA, ListB

# ---- group: split to both (continued)
dom² = ConstructDomain²(DomainU=crossref_6.ListA, DomainV=crossref_6.ListB)
subsrf_2 = Isotrim(Surface=reparameterize(srf_13), Domain=dom²)

# ---- group: "lift" modules
srf_14 = Surface(extended_sub_segments)
rec_3 = Rectangle(unflattened_modules)
pln_3 = Plane(rec_3)
independent = Boolean(independent_module_height)
trim_15 = TrimTree(Tree=srf_14, Depth="2")

# ----
trim_16 = TrimTree(Tree=pln_3, Depth=Slider(1, range=0..2))

# ---- group: "lift" modules (continued)
item_21 = ListItem(List=trim_16, Index=0, Wrap=True)
bbox_11 = BoundingBox(Content=trim_15, Plane=item_21)  # -> simplify(Box), Box_2
bbox_12 = BoundingBox(Content=trim_15, Plane=item_21, UnionBox=True)  # -> Box, Box_2
filter = StreamFilter(Gate=independent, Stream0=bbox_12.Box, Stream1=bbox_11.Box)  # -> simplify(Stream)
debox = DeconstructBox(Box=filter)  # -> Plane, X, Y, Z
dedomain = DeconstructDomain(Domain=debox.Z)  # -> Start, End
Z_8 = UnitZ(Factor=dedomain.Start)  # -> simplify(UnitVector)

# ----
lng_6 = ListLength(List=bbox_11.Box_2)
repeat = RepeatData(Data=Z_8, Length=lng_6)
filter_2 = StreamFilter(Gate=independent, Stream0=repeat, Stream1=Z_8)
unflatten_4 = UnflattenTree(Tree=filter_2, Guide=rec_3)

# ---- group: "lift" modules (continued)
move_10 = Move(Geometry=rec_3, Motion=unflatten_4)  # -> Geometry, Transform
lifted_modules = Rectangle(move_10.Geometry)
boundary_7 = BoundarySurfaces(Edges=move_10.Geometry)

# ---- group: make pinbed
number_slider_62 = Slider(3, range=0..10)
extended_sub_segments_2 = Surface(extended_sub_segments)
lifted_modules_2 = Rectangle(lifted_modules)
dividerect = DivideRect(rec=lifted_modules_2, divu=number_slider_62, divv=number_slider_62)  # -> simplify(rec_4)
area_23 = Area(Geometry=dividerect)  # -> Area, Centroid
Z_9 = UnitZ(Factor=1)
project_14 = ProjectPoint(Point=area_23.Centroid, Direction=Z_9, Geometry=extended_sub_segments_2)  # -> Point, Index
merge_21 = Merge(Data1=graft(area_23.Centroid), Data2=graft(project_14.Point))
crv_22 = Curve(lifted_modules_2)
pline_18 = PolyLine(Vertices=merge_21, Closed=False)
trim_17 = TrimTree(Tree=crv_22, Depth=Slider(0, range=0..10))
boundary_8 = BoundarySurfaces(Edges=crv_22)
trim_18 = TrimTree(Tree=pline_18, Depth=Slider(2, range=0..10))
merge_22 = Merge(Data2=trim_18, Data3=trim_17)

# ----
lifted_modules_3 = Rectangle(move_10.Geometry)
trim_19 = TrimTree(Tree=lifted_modules_3, Depth=1)
branch_12 = TreeBranch(Tree=trim_19, Path=segment, MaintainPaths=True)

# ---- group: viz pin
crv_23 = Curve(pline_18)
clean = CleanTree(RemoveNulls=True, RemoveInvalid=True, RemoveEmpty=False, Tree=crv_23)
trim_20 = TrimTree(Tree=crv_23, Depth=Slider(3, range=0..10))
geo_3 = Geometry(trim_20)
max_pin_height = Number(".40")
len_2 = Length(Curve=geo_3)
larger = LargerThan(FirstNumber=len_2, SecondNumber=max_pin_height)  # -> LargerThan, OrEqualTo
dispatch_4 = Dispatch(List=geo_3, DispatchPattern=larger.LargerThan)  # -> ListA, ListB
flatten_4 = FlattenTree(Tree=geo_3, Path="{0}")
geo_4 = Geometry(dispatch_4.ListA)
geo_5 = Geometry(dispatch_4.ListB)
entwine_9 = Entwine(Branch00=geo_4, Branch01=geo_5, FlattenInputs=True)  # -> simplify(Result)
number_slider_63 = Slider(0.02, range=0..0.1)
neg_16 = Negative(Value=number_slider_63)
Z_10 = UnitZ(Factor=neg_16)
move_11 = Move(Geometry=entwine_9, Motion=Z_10)  # -> Geometry, Transform
bang_12 = ExplodeTree(Data=move_11.Geometry)  # -> Branch0, Branch1
len_3 = Length(Curve=bang_12.Branch1)
pipe_3 = Pipe(Curve=bang_12.Branch0, Radius=number_slider_63, Caps=2)  # disabled
gradient = Gradient(
    LowerLimit="0",
    UpperLimit=max_pin_height,
    Parameter=len_3,
    stops=[0: RGB(0, 98, 0), 0.25: RGB(81, 175, 17), 0.5: RGB(159, 198, 146), 0.75: RGB(170, 235, 41), 1: RGB(221, 255, 53)])

# ----
branch_13 = TreeBranch(Tree=trim_20, Path=segment, MaintainPaths=True)
len_4 = Length(Curve=flatten_4)
end_4 = EndPoints(Curve=bang_12.Branch1)  # -> Start, End
pipe_4 = Pipe(Curve=bang_12.Branch1, Radius=number_slider_63, Caps=2)  # disabled
end_5 = EndPoints(Curve=bang_12.Branch0)  # -> Start, End
pt_14 = Point(end_4.End)
pt_15 = Point(end_5.End)
entwine_10 = Entwine(Branch00=pt_14, Branch01=pipe_4, FlattenInputs=True)  # -> simplify(Result)
merge_23 = Merge(Data2=pt_15, Data3=pipe_3)

# ---- group: viz pin (continued)
sort_5 = SortList(Keys=len_4, ValuesA=flatten_4)  # -> Keys, ValuesA
item_22 = ListItem(List=reverse(sort_5.Keys), Index=0, Wrap=True)
item_23 = ListItem(List=reverse(sort_5.ValuesA), Index=0, Wrap=True)
longest_travel_m = Number(item_22)
longest_traveller = Geometry(item_23)
panel_39 = Panel(longest_travel_m)
preview_3 = CustomPreview(Geometry=merge_23, Material=ColourSwatch(SwatchColor=RGB(255, 0, 0)))
preview_4 = CustomPreview(Geometry=entwine_10, Material=gradient)

# ==== cluster BottomPoints
ltol = ClusterInput()
mesh = ClusterInput()
mesh_2 = Mesh(mesh)
ltol_2 = Integer(ltol)
demesh = DeconstructMesh(Mesh=mesh_2)  # -> Vertices, Faces, Colours, Normals
pt = Point(demesh.Vertices)
bbox = BoundingBox(Content=pt, Plane=PlaneXY(0, 0, 0), UnionBox=True)  # -> Box, Box_2
box = EvaluateBox(Box=bbox.Box, UParameter="0", VParameter="0", WParameter="0")  # -> Plane, Point, Include
neg = Negative(Value=ltol_2)
_10º = PowerOf10(Value=neg)
cp = PlaneClosestPoint(Point=pt, Plane=box.Plane)  # -> Point, UVPoint, Distance
panel = Panel("1e-10")
smaller = SmallerThan(FirstNumber=cp.Distance, SecondNumber=_10º)  # -> SmallerThan, OrEqualTo
boxdims = BoxDims(box=bbox.Box)  # -> dx_2, dy_2, dz_2
dispatch = Dispatch(List=pt, DispatchPattern=smaller.SmallerThan)  # -> ListA, ListB
duppt = RemoveDuplicatePts(Points=dispatch.ListA, Tolerance=0.01)  # -> simplify(UniquePoints)
division = Division(A=boxdims.dx_2, B="2")
pgroups = PointGroups(Points=duppt, Distance=division)  # -> simplify(Groups), Indices
pt_2 = Point(pgroups.Groups)
pt_3 = ClusterOutput(pt_2)

# ==== cluster SubdivideSubcables
C = ClusterInput()
explode = Explode(Curve=C, Recursive=True)  # -> Segments, flatten(Vertices)
clean = CleanTree(RemoveNulls=True, RemoveInvalid=True, RemoveEmpty=False, Tree=explode.Segments)  # -> simplify(Tree)
len = Length(Curve=clean)
sort = SortList(Keys=flatten(len))  # -> Keys, ValuesA
item = ListItem(List=sort.Keys, Index=Slider(12, range=0..100), Wrap=True)
division = Division(A=len, B=item)
int = Integer(division)
divide = DivideCurve(Curve=clean, Count=int, Kinks=False)  # -> flatten(Points), simplify(Tangents), simplify(Parameters)
consec = ConsecutiveDomains(Numbers=simplify(divide.Parameters), Additive=False)  # -> simplify(Domains)
subcrv = SubCurve(BaseCurve=graft(clean), Domain=consec)
end = EndPoints(Curve=subcrv)  # -> Start, End

# ==== cluster MyCrvGraph
scale = ClusterInput()
density = ClusterInput()
crv = ClusterInput()
scale_2 = Number(scale)
density_2 = Integer(density)
crv_2 = Curve(crv)
range = Range(Domain=crv_2, Steps=density_2)  # -> simplify(Range)
panel = Panel("""0
1""")
curvature = Curvature(Curve=graft(crv_2), Parameter=panel)  # -> P, K, C
curvature_2 = Curvature(Curve=graft(crv_2), Parameter=range)  # -> P, K, C
vlen = VectorLength(Vector=curvature_2.K)
ma = MassAddition(Input=curvature.K)  # -> Result, PartialResults
sqrt = SquareRoot(Value=vlen)
cbrt = CubeRoot(Value=vlen)
len = Length(Curve=crv_2)
amp = Amplitude(Vector=curvature_2.K, Amplitude=vlen)
multiplication = Multiplication(A=amp, B=scale_2)
division = Division(A=multiplication, B=len)
subtraction = Subtraction(A=division, B=ma.Result)
vec_forces = Vector(division)
pt = Point(curvature_2.P)
vdis = VectorDisplay(Anchor=pt, Vector=vec_forces)
vec_forces_2 = ClusterOutput(vec_forces)
pt_2 = ClusterOutput(pt)

# ==== cluster BaseShape
# base shape
corner_width = ClusterInput()
normalized_shape = ClusterInput()
normalized_shape_2 = Geometry(normalized_shape)
explode = Explode(Curve=normalized_shape_2, Recursive=True)  # -> Segments, Vertices
corner_width_2 = Number(corner_width)
cull_i = CullIndex(List=explode.Vertices, Indices="0", Wrap=True)
pt = Point(cull_i)
neg = Negative(Value=corner_width_2)
dom = ConstructDomain(DomainStart=neg, DomainEnd=corner_width_2)
pline = PolyLine(Vertices=pt, Closed=Toggle(True))
rectangle = Rectangle(Plane=pt, XSize=dom, YSize=dom, Radius=0)  # -> Rectangle, Length
cir = Circle(Plane=pt, Radius=corner_width_2)
rdiff = RegionDifference(CurvesA=pline, CurvesB=cir)
explode_2 = Explode(Curve=rdiff, Recursive=True)  # -> Segments, Vertices
whole_shape = Curve(rdiff)
shift = ShiftList(List=explode_2.Segments, Shift=1, Wrap=True)
culln = CullNth(List=explode_2.Segments, CullFrequency=2)
culln_2 = CullNth(List=shift, CullFrequency=2)
crv = Curve(culln)
edges = Curve(culln_2)
len = Length(Curve=crv)
len_2 = Length(Curve=edges)
multiplication = Multiplication(A=len, B=Slider(0.05, range=0..0.05))
multiplication_2 = Multiplication(A=len_2, B=Slider(0.195, range=0..1))
neg_2 = Negative(Value=multiplication)
neg_3 = Negative(Value=multiplication_2)
ext = ExtendCurve(Curve=crv, Type=0, Start=neg_2, End=neg_2)
ext_2 = ExtendCurve(Curve=edges, Type=0, Start=neg_3, End=neg_3)
corners = Curve(crv)
edges_2 = Curve(edges)
whole_shape_2 = ClusterOutput(whole_shape)
corners_2 = ClusterOutput(corners)
edges_3 = ClusterOutput(edges_2)

# ==== cluster EdgeCables
edges = ClusterInput()
trim = ClusterInput()
edges_2 = Curve(edges)
trim_2 = Number(trim)
len = Length(Curve=edges_2)
multiplication = Multiplication(A=len, B=trim_2)
neg = Negative(Value=multiplication)
# cables from edges
ext = ExtendCurve(Curve=edges_2, Type=0, Start=neg, End=neg)
cables_per_edge = ClusterInput()
cables_per_edge_2 = Integer(cables_per_edge)
edges_3 = Curve(ext)
shift = ShiftList(List=edges_3, Shift=1, Wrap=True)
subtraction = Subtraction(A=cables_per_edge_2, B=1)
flip = FlipCurve(Curve=shift)  # -> Curve, Flag
pframes = PerpFrames(Curve=edges_3, Count=subtraction, Align=True)  # -> simplify(Frames), Parameters
pframes_2 = PerpFrames(Curve=flip.Curve, Count=subtraction, Align=True)  # -> simplify(Frames), Parameters
flip_2 = FlipMatrix(Data=pframes.Frames)
flip_3 = FlipMatrix(Data=pframes_2.Frames)
pln = Plane(flip_2)
pln_2 = Plane(flip_3)
number_slider = Slider(1.658, range=0..10)
deplane = DeconstructPlane(Plane=pln_2)  # -> Origin, XAxis, YAxis, ZAxis
deplane_2 = DeconstructPlane(Plane=pln)  # -> Origin, XAxis, YAxis, ZAxis
rev = Reverse(Vector=deplane.YAxis)
rev_2 = Reverse(Vector=deplane_2.YAxis)
amp = Amplitude(Vector=rev_2, Amplitude=number_slider)
amp_2 = Amplitude(Vector=deplane.YAxis, Amplitude=number_slider)
line = LineSDL(Start=deplane.Origin, Direction=rev, Length=1)
line_2 = LineSDL(Start=deplane_2.Origin, Direction=rev_2, Length=1)
vdis = VectorDisplay(Anchor=deplane_2.Origin, Vector=amp)
bzspan = BezierSpan(StartPoint=deplane_2.Origin, StartTangent=amp, EndPoint=deplane.Origin, EndTangent=amp_2)  # -> Curve, Length, Domain
llx = LineLine(Line1=line_2, Line2=line)  # -> ParamA, ParamB, PointA, PointB
rev_3 = Reverse(Vector=amp)
merge = Merge(Data1=graft(deplane_2.Origin), Data2=graft(llx.PointA), Data3=graft(deplane.Origin))
arc = ArcSED(Start=rev_3, End=deplane_2.Origin, Direction=deplane.Origin)  # -> Arc, Plane, Radius

# ----
# cable
# selection
flip_4 = FlipMatrix(Data=bzspan.Curve)
lng = ListLength(List=flip_4)
division = Division(A=lng, B=2)
split = SplitList(List=flip_4, Index=division)  # -> ListA, ListB
edge_cables = Curve(split.ListB)

nurbs = NurbsCurve(Vertices=merge, Degree=Slider(2, range=0..10), Periodic=False)  # -> Curve, Length, Domain
crvgraph = CurvatureGraph(Curve=bzspan.Curve, Density=5, Scale=Slider(92.87, range=0..100))
cpoly = ControlPolygon(Curve=nurbs.Curve)  # -> Polygon, Points
trim_3 = TrimTree(Tree=nurbs.Curve, Depth=1)
edge_cables_2 = ClusterOutput(edge_cables)

# ==== cluster CornerCables
corners = ClusterInput()
tanscale = ClusterInput()
cables = ClusterInput()
tanscale_2 = Number(tanscale)
corners_2 = Curve(corners)
cables_2 = Integer(cables)
number_slider = Slider(1.2, range=0..2)
c_distribute_cables = CSharpScript(corners=corners_2, cables=cables_2, sidesFirst=Toggle(True), scale=tanscale_2, fix=Toggle(False))  # -> out, A, B, C; inputs corners: list of Curve, cables: Int32, sidesFirst: Boolean, scale: Double, fix: Boolean
# ---------- c_distribute_cables: C# usings ----------
using System.Linq;
using Rhino.Geometry.Intersect;
# ---------- c_distribute_cables: C# ----------
    int sides = corners.Count;
    int finalCables = cables;
    // ensures minimum number of cables
    if (cables < (sides - 1)) finalCables = sides - 1;
    if (fix) cables = finalCables;
    //Print("cables at start: " + cables.ToString());


    // decision tree for patterns, making sure that are possible (rewrite)
    // odd or even sided
    // when possible, considers user preference in sidesFirst

    bool finalSidesFirst;
    // sidesFirst == true: starts filling at the sides
    // sidesFirst == false: starts filling at the diagonal

    if (sides % 2 == 0) // even sided
    {
      //if (cables % (sides - 1) == 0), either MODE works
      if ((cables % (sides - 1)) % 2 == 0) finalSidesFirst = true;
      else finalSidesFirst = false;
    }
    else // odd sided
    {
      // for odd-sided polygons, either MODE works
      // but only for even-numbered cables (no central diagonal)
      if (((cables % (sides - 1)) % 2 == 1) && (fix)) cables--;
      finalSidesFirst = sidesFirst; // consider user preference
    }



    //------------ construct distribution pattern -------------------
    // using the buckets analogy to distribute cables per other point
    int nrBuckets = sides - 1;
    int[] buckets = new int[nrBuckets];
    for (int i = 0; i < cables; i++)
    {
      int currBucket = i % nrBuckets;
      buckets[currBucket]++;
    }
    //testing
    foreach (int bucket in buckets) Print(bucket.ToString());

    //--------------- MODE selection
    // mode 0: automatic

    //---------- distributing according to sidesFirst
    int[] finalBuckets = new int[nrBuckets];

    if (finalSidesFirst) {
      // move half of the fullest buckets to the end
      Print("cables at case 1: " + cables.ToString());
      double halfTail = (double) (cables % nrBuckets) / 2;
      int nrTailBuckets = (int) Math.Ceiling(halfTail);
      Print("halfTail:" + halfTail);
      Print("nrTailBuckets:" + nrTailBuckets);
      int[] head = buckets.Take(nrTailBuckets).ToArray();
      int[] notHead = buckets.Skip(nrTailBuckets).ToArray();
      finalBuckets = notHead.Concat(head).ToArray();
    }
    else
    {
      // move half of the emptiest buckets to the beginning
      double halfHead = (double) (nrBuckets - (cables % nrBuckets)) / 2;
      int nrHeadBuckets = (int) Math.Ceiling(halfHead);
      Print("halfHead:" + halfHead);
      Print("nrHeadBuckets:" + nrHeadBuckets);
      int[] notTail = buckets.Take(nrBuckets - nrHeadBuckets).ToArray();
      int[] tail = buckets.Skip(nrBuckets - nrHeadBuckets).ToArray();
      finalBuckets = tail.Concat(notTail).ToArray();
    }
    //testing
    foreach (int bucket in finalBuckets) Print(bucket.ToString());

    // using the buckets to create the distribution pattern
    List<int> pattern = new List<int>();
    int path = 0;
    foreach (int bucket in finalBuckets)
    {
      for (int i = 0; i < bucket; i++)
      {
        pattern.Add(path);
      }
      path++;
    }

    pattern.Reverse();

    // ------------------ create cables

    Curve[] arrayCorners = corners.ToArray();
    Curve[] otherCorners = new Curve[arrayCorners.Length];
    Array.Copy(arrayCorners, otherCorners, arrayCorners.Length);

    List<Line> newCables = new List<Line>();
    List<NurbsCurve> newCablesB = new List<NurbsCurve>();
    // create list of used points to prevent duplicate cables
    List<Point3d> usedPts = new List<Point3d>();

    // iterates each corner curve
    for (int i = 0; i < arrayCorners.Length; i++)
    {
      Curve thisCorner = arrayCorners[i];
      // shift list of remaining corner curves
      otherCorners = ShiftArray<Curve>(otherCorners, 1);
      // divide current corner into parameters tis
      double[] tis = thisCorner.DivideByCount(cables - 1, true);

      // iterate each of the remaining corner curves
      for (int j = 0; j < otherCorners.Length - 1; j++)
      {
        Curve otherCorner = otherCorners[j];
        // divide current other corner into parameters tjs
        double[] tjs = otherCorner.DivideByCount(cables - 1, true);
        // reverses point order in other corner curve
        Array.Reverse(tjs);

        // iterates each cable position in the current corner curve (sort of)
        for (int currPt = 0; currPt < tis.Length; currPt++) {
          // only makes cable if this is the right other corner, according to pattern
          if (j == pattern[currPt]){
            Point3d thisPoint = thisCorner.PointAt(tis[currPt]);
            Point3d otherPoint = otherCorner.PointAt(tjs[currPt]);

            // to avoid repeated cables, check if end point is used
            if (FindNode(otherPoint, usedPts) < 0){
              // if not used, adds points to used list, and creates cable
              // avoiding repetition
              usedPts.Add(thisPoint);
              usedPts.Add(otherPoint);

              //List<double> tj = new List<double> ();
              //ti.Add(tjs[currPt]);
              Plane thisPlane = new Plane();
              thisCorner.PerpendicularFrameAt(tis[currPt], out thisPlane);
              Vector3d thisUnitTangent = thisPlane.XAxis;

              Plane otherPlane = new Plane();
              otherCorner.PerpendicularFrameAt(tjs[currPt], out otherPlane);
              Vector3d otherUnitTangent = otherPlane.XAxis;

              //determine intersection of SDL lines
              //tangents larger than that will create negative curvature in plane
              Line thisLine = new Line(thisPoint, thisUnitTangent);
              Line otherLine = new Line(otherPoint, otherUnitTangent);
              double thisIntParam, otherIntParam;
              Intersection.LineLine(thisLine, otherLine, out thisIntParam, out otherIntParam);
              Point3d thisIntPoint = thisLine.PointAt(thisIntParam);
              double thisMaxTangent = thisPoint.DistanceTo(thisIntPoint);
              Point3d otherIntPoint = otherLine.PointAt(otherIntParam);
              double otherMaxTangent = otherPoint.DistanceTo(otherIntPoint);


              //define tangents for bezier span

              Point3d thisPoint2 = Point3d.Add(thisPoint, thisUnitTangent * scale * thisMaxTangent);
              Point3d otherPoint2 = Point3d.Add(otherPoint, otherUnitTangent * scale * otherMaxTangent);


              List<Point3d> bezierPoints = new List<Point3d>();
              bezierPoints.Add(thisPoint);
              bezierPoints.Add(thisPoint2);
              bezierPoints.Add(otherPoint2);
              bezierPoints.Add(otherPoint);

              Line newCable = new Line (thisPoint, otherPoint);
              NurbsCurve newCableB = new BezierCurve(bezierPoints).ToNurbsCurve();
              newCables.Add(newCable);
              newCablesB.Add(newCableB);
            }
          }
        }
      }
    }

    A = pattern;
    B = newCablesB;
    C = cables;
# ---------- c_distribute_cables: C# additional code ----------
  int FindNode (Point3d point, List<Point3d> nodes){
    //tests if point already exists in list of points
    bool newNode = true;
    double tolerance = RhinoDoc.ActiveDoc.ModelAbsoluteTolerance;
    int i;
    for (i = 0; i < nodes.Count; i++){
      if (nodes[i].DistanceTo(point) < tolerance) {
        newNode = false;// using tolerance
        break;
      }
      //foreach (Point3d node in nodes){
      //if (node.Equals(point)) newNode = false;//returning duplicates
      //if (node.DistanceTo(point) < tolerance) newNode = false;// using tolerance
    } // could it be a reduce function?
    if (newNode) i = -1;
    return i;
  }


  // try later in buckets
  T[] ShiftArray<T> (T[] arr, int offset){
  int shift = 0;
  if (offset > 0) shift = offset;
  if (offset < 0) shift = arr.Length - offset;

  T[] left = arr.Take(shift).ToArray();
  T[] right = arr.Skip(shift).ToArray();
  return right.Concat(left).ToArray();
}
# ---------- end c_distribute_cables ----------
panel = Panel(c_distribute_cables.C)
panel_2 = Panel("0")
panel_3 = Panel(c_distribute_cables.out)
geo = Geometry(c_distribute_cables.B)
item = ListItem(List=geo, Index=Slider(5, range=0..10), Wrap=True)
curvature = Curvature(Curve=reparameterize(item), Parameter=Slider(0, range=0..1))  # -> P, K, C
crvgraph = CurvatureGraph(Curve=item, Density=5, Scale=Slider(105, range=0..105))
cpoly = ControlPolygon(Curve=geo)  # -> Polygon, Points
vdis = VectorDisplay(Anchor=curvature.P, Vector=curvature.K)
cables_3 = Integer(c_distribute_cables.C)
cables_4 = Curve(c_distribute_cables.B)
cables_5 = ClusterOutput(cables_3)
cables_6 = ClusterOutput(cables_4)

# ==== cluster IntersectCables
cables = ClusterInput()
cables_2 = Curve(cables)
bang = ExplodeTree(Data=cables_2)  # -> Branch0, Branch1
edge_cables = Curve(bang.Branch1)
corner_cables = Curve(bang.Branch0)
ccx = CurveCurve(CurveA=corner_cables, CurveB=simplify(graft(edge_cables)))  # -> Points, ParamsA, ParamsB
ccx_2 = CurveCurve(CurveA=simplify(graft(corner_cables)), CurveB=edge_cables)  # -> Points, ParamsA, ParamsB
end = EndPoints(Curve=simplify(graft(corner_cables)))  # -> Start, End
trim = TrimTree(Tree=ccx.Points, Depth=1)
trim_2 = TrimTree(Tree=ccx_2.Points, Depth=1)
trim_3 = TrimTree(Tree=ccx_2.ParamsA, Depth=1)
trim_4 = TrimTree(Tree=ccx.ParamsB, Depth=1)
merge = Merge(Data1=end.Start, Data2=trim_2, Data3=end.End)
alongcrv = SortAlongCurve(Points=trim, Curve=graft(edge_cables))  # -> Points, Indices
eval = EvaluateCurve(Curve=reparameterize(graft(corner_cables)), Parameter=trim_3)  # -> Point, Tangent, Angle
eval_2 = EvaluateCurve(Curve=reparameterize(graft(edge_cables)), Parameter=trim_4)  # -> Point, Tangent, Angle
rev = Reverse(Vector=eval.Tangent)
alongcrv_2 = SortAlongCurve(Points=merge, Curve=graft(corner_cables))  # -> Points, Indices
vdis = VectorDisplay(Anchor=eval_2.Point, Vector=eval_2.Tangent)
pline = PolyLine(Vertices=alongcrv_2.Points, Closed=False)
pline_2 = PolyLine(Vertices=alongcrv.Points, Closed=False)
vdis_2 = VectorDisplay(Anchor=eval.Point, Vector=rev)
vdis_3 = VectorDisplay(Anchor=eval.Point, Vector=eval.Tangent)
merge_2 = Merge(Data1=pline, Data2=pline_2)  # -> simplify(Result)
trim_5 = TrimTree(Tree=merge_2, Depth=1)
poly_cables = Curve(trim_5)
poly_cables_2 = ClusterOutput(poly_cables)

# ==== cluster FindBorderCables
edges = ClusterInput()
poly_cables = ClusterInput()
edges_2 = Curve(edges)
poly_cables_2 = Curve(poly_cables)
branch = TreeBranch(Tree=poly_cables_2, Path=Slider(0, range=0..1), MaintainPaths=True)  # -> simplify(graft(Branch))
corner_cables = Curve(branch)

# ---- group: determine index for border corner cables
end = EndPoints(Curve=edges_2)  # -> Start, End
ln = Line(StartPoint=end.Start, EndPoint=end.End)
line = Line(ln)
clx = CurveLine(Curve=corner_cables, Line=line)  # -> Points, Params, Count
int = Integer("2")
mindex = MemberIndex(Set=simplify(clx.Count), Member=flatten(int))  # -> Index, Count
clean = CleanTree(RemoveNulls=True, RemoveInvalid=True, RemoveEmpty="True", Tree=mindex.Index)  # -> simplify(Tree)
viewer = ParamViewer(clean)

# ----
branch_2 = TreeBranch(Tree=corner_cables, Path=viewer, MaintainPaths=True)
border_corner_cables = Curve(branch_2)
border_corner_cables_2 = ClusterOutput(border_corner_cables)

# ==== cluster KANGAROO
poly_cables = ClusterInput()
poly_cables_2 = Curve(poly_cables)
space = ClusterInput()
border_cables = ClusterInput()
concrete_weight_kn_m3 = ClusterInput()
thickness_m = ClusterInput()
space_2 = Curve(space)
border_cables_2 = Curve(border_cables)
concrete_weight_kn_m3_2 = Number(concrete_weight_kn_m3)
thickness_m_2 = Number(thickness_m)
explode = Explode(Curve=poly_cables_2, Recursive=True)  # -> Segments, Vertices
branch = TreeBranch(Tree=poly_cables_2, Path=Slider(0, range=0..1), MaintainPaths=True)
duppt = RemoveDuplicatePts(Points=flatten(explode.Vertices), Tolerance=0.01)
corner_cables = Curve(branch)
bbox = BoundingBox(Content=space_2, Plane=PlaneXY(0, 0, 0))  # -> Box, Box_2
pt = Point(duppt)
voronoi = Voronoi(Points=flatten(pt), Boundary=bbox.Box, BruteForceOverride=False)
length_factor = Slider(0.255, range=0..1)
number_slider = Slider(1, range=0..10)
crv = Curve(explode.Segments)
clean = CleanTree(RemoveNulls=True, RemoveInvalid=True, RemoveEmpty=False, Tree=voronoi)
explode_2 = Explode(Curve=border_cables_2, Recursive=True)  # -> Segments, Vertices
rint = RegionIntersection(CurvesA=space_2, CurvesB=graft(clean))  # -> flatten(Result)
neg = Negative(Value=Slider(0, range=0..10))
end = EndPoints(Curve=corner_cables)  # -> Start, End
trim = TrimTree(Tree=explode_2.Vertices, Depth=1)
neg_2 = Negative(Value=number_slider)
_10º = PowerOf10(Value=neg)
merge = Merge(Data1=end.Start, Data2=end.End)
area = Area(Geometry=rint)  # -> Area, Centroid
len = Length(Curve=crv)
_10º_2 = PowerOf10(Value=number_slider)
duppt_2 = RemoveDuplicatePts(Points=trim, Tolerance=0.01)  # -> simplify(UniquePoints)
multiplication = Multiplication(A=length_factor, B=_10º)
_10º_3 = PowerOf10(Value=Slider(5, range=0..10))
multiplication_2 = Multiplication(A=concrete_weight_kn_m3_2, B=thickness_m_2, C=area.Area)
toggle = BooleanToggle(True)
_10º_4 = PowerOf10(Value=Slider(9, range=0..10))
multiplication_3 = Multiplication(A=len, B=length_factor)
duppt_3 = RemoveDuplicatePts(Points=merge, Tolerance=0.01)
Z = UnitZ(Factor=multiplication_2)
anchor = Anchor(Point=duppt_3, Strength=_10º_4)
# KAN
# GA
# ROO
vdis = VectorDisplay(Anchor=pt, Vector=Z)
anchorxyz = AnchorXYZ(Point=duppt_2, X=toggle, Y=toggle, Z=False, Strength=_10º_3)
length_line = LengthLine(Line=crv, Length=multiplication_3, Strength=_10º_2)
show = Show()
load = Load(Point=pt, ForceVector=Z, Weighting=1)
merge_2 = Merge(Data1=load, Data2=anchorxyz, Data4=anchor)  # -> flatten(Result)
merge_3 = Merge(Data1=merge_2, Data2=length_line)
bouncysolver = BouncySolver(GoalObjects=merge_3, Reset=Button(), Threshold=1e-15, Tolerance=0.01, Damping=0.99, Iterations=10, On=Toggle(True))  # -> I, V, O
zombiesolver = ZombieSolver(GoalObjects=merge_3, Threshold=1e-10, Tolerance=0.01, MaxIterations=50000)  # -> I, V, O
bbox_2 = BoundingBox(Content=zombiesolver.O, Plane=PlaneXY(0, 0, 0), UnionBox=True)  # -> Box, Box_2
unflatten = UnflattenTree(Tree=zombiesolver.O, Guide=merge_3)
debox = DeconstructBox(Box=bbox_2.Box)  # -> Plane, X, Y, Z
clean_2 = CleanTree(RemoveNulls=True, RemoveInvalid=True, RemoveEmpty=Toggle(True), Tree=unflatten)
dedomain = DeconstructDomain(Domain=debox.Z)  # -> Start, End
subtraction = Subtraction(A=dedomain.End, B=dedomain.Start)
join = JoinCurves(Curves=clean_2, Preserve=False)  # -> simplify(Curves)
trim_2 = TrimTree(Tree=join, Depth=1)
bb_height = Number(subtraction)
ff_cables = Curve(trim_2)
bb_height_2 = ClusterOutput(bb_height)
ff_cables_2 = ClusterOutput(ff_cables)

# ==== cluster Segmentation
corner_polys = ClusterInput()
cables = ClusterInput()
corner_polys_2 = Curve(corner_polys)
border_corner_cables = ClusterInput()
cables_2 = Curve(cables)
merge = Merge(Data1=flatten(corner_polys_2), Data2=flatten(cables_2))
border_corner_cables_2 = Curve(border_corner_cables)
border_corner_cables_3 = Curve(border_corner_cables_2)
explode = Explode(Curve=border_corner_cables_3, Recursive=True)  # -> Segments, Vertices
merge_2 = Merge(Data1=corner_polys_2, Data2=border_corner_cables_3)  # -> flatten(Result)

# ---- group: extract regions from curve network
# segmentation
explode_2 = Explode(Curve=merge, Recursive=True)  # -> flatten(Segments), Vertices
clean = CleanTree(RemoveNulls=True, RemoveInvalid=True, RemoveEmpty=False, Tree=explode_2.Segments)
project = Project(Geometry=clean, Plane=PlaneXY(0, 0, 0))  # -> Geometry, Transform
end = EndPoints(Curve=project.Geometry)  # -> Start, End
crv = Curve(project.Geometry)
c_find_naked_lines = CSharpScript(curves=crv)  # -> out, A, B, C, D; inputs curves: list; disabled
# ---------- c_find_naked_lines: C# ----------
    // get unique points (or remove duplicate points) and create parallel branches list
    List<Point3d> nodes = new List<Point3d>();
    List<List<Curve>> branches = new List<List<Curve>>();
    foreach (Curve line in curves){
      int i;
      Point3d node;

      node = line.PointAtStart;
      i = FindNode(line.PointAtStart, nodes);
      if (i < 0) {
        branches.Insert(0, new List<Curve>());
        nodes.Insert(0, node);
      }

      node = line.PointAtEnd;
      i = FindNode(line.PointAtEnd, nodes);
      if (i < 0) {
        branches.Insert(0, new List<Curve>());
        nodes.Insert(0, node);
      }

    }

    // cycle through curves to assign it to branches
    foreach (Curve line in curves) {
      int iNode;

      Point3d start = line.PointAtStart;
      iNode = FindNode(start, nodes);
      branches[iNode].Add(line);

      Point3d end = line.PointAtEnd;
      iNode = FindNode(end, nodes);
      branches[iNode].Add(line);

    }

    //find "naked" nodes, aka with least curves
    // number of curves for selection should be parametric - later
    List<Point3d> nakedNodes = new List<Point3d>();
    for (int i = 0; i < branches.Count; i++){
      if(branches[i].Count < 4){
        nakedNodes.Add(nodes[i]);
      }
    }

    //find curves whose both endpoints are naked aka naked edge
    List<Curve> nakedCurves = new List<Curve>();
    //change names Curve to Edges (as in mesh)
    foreach (Curve line in curves) {

      Point3d start = line.PointAtStart;
      int iStart = FindNode(start, nakedNodes);
      Point3d end = line.PointAtEnd;
      int iEnd = FindNode(end, nakedNodes);

      if ((iStart > -1) && (iEnd > -1))
      {
        nakedCurves.Add(line);
      }
    }






    // from https://discourse.mcneel.com/t/list-of-lists-to-datatree-c-nested-lists/62732
    DataTree<Curve> tree = new DataTree<Curve>();
    int j = 0;
    foreach(List<Curve> innerList in branches){
      tree.AddRange(innerList, new GH_Path(new int[]{0,j}));
      j++;
    }

    A = nodes;
    B = tree;
    C = nakedNodes;
    D = nakedCurves;
# ---------- c_find_naked_lines: C# additional code ----------
  int FindNode (Point3d point, List<Point3d> nodes){
    //tests if point already exists in list of points
    bool newNode = true;
    double tolerance = RhinoDoc.ActiveDoc.ModelAbsoluteTolerance;
    int i;
    for (i = 0; i < nodes.Count; i++){
      if (nodes[i].DistanceTo(point) < tolerance) {
        newNode = false;// using tolerance
        break;
      }
      //foreach (Point3d node in nodes){
      //if (node.Equals(point)) newNode = false;//returning duplicates
      //if (node.DistanceTo(point) < tolerance) newNode = false;// using tolerance
    } // could it be a reduce function?
    if (newNode) i = -1;
    return i;
  }
# ---------- end c_find_naked_lines ----------
bbox = BoundingBox(Content=crv, Plane=PlaneXY(0, 0, 0), UnionBox=True)  # -> Box, Box_2
srfsplit = SurfaceSplit(Surface=bbox.Box, Curves=crv)
srf = Surface(srfsplit)
join = JoinCurves(Curves=merge_2, Preserve=False)
area = Area(Geometry=srf)  # -> Area, Centroid
incurve = PointInCurve(Point=area.Centroid, Curve=join)  # -> Relationship, Point
dispatch = Dispatch(List=srf, DispatchPattern=incurve.Relationship)  # -> ListA, ListB
srf_2 = Surface(dispatch.ListA)

# ----
crv_2 = Curve(explode.Segments)
pframe = PerpFrame(Curve=reparameterize(crv_2), Parameter=".5")
bbox_2 = BoundingBox(Content=flatten(crv_2), Plane=PlaneXY(0, 0, 0), UnionBox=True)  # -> Box, Box_2
deplane = DeconstructPlane(Plane=pframe)  # -> Origin, XAxis, YAxis, ZAxis
area_2 = Area(Geometry=bbox_2.Box)  # -> Area, Centroid
vec2pt = Vector2Pt(PointA=area_2.Centroid, PointB=deplane.Origin, Unitize=False)  # -> Vector, Length
align = AlignPlane(Plane=pframe, Direction=vec2pt.Vector)  # -> Plane, Angle
deplane_2 = DeconstructPlane(Plane=align.Plane)  # -> Origin, XAxis, YAxis, ZAxis
item = ListItem(List=srfsplit, Index=Slider(51, range=0..100), Wrap=True)
extr = Extrude(Base=crv_2, Direction=deplane_2.XAxis)
merge_3 = Merge(Data1=flatten(srf_2), Data2=flatten(extr))
crv_3 = Curve(join)
boundary = BoundarySurfaces(Edges=crv_3)

# ---- group: dual
srf_3 = Surface(merge_3)
join_2 = BrepJoin(Breps=srf_3)  # -> Breps, Closed
topology = BrepTopology(Brep=join_2.Breps, PerspectiveOnly=False)  # -> simplify(FaceFaceAdjacency), FaceEdgeAdjacency, EdgeFaceAdjacency
item_2 = ListItem(List=srf_3, Index=topology.FaceFaceAdjacency, Wrap=True)
area_3 = Area(Geometry=simplify(graft(srf_3)))  # -> Area, Centroid
area_4 = Area(Geometry=item_2)  # -> Area, Centroid
ln = Line(StartPoint=area_3.Centroid, EndPoint=area_4.Centroid)
crv_4 = Curve(flatten(ln))
srfsplit_2 = SurfaceSplit(Surface=boundary, Curves=crv_4)

# ----
srf_4 = Surface(srfsplit_2)

# ---- group: dual four (for merging)
number_slider = Slider(11, range=0..100)
srf_5 = Surface(merge_3)
edges = BrepEdges(Brep=srf_5)  # -> Naked, Interior, NonManifold
item_3 = ListItem(List=srf_5, Index=number_slider, Wrap=True)
join_3 = JoinCurves(Curves=edges.Naked, Preserve=False)
simplify = SimplifyCurve(Curve=join_3)  # -> Curve, Simplified
explode_3 = Explode(Curve=simplify.Curve, Recursive=True)  # -> Segments, Vertices
cull_i = CullIndex(List=explode_3.Vertices, Indices="0", Wrap=True)  # -> simplify(List)
incurve_2 = PointInCurve(Point=graft(cull_i), Curve=graft(srf_4))  # -> Relationship, Point
bool = Boolean(incurve_2.Relationship)
dispatch_2 = Dispatch(List=srf_4, DispatchPattern=bool)  # -> ListA, ListB
trim = TrimTree(Tree=dispatch_2.ListA, Depth=1)
srf_6 = Surface(dispatch_2.ListA)
join_4 = BrepJoin(Breps=trim)  # -> Breps, Closed

# ----
item_4 = ListItem(List=srfsplit_2, Index=Slider(9, range=0..100), Wrap=True)

# ----
# determine which cables intersect each segment
cables_3 = Curve(graft(cables_2))
surface_curve = SurfaceCurve(Surface=graft(srfsplit_2), Curve=flatten(cables_3))  # -> simplify(Curves), Points, UVPoints, Normals, Parameters, Tangents
clean_tree = CleanTree(RemoveNulls=True, RemoveInvalid=True, RemoveEmpty=Toggle(True), Tree=surface_curve.Curves)

segments = Surface(srfsplit_2)
segments_2 = ClusterOutput(segments)
branch = TreeBranch(Tree=simplify(join_4.Breps), Path=number_slider, MaintainPaths=True)
edges_2 = BrepEdges(Brep=join_4.Breps)  # -> Naked, Interior, NonManifold
tree_statistics = TreeStatistics(Tree=clean_tree)  # -> Paths, Length, Count
join_5 = JoinCurves(Curves=edges_2.Naked, Preserve=False)
deconstruct_path = DeconstructPath(Branch=tree_statistics.Paths)
trim_2 = TrimTree(Tree=join_5, Depth=Slider(2, range=0..10))
branch_2 = TreeBranch(Tree=simplify(trim_2), Path=number_slider, MaintainPaths=True)
match_tree = MatchTree(Tree=deconstruct_path, Guide=clean_tree)
tree_statistics_2 = TreeStatistics(Tree=cables_3)  # -> Paths, Length, Count
number_slider_2 = Slider(14, range=0..100)
cull_index = CullIndex(List=match_tree, Indices="0", Wrap=True)  # -> simplify(List)
trim_tree = TrimTree(Tree=cull_index, Depth=1)
list_item = ListItem(List=flatten(tree_statistics_2.Paths), Index=trim_tree, Wrap=True)
surface = Surface(simplify(graft(srfsplit_2)))
list_item_2 = ListItem(List=trim_tree, Index=0, Wrap=True)
tree_branch = TreeBranch(Tree=list_item, Path=number_slider_2, MaintainPaths=True)
tree_branch_2 = TreeBranch(Tree=surface, Path=number_slider_2, MaintainPaths=True)
cable_paths = DataPath(list_item)
panel = Panel(list_item)
tree_branch_3 = TreeBranch(Tree=cables_3, Path=tree_branch, MaintainPaths=True)
cable_paths_2 = ClusterOutput(cable_paths)

# ==== cluster MeshFromCables
cable_polys = ClusterInput()
cable_polys_2 = Geometry(cable_polys)
mesh_from_curves = MeshFromCurves(T=cable_polys_2)

# ---- group: cut out
mesh = Mesh(mesh_from_curves)
geo = Geometry(cable_polys_2)
project = Project(Geometry=geo, Plane=PlaneXY(0, 0, 0))  # -> Geometry, Transform
explode = Explode(Curve=project.Geometry, Recursive=True)  # -> flatten(Segments), Vertices
bbox = BoundingBox(Content=geo, Plane=PlaneXY(0, 0, 0), UnionBox=True)  # -> Box, Box_2
clean = CleanTree(RemoveNulls=True, RemoveInvalid=True, RemoveEmpty=False, Tree=explode.Segments)
debox = DeconstructBox(Box=bbox.Box)  # -> Plane, X, Y, Z
c_find_naked_lines = CSharpScript(curves=clean)  # -> out, A, B, C, D; inputs curves: list; same code as c_find_naked_lines
dedomain = DeconstructDomain(Domain=debox.Z)  # -> Start, End
subtraction = Subtraction(A=dedomain.End, B=dedomain.Start)
join = JoinCurves(Curves=c_find_naked_lines.D, Preserve=False)
Z = UnitZ(Factor=subtraction)
extr = Extrude(Base=join, Direction=Z)
explode_2 = MeshExplode(Mesh=mesh, Interpolate=False)
cap = CapHoles(Brep=extr)
facen = FaceNormals(Mesh=explode_2)  # -> Centers, Normals
brepinc = PointInBrep(Brep=cap, Point=facen.Centers, Strict=False)
dispatch = Dispatch(List=simplify(graft(explode_2)), DispatchPattern=simplify(brepinc))  # -> ListA, ListB
mjoin = MeshJoin(Meshes=flatten(dispatch.ListA))
weldvertices = MeshWeldVertices(Mesh=mjoin, Tolerance=0.01)  # -> RuntimeMessage, Mesh
unifynormals = MeshUnifyNormals(Mesh=weldvertices.Mesh)
mesh_2 = Mesh(unifynormals)

# ----
# mesh
# from
# curves
pt = Point(c_find_naked_lines.C)
mesh_3 = ClusterOutput(mesh_2)

# ==== cluster SplitShellMesh
segments_proj = ClusterInput()
mesh = ClusterInput()

# ---- group: split shell WIP fail?
# a couple of segments on the edges not spliting
segments_proj_2 = Surface(segments_proj)
mesh_2 = Mesh(mesh)
edges = BrepEdges(Brep=segments_proj_2)  # -> simplify(Naked), Interior, NonManifold
bbox = BoundingBox(Content=mesh_2, Plane=PlaneXY(0, 0, 0))  # -> Box, Box_2
boxsize = BoxSize(box=bbox.Box)  # -> X_2, Y_2, Z_2, A_2, V_2
Z = UnitZ(Factor=boxsize.Z_2)
extr = Extrude(Base=segments_proj_2, Direction=Z)
cap = CapHoles(Brep=extr)
project = ProjectPoint(Direction=Vector(0, 0, -1))  # -> Point, Index
mesh_3 = MeshBrep(
    Brep=cap,
    Settings={GridMaxCount=0, GridMinCount=16, JaggedSeams=False, MaxEdgeLength=0, MinEdgeLength=0.0001, MinTolerance=0, Refine=True, RefineAngle=0, RelativeTolerance=0.65, SimplePlanes=True, Tolerance=0})  # -> simplify(graft(Mesh))
msplit = MeshSplit(Mesh=mesh_2, Splitters=mesh_3)
number_slider = Slider(57, range=0..100)
item = ListItem(List=reverse(msplit), Index=0, Wrap=True)  # -> flatten(Item)
item_2 = ListItem(List=item, Index=number_slider, Wrap=True)
geo = Geometry(item)
lng = ListLength(List=geo)
random = Random(Range=Domain(0, 1), Number=lng, Seed=Slider(39, range=0..100))
panel = Panel(msplit)
number_slider_2 = Slider(0, range=0..2)
number_slider_3 = Slider(2, range=0..10)
hsl = ColourHSL(Alpha=1, Hue=random, Saturation=1, Luminance=0.5)
number_slider_4 = Slider(1, range=0..10)
preview = CustomPreview(Geometry=geo, Material=hsl)
m_root_3 = WeightedRoot3Subdivision(M=geo, L=number_slider_3, E=number_slider_2, DF=0, TV=1)  # -> out, A; inputs M: Mesh, DF: list, TV: list
# ---------- m_root_3: VB ----------
    Component.Params.Input(0).Name = "Mesh"
    Component.Params.Input(0).Description = "An open or closed mesh composed of either triangle or quad based faces. Note: The correct implementation of this method should use triangular faces as an input, however quad faces will still function"
    Component.Params.Input(1).Name = "Loops"
    Component.Params.Input(1).Description = "The number of iterations applied to each face"
    Component.Params.Input(2).Name = "Edge Type"
    Component.Params.Input(2).Description = "0=Fixed, 1=Smooth, 2=Fixed Corners"
    Component.Params.Input(3).Name = "Face Distance [Vertex]"
    Component.Params.Input(3).Description = "An optional list of double values which overides the distance the new faced based vertex will be offset along the face normal (0=Default)"
    Component.Params.Input(4).Name = "Vertex Weight [Vertex]"
    Component.Params.Input(4).Description = "An optional list of double values which overides the percent between the existing vertex and the new smoothed vertex (1=Default)"

    Component.Params.Output(1).Name = "Mesh"
    Component.Params.Output(1).Description = "If successful, a valid mesh"

    If m IsNot Nothing Then
      Dim ma As New mesh
      Dim i,lp As Integer
      Dim txV,txF As New list(Of Double)
      Dim xV(),xF() As Double
      Dim bn As Boolean
      Dim cb As Boolean

      'input mesh to the looped mesh
      m.weld(math.pi)
      ma = m

      ' match multiplier and color values to vertex count
      xV = TV.toarray()
      xF = DF.toarray()
      For i = 0 To m.Vertices.count() - 1 Step 1
        txV.add(xV(bC(xV, i)))
        txF.add(xF(bC(xF, i)))
      Next
      xV = txV.toarray()
      xF = txF.toarray()

      bn = m.IsClosed() = False

      For lp = 0 To L - 1 Step 1

        Dim mv As Rhino.Geometry.Collections.MeshVertexList
        Dim mf As Rhino.Geometry.Collections.MeshFaceList
        Dim mfn As Rhino.Geometry.Collections.MeshFaceNormalList
        Dim mc As Rhino.Geometry.Collections.MeshVertexColorList
        Dim mte As Rhino.Geometry.Collections.MeshTopologyEdgeList
        Dim mtv As Rhino.Geometry.Collections.MeshTopologyVertexList
        Dim mnv() As Boolean
        Dim nes As New list(Of Boolean)
        Dim pv() As point3d

        If ma.VertexColors.Count() > 0 Then
          cb = True
        Else
          cb = False
          ma.VertexColors.CreateMonotoneMesh(color.LightBlue)
        End If

        mv = ma.Vertices
        mf = ma.Faces
        mfn = ma.FaceNormals
        mc = ma.VertexColors
        mte = ma.TopologyEdges
        mtv = ma.TopologyVertices

        pv = mv.ToPoint3dArray
        mnv = ma.GetNakedEdgePointStatus

        Dim vo As New list(Of point3d)
        Dim fo As New list(Of MeshFace)
        Dim j,k,u,v,cf,ce,cv As Integer
        Dim fi() As Integer
        Dim p(4) As point3d
        Dim mvi(3) As Integer
        Dim av,af As Double
        Dim rv,rf As New list(Of Double)
        Dim tc As color
        Dim oc As New list(Of color)

        cv = mv.count()
        ce = mte.count()
        cf = mf.count()

        'Faces
        For i = 0 To cf - 1 Step 1
          Dim nrm As vector3d
          fi = mtv.IndicesFromFace(i)
          mvi(0) = mtv.MeshVertexIndices(fi(0))(0)
          mvi(1) = mtv.MeshVertexIndices(fi(1))(0)
          mvi(2) = mtv.MeshVertexIndices(fi(2))(0)
          If mf(i).IsQuad() Then mvi(3) = mtv.MeshVertexIndices(fi(3))(0)

          If mf(i).IsQuad() Then
            av = (xV(mvi(0)) + xV(mvi(1)) + xV(mvi(2)) + xV(mvi(3))) / 4
            af = (xF(mvi(0)) + xF(mvi(1)) + xF(mvi(2)) + xF(mvi(3))) / 4
            tc = avgC4(mc(mvi(0)), mc(mvi(1)), mc(mvi(2)), mc(mvi(3)))
          Else
            av = (xV(mvi(0)) + xV(mvi(1)) + xV(mvi(2))) / 3
            af = (xF(mvi(0)) + xF(mvi(1)) + xF(mvi(2))) / 3
            tc = avgC3(mc(mvi(0)), mc(mvi(1)), mc(mvi(2)))
          End If

          nrm = mfn(i)
          nrm.Unitize()
          nrm *= af

          vo.add(mf.getfacecenter(i) + nrm)
          rv.add(av)
          rf.add(af)
          oc.add(tc)
        Next

        'Edges
        For i = 0 To ce - 1 Step 1
          Dim cfi() As Integer
          cfi = mte.GetConnectedFaces(i)
          u = mtv.MeshVertexIndices(mte.GetTopologyVertices(i).I)(0)
          v = mtv.MeshVertexIndices(mte.GetTopologyVertices(i).J)(0)

          If ubound(cfi) > 0 Then
            fo.add(New meshface(cf + u, cfi(0), cfi(1)))
            fo.add(New meshface(cf + v, cfi(1), cfi(0)))
            nes.add(False)
          Else
            fo.add(New meshface(cf + u, cf + v, cfi(0)))
            nes.add(True)
          End If
        Next

        'Vertices
        For i = 0 To cv - 1 Step 1
          Dim zn As Integer
          Dim r As Double
          Dim cvi As New list(Of Integer)
          Dim q(6) As point3d
          Dim bne As Boolean = False
          q(0) = pv(i)

          cvi = mv.GetConnectedVertices(i).ToList()
          cvi.remove(i)
          k = cvi.count()
          zn = 0

          For j = 0 To k - 1 Step 1
            u = mte.GetEdgeIndex(mtv.TopologyVertexIndex(cvi.item((j))), mtv.TopologyVertexIndex(i))
            q(1) += pv(cvi.item(j))

            If nes(u) Then
              bne = True
              q(2) += (q(0) + pv(cvi.item(j))) / 2
              zn += 1
            End If
          Next
          q(1) /= k
          q(2) = (q(0) + q(2) / zn) / 2

          If bne Then
            If e = 0 Then
              q(3) = pv(i)
            ElseIf e = 2 Then
              If k = 2 Then
                q(3) = pv(i)
              Else
                q(3) = evalP(q(0), q(2), xV(i))
              End If
            Else
              q(3) = evalP(q(0), q(2), xV(i))
            End If
          Else
            r = (4 - 2 * math.Cos(2 * math.PI / k)) / 9
            q(3) = evalP(q(0), q(0) * (1 - r) + q(1) * r, xV(i))
          End If

          vo.add(q(3))
          rv.add(xV(i))
          rf.add(xF(i))
          oc.add(mc(i))

        Next

        Dim mo As New mesh
        mo.Vertices.AddVertices(vo)
        mo.Faces.AddFaces(fo)
        If cb Then mo.VertexColors.AppendColors(oc.toarray())
        mo.FaceNormals.ComputeFaceNormals()
        mo.UnifyNormals()
        mo.Normals.ComputeNormals()

        ma = mo
        xV = rv.toarray()
        xF = rf.toarray()

        'Loop
      Next
      A = ma
    End If
# ---------- m_root_3: VB additional code ----------
  Private Function bC(ByVal arrObj() As Double, ByVal t As Integer)
    Dim intOut As Integer
    If t > uBound(arrObj) Then intOut = uBound(arrObj) Else intOut = t
    Return intOut
  End Function

  Private Function evalP(ByVal op As point3d, ByVal tp As Point3d, ByVal t As Double)
    Return New point3d(op + (tp - op) * t)
  End Function

  Private Function avgC3(ByVal c0 As color, ByVal c1 As color, ByVal c2 As color)
    Dim r,g,b As Integer
    r = CInt((CInt(c0.R) + CInt(c1.R) + CInt(c2.R)) / 3)
    g = CInt((CInt(c0.G) + CInt(c1.G) + CInt(c2.G)) / 3)
    b = CInt((CInt(c0.B) + CInt(c1.B) + CInt(c2.B)) / 3)

    If R < 0 Then r = 0 Else If r > 255 Then r = 255
    If G < 0 Then g = 0 Else If r > 255 Then g = 255
    If B < 0 Then b = 0 Else If r > 255 Then b = 255

    Return color.FromArgb(r, g, b)
  End Function

  Private Function avgC4(ByVal c0 As color, ByVal c1 As color, ByVal c2 As color, ByVal c3 As color)
    Dim r,g,b As Integer
    r = CInt((CInt(c0.R) + CInt(c1.R) + CInt(c2.R) + CInt(c3.R)) / 4)
    g = CInt((CInt(c0.G) + CInt(c1.G) + CInt(c2.G) + CInt(c3.G)) / 4)
    b = CInt((CInt(c0.B) + CInt(c1.B) + CInt(c2.B) + CInt(c3.B)) / 4)

    If R < 0 Then r = 0 Else If r > 255 Then r = 255
    If G < 0 Then g = 0 Else If r > 255 Then g = 255
    If B < 0 Then b = 0 Else If r > 255 Then b = 255

    Return color.FromArgb(r, g, b)
  End Function
# ---------- end m_root_3 ----------
m_catmull_clark = WeightedCatmullClarkSubdivision(M=geo, L=number_slider_3, E=number_slider_2, DF=0, TE=1, TV=1)  # -> out, A; inputs M: Mesh, DF: list, TE: list, TV: list
# ---------- m_catmull_clark: VB ----------
    Component.Params.Input(0).Name = "Mesh"
    Component.Params.Input(0).Description = "An open or closed mesh composed of either triangle or quad based faces"
    Component.Params.Input(1).Name = "Loops"
    Component.Params.Input(1).Description = "The number of iterations applied to each face"
    Component.Params.Input(2).Name = "Edge Type"
    Component.Params.Input(2).Description = "0=Fixed, 1=Smooth, 2=Fixed Corners"
    Component.Params.Input(3).Name = "Face Distance [Vertex]"
    Component.Params.Input(3).Description = "An optional list of double values which overides the distance the new faced based vertex will be offset along the face normal (0=Default)"
    Component.Params.Input(4).Name = "Edge Weight [Vertex]"
    Component.Params.Input(4).Description = "An optional list of double values which overides the percent between the existing edge midpoint and the new smoothed vertex (1=Default)"
    Component.Params.Input(5).Name = "Vertex Weight [Vertex]"
    Component.Params.Input(5).Description = "An optional list of double values which overides the percent between the existing vertex and the new smoothed vertex (1=Default)"

    Component.Params.Output(1).Name = "Mesh"
    Component.Params.Output(1).Description = "If successful, a valid mesh"

    If m IsNot Nothing Then
      Dim ma As New mesh
      Dim i,lp As Integer
      Dim txV,txE,txF As New list(Of Double)
      Dim xV(),xE(),xF() As Double
      Dim bn As Boolean
      Dim cb As Boolean

      'input mesh to the looped mesh
      m.weld(math.pi)
      ma = m

      ' match multiplier and color values to vertex count
      xV = TV.toarray()
      xE = TE.toarray()
      xF = DF.toarray()
      For i = 0 To m.Vertices.count() - 1 Step 1
        txV.add(xV(bC(xV, i)))
        txE.add(xE(bC(xE, i)))
        txF.add(xF(bC(xF, i)))
      Next
      xV = txV.toarray()
      xE = txE.toarray()
      xF = txF.toarray()

      bn = m.IsClosed() = False

      For lp = 0 To L - 1 Step 1

        Dim mv As Rhino.Geometry.Collections.MeshVertexList
        Dim mf As Rhino.Geometry.Collections.MeshFaceList
        Dim mfn As Rhino.Geometry.Collections.MeshFaceNormalList
        Dim mc As Rhino.Geometry.Collections.MeshVertexColorList
        Dim mte As Rhino.Geometry.Collections.MeshTopologyEdgeList
        Dim mtv As Rhino.Geometry.Collections.MeshTopologyVertexList
        Dim mnv() As Boolean
        Dim nes As New list(Of Boolean)

        If ma.VertexColors.Count() > 0 Then
          cb = True
        Else
          cb = False
          ma.VertexColors.CreateMonotoneMesh(color.LightBlue)
        End If

        mv = ma.Vertices
        mf = ma.Faces
        mfn = ma.FaceNormals
        mc = ma.VertexColors
        mte = ma.TopologyEdges
        mtv = ma.TopologyVertices

        mnv = ma.GetNakedEdgePointStatus

        Dim vo As New list(Of point3d)
        Dim fo As New list(Of MeshFace)
        Dim j,k,u,v,cf,ce,cv As Integer
        Dim fi() As Integer
        Dim p(4) As point3d
        Dim mvi(3) As Integer
        Dim nrm As vector3d
        Dim av,ae,af As Double
        Dim rv,re,rf As New list(Of Double)
        Dim tc As color
        Dim oc As New list(Of color)

        cv = mv.count()
        ce = mte.count()
        cf = mf.count()

        'Faces
        For i = 0 To cf - 1 Step 1
          fi = mtv.IndicesFromFace(i)
          mvi(0) = mtv.MeshVertexIndices(fi(0))(0)
          mvi(1) = mtv.MeshVertexIndices(fi(1))(0)
          mvi(2) = mtv.MeshVertexIndices(fi(2))(0)
          If mf(i).IsQuad() Then mvi(3) = mtv.MeshVertexIndices(fi(3))(0)

          If mf(i).IsQuad() Then
            fo.add(New meshface(i, cF + mte.GetEdgeIndex(fi(0), fi(1)), cE + cF + mvi(1), cF + mte.GetEdgeIndex(fi(1), fi(2))))
            fo.add(New meshface(cF + mte.GetEdgeIndex(fi(1), fi(2)), cE + cF + mvi(2), cF + mte.GetEdgeIndex(fi(2), fi(3)), i))
            fo.add(New meshface(cE + cF + mvi(3), cF + mte.GetEdgeIndex(fi(3), fi(0)), i, cF + mte.GetEdgeIndex(fi(2), fi(3))))
            fo.add(New meshface(cF + mte.GetEdgeIndex(fi(0), fi(1)), i, cF + mte.GetEdgeIndex(fi(3), fi(0)), cE + cF + mvi(0)))
            av = (xV(mvi(0)) + xV(mvi(1)) + xV(mvi(2)) + xV(mvi(3))) / 4
            ae = (xE(mvi(0)) + xE(mvi(1)) + xE(mvi(2)) + xE(mvi(3))) / 4
            af = (xF(mvi(0)) + xF(mvi(1)) + xF(mvi(2)) + xF(mvi(3))) / 4
            tc = avgC4(mc(mvi(0)), mc(mvi(1)), mc(mvi(2)), mc(mvi(3)))
          Else
            fo.add(New meshface(i, cF + mte.GetEdgeIndex(fi(0), fi(1)), cE + cF + mvi(1), cF + mte.GetEdgeIndex(fi(1), fi(2))))
            fo.add(New meshface(cF + mte.GetEdgeIndex(fi(1), fi(2)), cE + cF + mvi(2), cF + mte.GetEdgeIndex(fi(2), fi(0)), i))
            fo.add(New meshface(cE + cF + mvi(0), cF + mte.GetEdgeIndex(fi(0), fi(1)), i, cF + mte.GetEdgeIndex(fi(2), fi(0))))
            av = (xV(mvi(0)) + xV(mvi(1)) + xV(mvi(2))) / 3
            ae = (xE(mvi(0)) + xE(mvi(1)) + xE(mvi(2))) / 3
            af = (xF(mvi(0)) + xF(mvi(1)) + xF(mvi(2))) / 3
            tc = avgC3(mc(mvi(0)), mc(mvi(1)), mc(mvi(2)))
          End If
          nrm = mfn(i)
          nrm.Unitize()
          vo.add(mf.getfacecenter(i) + nrm * af)
          rv.add(av)
          re.add(ae)
          rf.add(af)
          oc.add(tc)
        Next

        'Edges
        For i = 0 To ce - 1 Step 1

          u = mtv.MeshVertexIndices(mte.GetTopologyVertices(i).I)(0)
          v = mtv.MeshVertexIndices(mte.GetTopologyVertices(i).J)(0)
          p(0) = mv.item(u)
          p(1) = mv.item(v)

          If mte.GetConnectedFaces(i).Count() > 1 Then
            p(2) = mf.GetFaceCenter(mte.GetConnectedFaces(i)(0))
            p(3) = mf.GetFaceCenter(mte.GetConnectedFaces(i)(1))
            p(4) = evalP((p(0) + p(1)) / 2, ( p(2) + p(3)) / 2, (xE(u) / 2 + xE(v) / 2) / 2)
            nes.add(False)
          Else
            p(4) = (p(0) + p(1)) / 2
            nes.add(True)
          End If

          vo.add(p(4))
          rv.add((xV(u) + xV(v)) / 2)
          re.add((xE(u) + xE(v)) / 2)
          rf.add((xF(u) + xF(v)) / 2)
          oc.add(avgC2(mc(u), mc(v)))
        Next

        'Vertices
        For i = 0 To cv - 1 Step 1
          Dim zf,zn As Integer
          Dim cvi As New list(Of Integer)
          Dim q(6) As point3d
          Dim bne As Boolean = False
          q(4) = New point3d(mv(i))

          zf = mv.GetVertexFaces(i).count()
          For j = 0 To zf - 1 Step 1
            q(0) += mF.GetFaceCenter(mV.GetVertexFaces(i)(j))
          Next
          q(0) /= zf

          cvi = mv.GetConnectedVertices(i).ToList()
          cvi.remove(i)
          k = cvi.count()
          zn = 0
          For j = 0 To k - 1 Step 1
            u = mte.GetEdgeIndex(mtv.TopologyVertexIndex(cvi.item((j))), mtv.TopologyVertexIndex(i))
            q(1) = mv.item(mtv.MeshVertexIndices(mte.GetTopologyVertices(u).I)(0))
            q(2) = mv.item(mtv.MeshVertexIndices(mte.GetTopologyVertices(u).J)(0))
            q(3) += (q(1) + q(2)) / 2

            If nes(u) Then
              bne = True
              q(5) += (q(1) + q(2)) / 2
              zn += 1
            End If
          Next
          q(3) /= k

          If bne Then
            If e = 1 Then
              q(6) = (q(4) + q(5) / zn) / 2
            ElseIf e = 2 Then
              If k = 2 Then
                q(6) = q(4)
              Else
                q(6) = evalP(q(4), (q(4) + q(5) / zn) / 2, xV(i))
              End If
            Else
              q(6) = q(4)
            End If
          Else
            q(6) = evalP(q(4), (q(4) * ((zf - 3) / zf)) + (q(3) * (2 / zf)) + (q(0) * (1 / zf)), xV(i))
          End If

          vo.add(q(6))
          rv.add(xV(i))
          re.add(xE(i))
          rf.add(xF(i))
          oc.add(mc(i))

        Next

        Dim mo As New mesh
        mo.Vertices.AddVertices(vo)
        mo.Faces.AddFaces(fo)
        If cb Then mo.VertexColors.AppendColors(oc.toarray())
        mo.FaceNormals.ComputeFaceNormals()
        mo.Normals.ComputeNormals()

        ma = mo
        xV = rv.toarray()
        xE = re.toarray()
        xF = rf.toarray()

        'Loop
      Next
      
      A = ma
    End If
# ---------- m_catmull_clark: VB additional code ----------
  Private Function bC(ByVal arrObj() As Double, ByVal t As Integer)
    Dim intOut As Integer
    If t > uBound(arrObj) Then intOut = uBound(arrObj) Else intOut = t
    Return intOut
  End Function

  Private Function evalP(ByVal op As point3d, ByVal tp As Point3d, ByVal t As Double)
    Return New point3d(op + (tp - op) * t)
  End Function

  Private Function avgC2(ByVal c0 As color, ByVal c1 As color)
    Dim r,g,b As Integer
    r = CInt(((CInt(c0.R) + CInt(c1.R)) / 2))
    g = CInt(((CInt(c0.G) + CInt(c1.G)) / 2))
    b = CInt(((CInt(c0.B) + CInt(c1.B)) / 2))

    If R < 0 Then r = 0 Else If r > 255 Then r = 255
    If G < 0 Then g = 0 Else If r > 255 Then g = 255
    If B < 0 Then b = 0 Else If r > 255 Then b = 255

    Return color.FromArgb(r, g, b)
  End Function

  Private Function avgC3(ByVal c0 As color, ByVal c1 As color, ByVal c2 As color)
    Dim r,g,b As Integer
    r = CInt((CInt(c0.R) + CInt(c1.R) + CInt(c2.R)) / 3)
    g = CInt((CInt(c0.G) + CInt(c1.G) + CInt(c2.G)) / 3)
    b = CInt((CInt(c0.B) + CInt(c1.B) + CInt(c2.B)) / 3)

    If R < 0 Then r = 0 Else If r > 255 Then r = 255
    If G < 0 Then g = 0 Else If r > 255 Then g = 255
    If B < 0 Then b = 0 Else If r > 255 Then b = 255

    Return color.FromArgb(r, g, b)
  End Function

  Private Function avgC4(ByVal c0 As color, ByVal c1 As color, ByVal c2 As color, ByVal c3 As color)
    Dim r,g,b As Integer
    r = CInt((CInt(c0.R) + CInt(c1.R) + CInt(c2.R) + CInt(c3.R)) / 4)
    g = CInt((CInt(c0.G) + CInt(c1.G) + CInt(c2.G) + CInt(c3.G)) / 4)
    b = CInt((CInt(c0.B) + CInt(c1.B) + CInt(c2.B) + CInt(c3.B)) / 4)

    If R < 0 Then r = 0 Else If r > 255 Then r = 255
    If G < 0 Then g = 0 Else If r > 255 Then g = 255
    If B < 0 Then b = 0 Else If r > 255 Then b = 255

    Return color.FromArgb(r, g, b)
  End Function
# ---------- end m_catmull_clark ----------
m_loop = WeightedLoopSubdivision(M=geo, L=number_slider_3, E=number_slider_2, TE=1, TV=1)  # -> out, A; inputs M: Mesh, TE: list, TV: list
# ---------- m_loop: VB ----------
    Component.Params.Input(0).Name = "Mesh"
    Component.Params.Input(0).Description = "An open or closed mesh whose faces should be triangular, all quad faces will be triangulated automatically"
    Component.Params.Input(1).Name = "Loops"
    Component.Params.Input(1).Description = "The number of iterations applied to each face"
    Component.Params.Input(2).Name = "Edge Type"
    Component.Params.Input(2).Description = "0=Fixed, 1=Smooth, 2=Fixed Corners"
    Component.Params.Input(3).Name = "Edge Weight [Vertex]"
    Component.Params.Input(3).Description = "An optional list of double values which overides the percent between the existing edge midpoint and the new smoothed vertex (1=Default)"
    Component.Params.Input(4).Name = "Vertex Weight [Vertex]"
    Component.Params.Input(4).Description = "An optional list of double values which overides the percent between the existing vertex and the new smoothed vertex (1=Default)"

    Component.Params.Output(1).Name = "Mesh"
    Component.Params.Output(1).Description = "If successful, a valid mesh"

    If m IsNot Nothing Then
      Dim ma As New mesh
      Dim i,lp As Integer
      Dim txV,txE As New list(Of Double)
      Dim xV(),xE() As Double
      Dim bn As Boolean
      Dim cb As Boolean

      'input mesh to the looped mesh
      m.weld(math.pi)
      If m.Faces.QuadCount() > 0 Then m.Faces.ConvertQuadsToTriangles
      ma = m

      ' match multiplier and color values to vertex count
      xV = TV.toarray()
      xE = TE.toarray()
      For i = 0 To m.Vertices.count() - 1 Step 1
        txV.add(xV(bC(xV, i)))
        txE.add(xE(bC(xE, i)))
      Next
      xV = txV.toarray()
      xE = txE.toarray()

      bn = m.IsClosed() = False

      For lp = 0 To L - 1 Step 1

        Dim mv As Rhino.Geometry.Collections.MeshVertexList
        Dim mf As Rhino.Geometry.Collections.MeshFaceList
        Dim mfn As Rhino.Geometry.Collections.MeshFaceNormalList
        Dim mc As Rhino.Geometry.Collections.MeshVertexColorList
        Dim mte As Rhino.Geometry.Collections.MeshTopologyEdgeList
        Dim mtv As Rhino.Geometry.Collections.MeshTopologyVertexList
        Dim mnv() As Boolean
        Dim nes As New list(Of Boolean)
        Dim pv() As point3d

        If ma.VertexColors.Count() > 0 Then
          cb = True
        Else
          cb = False
          ma.VertexColors.CreateMonotoneMesh(color.LightBlue)
        End If

        mv = ma.Vertices
        mf = ma.Faces
        mfn = ma.FaceNormals
        mc = ma.VertexColors
        mte = ma.TopologyEdges
        mtv = ma.TopologyVertices

        pv = mv.ToPoint3dArray
        mnv = ma.GetNakedEdgePointStatus

        Dim vo,vt As New list(Of point3d)
        Dim fo As New list(Of MeshFace)
        Dim j,k,u,v,cf,ce,cv As Integer
        Dim fi() As Integer
        Dim p(3) As point3d
        Dim mvi(3) As Integer
        Dim rv,re As New list(Of Double)
        Dim oc As New list(Of color)

        cv = mv.count()
        ce = mte.count()
        cf = mf.count()

        'Faces
        For i = 0 To cf - 1 Step 1
          fi = mtv.IndicesFromFace(i)
          mvi(0) = mtv.MeshVertexIndices(fi(0))(0)
          mvi(1) = mtv.MeshVertexIndices(fi(1))(0)
          mvi(2) = mtv.MeshVertexIndices(fi(2))(0)

          fo.add(New meshface(mte.GetEdgeIndex(fi(0), fi(1)), mte.GetEdgeIndex(fi(1), fi(2)), mte.GetEdgeIndex(fi(2), fi(0))))

          fo.add(New meshface(mte.GetEdgeIndex(fi(0), fi(1)), ce + mvi(1), mte.GetEdgeIndex(fi(1), fi(2))))
          fo.add(New meshface(mte.GetEdgeIndex(fi(1), fi(2)), ce + mvi(2), mte.GetEdgeIndex(fi(2), fi(0))))
          fo.add(New meshface(mte.GetEdgeIndex(fi(2), fi(0)), ce + mvi(0), mte.GetEdgeIndex(fi(0), fi(1))))
        Next

        'Edges
        For i = 0 To ce - 1 Step 1
          Dim cfi() As Integer
          Dim ta,tb As New list(Of Integer)
          Dim cei As Rhino.IndexPair

          cfi = mte.GetConnectedFaces(i)
          cei = mte.GetTopologyVertices(i)
          u = mtv.MeshVertexIndices(cei.I)(0)
          v = mtv.MeshVertexIndices(cei.J)(0)
          p(0) = (pv(u) + pv(v)) / 2

          If ubound(cfi) > 0 Then
            ta = mf.GetTopologicalVertices(cfi(0)).tolist()
            ta.remove(cei.I)
            ta.remove(cei.J)

            tb = mf.GetTopologicalVertices(cfi(1)).tolist()
            tb.remove(cei.I)
            tb.remove(cei.J)

            p(1) = pv(mtv.meshvertexindices(ta(0))(0))
            p(2) = pv(mtv.meshvertexindices(tb(0))(0))
            p(3) = evalP(p(0), pv(u) * 3 / 8 + pv(v) * 3 / 8 + p(1) / 8 + p(2) / 8, (xe(u) + xe(v)) / 2)

            nes.add(False)
          Else
            p(3) = p(0)
            nes.add(True)
          End If

          vo.add(p(3))
          vt.add(p(3))
          rv.add((xV(u) + xV(v)) / 2)
          re.add((xE(u) + xE(v)) / 2)
          oc.add(avgC2(mc(u), mc(v)))
        Next

        'Vertices
        For i = 0 To cv - 1 Step 1
          Dim tvi As Integer
          Dim cvi As New list(Of Integer)
          Dim q(2) As point3d
          Dim bne As Boolean = False

          tvi = mtv.TopologyVertexIndex(i)

          mtv.SortEdges(tvi)

          cvi = mtv.ConnectedTopologyVertices(tvi).tolist()
          cvi.remove(tvi)
          k = cvi.count()

          For j = 0 To k - 1 Step 1
            u = mte.GetEdgeIndex(tvi, cvi.item(j))
            q(0) += pv(mtv.MeshVertexIndices(cvi.item(j))(0))

            If nes(u) Then
              bne = True
              q(2) += pv(mtv.MeshVertexIndices(cvi.item(j))(0))
            End If
          Next

          If bne Then
            If e = 0 Then
              q(1) = pv(i)
            ElseIf e = 2 Then
              If k = 2 Then
                q(1) = pv(i)
              Else
                q(1) = evalP(pv(i), q(2) / 2, 0.25)
              End If
            Else
              q(1) = evalP(pv(i), q(2) / 2, 0.25)
            End If
          Else
            If k = 3 Then
              q(1) = evalp(pv(i), q(0) / k, xv(i) * 9 / 16)
            Else
              q(1) = evalp(pv(i), q(0) / k, xv(i) * 3 / 8)
            End If
          End If


          vo.add(q(1))
          rv.add(xV(i))
          re.add(xE(i))
          oc.add(mc(i))

        Next

        Dim mo As New mesh
        mo.Vertices.AddVertices(vo)
        mo.Faces.AddFaces(fo)
        If cb Then mo.VertexColors.AppendColors(oc.toarray())
        mo.FaceNormals.ComputeFaceNormals()
        mo.Normals.ComputeNormals()

        ma = mo
        xV = rv.toarray()
        xE = re.toarray()

        'Loop
      Next
      A = ma
    End If
# ---------- m_loop: VB additional code ----------
  Private Function bC(ByVal arrObj() As Double, ByVal t As Integer)
    Dim intOut As Integer
    If t > uBound(arrObj) Then intOut = uBound(arrObj) Else intOut = t
    Return intOut
  End Function

  Private Function evalP(ByVal op As point3d, ByVal tp As Point3d, ByVal t As Double)
    Return New point3d(op + (tp - op) * t)
  End Function

  Private Function avgC2(ByVal c0 As color, ByVal c1 As color)
    Dim r,g,b As Integer
    r = CInt(((CInt(c0.R) + CInt(c1.R)) / 2))
    g = CInt(((CInt(c0.G) + CInt(c1.G)) / 2))
    b = CInt(((CInt(c0.B) + CInt(c1.B)) / 2))

    If R < 0 Then r = 0 Else If r > 255 Then r = 255
    If G < 0 Then g = 0 Else If r > 255 Then g = 255
    If B < 0 Then b = 0 Else If r > 255 Then b = 255

    Return color.FromArgb(r, g, b)
  End Function
# ---------- end m_loop ----------
item_3 = ListItem(List=m_catmull_clark.A, Index=number_slider, Wrap=True)

# ==== cluster PTForcesPolys
cables = ClusterInput()
pt_force = ClusterInput()
cables_2 = Geometry(cables)
pt_force_2 = Number(pt_force)

# ----
# PT forces
pt_kn = Number(pt_force_2)
crv = Curve(cables_2)
flip = FlipCurve(Curve=crv)  # -> Curve, Flag
explode = Explode(Curve=crv, Recursive=True)  # -> Segments, simplify(Vertices)
crv_2 = Curve(crv)
lng = ListLength(List=explode.Vertices)
series = Series(Start=0, Step=1, Count=lng)  # -> simplify(Series)
int = Integer(series)
neg = Negative(Value=int)
eval = EvaluateCurve(Curve=graft(crv_2), Parameter=int)  # -> Point, Tangent, Angle
eval_2 = EvaluateCurve(Curve=graft(flip.Curve), Parameter=neg)  # -> Point, Tangent, Angle
pt_intersection_nodes = Point(eval.Point)

intcrv = Interpolate(Vertices=explode.Vertices, Degree=3, Periodic=False, KnotStyle=1)  # -> Curve, Length, Domain
nurbs = NurbsCurve(Vertices=explode.Vertices, Degree=3, Periodic=False)  # -> Curve, Length, Domain
crvgraph = CurvatureGraph(Curve=intcrv.Curve, Density=5, Scale=Slider(103, range=0..120))
crossref = CrossReference(ListA=graft(pt_kn), ListB=eval.Point, CrossMode=1)  # -> ListA, ListB

amp = Amplitude(Vector=eval_2.Tangent, Amplitude=simplify(crossref.ListA))
amp_2 = Amplitude(Vector=eval.Tangent, Amplitude=simplify(crossref.ListA))
addition = Addition(A=amp_2, B=amp)
vdis = VectorDisplay(Anchor=pt_intersection_nodes, Vector=amp)
vdis_2 = VectorDisplay(Anchor=pt_intersection_nodes, Vector=amp_2)
vec_pt_force = Vector(addition)
vdis_3 = VectorDisplay(Anchor=pt_intersection_nodes, Vector=vec_pt_force)

item = ListItem(List=reverse(amp_2), Index=0, Wrap=True)
item_2 = ListItem(List=reverse(eval.Point), Index=0, Wrap=True)
item_3 = ListItem(List=eval_2.Point, Index=0, Wrap=True)
item_4 = ListItem(List=amp, Index=0, Wrap=True)
vdis_endforce = VectorDisplay(Anchor=item_2, Vector=item)
vdis_endforce_2 = VectorDisplay(Anchor=item_3, Vector=item_4)
merge = Merge(Data1=item, Data2=item_4)
pt_intersection_nodes_2 = Point(pt_intersection_nodes)
vec_end_force = Vector(merge)
vec_pt_force_2 = Vector(addition)
vec_end_force_2 = ClusterOutput(vec_end_force)
move = Move(Geometry=pt_intersection_nodes_2, Motion=vec_pt_force_2)  # -> Geometry, Transform

# ---- group: pair up curve intersection points by index, returns uniques
vec_pt_force_3 = Vector(flatten(vec_pt_force))
pt = Point(flatten(pt_intersection_nodes))
rdpoints = RemoveDuplicatePointsKaramba3D(Point=pt, LimitDistance=0.005)  # -> OutPoint, Info, Indexes
item_5 = ListItem(List=pt, Index=rdpoints.Indexes, Wrap=True)
cp = ClosestPoint(Point=item_5, Cloud=pt)  # -> ClosestPoint, simplify(graft(CPIndex)), Distance
merge_2 = Merge(Data1=simplify(graft(rdpoints.Indexes)), Data2=cp.CPIndex)
item_6 = ListItem(List=vec_pt_force_3, Index=merge_2, Wrap=True)
item_7 = ListItem(List=pt, Index=merge_2, Wrap=True)
ma = MassAddition(Input=item_6)  # -> Result, PartialResults
item_8 = ListItem(List=item_7, Index=0, Wrap=True)
vdisex = VectorDisplayEx(Point=item_8, Vector=ma.Result, Colour=RGB(0, 0, 0), Width=Slider(3, range=0..10))

# ----
pline = PolyLine(Vertices=move.Geometry, Closed=False)  # disabled
curve = Curve(pline)  # disabled
pt_intersection_nodes_3 = ClusterOutput(pt_intersection_nodes_2)
vec_pt_force_4 = ClusterOutput(vec_pt_force_2)

# ==== cluster KarambaSimple
mesh = ClusterInput()
thickness_m = ClusterInput()
pt_loads = ClusterInput()
pt_loads_2 = LoadKaramba3D(pt_loads)

# ----
# KARAMBA
mesh_2 = Mesh(mesh)
thickness_m_2 = Number(thickness_m)
bottompoints = BottomPoints(mesh=mesh_2, ltol=Slider(2, range=0..10))
bbox = BoundingBox(Content=mesh_2, Plane=PlaneXY(0, 0, 0), UnionBox=True)  # -> Box, Box_2
box = EvaluateBox(Box=bbox.Box, UParameter=0.5, VParameter=0.5, WParameter="1")  # -> Plane, Point, Include
multiplication = Multiplication(A=thickness_m_2, B=100)
supp = SupportKaramba3D(PosInd=flatten(bottompoints), menu=[buttons(off, off, on, on, on, off)])
supp_2 = SupportKaramba3D(PosInd=box.Point, menu=[buttons(on, on, off, off, off, on)])
cross_section = CrossSectionKaramba3D(
    FamilyNameOfCrossSection="DefaultCroSec",
    Material=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,
    Height_cm=multiplication,
    mode="Shell - Const")
loads = LoadsKaramba3D(Vector=Vector(0, 0, -1), mode="Gravity")
pt_loads_3 = LoadKaramba3D(pt_loads_2)
matselect = MaterialSelectionKaramba3D(menu=[dropdown(3), dropdown(4)])
meshtoshell = MeshToShellKaramba3D(Mesh=mesh_2, CrossSection=cross_section, LimitDistance_m=0.005)  # -> Element, Points, Info
merge = Merge(Data1=supp, Data2=supp_2)  # -> flatten(Result)
merge_2 = Merge(Data1=loads, Data2=pt_loads_3)
assemble = AssembleModelKaramba3D(Elem=meshtoshell.Element, Support=merge, Load=merge_2, Material=matselect, LimitDistance_m=0.005)  # -> Model, Info, Mass_kg, CenterOfGravity
analyze = AnalyzeKaramba3D(Model=assemble.Model)  # -> CalculatedModel, MaximumDisplacement_cm, ResultingForceOfGravity_kN, ElasticEnergy_kNm
modelview = ModelViewKaramba3D(Model=analyze.CalculatedModel, ResultFactors=1, ResultCase=-1)  # -> Model, DeformedMesh, DeformedAxes, DeformedModel
shellview = ShellViewKaramba3D(Model=modelview.Model, IndexOfLayer=0)  # -> Model, MeshesOfRenderedShells, LegendColors, LegendTags

shelllineresults = LineResultsOnShellsKaramba3D(
    AnalyzedModel=shellview.Model,
    LayerPosition=Slider(1, range=-1..1),
    ListOfSourcesOfPrincipalStressLinesLinesPoints=bottompoints,
    SegmentLength_m=0.5,
    DA_deg=5,
    mode="PrincStress")  # -> AnalyzedModel, Lines1, Lines2

# ==== cluster WIPSurfCurvatureAlongLine
crv = ClusterInput()
crv_2 = Curve(crv)
shell = ClusterInput()
int = ClusterInput()
shell_2 = Surface(shell)
int_2 = Integer(int)
range = Range(Domain=Domain(0, 1), Steps=Slider(100, range=0..1000))
eval = EvaluateCurve(Curve=crv_2, Parameter=range)  # -> Point, Tangent, Angle
srf_cp = SurfaceClosestPoint(Point=eval.Point, Surface=shell_2)  # -> Point, UVPoint, Distance
curvature = PrincipalCurvature(Surface=shell_2, Point=srf_cp.UVPoint)  # -> Frame, Min, Max, MinDirection, MaxDirection
curvature_2 = SurfaceCurvature(Surface=shell_2, Point=srf_cp.UVPoint)  # -> Frame, Gaussian, Mean
evalsrf = EvaluateSurface(Surface=shell_2, Point=srf_cp.UVPoint)  # -> Point, Normal, UDirection, VDirection, Frame
pt = Point(srf_cp.Point)
pt_2 = Point(srf_cp.Point)
_10º = PowerOf10(Value=int_2)
num = Number(curvature.Max)
vdis = VectorDisplay(Anchor=pt, Vector=curvature.MinDirection)
vdis_2 = VectorDisplay(Anchor=pt, Vector=curvature.MaxDirection)
multiplication = Multiplication(A=_10º, B=num)
line = LineSDL(Start=pt_2, Direction=evalsrf.Normal, Length=multiplication)

# ==== cluster WIPVisualizeSurfCurvature
number_slider = Slider(15, range=1..40)
srf = ClusterInput()
srf_2 = Surface(srf)
sdivide = DivideSurface(Surface=srf_2, UCount=number_slider, VCount=number_slider)  # -> Points, Normals, Parameters
curvature = PrincipalCurvature(Surface=srf_2, Point=sdivide.Parameters)  # -> Frame, Min, Max, MinDirection, MaxDirection
evalsrf = EvaluateSurface(Surface=srf_2, Point=sdivide.Parameters)  # -> Point, Normal, UDirection, VDirection, Frame
curvature_2 = SurfaceCurvature(Surface=srf_2, Point=sdivide.Parameters)  # -> Frame, Gaussian, Mean
num = Number(curvature_2.Mean)
_10º = PowerOf10(Value=Slider(0, range=0..10))
multiplication = Multiplication(A=_10º, B=num)
line = LineSDL(Start=evalsrf.Point, Direction=evalsrf.Normal, Length=multiplication)
panel = Panel(num)

# ==== cluster WIPCurvatureAtCableIntersections
crv = ClusterInput()
crv_2 = Curve(crv)
bang = ExplodeTree(Data=crv_2)  # -> Branch0, Branch1
edge_cables = Curve(bang.Branch1)
corner_cables = Curve(bang.Branch0)
number_slider = Slider(100, range=0..100)
ccx = CurveCurve(CurveA=corner_cables, CurveB=simplify(graft(edge_cables)))  # -> Points, ParamsA, ParamsB
ccx_2 = CurveCurve(CurveA=simplify(graft(corner_cables)), CurveB=edge_cables)  # -> Points, ParamsA, ParamsB
trim = TrimTree(Tree=ccx.ParamsB, Depth=1)
trim_2 = TrimTree(Tree=ccx_2.ParamsA, Depth=1)
mycrvgraph = MyCrvGraph(crv=edge_cables, density=Slider(30, range=0..100), scale=Slider(2, range=0..10))  # -> pt_2, vec_forces_2
curvature = Curvature(Curve=graft(corner_cables), Parameter=trim_2)  # -> P, K, C
curvature_2 = Curvature(Curve=graft(edge_cables), Parameter=trim)  # -> P, K, C
crvgraph = CurvatureGraph(Curve=corner_cables, Density=5, Scale=Slider(101, range=0..1000))
crvgraph_2 = CurvatureGraph(Curve=edge_cables, Density=5, Scale=Slider(100, range=0..100))
mycrvgraph_2 = MyCrvGraph(crv=corner_cables, density=Slider(30, range=0..100), scale=Slider(2, range=0..10))  # -> pt_2, vec_forces_2
multiplication = Multiplication(A=Slider(2, range=0..100), B=curvature.K)
vdis = VectorDisplay(Anchor=curvature_2.P, Vector=curvature_2.K)
vdis_2 = VectorDisplay(Anchor=curvature.P, Vector=multiplication)

# ==== cluster CurveClosestMeshVert
number_slider = Slider(8, range=0..100)
tol = ClusterInput()
curve = ClusterInput()
mesh = ClusterInput()
mesh_2 = Mesh(mesh)
number_slider_2 = Slider(0.01, range=0..0.01)
tol_2 = Number(tol)
curve_2 = Curve(curve)
branch = TreeBranch(Tree=mesh_2, Path=number_slider, MaintainPaths=True)
branch_2 = TreeBranch(Tree=curve_2, Path=number_slider, MaintainPaths=True)
deconstruct_mesh = DeconstructMesh(Mesh=mesh_2)  # -> Vertices, Faces, Colours, Normals
pipe = Pipe(Curve=curve_2, Radius=tol_2, Caps=0)  # -> simplify(Pipe); disabled
crv_cp = CurveClosestPoint(Point=deconstruct_mesh.Vertices, Curve=graft(curve_2))  # -> Point, Parameter, Distance
smaller = SmallerThan(FirstNumber=crv_cp.Distance, SecondNumber=tol_2)  # -> SmallerThan, OrEqualTo
cap = CapHoles(Brep=pipe)  # disabled
brepinc = PointInBrep(Brep=cap, Point=deconstruct_mesh.Vertices, Strict=False)  # disabled
dispatch = Dispatch(List=crv_cp.Point, DispatchPattern=smaller.SmallerThan)  # -> ListA, ListB
dispatch_2 = Dispatch(List=deconstruct_mesh.Vertices, DispatchPattern=brepinc)  # -> ListA, ListB; disabled
pt = Point(dispatch.ListA)
pt_2 = Point(dispatch_2.ListA)  # disabled
sort_along_curve = SortAlongCurve(Points=pt, Curve=graft(curve_2))  # -> simplify(Points), Indices
cullpt = CullDuplicates(Points=sort_along_curve.Points, Tolerance=tol_2, CullMode=3)  # -> Points, Indices, Valence
polyline = PolyLine(Vertices=cullpt.Points, Closed=False)
polyline_2 = ClusterOutput(polyline)

# ==== cluster BoxFit
box = ClusterInput()
box_2 = Box(box)
dim_1 = ClusterInput()
dim_2 = ClusterInput()
dim_1_2 = Number(dim_1)
dim_2_2 = Number(dim_2)
boxsize = BoxSize(box=box_2)  # -> X_2, Y_2, Z_2, A_2, V_2
smaller = SmallerThan(FirstNumber=boxsize.X_2, SecondNumber=dim_1_2)  # -> SmallerThan, OrEqualTo
smaller_2 = SmallerThan(FirstNumber=boxsize.Y_2, SecondNumber=dim_2_2)  # -> SmallerThan, OrEqualTo
smaller_3 = SmallerThan(FirstNumber=boxsize.X_2, SecondNumber=dim_2_2)  # -> SmallerThan, OrEqualTo
smaller_4 = SmallerThan(FirstNumber=boxsize.Y_2, SecondNumber=dim_1_2)  # -> SmallerThan, OrEqualTo
and = GateAnd(A=smaller.OrEqualTo, B=smaller_2.OrEqualTo)
and_2 = GateAnd(A=smaller_3.OrEqualTo, B=smaller_4.OrEqualTo)
or = GateOr(A=and, B=and_2)
toggle = BooleanToggle(True)
dispatch = Dispatch(List=box_2, DispatchPattern=or)  # -> ListA, ListB
clean = CleanTree(RemoveNulls=True, RemoveInvalid=True, RemoveEmpty=toggle, Tree=dispatch.ListB)
clean_2 = CleanTree(RemoveNulls=True, RemoveInvalid=True, RemoveEmpty=toggle, Tree=dispatch.ListA)
fit = Box(clean_2)
unfit = Box(clean)
unfit_2 = ClusterOutput(unfit)
fit_2 = ClusterOutput(fit)

# ==== cluster BoxDim
B = ClusterInput()
edges = BrepEdges(Brep=B)  # -> Naked, Interior, NonManifold
split = SplitList(List=edges.Naked, Index=Slider(2, range=0..10))  # -> ListA, ListB
S = ClusterInput()
end = EndPoints(Curve=split.ListA)  # -> Start, End
neg = Negative(Value=Slider(0.593, range=0..1))
aligndim = AlignedDimension(Plane=PlaneXY(0, 0, 0), PointA=end.Start, PointB=end.End, Offset=neg, Text="{0:0.00}", Size=S)

# ==== cluster RotatingCaliper
crv = ClusterInput()
pi = Pi(Factor=1)
crv_2 = Curve(crv)
range = Range(Domain=pi, Steps=Slider(100, range=0..100))
xy = XYPlane(Origin=Point(0, 0, 0))
prot = RotatePlane(Plane=xy, Angle=range)
bbox = BoundingBox(Content=graft(crv_2), Plane=prot)  # -> Box, Box_2
trim = TrimTree(Tree=simplify(bbox.Box), Depth=1)
geo = Geometry(simplify(trim))
area = Area(Geometry=geo)  # -> Area, Centroid
sort = SortList(Keys=area.Area, ValuesA=geo)  # -> Keys, ValuesA
item = ListItem(List=sort.ValuesA, Index=0, Wrap=True)
area_2 = Area(Geometry=item)  # -> Area, Centroid
box = Box(item)
area_3 = Number(area_2.Area)
box_2 = ClusterOutput(box)
area_4 = ClusterOutput(area_3)

# ==== cluster AlternativeMesh
shell = ClusterInput()

# ---- group: better mesh?
shell_2 = Surface(shell)
edges = BrepEdges(Brep=shell_2)  # -> Naked, Interior, NonManifold
crv = Curve(edges.Naked)
popgeo = PopulateGeometry(Geometry=shell_2, Count=Slider(1000, range=0..1000), Seed=1)
divide = DivideCurve(Curve=crv, Count=10, Kinks=False)  # -> Points, Tangents, Parameters
merge = Merge(Data1=popgeo, Data2=divide.Points)  # -> flatten(Result)
mesh_breps = MeshBrepsKaramba3D(
    Brep=shell_2,
    InclusionPoints=merge,
    MeshResolution=Slider(0.2, range=0..1),
    EdgeRefinementFactor=0.67,
    PointReduction=False,
    SmoothingStepSize=Slider(1, range=0..1),
    SmoothingIterations=Slider(7, range=0..10))  # -> Mesh, Info

# ==== cluster GeodesicCables
cables = ClusterInput()
srf = ClusterInput()

# ---- group: geodesics a better curve?
cables_2 = Curve(cables)  # disabled
srf_2 = Surface(srf)  # disabled
crv = Curve(simplify(graft(cables_2)))  # disabled
end = EndPoints(Curve=crv)  # -> Start, End; disabled
Z = UnitZ(Factor=1)  # disabled
project = ProjectPoint(Point=end.End, Direction=Z, Geometry=srf_2)  # -> Point, Index; disabled
project_2 = ProjectPoint(Point=end.Start, Direction=Z, Geometry=srf_2)  # -> Point, Index; disabled
geodesic = Geodesic(Surface=srf_2, Start=end.End, End=end.Start)  # disabled
geodesic_2 = Geodesic(Surface=srf_2, Start=project_2.Point, End=project.Point)  # disabled

number_slider = Slider(18, range=0..100)  # disabled
crv_2 = Curve(geodesic)  # disabled
range = Range(Domain=crv_2, Steps=number_slider)  # disabled
eval = EvaluateCurve(Curve=graft(crv_2), Parameter=range)  # -> Point, Tangent, Angle; disabled
number_slider_2 = Slider(100, range=0..100)  # disabled
number_slider_3 = Slider(0.64, range=0..10)  # disabled
number_slider_4 = Slider(15, range=0..100)  # disabled
pline = PolyLine(Vertices=eval.Point, Closed=False)  # -> flatten(Polyline); disabled
mycrvgraph = MyCrvGraph(crv=crv_2, density=number_slider, scale=number_slider_3)  # -> pt_2, vec_forces_2; disabled
pt_forces_polys = PTForcesPolys(pt_force=number_slider_4, cables=pline)  # -> pt_intersection_nodes_3, vec_pt_force_4, vec_end_force_2; disabled

# ==== cluster KarambaSegmentedShell
thickness_m = ClusterInput()
segment_breps = ClusterInput()
corner_polys = ClusterInput()
mesh = ClusterInput()
shell = ClusterInput()
thickness_m_2 = Number(thickness_m)
segment_breps_2 = Surface(segment_breps)
corner_polys_2 = Curve(corner_polys)
mesh_2 = Mesh(mesh)
shell_2 = Surface(shell)
corner_polys_3 = Curve(corner_polys_2)
mesh_3 = Mesh(flatten(mesh_2))

panel = Panel("main direction")
_10º = PowerOf10(Value=Slider(10, range=0..10))
multiplication = Multiplication(A=Slider(1, range=1..10), B=_10º)

_10º_2 = PowerOf10(Value=Slider(10, range=0..10))
multiplication_2 = Multiplication(A=Slider(1, range=1..10), B=_10º_2)

midpt = CurveMiddle(Curve=corner_polys_3)
explode = Explode(Curve=corner_polys_3, Recursive=True)  # -> Segments, Vertices
len = Length(Curve=explode.Segments)
mesh_4 = Mesh(mesh_3)
panel_3 = Panel(len)
_10º_3 = PowerOf10(Value=Slider(10, range=0..10))
_10º_4 = PowerOf10(Value=Slider(0, range=0..10))
_10º_5 = PowerOf10(Value=Slider(10, range=0..10))
_10º_6 = PowerOf10(Value=Slider(10, range=0..10))
_10º_7 = PowerOf10(Value=Slider(10, range=0..10))
segment_meshes = Mesh(mesh_2)
_10º_8 = PowerOf10(Value=Slider(10, range=0..10))
_10º_9 = PowerOf10(Value=Slider(10, range=0..10))
_10º_10 = PowerOf10(Value=Slider(10, range=0..10))
_10º_11 = PowerOf10(Value=Slider(0, range=0..10))
_10º_12 = PowerOf10(Value=Slider(0, range=0..10))
_10º_13 = PowerOf10(Value=Slider(0, range=0..10))
_10º_14 = PowerOf10(Value=Slider(10, range=0..10))
_10º_15 = PowerOf10(Value=Slider(10, range=0..10))
_10º_16 = PowerOf10(Value=Slider(10, range=0..10))
matselect = MaterialSelectionKaramba3D(menu=[dropdown(3), dropdown(1)])
segment_breps_3 = Surface(segment_breps_2)
list = ValueList({"STEEL": 1, "WOOD": 2, "GFRP": 3, "ETFE (Membrane)": 4, "CONCRETE": 5, "ALUMINIUM": 6}, selected="CONCRETE")
area = MeshArea(Mesh=mesh_4)  # -> Area, Centroid
shell_3 = Surface(shell_2)
multiplication_3 = Multiplication(A=Slider(1, range=0..1), B=_10º_5)
multiplication_4 = Multiplication(A=Slider(1, range=0..1), B=_10º_3)
multiplication_5 = Multiplication(A=Slider(1, range=0..1), B=_10º_6)
multiplication_6 = Multiplication(A=Slider(1, range=1..10), B=_10º_4)
multiplication_7 = Multiplication(A=Slider(1, range=0..1), B=_10º_9)
multiplication_8 = Multiplication(A=Slider(1, range=0..1), B=_10º_7)
multiplication_9 = Multiplication(A=Slider(1, range=0..1), B=_10º_10)
multiplication_10 = Multiplication(A=Slider(10, range=1..10), B=_10º_8)
multiplication_11 = Multiplication(A=Slider(1, range=0..1), B=_10º_12)
multiplication_12 = Multiplication(A=Slider(1, range=0..1), B=_10º_11)
multiplication_13 = Multiplication(A=Slider(1, range=0..1), B=_10º_13)
multiplication_14 = Multiplication(A=Slider(1, range=0..1), B=_10º_15)
multiplication_15 = Multiplication(A=Slider(1, range=0..1), B=_10º_14)
multiplication_16 = Multiplication(A=Slider(1, range=0..1), B=_10º_16)
Z = UnitZ(Factor=Slider(4, range=0..10))
panel_4 = Panel("find corner segments")
cp = ClosestPoint(Point=midpt, Cloud=area.Centroid)  # -> ClosestPoint, CPIndex, Distance
disassemble = DisassembleMaterialKaramba3D(Material=matselect)  # -> Material, TypeOfMaterial, FamilyNameOfMaterial, NameOfMaterial, ElemIdentifiers, Color, YoungsModulusKNCm2Dir12, InPlaneShearModulus_kN_cm2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
vec = VectorXYZ(XComponent=multiplication_3, YComponent=multiplication_5, ZComponent=multiplication_4)  # -> Vector, Length
# spring setup
vec_2 = VectorXYZ(XComponent=multiplication_6, YComponent=multiplication_6, ZComponent=multiplication_6)  # -> Vector, Length
rev = Reverse(Vector=Z)
vec_3 = VectorXYZ(XComponent=multiplication_7, YComponent=multiplication_9, ZComponent=multiplication_8)  # -> Vector, Length
# spring setup
vec_4 = VectorXYZ(XComponent=multiplication_10, YComponent=multiplication_10, ZComponent=multiplication_10)  # -> Vector, Length
vec_5 = VectorXYZ(XComponent=multiplication_12, YComponent=multiplication_12, ZComponent=multiplication_12)  # -> Vector, Length
matdef = MaterialDefaults(Type=list, IsNmm2=False, IskNcm2=False, IskNm2=True, mUnit=1)  # -> Material, YoungsModulus, AlphaT, Nue, Density, Strength
vec_6 = VectorXYZ(XComponent=multiplication_15, YComponent=multiplication_15, ZComponent=multiplication_15)  # -> Vector, Length
vec_7 = VectorXYZ(XComponent=multiplication_11, YComponent=multiplication, ZComponent=multiplication_13)  # -> Vector, Length
thickness_m_3 = Number(thickness_m_2)
vec_8 = VectorXYZ(XComponent=multiplication_14, YComponent=multiplication_2, ZComponent=multiplication_16)  # -> Vector, Length
segment_interfaces = SegmentInterfaces(shell=shell_3, srf=segment_breps_3, mesh=segment_meshes)  # -> springs_3, corner_springs_2, meshes_2, points_2
item = ListItem(List=mesh_4, Index=cp.CPIndex, Wrap=True)
demesh = DeconstructMesh(Mesh=item)  # -> Vertices, Faces, Colours, Normals
lng = ListLength(List=cp.CPIndex)
cp_2 = ClosestPoint(Point=explode.Vertices, Cloud=demesh.Vertices)  # -> simplify(ClosestPoint), CPIndex, Distance
mjoin = MeshJoin(Meshes=flatten(segment_meshes))
loads = LoadsKaramba3D(Vector=rev, mode="Gravity")
matselect_2 = MaterialSelectionKaramba3D(menu=[dropdown(3), dropdown(1)])
division = Division(A=matdef.YoungsModulus, B="1e4")
division_2 = Division(A=matdef.Strength, B="1e4")
multiplication_17 = Multiplication(A=thickness_m_3, B="100")
series = Series(Start=0, Step=1, Count=lng)
panel_5 = Panel("0,0,0")
bottompoints = BottomPoints(mesh=mjoin, ltol=Slider(2, range=0..10))
path = ConstructPath(Indices=graft(series))  # -> flatten(Branch)
merge = Merge(Data1=segment_interfaces.springs_3, Data2=segment_interfaces.corner_springs_2, Data3=segment_interfaces.meshes_2)  # -> flatten(Result)
cross_section = CrossSectionKaramba3D(
    FamilyNameOfCrossSection="DefaultCroSec",
    Material=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,
    Height_cm=multiplication_17,
    mode="Shell - Const")
matprops = MaterialPropertiesKaramba3D(
    FamilyOfMaterial=disassemble.FamilyNameOfMaterial,
    Name="kiwi3d",
    YoungsModulus_kN_cm2=division,
    InPlaneShearModulus_kN_cm2=disassemble.InPlaneShearModulus_kN_cm2,
    TransverseShearModulus_kN_cm2=disassemble.TransverseShearModulusKNCm2Dir12,
    SpecificWeight_kN_m3=disassemble.SpecificWeight_kN_m3,
    CoefficientOfThermalExpansion_1_C=disassemble.CoefficientOfThermalExpansion1CDir12,
    YieldStrength_kN_cm2=division_2,
    mode="Isotrop")
cross_section_2 = CrossSectionKaramba3D(
    FamilyNameOfCrossSection="DefaultCroSec",
    ElementIdentifier="corner spring",
    CTranslation_kN_m=vec_2.Vector,
    CRotation_kNm_rad=vec_5.Vector,
    mode="Spring")
cross_section_3 = CrossSectionKaramba3D(
    FamilyNameOfCrossSection="DefaultCroSec",
    ElementIdentifier="spring",
    CTranslation_kN_m=vec_4.Vector,
    CRotation_kNm_rad=vec_8.Vector,
    mode="Spring")
panel_7 = Panel(path)
supp = SupportKaramba3D(PosInd=flatten(bottompoints), menu=[buttons(on, on, on, on, on, on)])
replace = ReplacePaths(Data=simplify(cp_2.ClosestPoint), Search=path, Replace=cp.CPIndex)
merge_2 = Merge(Data1=cross_section, Data2=cross_section_3, Data3=cross_section_2)
assemble = AssembleModelKaramba3D(
    Point=segment_interfaces.points_2,
    Elem=merge,
    Support=supp,
    Load=loads,
    CrossSection=merge_2,
    Material=matselect_2,
    LimitDistance_m=0.005)  # -> Model, Info, Mass_kg, CenterOfGravity
replace_2 = ReplacePaths(Data=simplify(graft(item)), Search=path, Replace=cp.CPIndex)
bottompoints_2 = BottomPoints(mesh=item, ltol=Slider(2, range=0..10))
analyze = AnalyzeKaramba3D(Model=assemble.Model)  # -> CalculatedModel, MaximumDisplacement_cm, ResultingForceOfGravity_kN, ElasticEnergy_kNm
emodes = EigenModesKaramba3D(Model=assemble.Model, FromIndex=1, NumberOfModes=1, MaximumNumberOfIterations=300, Epsilon=1e-07)  # -> ModelWithEigenModesAsLoadCaseResults, Eigenvalues
thickness_m_4 = Number(thickness_m_2)
modelview = ModelViewKaramba3D(Model=analyze.CalculatedModel, ResultFactors=1, ResultCase=-1)  # -> Model, DeformedMesh, DeformedAxes, DeformedModel
number_slider = Slider(1, range=0..10)
Z_2 = UnitZ(Factor=Slider(4, range=0..10))
rev_2 = Reverse(Vector=Z_2)
multiplication_18 = Multiplication(A=thickness_m_4, B="100")
supp_2 = SupportKaramba3D(PosInd=flatten(replace), menu=[buttons(on, on, on, on, on, on)])
shellview = ShellViewKaramba3D(Model=modelview.Model, IndexOfLayer=0)  # -> Model, MeshesOfRenderedShells, LegendColors, LegendTags
cross_section_4 = CrossSectionKaramba3D(
    FamilyNameOfCrossSection="DefaultCroSec",
    Material=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,
    Height_cm=multiplication_18,
    mode="Shell - Const")
loads_2 = LoadsKaramba3D(Vector=rev_2, mode="Gravity")
meshtoshell = MeshToShellKaramba3D(Mesh=mesh_4, LimitDistance_m=0.005)  # -> Element, Points, Info
model = ModelKaramba3D(modelview.Model)
mesh_5 = Mesh(modelview.DeformedMesh)
assemble_2 = AssembleModelKaramba3D(
    Elem=meshtoshell.Element,
    Support=supp_2,
    Load=loads_2,
    CrossSection=cross_section_4,
    Material=matprops,
    LimitDistance_m=0.005)  # -> Model, Info, Mass_kg, CenterOfGravity
legend = Legend(Colour=shellview.LegendColors, Tags=shellview.LegendTags, LegendType=1)
analyze_2 = AnalyzeKaramba3D(Model=assemble_2.Model)  # -> CalculatedModel, MaximumDisplacement_cm, ResultingForceOfGravity_kN, ElasticEnergy_kNm
modelview_2 = ModelViewKaramba3D(Model=analyze_2.CalculatedModel, ResultFactors=1, ResultCase=-1)  # -> Model, DeformedMesh, DeformedAxes, DeformedModel
medges = MeshEdges(Mesh=modelview_2.DeformedMesh)  # -> NakedEdges, InteriorEdges, NonManifoldEdges
shellview_2 = ShellViewKaramba3D(Model=modelview_2.Model, IndexOfLayer=0)  # -> Model, MeshesOfRenderedShells, LegendColors, LegendTags
join = JoinCurves(Curves=medges.NakedEdges, Preserve=False)
legend_2 = Legend(Colour=shellview_2.LegendColors, Tags=shellview_2.LegendTags, LegendType=1)

# ==== cluster SegmentFeasibility2x24x1
srf = ClusterInput()
panel = Panel("""0
2
3
4""")
srf_2 = Surface(srf)
item = ListItem(List=srf_2, Index=panel, Wrap=True)
crv = Curve(srf_2)
rotating_caliper = RotatingCaliper(crv=crv)  # -> box_2, area_4
segments = Curve(simplify(graft(crv)))
boundary = BoundarySurfaces(Edges=segments)

# ---- group: sort segments per pinbed configuration
box = Box(simplify(rotating_caliper.box_2))
number_slider = Slider(0.354, range=0..1)
boxfit = BoxFit(box=box, dim_1="2", dim_2="2")  # -> fit_2, unfit_2
boxfit_2 = BoxFit(box=boxfit.unfit_2, dim_1="4", dim_2="1")  # -> fit_2, unfit_2
box_2x2s = Box(boxfit.fit_2)
box_4x1s = Box(boxfit_2.fit_2)
unfeasible = Box(boxfit_2.unfit_2)
tstat = TreeStatistics(Tree=box_2x2s)  # -> Paths, Length, Count
ahsl = SplitAHSL(Colour=ColourSwatch(SwatchColor=RGB(65, 156, 0)))  # -> Alpha, Hue, Saturation, Luminance
tstat_2 = TreeStatistics(Tree=box_4x1s)  # -> Paths, Length, Count
ahsl_2 = SplitAHSL(Colour=ColourSwatch(SwatchColor=RGB(255, 183, 0)))  # -> Alpha, Hue, Saturation, Luminance
ahsl_3 = SplitAHSL(Colour=ColourSwatch(SwatchColor=RGB(255, 69, 69)))  # -> Alpha, Hue, Saturation, Luminance
tstat_3 = TreeStatistics(Tree=unfeasible)  # -> Paths, Length, Count
branch = TreeBranch(Tree=simplify(boundary), Path=tstat.Paths, MaintainPaths=True)
hsl = ColourHSL(Alpha=number_slider, Hue=ahsl.Hue, Saturation=ahsl.Saturation, Luminance=ahsl.Luminance)
branch_2 = TreeBranch(Tree=simplify(boundary), Path=tstat_2.Paths, MaintainPaths=True)
branch_3 = TreeBranch(Tree=simplify(boundary), Path=tstat_3.Paths, MaintainPaths=True)
hsl_2 = ColourHSL(Alpha=number_slider, Hue=ahsl_2.Hue, Saturation=ahsl_2.Saturation, Luminance=ahsl_2.Luminance)
hsl_3 = ColourHSL(Alpha=number_slider, Hue=ahsl_3.Hue, Saturation=ahsl_3.Saturation, Luminance=ahsl_3.Luminance)
preview = CustomPreview(Geometry=branch, Material=hsl)
preview_2 = CustomPreview(Geometry=branch_3, Material=hsl_3)
preview_3 = CustomPreview(Geometry=branch_2, Material=hsl_2)
boxdim = BoxDim(B=unfeasible, S=1)

# ==== cluster SegmentFeasibility3x1
srf = ClusterInput()
panel = Panel("""0
2
3
4""")
srf_2 = Surface(srf)
item = ListItem(List=srf_2, Index=panel, Wrap=True)
crv = Curve(srf_2)
rotating_caliper = RotatingCaliper(crv=crv)  # -> box_2, area_4
segments = Curve(simplify(graft(crv)))
boundary = BoundarySurfaces(Edges=segments)

# ---- group: sort segments per pinbed configuration
box = Box(simplify(rotating_caliper.box_2))
number_slider = Slider(0.354, range=0..1)
boxfit = BoxFit(box=box, dim_1="3", dim_2="1")  # -> fit_2, unfit_2
box_2x2s = Box(boxfit.fit_2)
unfeasible = Box(boxfit.unfit_2)
tstat = TreeStatistics(Tree=box_2x2s)  # -> Paths, Length, Count
ahsl = SplitAHSL(Colour=ColourSwatch(SwatchColor=RGB(65, 156, 0)))  # -> Alpha, Hue, Saturation, Luminance
ahsl_2 = SplitAHSL(Colour=ColourSwatch(SwatchColor=RGB(255, 69, 69)))  # -> Alpha, Hue, Saturation, Luminance
tstat_2 = TreeStatistics(Tree=unfeasible)  # -> Paths, Length, Count
number_slider_2 = Slider(0.089, range=0..1)
branch = TreeBranch(Tree=simplify(boundary), Path=tstat.Paths, MaintainPaths=True)
hsl = ColourHSL(Alpha=number_slider, Hue=ahsl.Hue, Saturation=ahsl.Saturation, Luminance=ahsl.Luminance)
branch_2 = TreeBranch(Tree=simplify(boundary), Path=tstat_2.Paths, MaintainPaths=True)
hsl_2 = ColourHSL(Alpha=number_slider, Hue=ahsl_2.Hue, Saturation=ahsl_2.Saturation, Luminance=ahsl_2.Luminance)
preview = CustomPreview(Geometry=branch, Material=hsl)
preview_2 = CustomPreview(Geometry=branch_2, Material=hsl_2)
boxdim = BoxDim(B=unfeasible, S=number_slider_2)

# ----
boxdim_2 = BoxDim(B=box_2x2s, S=number_slider_2)

# ==== cluster MeshWithCables
formfound_cables = ClusterInput()
path = ClusterInput()
mesh_res = ClusterInput()
srf = ClusterInput()
number_slider = Slider(0.1, range=0..0.1)

# ---- group: split segments with cables
formfound_cables_2 = Curve(formfound_cables)
path_2 = DataPath(path)
number_slider_2 = Slider(25, range=0..25)
mesh_res_2 = Number(mesh_res)
path_mapper = PathMapper(formfound_cables_2, source="{a}", target="{a-1}")
srf_2 = Surface(srf)
item = TreeItem(Tree=graft(path_mapper), Path=path_2, Index=0, Wrap=True)

# ---- group: number tree items
area = Area(Geometry=srf_2)  # -> Area, Centroid
tstat = TreeStatistics(Tree=area.Centroid)  # -> simplify(graft(Paths)), Length, Count
tag = TextTag(Location=area.Centroid, Text=tstat.Paths)

# ----
ext = ExtendCurve(Curve=item, Type=Slider(1, range=0..10), Start=number_slider, End=number_slider)
branch = TreeBranch(Tree=simplify(item), Path=number_slider_2, MaintainPaths=True)
branch_2 = TreeBranch(Tree=simplify(srf_2), Path=number_slider_2, MaintainPaths=True)

# ---- group: experiment with c# trees
c_script = CSharpScript(surfaceTree=srf_2, curveTree=item)  # -> out, A; inputs surfaceTree: tree of Brep, curveTree: tree of Curve, tFactor: Double
# ---------- c_script: C# ----------
    DataTree<Brep> splitSurfacesTree = new DataTree<Brep>();
    double tol = RhinoDocument.ModelAbsoluteTolerance;

    foreach (GH_Path path in surfaceTree.Paths)
      //assuming trees match
    {

      List<Brep> surfaces = surfaceTree.Branch(path);
      List<Curve> curves = curveTree.Branch(path);
      List<Brep> splitSurfaces = new List<Brep>();

      foreach (Brep surface in surfaces)
      {
        Brep[] splitParts = surface.Split(curves, tol * tFactor);
        foreach (Brep splitPart in splitParts)
          splitSurfaces.Add(splitPart);
      }

      splitSurfacesTree.AddRange(splitSurfaces, path);

    }
    A = splitSurfacesTree;
    //Brep[] splitSurface = S.Split(C, RhinoDocument.ModelAbsoluteTolerance);
    //A = splitSurface;
# ---------- end c_script ----------

# ---- group: split segments with cables (continued)
srfsplit = SurfaceSplit(Surface=srf_2, Curves=ext)
mesh_breps = MeshBrepsKaramba3D(
    Brep=srfsplit,
    MeshResolution=mesh_res_2,
    EdgeRefinementFactor=Slider(0.67, range=0..1),
    PointReduction=False,
    SmoothingStepSize=0,
    SmoothingIterations=5)  # -> Mesh, Info
branch_3 = TreeBranch(Tree=simplify(mesh_breps.Mesh), Path=number_slider_2, MaintainPaths=True)

# ----
mjoin = MeshJoin(Meshes=mesh_breps.Mesh)  # -> simplify(Mesh)

# ---- group: split segments with cables (continued)
branch_4 = TreeBranch(Tree=simplify(mjoin), Path=Slider(4, range=0..14), MaintainPaths=True)

# ----
weldvertices = MeshWeldVertices(Mesh=mjoin, Tolerance=0.01)  # -> RuntimeMessage, Mesh
unifynormals = MeshUnifyNormals(Mesh=weldvertices.Mesh)
mesh = Mesh(unifynormals)
mjoin_2 = MeshJoin(Meshes=flatten(mesh))
mesh_2 = ClusterOutput(mesh)
medges = MeshEdges(Mesh=mesh)  # -> NakedEdges, InteriorEdges, NonManifoldEdges
crv = Curve(medges.NakedEdges)

# ==== cluster RotatingCaliper_2
pi = Pi(Factor=1)
geo = ClusterInput()
range = Range(Domain=pi, Steps=Slider(100, range=0..100))
xy = XYPlane(Origin=Point(0, 0, 0))
geo_2 = Geometry(geo)
prot = RotatePlane(Plane=xy, Angle=range)
bbox = BoundingBox(Content=graft(geo_2), Plane=prot)  # -> Box, Box_2
trim = TrimTree(Tree=simplify(bbox.Box), Depth=1)
geo_3 = Geometry(simplify(trim))
area = Area(Geometry=geo_3)  # -> Area, Centroid
sort = SortList(Keys=area.Area, ValuesA=geo_3)  # -> Keys, ValuesA
item = ListItem(List=sort.ValuesA, Index=0, Wrap=True)
area_2 = Area(Geometry=item)  # -> Area, Centroid
box = Box(item)
area_3 = Number(area_2.Area)
box_2 = ClusterOutput(box)
area_4 = ClusterOutput(area_3)

# ==== cluster DivInt
crv = ClusterInput()
num = ClusterInput()

# ---- group: divide curve integer
crv_2 = Curve(crv)
len = Length(Curve=crv_2)
num_2 = Number(num)
division = Division(A=len, B=num_2)
round = Round(Number=division)  # -> Nearest, Floor, Ceiling
divide = DivideCurve(Curve=crv_2, Count=round.Ceiling, Kinks=False)  # -> simplify(Points), Tangents, Parameters

# ----
P = ClusterOutput(divide.Points)

# ==== cluster DivideRect
rec = ClusterInput()
divv = ClusterInput()
divu = ClusterInput()
rec_2 = Rectangle(rec)
divv_2 = Integer(divv)
divu_2 = Integer(divu)
drec = DeconstuctRectangle(Rectangle=rec_2)  # -> BasePlane, XInterval, YInterval
dom² = ConstructDomain²(DomainU=drec.XInterval, DomainV=drec.YInterval)
divide = DivideDomain²(Domain=dom², UCount=divu_2, VCount=divv_2)
dedom2 = DeconstructDomain²(Domain=divide)  # -> UComponent, VComponent
graft = GraftTree(Tree=drec.BasePlane, IncludeEmptyLists=True, IncludeNullItems=True)
rectangle = Rectangle(Plane=graft, XSize=dedom2.UComponent, YSize=dedom2.VComponent, Radius=0)  # -> Rectangle, Length
rec_3 = Rectangle(rectangle.Rectangle)
rec_4 = ClusterOutput(rec_3)

# ==== cluster BoxDims
box = ClusterInput()
box_2 = Box(box)
debox = DeconstructBox(Box=box_2)  # -> Plane, X, Y, Z
dedomain = DeconstructDomain(Domain=debox.X)  # -> Start, End
dedomain_2 = DeconstructDomain(Domain=debox.Y)  # -> Start, End
dedomain_3 = DeconstructDomain(Domain=debox.Z)  # -> Start, End
subtraction = Subtraction(A=dedomain.End, B=dedomain.Start)
subtraction_2 = Subtraction(A=dedomain_2.End, B=dedomain_2.Start)
subtraction_3 = Subtraction(A=dedomain_3.End, B=dedomain_3.Start)
dx = Number(subtraction)
dy = Number(subtraction_2)
dz = Number(subtraction_3)
dx_2 = ClusterOutput(dx)
dy_2 = ClusterOutput(dy)
dz_2 = ClusterOutput(dz)

# ==== cluster MeshFromCurves
T = ClusterInput()
clean = CleanTree(RemoveNulls=True, RemoveInvalid=True, RemoveEmpty=False, Tree=T)
len = Length(Curve=clean)
sort = SortList(Keys=len)  # -> Keys, ValuesA
item = ListItem(List=sort.Keys, Index=Slider(31, range=0..100), Wrap=True)
explode = Explode(Curve=clean, Recursive=True)  # -> Segments, Vertices
division = Division(A=len, B=item)
end = EndPoints(Curve=flatten(explode.Segments))  # -> Start, End
int = Integer(division)
divide = DivideCurve(Curve=clean, Count=int, Kinks=False)  # -> flatten(Points), Tangents, Parameters
merge = Merge(Data1=end.Start, Data2=end.End)
duppt = RemoveDuplicatePts(Points=merge, Tolerance=0.01)
bbox = BoundingBox(Content=duppt, Plane=PlaneXY(0, 0, 0), UnionBox=True)  # -> Box, Box_2
box = EvaluateBox(Box=bbox.Box, UParameter=0.5, VParameter=0.5, WParameter="1")  # -> Plane, Point, Include
merge_2 = Merge(Data1=duppt, Data2=box.Point)
del = DelaunayMesh(Points=merge_2, Plane=PlaneXY(0, 0, 0))
quad = Quadrangulate(Mesh=del, Angle=0.03490658504, Ratio=Slider(0.926, range=0..1))  # -> Mesh, Count
M = ClusterOutput(del)

# ==== cluster BoxSize
box = ClusterInput()
box_2 = Box(box)
debox = DeconstructBox(Box=box_2)  # -> Plane, X, Y, Z
dedomain = DeconstructDomain(Domain=debox.X)  # -> Start, End
dedomain_2 = DeconstructDomain(Domain=debox.Y)  # -> Start, End
dedomain_3 = DeconstructDomain(Domain=debox.Z)  # -> Start, End
subtraction = Subtraction(A=dedomain_2.End, B=dedomain_2.Start)
subtraction_2 = Subtraction(A=dedomain.End, B=dedomain.Start)
subtraction_3 = Subtraction(A=dedomain_3.End, B=dedomain_3.Start)
Y = Number(subtraction)
X = Number(subtraction_2)
Z = Number(subtraction_3)
multiplication = Multiplication(A=X, B=Y)
multiplication_2 = Multiplication(A=multiplication, B=Z)
V = Number(multiplication_2)
A = Number(multiplication)
Y_2 = ClusterOutput(Y)
X_2 = ClusterOutput(X)
Z_2 = ClusterOutput(Z)
V_2 = ClusterOutput(V)
A_2 = ClusterOutput(A)

# ==== cluster SegmentInterfaces
mesh = ClusterInput()
shell = ClusterInput()
srf = ClusterInput()
mesh_2 = Mesh(mesh)
shell_2 = Surface(shell)
srf_2 = Surface(srf)

# ---- group: segment numbering
geo = Geometry(flatten(mesh_2))
tstat = TreeStatistics(Tree=simplify(graft(geo)))  # -> Paths, Length, Count
dpath = DeconstructPath(Branch=tstat.Paths)  # -> flatten(Indices)
area = Area(Geometry=geo)  # -> Area, Centroid
tag = TextTag(Location=area.Centroid, Text=dpath)

# ---- group: determine internal edges
join = BrepJoin(Breps=flatten(srf_2))  # -> Breps, Closed
debrep = DeconstructBrep(Brep=join.Breps)  # -> Faces, Edges, Vertices
topology = BrepTopology(Brep=join.Breps, PerspectiveOnly=False)  # -> FaceFaceAdjacency, FaceEdgeAdjacency, simplify(EdgeFaceAdjacency)
lng = ListLength(List=topology.EdgeFaceAdjacency)
larger = LargerThan(FirstNumber=lng, SecondNumber="2")  # -> LargerThan, OrEqualTo
dispatch = Dispatch(List=topology.EdgeFaceAdjacency, DispatchPattern=larger.OrEqualTo)  # -> ListA, ListB
clean = CleanTree(RemoveNulls=True, RemoveInvalid=True, RemoveEmpty=Toggle(True), Tree=dispatch.ListA)
tstat_2 = TreeStatistics(Tree=clean)  # -> Paths, Length, Count
dpath_2 = DeconstructPath(Branch=tstat_2.Paths)
item = ListItem(List=debrep.Edges, Index=flatten(dpath_2), Wrap=True)
match = MatchTree(Tree=graft(item), Guide=clean)

# ---- group: segment numbering
geo_2 = Geometry(debrep.Faces)
tstat_3 = TreeStatistics(Tree=simplify(graft(geo_2)))  # -> Paths, Length, Count
dpath_3 = DeconstructPath(Branch=tstat_3.Paths)  # -> flatten(Indices)
area_2 = Area(Geometry=geo_2)  # -> Area, Centroid
tag_2 = TextTag(Location=area_2.Centroid, Text=dpath_3)

# ---- group: mesh vertices on curves
item_2 = ListItem(List=flatten(mesh_2), Index=clean, Wrap=True)
crv = Curve(match)
demesh = DeconstructMesh(Mesh=item_2)  # -> Vertices, Faces, Colours, Normals
trim = TrimTree(Tree=demesh.Vertices, Depth=1)
rdpoints = RemoveDuplicatePointsKaramba3D(Point=trim, LimitDistance=0.005)  # -> OutPoint, Info, Indexes
pull = PullPoint(Point=rdpoints.OutPoint, Geometry=crv, ClosestOnly=True)  # -> ClosestPoint, Distance
smaller = SmallerThan(FirstNumber=pull.Distance, SecondNumber="1e-4")  # -> SmallerThan, OrEqualTo
cull = CullPattern(List=pull.ClosestPoint, CullPattern=smaller.SmallerThan)  # -> simplify(List)
alongcrv = SortAlongCurve(Points=cull, Curve=crv)  # -> simplify(Points), Indices

# ----
pt = Point(alongcrv.Points)
panel = Panel("""0
-1""")
cull_i = CullIndex(List=pt, Indices=panel, Wrap=True)
item_3 = ListItem(List=pt, Index=panel, Wrap=True)
merge = Merge(Data1=pt, Data2=pt)
ln = Line(StartPoint=pt, EndPoint=pt)
mesh_3 = Mesh(flatten(mesh_2))
pt_2 = Point(flatten(merge))
linetobeam = LineToBeamKaramba(Line=ln, Identifier="spring", Points=merge, New=True, Remove=True, LimitDistance_m=0.005)  # -> simplify(Element), Points, Info

# ---- group: setting spring orientation
# Z is normal to surface
# X is tangent to surface, perp to edge
# 
# try using curve tangent directly, and using X as mian direction instead of Y in Cross Section SPring Ct/Cr
srf_3 = Surface(shell_2)
crv_2 = Curve(match)
pt_3 = Point(alongcrv.Points)
srf_cp = SurfaceClosestPoint(Point=pt_3, Surface=srf_3)  # -> Point, UVPoint, Distance
crv_cp = CurveClosestPoint(Point=pt_3, Curve=crv_2)  # -> Point, Parameter, Distance
eval = EvaluateCurve(Curve=crv_2, Parameter=crv_cp.Parameter)  # -> Point, Tangent, Angle
evalsrf = EvaluateSurface(Surface=srf_3, Point=srf_cp.UVPoint)  # -> Point, Normal, UDirection, VDirection, Frame
xprod = CrossProduct(VectorA=evalsrf.Normal, VectorB=eval.Tangent, Unitize=False)  # -> Vector, Length
vdis = VectorDisplay(Anchor=evalsrf.Point, Vector=evalsrf.Normal)
vdis_2 = VectorDisplay(Anchor=eval.Point, Vector=xprod.Vector)
vdis_3 = VectorDisplay(Anchor=eval.Point, Vector=eval.Tangent)
vec = Vector(evalsrf.Normal)
vec_2 = Vector(xprod.Vector)
modifyelem = ModifyElementKaramba3D(Beam=linetobeam.Element, XOrientation=vec_2, ZOrientation=vec, mode="Beam")

# ----
meshtoshell = MeshToShellKaramba3D(Mesh=mesh_3, Points=pt_2, LimitDistance_m=0.005)  # -> Element, Points, Info
springs = ElementKaramba3D(modifyelem)
panel_2 = Panel("""0
-1""")
cull_i_2 = CullIndex(List=springs, Indices=panel_2, Wrap=True)  # -> simplify(List)
item_4 = ListItem(List=springs, Index=panel_2, Wrap=True)
modifyelem_2 = ModifyElementKaramba3D(Beam=item_4, BeamIdentifierIndex="corner spring", mode="Beam")
flatten = FlattenTree(Tree=modifyelem_2, Path="{0}")
flatten_2 = FlattenTree(Tree=cull_i_2, Path="{0}")
corner_springs = ElementKaramba3D(flatten)
springs_2 = ElementKaramba3D(flatten_2)
points = Point(meshtoshell.Points)
meshes = ElementKaramba3D(meshtoshell.Element)
springs_3 = ClusterOutput(springs_2)
corner_springs_2 = ClusterOutput(corner_springs)
meshes_2 = ClusterOutput(meshes)
points_2 = ClusterOutput(points)
