# Grasshopper definition SHELLS_ACORN_master.gh (Grasshopper 1.0.7)
# plug-ins: Kiwi3d

number_slider = Slider(0.25, range=0..1)
concrete_weight_kn_m3 = Slider(24, range=0..100)
merge = Merge(Data1=Slider(8, range=5..10), Data2=Slider(0.8, range=0..1), Data3=Slider(0.06, range=0.02..0.12))
item = ListItem(List=merge, Index=0, Wrap=True)  # -> Item, Item1, Item2
concrete_weight_kn_m3_2 = Number(concrete_weight_kn_m3)
thickness_m = Number(item.Item2)
span_m = Number(item.Item)
height_m = Number(item.Item1)
division = Division(A=Slider(6, range=0..10), B=2)
division_2 = Division(A=span_m, B=2)
neg = Negative(Value=division)
neg_2 = Negative(Value=division_2)
pt = Point([Point(0, 0, 0), Point(8, 0, 0), Point(6, 6, 0), Point(0, 6, 0)])
pt_2 = Point([Point(-2.65739868, 2.586695785, 0), Point(2.522828173, 2.363083722, 0), Point(4.069487342, -3.772482641, 0), Point(-1.375177545, -2.361354304, 0)])
dom = ConstructDomain(DomainStart=neg, DomainEnd=division)
dom_2 = ConstructDomain(DomainStart=neg_2, DomainEnd=division_2)
vec = VectorXYZ(XComponent="-4", YComponent="-4", ZComponent=0)  # -> Vector, Length
pline = PolyLine(Vertices=pt, Closed=True)
rectangle = Rectangle(Plane=PlaneXY(0, 0, 0), XSize=dom_2, YSize=dom, Radius=0)  # -> Rectangle, Length
polygon = Polygon(Plane=PlaneXY(0, 0, 0), Radius=3, Segments=Slider(5, range=3..6), FilletRadius=0)  # -> Polygon, Length
flip = FlipCurve(Curve=pline)  # -> Curve, Flag
move = Move(Geometry=pline, Motion=vec.Vector)  # -> Geometry, Transform
regular_quad = Curve(rectangle.Rectangle)
regular_polygon = Curve(polygon.Polygon)
irregular_quad = Curve(move.Geometry)

# ---- group: normalize shape
target_area = Number(Slider(36, range=0..100))
main_shape = Curve(regular_polygon)
area = Area(Geometry=main_shape)  # -> Area, Centroid
division_3 = Division(A=target_area, B=area.Area)
sqrt = SquareRoot(Value=division_3)
scale = Scale(Geometry=main_shape, Center=Point(0, 0, 0), Factor=sqrt)  # -> Geometry, Transform

# ----
image = ImageSampler(Filter="Colour", Interpolate=False, Umax=1, Umin=0, Vmax=1, Vmin=0, Wrap=1)
number_slider_2 = Slider(6, range=0..10)

# ---- group: normalize shape / just because of squares
pi = Pi(Factor=".25")
rotate = Rotate(Geometry=scale.Geometry, Angle=pi, Plane=PlaneXY(0, 0, 0))  # -> Geometry, Transform

# ----
division_4 = Division(A=Slider(7.8, range=0..10), B=2)
division_5 = Division(A=Slider(7.2, range=0..10), B=2)
neg_3 = Negative(Value=division_4)
neg_4 = Negative(Value=division_5)
dom_3 = ConstructDomain(DomainStart=neg_3, DomainEnd=division_4)
dom_4 = ConstructDomain(DomainStart=neg_4, DomainEnd=division_5)
corner_width = Number(Slider(0.2, range=0..1))
rectangle_2 = Rectangle(Plane=PlaneXY(0, 0, 0), XSize=dom_3, YSize=dom_4, Radius=0)  # -> Rectangle, Length
regular_quad_2 = Curve(rectangle_2.Rectangle)
make_plan = MakePlan(normalized_shape=regular_quad_2, corner_width=corner_width)  # -> whole_shape_2, corners_2, edges_3
plan = Curve(make_plan.whole_shape_2)

plan_2 = Curve(plan)
explode = Explode(Curve=plan_2, Recursive=True)  # -> Segments, Vertices
culln = CullNth(List=reverse(explode.Segments), CullFrequency=2)
culln_2 = CullNth(List=explode.Segments, CullFrequency=2)
edges = Curve(culln)
corners = Curve(culln_2)

# ----
# internalised from Analysis so I don't have to run it everytime I open the doc
data = Data("Grasshopper.Kernel.Types.GH_ObjectWrapper")
height_m_2 = Number(height_m)

# ---- group: Kiwi simple (UNCLUSTERABLE)
corners_2 = Curve(corners)
srf = Surface(plan)
srf_2 = Surface(srf)
number_slider_3 = Slider(10, range=0..10)
list = ValueList({"STEEL": 1, "WOOD": 2, "GFRP": 3, "ETFE (Membrane)": 4, "CONCRETE": 5, "ALUMINIUM": 6}, selected="CONCRETE")
untrim = Untrim(Surface=srf_2)
list_2 = ValueList({"DEAD": 1, "SNOW": 2, "PRES": 3, "PRES_FL": 4}, selected="DEAD")
srfref = SurfaceRefinement(
    PDeg=3,
    QDeg=3,
    MinElementsU=number_slider_3,
    MinElementsV=number_slider_3,
    IsKnotApproxElementSize=False,
    IsKnotSubdivision=True)
matdef = MaterialDefaults(Type=list, IsNmm2=False, IskNcm2=False, IskNm2=True, mUnit=1)  # -> Material, YoungsModulus, AlphaT, Nue, Density, Strength
Z = UnitZ(Factor=1)
shell = ShellElement(Brep=srf_2, Material=matdef.Material, Thickness=0.1, Refinement=srfref, HingeCoupling=False)
supcrv = SupportCurve(Crv=corners_2, DispX=True, DispY=True, DispZ=True, Rot=Toggle(False))
srfload = SurfaceLoad(Brep=srf_2, Loadtype=list_2, Direction=Z, Value=Slider(100, range=0..500), LoadCase=1)
list_3 = ValueList({"Displacements": 1, "Stresses": 2, "SupportForces": 3}, selected=["Displacements", "Stresses", "SupportForces"])
lina = LinearAnalysis(Name="MyAnalysis", OutputSetting=list_3)
amodel = AnalysisModel(
    Analysis=lina,
    StructuralElements=shell,
    Supports=supcrv,
    Loads=srfload,
    IntersectionTolerance=0.001,
    IsCarat=True,
    IsKratos=False,
    PenaltyFac=10000000,
    ShowCouplingIDs=False,
    ShowEdgeIDs=False,
    ShowGeo=True,
    ShowPatchIDs=True,
    ShowPrePro=True,
    ShowRef=False)
run_analysis = IGASolver(AnalysisModel=amodel, Run=Button(), antiFreeze=False, showWindow=True)  # -> ResultModel, ErrorReport
defmod = DeformedModel(Model=run_analysis.ResultModel, ScaleFactor=Slider(0.395, range=0..30), FlyingNodeLimit=100000)  # -> Model, Geo, DeformedStructuralElements
kiwi_model = Data(defmod.Model)
shell_2 = Surface(defmod.Geo)

# ----
bbox = BoundingBox(Content=shell_2, Plane=PlaneXY(0, 0, 0))  # -> Box, Box_2
boxsize = BoxSize(box=bbox.Box)  # -> X_2, Y_2, Z_2, A_2, V_2
division_6 = Division(A=height_m_2, B=boxsize.Z_2)
panel = Panel(division_6)
panel_2 = Panel(boxsize.Z_2)
cornerstone_width = Slider(1.5, range=0..2)
lor_7_8x7_2 = Surface(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)
keystone_width = Slider(2, range=0..2)
_6x6 = Surface(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)
list_4 = ValueList({"Split to edge": 0, "Split to corner": 1}, selected="Split to edge")

# ----
# SEGMENTATION
shell_3 = Brep(lor_7_8x7_2)
thickness_m_2 = Number(thickness_m)
prelim_analysis = PrelimAnalysis(shell=shell_3, thickness_m=thickness_m_2)
get_stress_lines = GetStressLines(
    shell=shell_3,
    k3d_model=prelim_analysis,
    pour_width=Slider(1.5, range=0..3),
    pour_length=Slider(2.7, range=0..3),
    keystone_width=keystone_width,
    cornerstone_width=cornerstone_width)  # -> split_lines_4, cable_lines_4
max_r = Slider(0.26, range=0..1)
genes_for_r = GenePool(
    Decimals=3,
    Maximum=1,
    Minimum=0,
    Value=[0.728, 0.278, 0.433, 0.626, 0.372, 0.386, 0.577, 0.602, 0.355, 0.402, 0.734, 0.343, 0.433, 0.4, 0.584, 0.602, 0.546, 0.339, 0.419, 0.149, 0.301, 0.008, 0.324, 0.386])
genes_for_phi = GenePool(
    Decimals=3,
    Maximum=2,
    Minimum=0,
    Value=[0.427, 1.627, 0.784, 0.976, 1.468, 0.46, 1.011, 0.388, 0.825, 1.223, 1.146, 1.007, 0.773, 1.539, 1.505, 0.869, 0.424, 1.086, 1.514, 0.679, 1.331, 1.248, 1.135, 0.331])
local_optimization = BooleanToggle(False)
get_projected_segments = GetProjectedSegments(
    shell=shell_3,
    stress_lines=get_stress_lines.split_lines_4,
    maximum_deviation=max_r,
    local_optimization=local_optimization,
    phi_values=genes_for_phi,
    rho_values=genes_for_r)
segment_subdivision_wip = SegmentSubdivisionWIP(shell=shell_3, model=prelim_analysis, proj_segments=get_projected_segments, split_direction=list_4)

crv = Curve(get_stress_lines.cable_lines_4)
crv_2 = Curve(get_stress_lines.split_lines_4)

# ---- group: # segments
geo = Geometry(get_projected_segments)
lng = ListLength(List=geo)
bbox_2 = BoundingBox(Content=geo, Plane=PlaneXY(0, 0, 0), UnionBox=True)  # -> Box, Box_2
volume = Volume(Geometry=bbox_2.Box)  # -> Volume, Centroid
tag = TextTag(Location=volume.Centroid, Text=lng)

# ----
shell_4 = Surface(shell_3)
split_shell = SplitShell(shell=shell_4, segments=get_projected_segments)  # -> simplify(sub_segments_2)
static_segmentations = StaticSegmentations()
cables = Curve(get_stress_lines.cable_lines_4)
output = DataOutput(
    segments=split_shell,
    cables=cables,
    Destination="C:\Users\ec977\Documents\GitHub\ACORN-shells\GH\ACORN-shells.ghdata",
    RelativePath="C:\Users\ec977\Documents\GitHub\ACORN-shells\GH\ACORN-shells.ghdata|ACORN-shells.ghdata")

# ----
# PINBED
# SIMULATION
# Calculate Modules
# slow due to
# Minimum Bounding Box
segments = Surface(split_shell)
calculate_modules = CalculateModules(segments=segments)  # -> modules_2, avr_efficiency
simulate_pinbed = SimulatePinbed(segments=segments, modules=calculate_modules.modules_2)
avr_efficiency = Number(calculate_modules.avr_efficiency)
panel_3 = Panel(calculate_modules.avr_efficiency)

galapagos = Galapagos(fitness=avr_efficiency, gene=[genes_for_r, genes_for_phi])

# ==== cluster BoxSize
box = ClusterInput()
box_2 = Box(box)
debox = DeconstructBox(Box=box_2)  # -> Plane, X, Y, Z
dedomain = DeconstructDomain(Domain=debox.X)  # -> Start, End
dedomain_2 = DeconstructDomain(Domain=debox.Y)  # -> Start, End
dedomain_3 = DeconstructDomain(Domain=debox.Z)  # -> Start, End
subtraction = Subtraction(A=dedomain_2.End, B=dedomain_2.Start)
subtraction_2 = Subtraction(A=dedomain.End, B=dedomain.Start)
subtraction_3 = Subtraction(A=dedomain_3.End, B=dedomain_3.Start)
Y = Number(subtraction)
X = Number(subtraction_2)
Z = Number(subtraction_3)
multiplication = Multiplication(A=X, B=Y)
multiplication_2 = Multiplication(A=multiplication, B=Z)
V = Number(multiplication_2)
A = Number(multiplication)
Y_2 = ClusterOutput(Y)
X_2 = ClusterOutput(X)
Z_2 = ClusterOutput(Z)
V_2 = ClusterOutput(V)
A_2 = ClusterOutput(A)

# ==== cluster MakePlan
# base shape
normalized_shape = ClusterInput()
corner_width = ClusterInput()
normalized_shape_2 = Geometry(normalized_shape)
explode = Explode(Curve=normalized_shape_2, Recursive=True)  # -> Segments, Vertices
corner_width_2 = Number(corner_width)
cull_i = CullIndex(List=explode.Vertices, Indices="0", Wrap=True)
pt = Point(cull_i)
neg = Negative(Value=corner_width_2)
dom = ConstructDomain(DomainStart=neg, DomainEnd=corner_width_2)
pline = PolyLine(Vertices=pt, Closed=Toggle(True))
rectangle = Rectangle(Plane=pt, XSize=dom, YSize=dom, Radius=0)  # -> Rectangle, Length
cir = Circle(Plane=pt, Radius=corner_width_2)
rdiff = RegionDifference(CurvesA=pline, CurvesB=cir)
explode_2 = Explode(Curve=rdiff, Recursive=True)  # -> Segments, Vertices
shift = ShiftList(List=explode_2.Segments, Shift=1, Wrap=True)
culln = CullNth(List=explode_2.Segments, CullFrequency=2)
culln_2 = CullNth(List=shift, CullFrequency=2)
crv = Curve(culln)
edges = Curve(culln_2)
len = Length(Curve=crv)
len_2 = Length(Curve=edges)
multiplication = Multiplication(A=len, B=Slider(0.05, range=0..0.05))
multiplication_2 = Multiplication(A=len_2, B=Slider(0.195, range=0..1))
neg_2 = Negative(Value=multiplication)
neg_3 = Negative(Value=multiplication_2)
ext = ExtendCurve(Curve=crv, Type=0, Start=neg_2, End=neg_2)
ext_2 = ExtendCurve(Curve=edges, Type=0, Start=neg_3, End=neg_3)
whole_shape = Curve(rdiff)
corners = Curve(crv)
edges_2 = Curve(edges)
whole_shape_2 = ClusterOutput(whole_shape)
corners_2 = ClusterOutput(corners)
edges_3 = ClusterOutput(edges_2)

# ==== cluster SimulatePinbed
segments = ClusterInput()
modules = ClusterInput()
modules_2 = Geometry(modules)
segments_2 = Geometry(segments)
item = ListItem(List=flatten(segments_2), Index=0, Wrap=True)
untrim = Untrim(Surface=item)
# Slow due to surface split
extend_segments = ExtendSegments(shell=untrim, modules=modules_2)
vmh = BooleanToggle(True)
ajust_module_heights = AjustModuleHeights(extended_segments=extend_segments, modules=modules_2, variable_module_height=vmh)

# ---- group: for viz
extended_segments = Surface(extend_segments)
segments_3 = Surface(segments_2)
modules_3 = Rectangle(ajust_module_heights)
merge = Merge(Data1=extended_segments, Data2=modules_3)
bbox = BoundingBox(Content=merge, Plane=modules_3, UnionBox=True)  # -> simplify(Box), Box_2
number_slider = Slider(6, range=0..10)
trim = TrimTree(Tree=extended_segments, Depth="2")
trim_2 = TrimTree(Tree=bbox.Box, Depth="2")
branch = TreeBranch(Tree=segments_3, Path=number_slider, MaintainPaths=True)
branch_2 = TreeBranch(Tree=trim, Path=number_slider, MaintainPaths=True)
branch_3 = TreeBranch(Tree=trim_2, Path=number_slider, MaintainPaths=True)
edges = BrepEdges(Brep=branch_3)  # -> Naked, Interior, NonManifold
edges_2 = BrepEdges(Brep=branch)  # -> Naked, Interior, NonManifold

# ----
calculate_pin_heights = CalculatePinHeights(extended_sub_segments=extend_segments, modules=ajust_module_heights)
visualise_pins = VisualisePins(crv=calculate_pin_heights)

# ==== cluster CalculateModules
segments = ClusterInput()
segments_2 = Surface(segments)
_3d_rotate = BooleanToggle(True)
fitbbox = FitBBox(segments=segments_2, _3d_rotate=_3d_rotate)
divide_segments = DivideSegments(bbs=fitbbox)
# OBSOLETE >>
# but it might be worth to color the modules according to configration, especially if unfeasable
calculate_efficiency = CalculateEfficiency(segments=segments_2, modules=divide_segments)
modules = Geometry(divide_segments)
modules_2 = ClusterOutput(modules)
segment_feasibility_2x2_4x1 = SegmentFeasibility2x24x1()  # disabled
avr_efficiency = ClusterOutput(calculate_efficiency)

# ==== cluster PrelimAnalysis
shell = ClusterInput()
thickness_m = ClusterInput()

# ---- group: preliminary analysis for segmentation
# IPts not working on trimmed surface
shell_2 = Brep(shell)
thickness_m_2 = Number(thickness_m)
number_slider = Slider(0.333, range=0..1)
list = ValueList({"STEEL": 1, "WOOD": 2, "GFRP": 3, "ETFE (Membrane)": 4, "CONCRETE": 5, "ALUMINIUM": 6}, selected="CONCRETE")
mesh_breps = MeshBrepsKaramba3D(
    Brep=shell_2,
    MeshResolution=Slider(0.095, range=0..1),
    EdgeRefinementFactor=0.67,
    PointReduction=Toggle(False),
    SmoothingStepSize=Slider(1, range=0..1),
    SmoothingIterations=Slider(1, range=0..10))  # -> Mesh, Info
matselect = MaterialSelectionKaramba3D(menu=[dropdown(3), dropdown(1)])
matdef = MaterialDefaults(Type=list, IsNmm2=False, IskNcm2=False, IskNm2=True, mUnit=1)  # -> Material, YoungsModulus, AlphaT, Nue, Density, Strength
mesh = Mesh(mesh_breps.Mesh)
disassemble = DisassembleMaterialKaramba3D(Material=matselect)  # -> Material, TypeOfMaterial, FamilyNameOfMaterial, NameOfMaterial, ElemIdentifiers, Color, YoungsModulusKNCm2Dir12, InPlaneShearModulus_kN_cm2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
division = Division(A=matdef.YoungsModulus, B="1e4")
division_2 = Division(A=matdef.Strength, B="1e4")
bottompoints = BottomPoints(mesh=mesh, ltol=Slider(2, range=0..10))
multiplication = Multiplication(A=thickness_m_2, B="100")
supp = SupportKaramba3D(PosInd=flatten(bottompoints), menu=[buttons(on, on, on, on, on, on)])
cross_section = CrossSectionKaramba3D(
    FamilyNameOfCrossSection="DefaultCroSec",
    Material=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,
    Height_cm=multiplication,
    mode="Shell - Const")
loads = LoadsKaramba3D(Vector=Vector(0, 0, -1), mode="Gravity")
matprops = MaterialPropertiesKaramba3D(
    FamilyOfMaterial=disassemble.FamilyNameOfMaterial,
    Name="kiwi3d",
    YoungsModulus_kN_cm2=division,
    InPlaneShearModulus_kN_cm2=disassemble.InPlaneShearModulus_kN_cm2,
    TransverseShearModulus_kN_cm2=disassemble.TransverseShearModulusKNCm2Dir12,
    SpecificWeight_kN_m3=disassemble.SpecificWeight_kN_m3,
    CoefficientOfThermalExpansion_1_C=disassemble.CoefficientOfThermalExpansion1CDir12,
    YieldStrength_kN_cm2=division_2,
    mode="Isotrop")

# ----
meshtoshell = MeshToShellKaramba3D(Mesh=mesh, LimitDistance_m=0.005)  # -> Element, Points, Info

# ---- group: preliminary analysis for segmentation (continued)
assemble = AssembleModelKaramba3D(Elem=meshtoshell.Element, Support=supp, Load=loads, CrossSection=cross_section, Material=matprops, LimitDistance_m=0.005)  # -> Model, Info, Mass_kg, CenterOfGravity
analyze = AnalyzeKaramba3D(Model=assemble.Model)  # -> CalculatedModel, MaximumDisplacement_cm, ResultingForceOfGravity_kN, ElasticEnergy_kNm
model = ModelKaramba3D(analyze.CalculatedModel)

# ----
model_2 = ClusterOutput(model)
modelview = ModelViewKaramba3D(Model=model, ResultFactors=1, ResultCase=-1)  # -> Model, DeformedMesh, DeformedAxes, DeformedModel
react = ReactionForcesKaramba3D(AnalyzedModel=modelview.Model)  # -> AnalyzedModel, ReactionForces_kN, ReactionMoments_kNm, SupportPosition, SumOfReactionForces_kN, SumOfReactionMoments_kNm
shellview = ShellViewKaramba3D(Model=modelview.Model, IndexOfLayer=0)  # -> Model, MeshesOfRenderedShells, LegendColors, LegendTags
panel = Panel(react.SumOfReactionForces_kN)
legend = Legend(Colour=shellview.LegendColors, Tags=shellview.LegendTags, LegendType=1)

# ==== cluster SegmentSubdivisionWIP
split_direction = ClusterInput()
proj_segments = ClusterInput()
shell = ClusterInput()
model = ClusterInput()
proj_segments_2 = Surface(proj_segments)
shell_2 = Surface(shell)
model_2 = ModelKaramba3D(model)
split_direction_2 = Integer(split_direction)

srf = Surface(proj_segments_2)
bbox = BoundingBox(Content=srf, Plane=PlaneXY(0, 0, 0), UnionBox=True)  # -> Box, Box_2
area = Area(Geometry=bbox.Box)  # -> Area, Centroid
box_corners = BoxCorners(Box=bbox.Box)  # -> CornerA, CornerB, CornerC, CornerD, CornerE, CornerF, CornerG, CornerH
panel = Panel("exclude keystone + cornerstones")
merge = Merge(Data1=box_corners.CornerA, Data2=box_corners.CornerB, Data3=box_corners.CornerC, Data4=box_corners.CornerD)
area_2 = Area(Geometry=srf)  # -> Area, Centroid
merge_2 = Merge(Data1=area.Centroid, Data2=merge)
cp = ClosestPoint(Point=merge_2, Cloud=area_2.Centroid)  # -> ClosestPoint, CPIndex, Distance
cull_i = CullIndex(List=srf, Indices=cp.CPIndex, Wrap=True)

item = ListItem(List=cull_i, Index=Slider(7, range=0..10), Wrap=True)
split_to_corner = Slider(0.646, range=0..1)  # disabled
split_to_edge = Slider(0.5, range=0..1)
num = Number(split_to_corner)
merge_3 = Merge(Data1="0", Data2=num, Data3="1")

# ----
# rebuild segment surfaces with appropriate UV space
srf_2 = Surface(simplify(graft(cull_i)))
crv = Curve(srf_2)
bbox_2 = BoundingBox(Content=flatten(crv), Plane=PlaneXY(0, 0, 0), UnionBox=True)  # -> Box, Box_2
area_3 = Area(Geometry=crv)  # -> Area, Centroid
volume = Volume(Geometry=bbox_2.Box)  # -> Volume, Centroid
vec2pt = Vector2Pt(PointA=area_3.Centroid, PointB=volume.Centroid, Unitize=False)  # -> Vector, Length
explode = Explode(Curve=crv, Recursive=True)  # -> simplify(Segments), Vertices
cull_i_2 = CullIndex(List=explode.Vertices, Indices="0", Wrap=True)
loft_opt = LoftOptions(Closed=False, Adjust=Toggle(True), Rebuild=0, Refit=0, Type=0)

# ---- group: to which support should each segment look at
# get support points
# (temporary, only works for rectangles)
# determine edge closest to support
srf_3 = Surface(srf_2)
bbox_3 = BoundingBox(Content=flatten(srf_3), Plane=PlaneXY(0, 0, 0), UnionBox=True)  # -> Box, Box_2
box_corners_2 = BoxCorners(Box=bbox_3.Box)  # -> CornerA, CornerB, CornerC, CornerD, CornerE, CornerF, CornerG, CornerH
merge_4 = Merge(Data1=box_corners_2.CornerA, Data2=box_corners_2.CornerB, Data3=box_corners_2.CornerC, Data4=box_corners_2.CornerD)
area_4 = Area(Geometry=srf_3)  # -> Area, Centroid
cp_2 = ClosestPoint(Point=area_4.Centroid, Cloud=merge_4)  # -> ClosestPoint, CPIndex, Distance

# ----
vec2pt_2 = Vector2Pt(PointA=area_3.Centroid, PointB=cp_2.ClosestPoint, Unitize=False)  # -> Vector, Length
pl = ConstructPlane(Origin=area_3.Centroid, XAxis=vec2pt_2.Vector, YAxis=vec2pt.Vector)
cir = Circle(Plane=pl, Radius="0.2")
alongcrv = SortAlongCurve(Points=cull_i_2, Curve=cir)  # -> Points, Indices
item_2 = ListItem(List=alongcrv.Points, Index=0, Wrap=True)  # -> Item, Item1, Item2, Item3
ln = Line(StartPoint=item_2.Item3, EndPoint=item_2.Item2)
ln_2 = Line(StartPoint=item_2.Item, EndPoint=item_2.Item1)
merge_5 = Merge(Data1=ln_2, Data2=ln)  # -> simplify(Result)
loft = Loft(Curves=merge_5, Options=loft_opt)

# ---- group: number points in closed polyline
pt = Point(simplify(alongcrv.Points))
pline = PolyLine(Vertices=pt, Closed="True")
area_5 = Area(Geometry=pline)  # -> Area, simplify(Centroid)
vec2pt_3 = Vector2Pt(PointA=pt, PointB=area_5.Centroid, Unitize="True")  # -> Vector, Length
lng = ListLength(List=pt)
multiplication = Multiplication(A=vec2pt_3.Vector, B=Slider(0.312, range=0..1))
move = Move(Geometry=pt, Motion=multiplication)  # -> Geometry, Transform
series = Series(Start=0, Step=1, Count=lng)
tag = TextTag(Location=move.Geometry, Text=series)

# ---- group: split using PSlines
md_slider = MDSlider(SliderMode=0, slider_value=Point(0.5, 0.5, 0.5), x_domain=Domain(0, 1), y_domain=Domain(0, 1), z_domain=Domain(0, 1))
srf_4 = Surface(loft)
evalsrf = EvaluateSurface(Surface=reparameterize(srf_4), Point=md_slider)  # -> Point, Normal, UDirection, VDirection, Frame
Z = UnitZ(Factor=1)
shell_3 = Surface(shell_2)
project = ProjectPoint(Point=evalsrf.Point, Direction=Z, Geometry=shell_3)  # -> Point, Index
model_3 = ModelKaramba3D(model_2)
shelllineresults = LineResultsOnShellsKaramba3D(
    AnalyzedModel=model_3,
    LayerPosition=Slider(0, range=-1..1),
    ListOfSourcesOfPrincipalStressLinesLinesPoints=project.Point,
    SegmentLength_m=0.5,
    DA_deg=5,
    mode="PrincStress")  # -> AnalyzedModel, Lines1, Lines2
crv_2 = Curve(shelllineresults.Lines2)
crv_3 = Curve(shelllineresults.Lines1)
trim = TrimTree(Tree=simplify(crv_3), Depth=1)
trim_2 = TrimTree(Tree=simplify(crv_2), Depth=1)
join = JoinCurves(Curves=trim, Preserve=False)
join_2 = JoinCurves(Curves=trim_2, Preserve=False)
project_2 = Project(Geometry=join, Plane=PlaneXY(0, 0, 0))  # -> simplify(Geometry), Transform
project_3 = Project(Geometry=join_2, Plane=PlaneXY(0, 0, 0))  # -> simplify(Geometry), Transform
split_direction_3 = Integer(split_direction_2)
merge_6 = Merge(Data1=project_2.Geometry, Data2=project_3.Geometry)
crv_4 = Curve(srf_4)
item_3 = ListItem(List=merge_6, Index=split_direction_3, Wrap=True)
ccx = CurveCurve(CurveA=crv_4, CurveB=item_3)  # -> Points, ParamsA, ParamsB
toggle = BooleanToggle(False)
pline_2 = PolyLine(Vertices=ccx.Points, Closed=False)
srfsplit = SurfaceSplit(Surface=srf_4, Curves=pline_2)

# ---- group: split to edge
srf_5 = Surface(loft)
divide = DivideDomain²(Domain=srf_5, UCount=Slider(1, range=1..2), VCount=Slider(2, range=1..2))
subsrf = Isotrim(Surface=srf_5, Domain=divide)

# ----
split_segments = Geometry(simplify(srfsplit))
split_segments_2 = ClusterOutput(split_segments)

# ---- group: split to both
num_2 = Number(split_to_edge)
srf_6 = Surface(loft)
merge_7 = Merge(Data1="0", Data2=num_2, Data3="1")
panel_2 = Panel("False")
consec = ConsecutiveDomains(Numbers=merge_7, Additive=panel_2)

# ----
consec_2 = ConsecutiveDomains(Numbers=merge_3, Additive=panel_2)
crossref = CrossReference(ListA=consec, ListB=consec_2, CrossMode=1)  # -> ListA, ListB

# ---- group: split to both (continued)
dom² = ConstructDomain²(DomainU=crossref.ListA, DomainV=crossref.ListB)
subsrf_2 = Isotrim(Surface=reparameterize(srf_6), Domain=dom²)

# ==== cluster GetStressLines
k3d_model = ClusterInput()
cornerstone_width = ClusterInput()
keystone_width = ClusterInput()
shell = ClusterInput()
pour_length = ClusterInput()
pour_width = ClusterInput()
k3d_model_2 = ModelKaramba3D(k3d_model)
shell_2 = Brep(shell)
edges = BrepEdges(Brep=shell_2)  # -> Naked, Interior, NonManifold
project = Project(Geometry=edges.Naked, Plane=PlaneXY(0, 0, 0))  # -> Geometry, Transform
keystone_width_2 = Number(keystone_width)
cornerstone_width_2 = Number(cornerstone_width)
join = JoinCurves(Curves=project.Geometry, Preserve=False)
pour_length_2 = Number(pour_length)
pour_width_2 = Number(pour_width)
surfce_plan = Curve(join)
crv = Curve(surfce_plan)
crv_2 = Curve(surfce_plan)
area = Area(Geometry=crv)  # -> Area, Centroid
explode = Explode(Curve=crv, Recursive=True)  # -> Segments, Vertices
area_2 = Area(Geometry=crv_2)  # -> Area, Centroid
explode_2 = Explode(Curve=crv_2, Recursive=True)  # -> Segments, Vertices
# using input shape, use geodesics on brep instead?
culln = CullNth(List=reverse(explode.Segments), CullFrequency=2)
# using input shape, use geodesics on brep instead?
culln_2 = CullNth(List=explode_2.Segments, CullFrequency=2)
keystone_width_3 = Number(keystone_width_2)
midpt = CurveMiddle(Curve=culln)
midpt_2 = CurveMiddle(Curve=culln_2)
ln = Line(StartPoint=area.Centroid, EndPoint=midpt)
cornerstone_width_3 = Number(cornerstone_width_2)
division = Division(A=keystone_width_3, B=2)
ln_2 = Line(StartPoint=area_2.Centroid, EndPoint=midpt_2)
sqrt = SquareRoot(Value=keystone_width_3)
neg = Negative(Value=division)
crv_3 = Curve(ln)
neg_2 = Negative(Value=cornerstone_width_3)
neg_3 = Negative(Value=sqrt)
crv_4 = Curve(ln_2)
pour_width_3 = Number(pour_width_2)
ext = ExtendCurve(Curve=crv_3, Type=0, Start=neg_3, End="0")
pour_length_3 = Number(pour_length_2)
ext_2 = ExtendCurve(Curve=crv_4, Type=0, Start=neg, End=neg_2)
divint = DivInt(crv=ext, num=pour_width_3)  # -> pts_2, midpts_2
divint_2 = DivInt(crv=ext_2, num=pour_length_3)  # -> pts_2, midpts_2
cull_i = CullIndex(List=reverse(divint.pts_2), Indices="0", Wrap=True)  # -> simplify(List)
cull_i_2 = CullIndex(List=divint_2.pts_2, Indices="0", Wrap=True)  # -> simplify(List)
shell_3 = Brep(shell_2)
entwine = Entwine(Branch0X=cull_i, Branch1X=divint.midpts_2, FlattenInputs=False)
Z = UnitZ(Factor=1)
entwine_2 = Entwine(Branch0X=cull_i_2, Branch1X=divint_2.midpts_2, FlattenInputs=False)
Z_2 = UnitZ(Factor=1)
project_2 = ProjectPoint(Point=entwine, Direction=Z, Geometry=shell_3)  # -> simplify(Point), Index
project_3 = ProjectPoint(Point=entwine_2, Direction=Z_2, Geometry=shell_3)  # -> simplify(Point), Index
number_slider = Slider(0, range=-1..1)
k3d_model_3 = ModelKaramba3D(k3d_model_2)
surface_plan = Curve(surfce_plan)
shelllineresults = LineResultsOnShellsKaramba3D(
    AnalyzedModel=k3d_model_3,
    LayerPosition=number_slider,
    ListOfSourcesOfPrincipalStressLinesLinesPoints=project_3.Point,
    SegmentLength_m=0.5,
    DA_deg=5,
    mode="PrincStress")  # -> AnalyzedModel, simplify(Lines1), Lines2
shelllineresults_2 = LineResultsOnShellsKaramba3D(
    AnalyzedModel=k3d_model_3,
    LayerPosition=number_slider,
    ListOfSourcesOfPrincipalStressLinesLinesPoints=project_2.Point,
    SegmentLength_m=0.5,
    DA_deg=5,
    mode="PrincStress")  # -> AnalyzedModel, Lines1, simplify(Lines2)
crv_5 = Curve(shelllineresults.Lines1)
crv_6 = Curve(shelllineresults_2.Lines2)
trim = TrimTree(Tree=simplify(crv_5), Depth=1)
trim_2 = TrimTree(Tree=simplify(crv_6), Depth=1)
crv_7 = Curve(surface_plan)
join_2 = JoinCurves(Curves=trim_2, Preserve=False)
join_3 = JoinCurves(Curves=trim, Preserve=False)
area_3 = Area(Geometry=crv_7)  # -> Area, Centroid
explode_3 = Explode(Curve=crv_7, Recursive=True)  # -> Segments, Vertices
split = SplitTree(Data=simplify(join_2), Masks=flatten("{0;*}"))  # -> Positive, Negative
split_2 = SplitTree(Data=simplify(join_3), Masks=flatten("{0;*}"))  # -> Positive, Negative
# using input shape, use geodesics on brep instead?
culln_3 = CullNth(List=reverse(explode_3.Segments), CullFrequency=2)
crv_8 = Curve(surface_plan)
project_4 = Project(Geometry=split.Positive, Plane=PlaneXY(0, 0, 0))  # -> Geometry, Transform
project_5 = Project(Geometry=split_2.Positive, Plane=PlaneXY(0, 0, 0))  # -> Geometry, Transform
explode_4 = Explode(Curve=crv_8, Recursive=True)  # -> Segments, Vertices
midpt_3 = CurveMiddle(Curve=culln_3)
split_lines = Curve(simplify(project_5.Geometry))
split_lines_2 = Curve(simplify(project_4.Geometry))
cable_lines = Curve(split_2.Negative)
cable_lines_2 = Curve(split.Negative)
culln_4 = CullNth(List=reverse(explode_4.Segments), CullFrequency=2)
ln_3 = Line(StartPoint=area_3.Centroid, EndPoint=midpt_3)
merge = Merge(Data1=culln_4, Data2=split_lines_2)
merge_2 = Merge(Data1=split_lines, Data2=ln_3)
entwine_3 = Entwine(Branch00=merge, Branch01=merge_2, FlattenInputs=True)  # -> simplify(Result)
entwine_4 = Entwine(Branch00=cable_lines_2, Branch01=cable_lines, FlattenInputs=True)  # -> simplify(Result)
cable_lines_3 = Curve(entwine_4)
split_lines_3 = Curve(entwine_3)
split_lines_4 = ClusterOutput(split_lines_3)
cable_lines_4 = ClusterOutput(cable_lines_3)

# ==== cluster GetProjectedSegments
maximum_deviation = ClusterInput()
local_optimization = ClusterInput()
stress_lines = ClusterInput()
rho_values = ClusterInput()
phi_values = ClusterInput()
shell = ClusterInput()
shell_2 = Brep(shell)
stress_lines_2 = Curve(stress_lines)
rho_values_2 = Number(rho_values)
maximum_deviation_2 = Number(maximum_deviation)
local_optimization_2 = Boolean(local_optimization)
phi_values_2 = Number(phi_values)
shell_3 = Brep(shell_2)
edges = BrepEdges(Brep=shell_3)  # -> Naked, Interior, NonManifold

# ---- group: [OBSOLETE] intersect and polygonize
bang = ExplodeTree(Data=stress_lines_2)  # -> Branch0, Branch1; disabled
edge_cables = Curve(bang.Branch1)  # disabled
corner_cables = Curve(bang.Branch0)  # disabled
ccx = CurveCurve(CurveA=simplify(graft(corner_cables)), CurveB=edge_cables)  # -> Points, ParamsA, ParamsB; disabled
ccx_2 = CurveCurve(CurveA=corner_cables, CurveB=simplify(graft(edge_cables)))  # -> Points, ParamsA, ParamsB; disabled
trim = TrimTree(Tree=ccx.Points, Depth=1)  # disabled
trim_2 = TrimTree(Tree=ccx_2.Points, Depth=1)  # disabled
alongcrv = SortAlongCurve(Points=trim, Curve=graft(corner_cables))  # -> Points, Indices; disabled
alongcrv_2 = SortAlongCurve(Points=trim_2, Curve=graft(edge_cables))  # -> Points, Indices; disabled
pline = PolyLine(Vertices=alongcrv.Points, Closed=False)  # disabled
pline_2 = PolyLine(Vertices=alongcrv_2.Points, Closed=False)  # disabled
merge = Merge(Data1=pline, Data2=pline_2)  # -> simplify(Result); disabled
trim_3 = TrimTree(Tree=merge, Depth=1)  # disabled
poly_cables = Curve(flatten(trim_3))  # disabled

# ----
project = Project(Geometry=edges.Naked, Plane=PlaneXY(0, 0, 0))  # -> Geometry, Transform
join = JoinCurves(Curves=project.Geometry, Preserve=False)
intersect_stress_lines = IntersectStressLines(stress_lines=stress_lines_2)
surface_plan = Curve(join)
jiggle_points = JigglePoints(
    intersection_points=intersect_stress_lines,
    maximum_deviation=maximum_deviation_2,
    phi_values=phi_values_2,
    rho_values=rho_values_2,
    curves_to_snap=surface_plan)
intersection_points = Point(intersect_stress_lines)
local_optimization_3 = Boolean(local_optimization_2)
jiggled_points = Point(jiggle_points)
filter = StreamFilter(Gate=local_optimization_3, Stream0=intersection_points, Stream1=jiggled_points)
make_segments = MakeSegments(stress_lines=stress_lines_2, intersection_points=filter, tolerance=maximum_deviation_2)
make_keystone = MakeKeystone(surface_plan=surface_plan, intersection_points=filter)
merge_2 = Merge(Data1=make_keystone, Data2=make_segments)  # -> flatten(Result)
brep = Brep(surface_plan)
srfsplit = SurfaceSplit(Surface=brep, Curves=merge_2)
straight_proj_segments = Surface(srfsplit)
straight_proj_segments_2 = ClusterOutput(straight_proj_segments)

# ==== cluster StaticSegmentations
manualopt02_1_4 = Curve([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])
manualopt01 = Curve([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])
xz = XZPlane(Origin=Point(0, 0, 0))
crv = Curve(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)
_6x6_segments = Surface([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])
lor_segments = Surface([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])
geo = Geometry(manualopt02_1_4)
mirror = Mirror(Geometry=geo, Plane=xz)  # -> Geometry, Transform
edges = BrepEdges(Brep=lor_segments)  # -> Naked, Interior, NonManifold
merge = Merge(Data1=geo, Data2=mirror.Geometry)
yz = YZPlane(Origin=Point(0, 0, 0))
join = JoinCurves(Curves=edges.Naked, Preserve=False)
mirror_2 = Mirror(Geometry=merge, Plane=yz)  # -> Geometry, Transform
merge_2 = Merge(Data1=merge, Data2=mirror_2.Geometry, Data3=crv)
boundary = BoundarySurfaces(Edges=merge_2)
segments = Surface(_6x6_segments)
segments_2 = ClusterOutput(segments)

# ==== cluster SplitShell
segments = ClusterInput()
shell = ClusterInput()
segments_2 = Geometry(segments)
shell_2 = Surface(shell)
project = Project(Curve=segments_2, Brep=shell_2, Direction=Vector(0, 0, 1))  # -> simplify(Curve)
bbox = BoundingBox(Content=project, Plane=PlaneXY(0, 0, 0))  # -> simplify(graft(Box)), Box_2
srfsplit = SurfaceSplit(Surface=shell_2, Curves=project)  # -> simplify(Fragments)

# ---- group: quick centroid
bbox_2 = BoundingBox(Content=srfsplit, Plane=PlaneXY(0, 0, 0))  # -> Box, Box_2
box = EvaluateBox(Box=bbox_2.Box, UParameter=0.5, VParameter=0.5, WParameter=0.5)  # -> Plane, Point, Include

# ----
area = Area(Geometry=bbox.Box)  # -> Area, Centroid
dist = Distance(PointA=box.Point, PointB=area.Centroid)
sort = SortList(Keys=dist, ValuesA=srfsplit)  # -> Keys, ValuesA
item = ListItem(List=sort.ValuesA, Index=0, Wrap=True)
sub_segments = Surface(item)
sub_segments_2 = ClusterOutput(sub_segments)

# ==== cluster VisualisePins
crv = ClusterInput()
crv_2 = Curve(crv)
trim = TrimTree(Tree=crv_2, Depth=Slider(3, range=0..10))
geo = Geometry(trim)
len = Length(Curve=geo)
max_pin_height = Number(".40")
larger = LargerThan(FirstNumber=len, SecondNumber=max_pin_height)  # -> LargerThan, OrEqualTo
dispatch = Dispatch(List=geo, DispatchPattern=larger.LargerThan)  # -> ListA, ListB
flatten = FlattenTree(Tree=geo, Path="{0}")
geo_2 = Geometry(dispatch.ListA)
geo_3 = Geometry(dispatch.ListB)
len_2 = Length(Curve=flatten)
entwine = Entwine(Branch00=geo_2, Branch01=geo_3, FlattenInputs=True)  # -> simplify(Result)
sort = SortList(Keys=len_2, ValuesA=flatten)  # -> Keys, ValuesA
number_slider = Slider(0.02, range=0..0.1)
item = ListItem(List=reverse(sort.Keys), Index=0, Wrap=True)
item_2 = ListItem(List=reverse(sort.ValuesA), Index=0, Wrap=True)
num = Number(number_slider)
longest_height_m = Number(item)
longest_traveller = Geometry(item_2)
neg = Negative(Value=num)
ext = ExtendCurve(Curve=entwine, Type=0, Start=num, End=neg)
bang = ExplodeTree(Data=ext)  # -> Branch0, Branch1
longest_height_m_2 = ClusterOutput(longest_height_m)
end = EndPoints(Curve=bang.Branch1)  # -> Start, End
end_2 = EndPoints(Curve=bang.Branch0)  # -> Start, End
pt = Point(end.End)
pt_2 = Point(end_2.End)
panel = Panel(longest_height_m)
pipe = Pipe(Curve=bang.Branch0, Radius=number_slider, Caps=2)  # disabled
pipe_2 = Pipe(Curve=bang.Branch1, Radius=number_slider, Caps=2)  # disabled
len_3 = Length(Curve=bang.Branch1)
entwine_2 = Entwine(Branch00=pt, Branch01=pipe_2, FlattenInputs=True)  # -> simplify(Result)
merge = Merge(Data2=pt_2, Data3=pipe)
gradient = Gradient(
    LowerLimit="0",
    UpperLimit=max_pin_height,
    Parameter=len_3,
    stops=[0: RGB(0, 98, 0), 0.25: RGB(81, 175, 17), 0.5: RGB(159, 198, 146), 0.746: RGB(170, 235, 41), 1: RGB(221, 255, 53)])
preview = CustomPreview(Geometry=merge, Material=ColourSwatch(SwatchColor=RGB(255, 0, 0)))
preview_2 = CustomPreview(Geometry=entwine_2, Material=gradient)

# ==== cluster CalculatePinHeights
extended_sub_segments = ClusterInput()
modules = ClusterInput()
number_slider = Slider(3, range=0..10)
extended_sub_segments_2 = Surface(extended_sub_segments)
modules_2 = Rectangle(modules)
dividerect = DivideRect(rec=modules_2, divu=number_slider, divv=number_slider)  # -> simplify(rec_4)
vec = Vector(modules_2)
area = Area(Geometry=dividerect)  # -> Area, Centroid
project = ProjectPoint(Point=area.Centroid, Direction=vec, Geometry=extended_sub_segments_2)  # -> Point, Index
merge = Merge(Data1=graft(area.Centroid), Data2=graft(project.Point))
pline = PolyLine(Vertices=merge, Closed=False)
pin_axes = Curve(pline)
pin_axes_2 = ClusterOutput(pin_axes)

# ==== cluster AjustModuleHeights
extended_segments = ClusterInput()
variable_module_height = ClusterInput()
modules = ClusterInput()
variable_module_height_2 = Boolean(simplify(variable_module_height))
extended_segments_2 = Surface(extended_segments)
modules_2 = Rectangle(modules)
pln = Plane(modules_2)
trim = TrimTree(Tree=pln, Depth="1")
trim_2 = TrimTree(Tree=extended_segments_2, Depth="2")
item = ListItem(List=trim, Index=0, Wrap=True)
bbox = BoundingBox(Content=trim_2, Plane=item)  # -> simplify(Box), Box_2
bbox_2 = BoundingBox(Content=trim_2, Plane=item, UnionBox=True)  # -> Box, Box_2
filter = StreamFilter(Gate=variable_module_height_2, Stream0=bbox_2.Box, Stream1=bbox.Box)  # -> simplify(Stream)
debox = DeconstructBox(Box=filter)  # -> Plane, X, Y, Z
lng = ListLength(List=bbox.Box_2)
deplane = DeconstructPlane(Plane=debox.Plane)  # -> Origin, XAxis, YAxis, ZAxis
dedomain = DeconstructDomain(Domain=debox.Z)  # -> Start, End
amp = Amplitude(Vector=deplane.ZAxis, Amplitude=dedomain.Start)
vec = Vector(amp)
repeat = RepeatData(Data=vec, Length=lng)
# in ROTATED mode, this only readjusts modules height to consider extended segments
# 
# ROTATED mode is so efficient, it might not really need independent heights
filter_2 = StreamFilter(Gate=variable_module_height_2, Stream0=repeat, Stream1=vec)
unflatten = UnflattenTree(Tree=filter_2, Guide=modules_2)
move = Move(Geometry=modules_2, Motion=unflatten)  # -> Geometry, Transform
adjusted_modules = Rectangle(graft(move.Geometry))
boundary = BoundarySurfaces(Edges=move.Geometry)
adjusted_modules_2 = ClusterOutput(adjusted_modules)

# ==== cluster ExtendSegments
modules = ClusterInput()
shell = ClusterInput()
modules_2 = Rectangle(modules)
shell_2 = Surface(shell)
project = Project(Curve=modules_2, Brep=shell_2, Direction=modules_2)
trim = TrimTree(Tree=project, Depth=1)
crossref = CrossReference(ListA=shell_2, ListB=trim, CrossMode=1)  # -> ListA, ListB
bbox = BoundingBox(Content=crossref.ListB, Plane=PlaneXY(0, 0, 0))  # -> simplify(graft(Box)), Box_2
srfsplit = SurfaceSplit(Surface=crossref.ListA, Curves=crossref.ListB)  # -> simplify(Fragments)

# ---- group: quick centroid
bbox_2 = BoundingBox(Content=srfsplit, Plane=PlaneXY(0, 0, 0))  # -> Box, Box_2
box = EvaluateBox(Box=bbox_2.Box_2, UParameter=0.5, VParameter=0.5, WParameter=0.5)  # -> Plane, simplify(Point), Include

# ----
area = Area(Geometry=bbox.Box)  # -> Area, Centroid
dist = Distance(PointA=box.Point, PointB=area.Centroid)
# segments are extended for
# covering whole pinbed module,
# for shape continuity
sort = SortList(Keys=dist, ValuesA=srfsplit)  # -> Keys, ValuesA
item = ListItem(List=sort.ValuesA, Index=0, Wrap=True)
extended_sub_segments = Surface(item)
extended_sub_segments_2 = ClusterOutput(extended_sub_segments)

# ==== cluster DivideSegments
bbs = ClusterInput()
bbs_2 = Box(simplify(bbs))

# ---- group: tolerance for input integer numbers
lot = Integer(Slider(10, range=0..10))
neg = Negative(Value=lot)
_10º = PowerOf10(Value=neg)

# ----
boxsize = BoxSize(box=bbs_2)  # -> X_2, Y_2, Z_2, A_2, V_2
subtraction = Subtraction(A=boxsize.Y_2, B=_10º)
subtraction_2 = Subtraction(A=boxsize.X_2, B=_10º)
pln = Plane(bbs_2)
round = Round(Number=subtraction_2)  # -> Nearest, Floor, Ceiling
round_2 = Round(Number=subtraction)  # -> Nearest, Floor, Ceiling
sqgrid = Square(Plane=pln, Size="1", ExtentX=round.Ceiling, ExtentY=round_2.Ceiling)  # -> Cells, Points
trim = TrimTree(Tree=sqgrid.Cells, Depth=Slider(1, range=0..1))  # -> simplify(Tree)
box = EvaluateBox(Box=bbs_2, UParameter=0.5, VParameter=0.5, WParameter="0")  # -> Plane, Point, Include
bbox = BoundingBox(Content=trim, Plane=pln, UnionBox=True)  # -> Box, Box_2
volume = Volume(Geometry=bbox.Box)  # -> Volume, Centroid
vec2pt = Vector2Pt(PointA=volume.Centroid, PointB=box.Point, Unitize=False)  # -> Vector, Length
modulesiny = Integer(round_2.Ceiling)
modulesinx = Integer(round.Ceiling)
move = Move(Geometry=trim, Motion=vec2pt.Vector)  # -> Geometry, Transform
modules = Rectangle(move.Geometry)
unflatten = UnflattenTree(Tree=move.Geometry, Guide=sqgrid.Cells)  # -> simplify(Tree)
modules_2 = Rectangle(unflatten)
modules_3 = ClusterOutput(modules_2)

# ==== cluster FitBBox
segments = ClusterInput()
_3d_rotate = ClusterInput()
segments_2 = Geometry(segments)
_3d_rotate_2 = Boolean(_3d_rotate)
gate = StreamGate(Stream=segments_2, Gate=_3d_rotate_2)  # -> Target0, Target1
segments_3 = Geometry(gate.Target0)
segments_4 = Geometry(gate.Target1)

# ----
# minimum bounding box IN 3D
# 
# https://discourse.mcneel.com/t/minimum-oriented-bounding-box-implementation-in-grasshopper-python-script-node/64344/61
rotations = Slider(300, range=1..360)
# downloaded algorithm is a black box!
# use something from compas or my own...
iterations = Slider(1, range=1..10)
minbb_c = CSharpScript(G=segments_4, D=rotations, I=iterations)  # -> out, MinBB; inputs G: GeometryBase, D: Int32, I: Int32
# ---------- minbb_c: C# ----------
    /* ==============================================*
    | Min Bounding Box Calculation                   |
    | Original Author Ilja Asanovic (Python)         |
    |                                                |
    | Parallel C# version, code refactored           |
    | RIL, R3                                        |
    ================================================= */

    RhinoApp.ClearCommandHistoryWindow();

    var version = "R6";
    Component.Message = "Parallel " + version;

    // --------------------------------------
    // INPUT
    // --------------------------------------
    var geo = (GeometryBase) G; // Geometry to align the bbox about
    m_rotations = D;            // Rotate Degrees. Default = 90º
    var iterations = I;

    // --------------------------------------
    // Modify the rotation step size to less than 1 (degree) if input
    // is greater than 180 rotation steps. This increases the number of
    // steps AND reduces the angle. Conversion from degrees to radians
    // is done in the respective functions since the angle is depending
    // on a integer loop-variable (i).
    // --------------------------------------
    m_rotation_factor = 1;
    if (m_rotations > 180)
    {
      // reduce whole degrees to a fraction of a degree
      m_rotation_factor = 180.0 / m_rotations;
      // increase the rotation steps needed to cover 180 degrees
      m_rotations = (int) (D / m_rotation_factor);
    }

    // --------------------------------------
    // Prepare initial plane
    // --------------------------------------
    // Start the rotation attempts from WorldXY plane, and then get to work
    var init_plane = Plane.WorldXY; // default
    System.Object obj = P;
    if (obj != null)
      init_plane = (Plane) obj; // custom user-defined start plane

    // --------------------------------------
    // Output
    // --------------------------------------
    var plane = init_plane;
    for (int i = 0; i < iterations; i++)
    {
      plane = RotateAllCombinationsOfPlane(geo, plane);
    }

    // --------------------------------------
    // Output
    // --------------------------------------
    var bb = Box.Unset; geo.GetBoundingBox(plane, out bb);
    MinBB = bb;
# ---------- minbb_c: C# additional code ----------
  private int m_rotations = 90; // default
  private double m_rotation_factor;
  const double TO_RADIANS = Math.PI / 180;

  private Plane RotateAllCombinationsOfPlane(GeometryBase geo, Plane initial_plane)
  {
    // --------------------------------------
    // Rotate about X axis of initial plane
    // --------------------------------------
    var rotation_axis = initial_plane.XAxis;
    var rotation = GetRotationAtMinimumVolume(geo, initial_plane, rotation_axis);
    var plane_x = initial_plane;
    plane_x.Rotate(rotation, rotation_axis);

    // --------------------------------------
    // Rotate about Y axis of rotated plane_x
    // --------------------------------------
    rotation_axis = plane_x.YAxis;
    rotation = GetRotationAtMinimumVolume(geo, plane_x, rotation_axis);
    var plane_y = plane_x;
    plane_y.Rotate(rotation, rotation_axis);

    // --------------------------------------
    // Rotate about Z axis of rotated plane_y
    // --------------------------------------
    rotation_axis = plane_y.ZAxis;
    rotation = GetRotationAtMinimumVolume(geo, plane_y, rotation_axis);
    var plane_z = plane_y;
    plane_z.Rotate(rotation, rotation_axis);

    // =====================================
    // Another round of rotations starting
    // from the 3 axes of the last plane_z
    // =====================================

    // --------------------------------------
    // Rotate about X axis of rotated plane_z
    // --------------------------------------
    rotation_axis = plane_z.XAxis;
    rotation = GetRotationAtMinimumVolume(geo, plane_z, rotation_axis);
    var plane_x_refined = plane_z;
    plane_x_refined.Rotate(rotation, rotation_axis);

    // --------------------------------------
    // Rotate about Y axis of refined plane_z
    // --------------------------------------
    rotation_axis = plane_x_refined.YAxis;
    rotation = GetRotationAtMinimumVolume(geo, plane_x_refined, rotation_axis);
    var plane_y_refined = plane_x_refined;
    plane_y_refined.Rotate(rotation, rotation_axis);

    // --------------------------------------
    // Rotate about Z axis of refined plane_y
    // --------------------------------------
    rotation_axis = plane_y_refined.ZAxis;
    rotation = GetRotationAtMinimumVolume(geo, plane_y_refined, rotation_axis);
    var plane_z_refined = plane_y_refined;
    plane_z_refined.Rotate(rotation, rotation_axis);
    
    return plane_z_refined; // the lastly rotated plane
  }

  /// <summary>
  /// Returns the rotation (in radians) of the smallest volume. The parallel loop
  /// performs m_rotations rotations of 1º each (90 rotations is default)
  /// </summary>
  private double GetRotationAtMinimumVolume(GeometryBase geo, Plane start_plane, Vector3d rotation_axis)
  {
    var rotated_volumes = new double[m_rotations];
    var rad_angle_factor = m_rotation_factor * TO_RADIANS; // calculate once
    
    // Let the .NET platform take care of spreading out the for-loop iterations
    // on  different threads. To avoid data races we use local block variables
    // inside the for-loop, and results are put into array slots, each result into
    // its own index in the array, which prevents "collisions" (meaning, different
    // threads overwriting each others values).
    System.Threading.Tasks.Parallel.For(0, m_rotations, i =>
    {
      // Make a fresh new rotation starting from the original plane on each try.
      // A local variable (_plane) is required here in order to "isolate" it from 
      // other threads operating simultaneously on other indexes (i), so they will 
      // have their own copy of _plane, and therefore we don't overwrite each other.
      // Take this as  a general rule for Parallel.For-blocks
      var _plane = start_plane;
      
      // The rad_angle_factor is converting the integer ("degrees") into radians AND
      // transforms it into a fraction of a degree if the input (D) is greater than 180
      _plane.Rotate(i * rad_angle_factor, rotation_axis);
      
      // Since each thread works with different indexes (i), and when done, assigning
      // each result value into "its own array index", then no conflict can occur be-
      // tween threads so that any one thread would overwrite the result produced by
      // another thread, and therefore no data-races will occur. This is a red-neck
      // approach which ALWAYS works if the size of the array can be known in advance
      rotated_volumes[i] = geo.GetBoundingBox(_plane).Volume;
    });
    
    // now find that index (degree of rotation) at which we had the smallest BoundingBox
    var rotation = IndexOfMinimumVolume(ref rotated_volumes);
    // Convert Degrees to Radians before returning the angle
    return rotation * rad_angle_factor;
  }

  /// <summary>
  /// Returns the index of the smallest volume recorded in the array
  /// </summary>
  /// <returns>Returns the index of the smalles volume, which also is
  /// equal to the degree at which this volume was achieved.</returns>
  private double IndexOfMinimumVolume(ref double[] recorded_volumes)
  {
    var min_index = -1;
    var min_value = Double.MaxValue;
    for (var i = 0; i < recorded_volumes.Length; i++)
    {
      if (recorded_volumes[i] < min_value)
      {
        min_index = i;
        min_value = recorded_volumes[i];
      }
    }
    return min_index; // Index is the same as the degree
  }
# ---------- end minbb_c ----------

rotating_caliper_3d = RotatingCaliper3D(geo=segments_4)  # -> horizontal_box_2, area_4, rotated_box_2; disabled
geo = Geometry(rotating_caliper_3d.horizontal_box_2)  # disabled
geo_2 = Geometry(rotating_caliper_3d.rotated_box_2)  # disabled
rotating_caliper = RotatingCaliper(geo=segments_3)  # -> box_2, area_4
_3d_rotate_3 = Boolean(_3d_rotate_2)

# ---- group: assign box plane to lowest largest face
# normalize plane normal directions
box = Box(simplify(minbb_c.MinBB))
debrep = DeconstructBrep(Brep=box)  # -> simplify(Faces), Edges, Vertices
area = Area(Geometry=debrep.Faces)  # -> Area, Centroid
sort = SortList(Keys=area.Area, ValuesA=debrep.Faces)  # -> Keys, reverse(ValuesA)
item = ListItem(List=sort.ValuesA, Index=0, Wrap=True)  # -> Item, Item1

# ----
merge = Merge(Data1=item.Item, Data2=item.Item1)

# ---- group: assign box plane to lowest largest face (continued)
area_2 = Area(Geometry=merge)  # -> Area, Centroid
pdecon = Deconstruct(Point=area_2.Centroid)  # -> XComponent, YComponent, ZComponent
sort_2 = SortList(Keys=pdecon.ZComponent, ValuesA=merge)  # -> Keys, ValuesA
item_2 = ListItem(List=sort_2.ValuesA, Index=0, Wrap=True)
pln = Plane(item_2)
deplane = DeconstructPlane(Plane=pln)  # -> Origin, XAxis, YAxis, ZAxis
pl_origin = PlaneOrigin(Base=pln, Origin="0,0,0")
devec = DeconstructVector(Vector=deplane.ZAxis)  # -> XComponent, YComponent, ZComponent
larger = LargerThan(FirstNumber=devec.ZComponent, SecondNumber=0)  # -> LargerThan, OrEqualTo
dispatch = Dispatch(List=pln, DispatchPattern=larger.LargerThan)  # -> ListA, ListB
pflip = FlipPlane(Plane=dispatch.ListB, ReverseX=False, ReverseY=False, SwapAxes=True)
merge_2 = Merge(Data1=dispatch.ListA, Data2=pflip)
bbox = BoundingBox(Content=box, Plane=merge_2)  # -> simplify(Box), Box_2

# ----
bbs = Box(simplify(bbox.Box))
filter = StreamFilter(Gate=_3d_rotate_3, Stream0=rotating_caliper.box_2, Stream1=bbs)
bbs_2 = Box(simplify(filter))
bbs_3 = ClusterOutput(bbs_2)

# ==== cluster CalculateEfficiency
segments = ClusterInput()
modules = ClusterInput()
segments_2 = Surface(segments)
modules_2 = Data(modules)
trim = TrimTree(Tree=modules_2, Depth=1)

# ----
# direct connection segments>>area was causing problems
debrep = DeconstructBrep(Brep=segments_2)  # -> Faces, Edges, Vertices
join = JoinCurves(Curves=debrep.Edges, Preserve=False)

lng = ListLength(List=trim)
runion = RegionUnion(Curves=trim)  # -> simplify(Result)
project = Project(Geometry=join, Plane=runion)  # -> Geometry, Transform
area = Area(Geometry=project.Geometry)  # -> Area, Centroid
area_2 = Area(Geometry=runion)  # -> Area, Centroid
modules_segment = Integer(lng)
division = Division(A=area.Area, B=area_2.Area)
area_efficiency = Number(simplify(division))
panel = Panel(modules_segment)
avr = Average(Input=flatten(area_efficiency))
avr_efficiency = Number(avr)
panel_2 = Panel(avr_efficiency)
avr_efficiency_2 = ClusterOutput(avr_efficiency)

# ==== cluster SegmentFeasibility2x24x1
srf = ClusterInput()
panel = Panel("""0
2
3
4""")
srf_2 = Surface(srf)
item = ListItem(List=srf_2, Index=panel, Wrap=True)
crv = Curve(srf_2)
rotating_caliper = RotatingCaliper_2(crv=crv)  # -> box_2, area_4
segments = Curve(simplify(graft(crv)))
boundary = BoundarySurfaces(Edges=segments)

# ---- group: sort segments per pinbed configuration
box = Box(simplify(rotating_caliper.box_2))
number_slider = Slider(0.354, range=0..1)
boxfit = BoxFit(box=box, dim_1="2", dim_2="2")  # -> fit_2, unfit_2
boxfit_2 = BoxFit(box=boxfit.unfit_2, dim_1="4", dim_2="1")  # -> fit_2, unfit_2
box_2x2s = Box(boxfit.fit_2)
box_4x1s = Box(boxfit_2.fit_2)
unfeasible = Box(boxfit_2.unfit_2)
tstat = TreeStatistics(Tree=box_2x2s)  # -> Paths, Length, Count
ahsl = SplitAHSL(Colour=ColourSwatch(SwatchColor=RGB(65, 156, 0)))  # -> Alpha, Hue, Saturation, Luminance
tstat_2 = TreeStatistics(Tree=box_4x1s)  # -> Paths, Length, Count
ahsl_2 = SplitAHSL(Colour=ColourSwatch(SwatchColor=RGB(255, 183, 0)))  # -> Alpha, Hue, Saturation, Luminance
ahsl_3 = SplitAHSL(Colour=ColourSwatch(SwatchColor=RGB(255, 69, 69)))  # -> Alpha, Hue, Saturation, Luminance
tstat_3 = TreeStatistics(Tree=unfeasible)  # -> Paths, Length, Count
branch = TreeBranch(Tree=simplify(boundary), Path=tstat.Paths, MaintainPaths=True)
hsl = ColourHSL(Alpha=number_slider, Hue=ahsl.Hue, Saturation=ahsl.Saturation, Luminance=ahsl.Luminance)
branch_2 = TreeBranch(Tree=simplify(boundary), Path=tstat_2.Paths, MaintainPaths=True)
branch_3 = TreeBranch(Tree=simplify(boundary), Path=tstat_3.Paths, MaintainPaths=True)
hsl_2 = ColourHSL(Alpha=number_slider, Hue=ahsl_2.Hue, Saturation=ahsl_2.Saturation, Luminance=ahsl_2.Luminance)
hsl_3 = ColourHSL(Alpha=number_slider, Hue=ahsl_3.Hue, Saturation=ahsl_3.Saturation, Luminance=ahsl_3.Luminance)
preview = CustomPreview(Geometry=branch, Material=hsl)
preview_2 = CustomPreview(Geometry=branch_3, Material=hsl_3)
preview_3 = CustomPreview(Geometry=branch_2, Material=hsl_2)
boxdim = BoxDim(B=unfeasible, S=1)

# ==== cluster BottomPoints
ltol = ClusterInput()
mesh = ClusterInput()
mesh_2 = Mesh(mesh)
ltol_2 = Integer(ltol)
demesh = DeconstructMesh(Mesh=mesh_2)  # -> Vertices, Faces, Colours, Normals
pt = Point(demesh.Vertices)
bbox = BoundingBox(Content=pt, Plane=PlaneXY(0, 0, 0), UnionBox=True)  # -> Box, Box_2
box = EvaluateBox(Box=bbox.Box, UParameter="0", VParameter="0", WParameter="0")  # -> Plane, Point, Include
neg = Negative(Value=ltol_2)
_10º = PowerOf10(Value=neg)
cp = PlaneClosestPoint(Point=pt, Plane=box.Plane)  # -> Point, UVPoint, Distance
panel = Panel("1e-10")
smaller = SmallerThan(FirstNumber=cp.Distance, SecondNumber=_10º)  # -> SmallerThan, OrEqualTo
boxdims = BoxDims(box=bbox.Box)  # -> dx_2, dy_2, dz_2
dispatch = Dispatch(List=pt, DispatchPattern=smaller.SmallerThan)  # -> ListA, ListB
duppt = RemoveDuplicatePts(Points=dispatch.ListA, Tolerance=0.01)  # -> simplify(UniquePoints)
division = Division(A=boxdims.dx_2, B="2")
pgroups = PointGroups(Points=duppt, Distance=division)  # -> simplify(Groups), Indices
pt_2 = Point(pgroups.Groups)
pt_3 = ClusterOutput(pt_2)

# ==== cluster DivInt
crv = ClusterInput()
num = ClusterInput()

# ---- group: divide curve integer
crv_2 = Curve(crv)
len = Length(Curve=crv_2)
num_2 = Number(num)
division = Division(A=len, B=num_2)
round = Round(Number=division)  # -> Nearest, Floor, Ceiling
divide = DivideCurve(Curve=crv_2, Count=round.Ceiling, Kinks=False)  # -> simplify(Points), Tangents, Parameters

# ----
pline = PolyLine(Vertices=divide.Points, Closed=False)
explode = Explode(Curve=pline, Recursive=True)  # -> Segments, Vertices
eval = EvaluateCurve(Curve=reparameterize(explode.Segments), Parameter=".5")  # -> Point, Tangent, Angle
midpts = Point(simplify(eval.Point))
pts = Point(divide.Points)
pts_2 = ClusterOutput(pts)
midpts_2 = ClusterOutput(midpts)

# ==== cluster IntersectStressLines
stress_lines = ClusterInput()
stress_lines_2 = Curve(stress_lines)
bang = ExplodeTree(Data=stress_lines_2)  # -> Branch0, Branch1
edge_cables = Curve(bang.Branch1)
corner_cables = Curve(bang.Branch0)
crossref = CrossReference(ListA=corner_cables, ListB=edge_cables, CrossMode=1)  # -> ListA, ListB
ccx = CurveCurve(CurveA=crossref.ListA, CurveB=crossref.ListB)  # -> Points, ParamsA, ParamsB
intersection_points = Point(ccx.Points)
intersection_points_2 = ClusterOutput(intersection_points)

# ==== cluster JigglePoints
maximum_deviation = ClusterInput()
intersection_points = ClusterInput()
curves_to_snap = ClusterInput()
rho_values = ClusterInput()
phi_values = ClusterInput()
intersection_points_2 = Point(flatten(intersection_points))
curves_to_snap_2 = Curve(curves_to_snap)
phi_values_2 = Number(phi_values)
maximum_deviation_2 = Number(maximum_deviation)
rho_values_2 = Number(rho_values)
pt = Point(simplify(graft(intersection_points_2)))
lot = Integer(Slider(2, range=0..10))
neg = Negative(Value=lot)
crv_cp = CurveClosestPoint(Point=pt, Curve=curves_to_snap_2)  # -> Point, Parameter, Distance
_10º = PowerOf10(Value=neg)
smaller = SmallerThan(FirstNumber=crv_cp.Distance, SecondNumber=_10º)  # -> SmallerThan, OrEqualTo
pt_2 = Point(pt)
dispatch = Dispatch(List=pt, DispatchPattern=smaller.SmallerThan)  # -> simplify(ListA), simplify(ListB)
bbox = BoundingBox(Content=flatten(pt_2), Plane=PlaneXY(0, 0, 0), UnionBox=True)  # -> Box, Box_2
edges = BrepEdges(Brep=bbox.Box)  # -> Naked, Interior, NonManifold
pt_on_curve = Point(dispatch.ListA)
pt_off_curve = Point(dispatch.ListB)
end = EndPoints(Curve=edges.Naked)  # -> Start, End
phi = Number(graft(phi_values_2))
toggle = BooleanToggle(False)
cp = ClosestPoint(Point=pt_2, Cloud=end.Start)  # -> ClosestPoint, CPIndex, Distance
max_phi = Slider(1, range=1..2)
round = Round(Number=phi)  # -> Nearest, Floor, Ceiling
Z = UnitZ(Factor=1)
vec2pt = Vector2Pt(PointA=pt_2, PointB=cp.ClosestPoint, Unitize=toggle)  # -> Vector, Length
cir = Circle(Plane=pt, Radius=maximum_deviation_2)
crossref = CrossReference(ListA=pt_off_curve, ListB=round.Nearest, CrossMode=3)  # -> ListA, ListB
crossref_2 = CrossReference(ListA=pt_on_curve, ListB=phi, CrossMode=3)  # -> ListA, ListB
radius = Number(graft(rho_values_2))
xprod = CrossProduct(VectorA=vec2pt.Vector, VectorB=Z, Unitize=toggle)  # -> Vector, Length
merge = Merge(Data1=crossref_2.ListB, Data2=crossref.ListB)
pi = Pi(Factor=max_phi)
pl = ConstructPlane(Origin=pt_2, XAxis=vec2pt.Vector, YAxis=xprod.Vector)
remap = RemapNumbers(Value=merge, Source=Domain(0, 1), Target=pi)  # -> Mapped, Clipped
remap_2 = RemapNumbers(Value=radius, Source=Domain(0, 1), Target=maximum_deviation_2)  # -> Mapped, Clipped
deviation_spaces = Curve(cir)
pt_3 = PointPolar(BasePlane=pl, XYAngle=remap.Mapped, ZAngle=0, Offset=remap_2.Mapped)
jiggled_points = Point(pt_3)
jiggled_points_2 = ClusterOutput(jiggled_points)

# ==== cluster MakeSegments
tolerance = ClusterInput()
stress_lines = ClusterInput()
tolerance_2 = Number(tolerance)
stress_lines_2 = Curve(stress_lines)
bang = ExplodeTree(Data=stress_lines_2)  # -> Branch0, Branch1
intersection_points = ClusterInput()
lot = Integer(Slider(0, range=0..10))
neg = Negative(Value=lot)
intersection_points_2 = Point(flatten(intersection_points))
corner_lines = Curve(bang.Branch0)
edge_lines = Curve(bang.Branch1)
_10º = PowerOf10(Value=neg)
# tolerance same as max deviation because maxDev is being set do that circles do not intersect - needs improvement
tolerance_3 = Number(tolerance_2)
crv_cp = CurveClosestPoint(Point=intersection_points_2, Curve=graft(corner_lines))  # -> Point, Parameter, Distance
crv_cp_2 = CurveClosestPoint(Point=intersection_points_2, Curve=graft(edge_lines))  # -> Point, Parameter, Distance
smaller = SmallerThan(FirstNumber=crv_cp.Distance, SecondNumber=tolerance_3)  # -> SmallerThan, OrEqualTo
smaller_2 = SmallerThan(FirstNumber=crv_cp_2.Distance, SecondNumber=tolerance_3)  # -> SmallerThan, OrEqualTo
dispatch = Dispatch(List=intersection_points_2, DispatchPattern=smaller_2.SmallerThan)  # -> ListA, ListB
dispatch_2 = Dispatch(List=intersection_points_2, DispatchPattern=simplify(smaller.SmallerThan))  # -> ListA, ListB
pt_on_curve = Point(simplify(dispatch_2.ListA))
pt_on_curve_2 = Point(simplify(dispatch.ListA))
alongcrv = SortAlongCurve(Points=pt_on_curve, Curve=simplify(graft(corner_lines)))  # -> simplify(Points), Indices
alongcrv_2 = SortAlongCurve(Points=pt_on_curve_2, Curve=simplify(graft(edge_lines)))  # -> simplify(Points), Indices
pline = PolyLine(Vertices=alongcrv.Points, Closed=False)
pline_2 = PolyLine(Vertices=alongcrv_2.Points, Closed=False)
entwine = Entwine(Branch00=pline, Branch01=pline_2, FlattenInputs=True)  # -> simplify(Result)
segment_plans = Curve(entwine)
segment_plans_2 = ClusterOutput(segment_plans)

# ==== cluster MakeKeystone
surface_plan = ClusterInput()
intersection_points = ClusterInput()
surface_plan_2 = Curve(surface_plan)
intersection_points_2 = Point(intersection_points)
explode = Explode(Curve=surface_plan_2, Recursive=True)  # -> Segments, Vertices
lng = ListLength(List=explode.Segments)
division = Division(A=lng, B=2)
area = Area(Geometry=surface_plan_2)  # -> Area, Centroid
center = Point(area.Centroid)
cps = ClosestPoints(Point=center, Cloud=flatten(intersection_points_2), Count=division)  # -> ClosestPoint, CPIndex, Distance
cir = Circle(Plane=center, Radius=1)
alongcrv = SortAlongCurve(Points=cps.ClosestPoint, Curve=cir)  # -> Points, Indices
pline = PolyLine(Vertices=alongcrv.Points, Closed=Toggle(True))
keystone_plan = Curve(pline)
keystone_plan_2 = ClusterOutput(keystone_plan)

# ==== cluster DivideRect
rec = ClusterInput()
divv = ClusterInput()
divu = ClusterInput()
rec_2 = Rectangle(rec)
divv_2 = Integer(divv)
divu_2 = Integer(divu)
drec = DeconstuctRectangle(Rectangle=rec_2)  # -> BasePlane, XInterval, YInterval
dom² = ConstructDomain²(DomainU=drec.XInterval, DomainV=drec.YInterval)
divide = DivideDomain²(Domain=dom², UCount=divu_2, VCount=divv_2)
dedom2 = DeconstructDomain²(Domain=divide)  # -> UComponent, VComponent
graft = GraftTree(Tree=drec.BasePlane, IncludeEmptyLists=True, IncludeNullItems=True)
rectangle = Rectangle(Plane=graft, XSize=dedom2.UComponent, YSize=dedom2.VComponent, Radius=0)  # -> Rectangle, Length
rec_3 = Rectangle(rectangle.Rectangle)
rec_4 = ClusterOutput(rec_3)

# ==== cluster RotatingCaliper
pi = Pi(Factor=1)
geo = ClusterInput()
range = Range(Domain=pi, Steps=Slider(100, range=0..100))
xy = XYPlane(Origin=Point(0, 0, 0))
geo_2 = Geometry(geo)
prot = RotatePlane(Plane=xy, Angle=range)
bbox = BoundingBox(Content=graft(geo_2), Plane=prot)  # -> Box, Box_2
trim = TrimTree(Tree=simplify(bbox.Box), Depth=1)
geo_3 = Geometry(simplify(trim))
area = Area(Geometry=geo_3)  # -> Area, Centroid
sort = SortList(Keys=area.Area, ValuesA=geo_3)  # -> Keys, ValuesA
item = ListItem(List=sort.ValuesA, Index=0, Wrap=True)
area_2 = Area(Geometry=item)  # -> Area, Centroid
box = Box(item)
area_3 = Number(area_2.Area)
box_2 = ClusterOutput(box)
area_4 = ClusterOutput(area_3)

# ==== cluster RotatingCaliper3D
pi = Pi(Factor=Slider(0.5, range=0..0.5))
pi_2 = Pi(Factor=Slider(0.5, range=0..0.5))
number_slider = Slider(5, range=0..10)
geo = ClusterInput()
range = Range(Domain=pi, Steps=Slider(61, range=0..100))
range_2 = Range(Domain=pi_2, Steps=Slider(20, range=0..100))
cull_i = CullIndex(List=range_2, Indices="0", Wrap=True)
item = ListItem(List=geo, Index=number_slider, Wrap=True)
xy = XYPlane(Origin=Point(0, 0, 0))
phi = Number(range)
theta = Number(cull_i)
geo_2 = Geometry(simplify(graft(geo)))
prot = RotatePlane(Plane=xy, Angle=theta)
bbox = BoundingBox(Content=geo_2, Plane=prot)  # -> Box, Box_2
trim = TrimTree(Tree=simplify(bbox.Box), Depth=1)
geo_3 = Geometry(simplify(trim))
area = Area(Geometry=geo_3)  # -> Area, Centroid
sort = SortList(Keys=area.Area, ValuesA=prot)  # -> Keys, simplify(ValuesA)
item_2 = ListItem(List=sort.ValuesA, Index=0, Wrap=True)
geo_4 = Geometry(geo_2)
# switch to transformations instead of planes!
best_horizontal_rotation_plane = Plane(item_2)
rotate = Rotate(Angle=1.570796327, Plane=PlaneXY(0, 0, 0))  # -> Geometry, Transform
neg = Negative(Value=phi)
deplane = DeconstructPlane(Plane=best_horizontal_rotation_plane)  # -> Origin, XAxis, YAxis, ZAxis
rot3d = Rotate3D(Geometry=best_horizontal_rotation_plane, Angle=neg, Center=deplane.Origin, Axis=deplane.YAxis)  # -> simplify(Geometry), Transform
bbox_2 = BoundingBox(Content=geo_4, Plane=rot3d.Geometry)  # -> Box, Box_2
trim_2 = TrimTree(Tree=simplify(bbox_2.Box), Depth=1)
geo_5 = Geometry(simplify(trim_2))
volume = Volume(Geometry=geo_5)  # -> Volume, Centroid
sort_2 = SortList(Keys=volume.Volume, ValuesA=geo_5)  # -> Keys, ValuesA
sort_3 = SortList(Keys=area.Area, ValuesA=geo_3)  # -> Keys, ValuesA
item_3 = ListItem(List=sort_2.ValuesA, Index=0, Wrap=True)
item_4 = ListItem(List=sort_3.ValuesA, Index=0, Wrap=True)
area_2 = Area(Geometry=item_4)  # -> Area, Centroid
horizontal_box = Box(item_4)
rotated_box = Box(item_3)
branch = TreeBranch(Tree=[item_3, item_4], Path=number_slider, MaintainPaths=True)
area_3 = Number(area_2.Area)
horizontal_box_2 = ClusterOutput(horizontal_box)
area_4 = ClusterOutput(area_3)
rotated_box_2 = ClusterOutput(rotated_box)
boxsize = BoxSize(box=horizontal_box)  # -> X_2, Y_2, Z_2, A_2, V_2
boxsize_2 = BoxSize(box=item_3)  # -> X_2, Y_2, Z_2, A_2, V_2
panel = Panel(boxsize.Z_2)
panel_2 = Panel(boxsize_2.Z_2)

# ==== cluster BoxFit
box = ClusterInput()
box_2 = Box(box)
dim_1 = ClusterInput()
dim_2 = ClusterInput()
dim_1_2 = Number(dim_1)
dim_2_2 = Number(dim_2)
boxsize = BoxSize(box=box_2)  # -> X_2, Y_2, Z_2, A_2, V_2
smaller = SmallerThan(FirstNumber=boxsize.X_2, SecondNumber=dim_1_2)  # -> SmallerThan, OrEqualTo
smaller_2 = SmallerThan(FirstNumber=boxsize.Y_2, SecondNumber=dim_2_2)  # -> SmallerThan, OrEqualTo
smaller_3 = SmallerThan(FirstNumber=boxsize.X_2, SecondNumber=dim_2_2)  # -> SmallerThan, OrEqualTo
smaller_4 = SmallerThan(FirstNumber=boxsize.Y_2, SecondNumber=dim_1_2)  # -> SmallerThan, OrEqualTo
and = GateAnd(A=smaller.OrEqualTo, B=smaller_2.OrEqualTo)
and_2 = GateAnd(A=smaller_3.OrEqualTo, B=smaller_4.OrEqualTo)
or = GateOr(A=and, B=and_2)
toggle = BooleanToggle(True)
dispatch = Dispatch(List=box_2, DispatchPattern=or)  # -> ListA, ListB
clean = CleanTree(RemoveNulls=True, RemoveInvalid=True, RemoveEmpty=toggle, Tree=dispatch.ListB)
clean_2 = CleanTree(RemoveNulls=True, RemoveInvalid=True, RemoveEmpty=toggle, Tree=dispatch.ListA)
fit = Box(clean_2)
unfit = Box(clean)
unfit_2 = ClusterOutput(unfit)
fit_2 = ClusterOutput(fit)

# ==== cluster BoxDim
B = ClusterInput()
edges = BrepEdges(Brep=B)  # -> Naked, Interior, NonManifold
split = SplitList(List=edges.Naked, Index=Slider(2, range=0..10))  # -> ListA, ListB
S = ClusterInput()
end = EndPoints(Curve=split.ListA)  # -> Start, End
neg = Negative(Value=Slider(0.593, range=0..1))
aligndim = AlignedDimension(Plane=PlaneXY(0, 0, 0), PointA=end.Start, PointB=end.End, Offset=neg, Text="{0:0.00}", Size=S)

# ==== cluster RotatingCaliper_2
crv = ClusterInput()
pi = Pi(Factor=1)
crv_2 = Curve(crv)
range = Range(Domain=pi, Steps=Slider(100, range=0..100))
xy = XYPlane(Origin=Point(0, 0, 0))
prot = RotatePlane(Plane=xy, Angle=range)
bbox = BoundingBox(Content=graft(crv_2), Plane=prot)  # -> Box, Box_2
trim = TrimTree(Tree=simplify(bbox.Box), Depth=1)
geo = Geometry(simplify(trim))
area = Area(Geometry=geo)  # -> Area, Centroid
sort = SortList(Keys=area.Area, ValuesA=geo)  # -> Keys, ValuesA
item = ListItem(List=sort.ValuesA, Index=0, Wrap=True)
area_2 = Area(Geometry=item)  # -> Area, Centroid
box = Box(item)
area_3 = Number(area_2.Area)
box_2 = ClusterOutput(box)
area_4 = ClusterOutput(area_3)

# ==== cluster BoxDims
box = ClusterInput()
box_2 = Box(box)
debox = DeconstructBox(Box=box_2)  # -> Plane, X, Y, Z
dedomain = DeconstructDomain(Domain=debox.X)  # -> Start, End
dedomain_2 = DeconstructDomain(Domain=debox.Y)  # -> Start, End
dedomain_3 = DeconstructDomain(Domain=debox.Z)  # -> Start, End
subtraction = Subtraction(A=dedomain.End, B=dedomain.Start)
subtraction_2 = Subtraction(A=dedomain_2.End, B=dedomain_2.Start)
subtraction_3 = Subtraction(A=dedomain_3.End, B=dedomain_3.Start)
dx = Number(subtraction)
dy = Number(subtraction_2)
dz = Number(subtraction_3)
dx_2 = ClusterOutput(dx)
dy_2 = ClusterOutput(dy)
dz_2 = ClusterOutput(dz)
