# Grasshopper definition SHELLS_ACORN_master_2021.gh (Grasshopper 1.0.7)
# plug-ins: Kiwi3d, ACORNshells, karambaGH

number_slider = Slider(0.25, range=0..1)
image = ImageSampler(Filter="Colour", Interpolate=False, Umax=1, Umin=0, Vmax=1, Vmin=0, Wrap=1)
concrete_weight_kn_m3 = Slider(24, range=0..100)
merge = Merge(Data1=Slider(8, range=5..10), Data2=Slider(0.8, range=0..1), Data3=Slider(0.061, range=0.02..0.12))
item = ListItem(List=merge, Index=0, Wrap=True)  # -> Item, Item1, Item2
concrete_weight_kn_m3_2 = Number(concrete_weight_kn_m3)
thickness_m = Number(item.Item2)
span_m = Number(item.Item)
height_m = Number(item.Item1)
division = Division(A=Slider(6, range=0..10), B=2)
division_2 = Division(A=span_m, B=2)
neg = Negative(Value=division)
neg_2 = Negative(Value=division_2)
pt = Point([Point(0, 0, 0), Point(8, 0, 0), Point(6, 6, 0), Point(0, 6, 0)])
pt_2 = Point([Point(-2.65739868, 2.586695785, 0), Point(2.522828173, 2.363083722, 0), Point(4.069487342, -3.772482641, 0), Point(-1.375177545, -2.361354304, 0)])
dom = ConstructDomain(DomainStart=neg, DomainEnd=division)
dom_2 = ConstructDomain(DomainStart=neg_2, DomainEnd=division_2)
vec = VectorXYZ(XComponent="-4", YComponent="-4", ZComponent=0)  # -> Vector, Length
pline = PolyLine(Vertices=pt, Closed=True)
rectangle = Rectangle(Plane=PlaneXY(0, 0, 0), XSize=dom_2, YSize=dom, Radius=0)  # -> Rectangle, Length
polygon = Polygon(Plane=PlaneXY(0, 0, 0), Radius=3, Segments=Slider(5, range=3..6), FilletRadius=0)  # -> Polygon, Length
flip = FlipCurve(Curve=pline)  # -> Curve, Flag
move = Move(Geometry=pline, Motion=vec.Vector)  # -> Geometry, Transform
regular_quad = Curve(rectangle.Rectangle)
regular_polygon = Curve(polygon.Polygon)
irregular_quad = Curve(move.Geometry)

# ---- group: normalize shape
target_area = Number(Slider(36, range=0..100))
main_shape = Curve(regular_polygon)
area = Area(Geometry=main_shape)  # -> Area, Centroid
division_3 = Division(A=target_area, B=area.Area)
sqrt = SquareRoot(Value=division_3)
scale = Scale(Geometry=main_shape, Center=Point(0, 0, 0), Factor=sqrt)  # -> Geometry, Transform

# ----
dom_3 = ConstructDomain(DomainStart=0, DomainEnd=1)
number_slider_2 = Slider(6, range=0..10)
division_4 = Division(A=Slider(7.8, range=0..10), B=2)
division_5 = Division(A=Slider(7.2, range=0..10), B=2)

# ---- group: normalize shape / just because of squares
pi = Pi(Factor=".25")
rotate = Rotate(Geometry=scale.Geometry, Angle=pi, Plane=PlaneXY(0, 0, 0))  # -> Geometry, Transform

# ----
neg_3 = Negative(Value=division_4)
neg_4 = Negative(Value=division_5)
dom_4 = ConstructDomain(DomainStart=neg_3, DomainEnd=division_4)
dom_5 = ConstructDomain(DomainStart=neg_4, DomainEnd=division_5)
rectangle_2 = Rectangle(Plane=PlaneXY(0, 0, 0), XSize=dom_4, YSize=dom_5, Radius=0)  # -> Rectangle, Length
geo = Geometry(rectangle_2.Rectangle)
explode = Explode(Curve=geo, Recursive=True)  # -> graft(Segments), Vertices
intcrv = Interpolate(Vertices=explode.Vertices, Degree=3, Periodic=Toggle(True), KnotStyle=1)  # -> Curve, Length, Domain
boundary = BoundarySurfaces(Edges=intcrv.Curve)
area_2 = Area(Geometry=intcrv.Curve)  # -> Area, Centroid
extr = ExtrudePoint(Base=flatten(intcrv.Curve), Point=area_2.Centroid)

# ---- group: isolines
number_slider_3 = Slider(8, range=0..10)
number_slider_4 = Slider(9, range=0..10)
number_slider_5 = Slider(7, range=0..10)
one_over_x = OneOverX(Value=number_slider_3)
one_over_x_2 = OneOverX(Value=number_slider_4)
one_over_x_3 = OneOverX(Value=number_slider_5)
recgrid = Rectangular(Plane=PlaneXY(0, 0, 0), SizeX=one_over_x_3, SizeY=one_over_x_2, ExtentX=number_slider_5, ExtentY=number_slider_4)  # -> Cells, Points
sqgrid = Square(Plane=PlaneXY(0, 0, 0), Size=one_over_x, ExtentX=number_slider_3, ExtentY=number_slider_3)  # -> Cells, Points
iso = IsoCurve(Surface=reparameterize(extr), UVPoint=sqgrid.Points)  # -> UIsocurve, VIsocurve

# ----
srf_cp = SurfaceClosestPoint(Point=explode.Vertices, Surface=reparameterize(extr))  # -> Point, UVPoint, Distance
pdecon = Deconstruct(Point=srf_cp.UVPoint)  # -> XComponent, YComponent, ZComponent
lng = ListLength(List=pdecon.YComponent)
subtraction = Subtraction(A=lng, B="1")
replace = ReplaceItems(List=pdecon.YComponent, Item="1", Indices=subtraction, Wrap=False)
consec = ConsecutiveDomains(Numbers=replace, Additive=False)
panel = Panel(consec)
dom² = ConstructDomain²(DomainU=dom_3, DomainV=consec)
divide = DivideDomain²(Domain=extr, UCount=Slider(1, range=0..10), VCount=Slider(10, range=0..10))
subsrf = Isotrim(Surface=reparameterize(extr), Domain=dom²)
join = BrepJoin(Breps=subsrf)  # -> Breps, Closed

# ---- group: Generate plan
regular_quad_2 = Curve(rectangle_2.Rectangle)
a_makeshellplan = MakeShellPlan(Outline=regular_quad_2, CornerRadius=Slider(0.2, range=0..1), CurvedCorner=Toggle(True))  # -> Plan, Corners, Edges

# ----
plan = Curve(a_makeshellplan.Plan)
split = SplitBrep(Brep=subsrf, Cutter=a_makeshellplan.Plan)
srfsplit = SurfaceSplit(Surface=join.Breps, Curves=a_makeshellplan.Plan)
item_2 = ListItem(List=srfsplit, Index=0, Wrap=True)
item_3 = ListItem(List=split, Index=0, Wrap=True)
srf = Surface(a_makeshellplan.Plan)
corners = Curve(a_makeshellplan.Corners)
height_m_2 = Number(height_m)
srf_2 = Surface(srf)
edges = Curve(a_makeshellplan.Edges)
lor_7_8x7_2 = Surface(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)
_6x6 = Surface(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)
simple_plan = Surface(rectangle_2.Rectangle)  # disabled
simple_plan_2 = Surface(rectangle_2.Rectangle)
srf_3 = Surface(simple_plan)  # disabled
height_m_3 = Number(height_m_2)  # disabled
number_slider_6 = Slider(1, range=0..10)  # disabled
corners_2 = Curve(corners)  # disabled
edges_2 = Curve(edges)  # disabled
height_m_4 = Number(height_m_2)
number_slider_7 = Slider(1.5, range=1..10)  # disabled
srf_4 = Surface(srf_2)
corners_3 = Curve(corners)
edges_3 = Curve(edges)
neg_5 = Negative(Value=number_slider_6)  # disabled
brep = Brep(srf_4)
corners_4 = Curve(corners_3)
edges_4 = Curve(edges_3)
number_slider_8 = Slider(0.1, range=0..1)  # disabled

# ---- group: similar to Wills
number_slider_9 = Slider(2, range=0..10)  # disabled
number_slider_10 = Slider(1.5, range=1..10)  # disabled
neg_6 = Negative(Value=number_slider_9)  # disabled
_10º = PowerOf10(Value=neg_6)  # disabled
multiplication = Multiplication(A=number_slider_10, B=_10º)  # disabled
panel_2 = Panel(multiplication)  # disabled
tested_anna_bauer = Panel("0.013")  # disabled
prestress_cable = Number(number_slider_8)  # disabled
load = Number(multiplication)  # disabled

# ----
number_slider_11 = Slider(0.15, range=0..1)  # disabled
_10º_2 = PowerOf10(Value=neg_5)  # disabled
brep_2 = Brep(srf_3)  # disabled

# ---- group: similar to Wills
neg_7 = Negative(Value=Slider(2, range=0..10))
# cable prestress 0.1
# load 0.015
_10º_3 = PowerOf10(Value=neg_7)
multiplication_2 = Multiplication(A=Slider(1.5, range=1..10), B=_10º_3)
panel_3 = Panel(multiplication_2)
tested_anna_bauer_2 = Panel("0.013")
prestress_cable_2 = Number(Slider(0.15, range=0..1))
load_2 = Number(multiplication_2)

# ----
multiplication_3 = Multiplication(A=number_slider_7, B=_10º_2)  # disabled
edges_5 = BrepEdges(Brep=brep_2)  # -> Naked, Interior, NonManifold; disabled
debrep = DeconstructBrep(Brep=brep_2)  # -> Faces, Edges, Vertices; disabled
edges_6 = BrepEdges(Brep=edges_4)  # -> Naked, Interior, NonManifold
pframes = PerpFrames(Curve=edges_4, Count="8", Align=True)  # -> simplify(Frames), Parameters
panel_4 = Panel(multiplication_3)  # disabled
prestress_cable_3 = Number(number_slider_11)  # disabled
load_3 = Number(multiplication_3)  # disabled
debrep_2 = DeconstructBrep(Brep=brep)  # -> Faces, Edges, Vertices
list = ValueList({"STEEL": 1, "WOOD": 2, "GFRP": 3, "ETFE (Membrane)": 4, "CONCRETE": 5, "ALUMINIUM": 6}, selected="ETFE (Membrane)")  # disabled
list_2 = ValueList({"STEEL": 1, "WOOD": 2, "GFRP": 3, "ETFE (Membrane)": 4, "CONCRETE": 5, "ALUMINIUM": 6}, selected="ETFE (Membrane)")
list_3 = ValueList({"STEEL": 1, "WOOD": 2, "GFRP": 3, "ETFE (Membrane)": 4, "CONCRETE": 5, "ALUMINIUM": 6}, selected="STEEL")

# ---- group: Edge Cables
crv = Curve(edges_5.Naked)  # disabled

# ---- group: Supports
pt_3 = Point(debrep.Vertices)  # disabled

# ----
cull_i = CullIndex(List=pframes.Frames, Indices="0", Wrap=True)

# ---- group: Edge Cables
crv_2 = Curve(edges_4)

# ---- group: Supports
pt_4 = Point(debrep_2.Vertices)

# ----
entwine = Entwine(Branch00=prestress_cable_3, Branch01=load_3, FlattenInputs=True)  # -> simplify(Result); disabled
entwine_2 = Entwine(Branch00=prestress_cable, Branch01=load, FlattenInputs=True)  # -> simplify(Result); disabled
cull_i_2 = CullIndex(List=reverse(cull_i), Indices="0", Wrap=True)  # -> simplify(List)
matdef = MaterialDefaults(Type=list, IsNmm2=False, IskNcm2=False, IskNm2=True, mUnit=1)  # -> Material, YoungsModulus, AlphaT, Nue, Density, Strength; disabled
number_slider_12 = Slider(0.08, range=0..0.1)  # disabled
matdef_2 = MaterialDefaults(Type=list_2, IsNmm2=False, IskNcm2=False, IskNm2=True, mUnit=1)  # -> Material, YoungsModulus, AlphaT, Nue, Density, Strength
entwine_3 = Entwine(Branch00=prestress_cable_2, Branch01=load_2, FlattenInputs=True)  # -> simplify(Result)
bang = ExplodeTree(Data=entwine_2)  # -> Branch0, Branch1; disabled
bang_2 = ExplodeTree(Data=entwine_3)  # -> Branch0, Branch1
matdef_3 = MaterialDefaults(Type=list_3, IsNmm2=False, IskNcm2=False, IskNm2=True, mUnit=1)  # -> Material, YoungsModulus, AlphaT, Nue, Density, Strength
deplane = DeconstructPlane(Plane=cull_i_2)  # -> Origin, XAxis, YAxis, ZAxis
prestress_cable_4 = Number(bang.Branch0)  # disabled
load_4 = Number(bang.Branch1)  # disabled
prestress_cable_5 = Number(bang_2.Branch0)
load_5 = Number(bang_2.Branch1)
Y = UnitY(Factor=1)
prestress = Number(Slider(0.15, range=0..1))
number_slider_13 = Slider(0.15, range=0..1)  # disabled
panel_5 = Panel("8")  # disabled
X = UnitX(Factor=1)
number_slider_14 = Slider(5, range=0..10)  # disabled
number_slider_15 = Slider(5, range=0..10)
mat = Material(Name="Steel", Type="LIN_ELAST_ISOTROPIC", YoungsModulus=210000000, AlphaT=0, Nue=0, Density=78.5, Strength=235000)  # disabled
crvref = CurveRefinement(PDeg=3, MinElementsU=panel_5, IsKnotApproxElementSize=False, IsKnotSubdivision=True)  # disabled
crvref_2 = CurveRefinement(PDeg=3, MinElementsU="8", IsKnotApproxElementSize=False, IsKnotSubdivision=True)
dprod = DotProduct(VectorA=X, VectorB=deplane.YAxis, Unitize=False)
dprod_2 = DotProduct(VectorA=Y, VectorB=deplane.YAxis, Unitize=False)
initial_prestress = Panel("0.15")  # disabled
initial_prestress_2 = Panel("0.15")

# ---- group: Formfinding - membrane
supportcurve = BooleanToggle(True)
scaledeform = BooleanToggle(True)
height_m_5 = Number(height_m)
a_formfindmembrane = FormFindMembrane(
    PlanShell=srf_4,
    Corners=corners_3,
    Edges=edges_3,
    Height=height_m_5,
    SubDiv=Slider(10, range=0..100),
    Run=Button(),
    CurveSupports=supportcurve,
    ScaleDeform=scaledeform,
    ThicknessFactor=Slider(0.13, range=0..1),
    MembranePrestressU=prestress,
    MembranePrestressV=prestress,
    CablePrestressV=prestress_cable_2,
    Load=load_2,
    PlanarEdges=Toggle(True))  # -> KiwiErrors, FormFoundShell, FormFoundCorners, FormFoundEdges

# ----
panel_6 = Panel("FormFinding")  # disabled
tested_anna_bauer_4 = Panel("1.7")  # disabled
tested_ed = Panel("0.1")  # disabled
list_4 = ValueList({"DEAD": 1, "SNOW": 2, "PRES": 3, "PRES_FL": 4}, selected="DEAD")  # disabled
list_5 = ValueList({"Displacements": 1, "Stresses": 2, "SupportForces": 3}, selected="Displacements")  # disabled
thickness = Panel("0.001")  # disabled
list_6 = ValueList({"DEAD": 1, "SNOW": 2, "PRES": 3, "PRES_FL": 4}, selected="DEAD")
abs = Absolute(Value=dprod)
abs_2 = Absolute(Value=dprod_2)
tested_anna_bauer_5 = Panel("1.7")
list_7 = ValueList({"Displacements": 1, "Stresses": 2, "SupportForces": 3}, selected="Displacements")
prestress_cable_7 = Panel("0.1")
Z = UnitZ(Factor=1)  # disabled
thickness_2 = Panel("0.001")
prestress_2 = Number(number_slider_13)  # disabled
Z_2 = UnitZ(Factor=1)
srfref = SurfaceRefinement(PDeg=3, QDeg=3, IsKnotApproxElementSize=False, IsKnotSubdivision=True)  # disabled
prestress_3 = Number(Slider(0.15, range=0..1))
srfref_2 = SurfaceRefinement(PDeg=3, QDeg=3, IsKnotApproxElementSize=False, IsKnotSubdivision=True)
supcrv = SupportCurve(Crv=corners_4, DispX=True, DispY=True, DispZ=True, Rot=False)
suppt_constrain_edges = SupportPoint(Point=deplane.Origin, DispX=abs, DispY=abs_2, DispZ=Toggle(False), Rotation=False, Torsion=False)
panel_7 = Panel("C:\Users\ec977\OneDrive - University of Bath\Eduardo\_DEVELOPMENT\__ PINBED SHELL\kiwiDump")  # disabled
membrane = MembraneElement(
    Brep=srf_3,
    Material=matdef.Material,
    Thickness=thickness,
    Prestress1=prestress_2,
    Prestress2=prestress_2,
    Refinement=srfref,
    Formfinding=True,
    ShowPrestressDirections=False)  # disabled
cable = CableElement(
    Curve=crv,
    Material=mat,
    Diameter=0.01,
    Prestress=prestress_cable_4,
    PrestressControl=False,
    CurveRefinement=crvref,
    Formfinding=True)  # disabled
fofi = Formfinding(Name=panel_6, FormfindingSteps=number_slider_14, Iterations=number_slider_14, OutputSetting=list_5)  # disabled
suppt = SupportPoint(Point=pt_3, DispX=True, DispY=True, DispZ=True, Rotation=False, Torsion=False)  # disabled
srfload = SurfaceLoad(Brep=srf_3, Loadtype=list_4, Direction=Z, Value=load_4, LoadCase=1)  # disabled
suppt_2 = SupportPoint(Point=pt_4, DispX=True, DispY=True, DispZ=True, Rotation=False, Torsion=False)
membrane_2 = MembraneElement(
    Brep=srf_4,
    Material=matdef_2.Material,
    Thickness=thickness_2,
    Prestress1=prestress_3,
    Prestress2=prestress_3,
    Refinement=srfref_2,
    Formfinding=True,
    ShowPrestressDirections=False)
cable_2 = CableElement(
    Curve=crv_2,
    Material=matdef_3.Material,
    Diameter=0.01,
    Prestress=prestress_cable_5,
    PrestressControl=False,
    CurveRefinement=crvref_2,
    Formfinding=True)
fofi_2 = Formfinding(Name="FormFinding", FormfindingSteps=number_slider_15, Iterations=number_slider_15, OutputSetting=list_7)
srfload_2 = SurfaceLoad(Brep=srf_4, Loadtype=list_6, Direction=Z_2, Value=load_5, LoadCase=1)
path_mapper = PathMapper(suppt_constrain_edges, source="{A;B} (C)", target="{A;C} (B)")
panel_8 = Panel(dprod)
merge_2 = Merge(Data1=membrane_2, Data2=cable_2)  # -> flatten(Result)
item_4 = ListItem(List=path_mapper, Index=0, Wrap=True)
panel_9 = Panel(item_4)
merge_3 = Merge(Data1=item_4, Data2=supcrv)  # -> flatten(Result)
panel_10 = Panel("C:\Users\ec977\OneDrive - University of Bath\Eduardo\_DEVELOPMENT\__ PINBED SHELL\kiwiDump")
button = Button()  # disabled
# Kiwi Membrane
amodel = AnalysisModel(
    Analysis=fofi,
    StructuralElements=[membrane, cable],
    Supports=suppt,
    Loads=srfload,
    IntersectionTolerance=0.001,
    IsCarat=True,
    IsKratos=False,
    PenaltyFac=10000000,
    ShowCouplingIDs=False,
    ShowEdgeIDs=False,
    ShowGeo=True,
    ShowPatchIDs=True,
    ShowPrePro=True,
    ShowRef=False)  # disabled
# Kiwi Membrane
# fixed edges
amodel_2 = AnalysisModel(
    Analysis=fofi_2,
    StructuralElements=merge_2,
    Supports=merge_3,
    Loads=srfload_2,
    IntersectionTolerance=0.001,
    IsCarat=True,
    IsKratos=False,
    PenaltyFac=10000000,
    ShowCouplingIDs=False,
    ShowEdgeIDs=False,
    ShowGeo=True,
    ShowPatchIDs=True,
    ShowPrePro=True,
    ShowRef=False)
demodel = DeconstructModel(Model=amodel_2)  # -> StructuralElements, RefinedGeometries, GaussPoints, InputText
run_analysis = IGASolver(AnalysisModel=amodel, Run=button, antiFreeze=False, showWindow=True)  # -> ResultModel, ErrorReport; disabled
analysis_completed = IGASolver(AnalysisModel=amodel_2, Path=panel_10, Run=Button(), antiFreeze=False, showWindow=True)  # -> ResultModel, ErrorReport
panel_11 = Panel(demodel.InputText)

# ---- group: Scale deformed shell to target height
defmod = DeformedModel(Model=run_analysis.ResultModel, ScaleFactor=1, FlyingNodeLimit=100000)  # -> Model, Geo, DeformedStructuralElements; disabled
item_5 = ListItem(List=defmod.Geo, Index=0, Wrap=True)  # disabled
shell = Surface(item_5)  # disabled
bbox = BoundingBox(Content=shell, Plane=PlaneXY(0, 0, 0))  # -> Box, Box_2; disabled
boxsize = BoxSize(box=bbox.Box)  # -> X_2, Y_2, Z_2, A_2, V_2; disabled
height_m_6 = Number(height_m_3)  # disabled
panel_12 = Panel(boxsize.Z_2)  # disabled
division_6 = Division(A=height_m_6, B=boxsize.Z_2)  # disabled
defmod_2 = DeformedModel(Model=defmod.Model, ScaleFactor=division_6, FlyingNodeLimit=100000)  # -> Model, Geo, DeformedStructuralElements; disabled
panel_13 = Panel(division_6)  # disabled
item_6 = ListItem(List=defmod_2.Geo, Index=0, Wrap=True)  # disabled
shell_2 = Surface(item_6)  # disabled

defmod_3 = DeformedModel(Model=analysis_completed.ResultModel, ScaleFactor=1, FlyingNodeLimit=100000)  # -> Model, Geo, DeformedStructuralElements
item_7 = ListItem(List=defmod_3.Geo, Index=0, Wrap=True)
shell_3 = Surface(item_7)
bbox_2 = BoundingBox(Content=shell_3, Plane=PlaneXY(0, 0, 0))  # -> Box, Box_2
boxsize_2 = BoxSize(box=bbox_2.Box)  # -> X_2, Y_2, Z_2, A_2, V_2
height_m_7 = Number(height_m_4)
panel_14 = Panel(boxsize_2.Z_2)
division_7 = Division(A=height_m_7, B=boxsize_2.Z_2)
defmod_4 = DeformedModel(Model=defmod_3.Model, ScaleFactor=division_7, FlyingNodeLimit=100000)  # -> Model, Geo, DeformedStructuralElements
panel_15 = Panel(division_7)
item_8 = ListItem(List=defmod_4.Geo, Index=0, Wrap=True)
shell_4 = Surface(item_8)

# ----
panel_16 = Panel("""prestress 0.10
load 0.015""")  # disabled
kiwi_model = Data("Grasshopper.Kernel.Types.GH_ObjectWrapper")  # disabled
panel_17 = Panel("""prestress 0.05
load 0.015""")  # disabled
kiwi_model_2 = Data("Grasshopper.Kernel.Types.GH_ObjectWrapper")  # disabled
panel_18 = Panel("""prestress 0.15
load 0.15""")  # disabled
kiwi_model_3 = Data("Grasshopper.Kernel.Types.GH_ObjectWrapper")  # disabled
panel_19 = Panel("""prestress 0.10
load 0.015""")
kiwi_model_4 = Data("Grasshopper.Kernel.Types.GH_ObjectWrapper")
panel_20 = Panel("""prestress 0.05
load 0.015""")
kiwi_model_5 = Data("Grasshopper.Kernel.Types.GH_ObjectWrapper")
panel_21 = Panel("""prestress 0.15
load 0.15""")
kiwi_model_6 = Data("Grasshopper.Kernel.Types.GH_ObjectWrapper")
number_slider_16 = Slider(0.215, range=0..30)  # disabled

# ---- group: Kiwi simple (UNCLUSTERABLE)
# Kiwi Shell (original)
# this is automated in Mish's C#?
height_m_8 = Number(height_m_2)  # disabled
corners_5 = Curve(corners)  # disabled
srf_5 = Surface(srf_2)  # disabled
srf_6 = Surface(srf_5)  # disabled
number_slider_17 = Slider(30, range=0..30)  # disabled
list_8 = ValueList({"STEEL": 1, "WOOD": 2, "GFRP": 3, "ETFE (Membrane)": 4, "CONCRETE": 5, "ALUMINIUM": 6}, selected="CONCRETE")  # disabled
untrim = Untrim(Surface=srf_6)  # disabled
number_slider_18 = Slider(0.05, range=0..1)  # disabled
number_slider_19 = Slider(100, range=0..500)  # disabled
list_9 = ValueList({"DEAD": 1, "SNOW": 2, "PRES": 3, "PRES_FL": 4}, selected="DEAD")  # disabled
toggle = BooleanToggle(False)  # disabled
srfref_3 = SurfaceRefinement(
    PDeg=3,
    QDeg=3,
    MinElementsU=number_slider_17,
    MinElementsV=number_slider_17,
    IsKnotApproxElementSize=False,
    IsKnotSubdivision=True)  # disabled
matdef_4 = MaterialDefaults(Type=list_8, IsNmm2=False, IskNcm2=False, IskNm2=True, mUnit=1)  # -> Material, YoungsModulus, AlphaT, Nue, Density, Strength; disabled
Z_3 = UnitZ(Factor=1)  # disabled
shell_5 = ShellElement(Brep=srf_6, Material=matdef_4.Material, Thickness=number_slider_12, Refinement=srfref_3, HingeCoupling=False)  # disabled
supcrv_2 = SupportCurve(Crv=corners_5, DispX=True, DispY=True, DispZ=True, Rot=toggle)  # disabled
visopt = VisualizeOptions(
    ScaleCrossSections=1,
    ScaleSupports=1,
    ScaleLoads=number_slider_18,
    ScaleCouplingPoints=1,
    ScaleConnectingPoints=1,
    ScaleRefinedControlPoints=1,
    ColourBeam=RGB(211, 211, 211),
    ColourCable=RGB(255, 255, 255),
    ColourSupports=RGB(232, 65, 119),
    ColourLoads=RGB(232, 65, 119),
    ColourConnects=RGB(255, 255, 255),
    ColourRefinedPatches=RGB(139, 0, 0),
    ColourSliding=RGB(135, 16, 55))  # disabled
srfload_3 = SurfaceLoad(Brep=srf_6, Loadtype=list_9, Direction=Z_3, Value=number_slider_19, LoadCase=1)  # disabled
list_10 = ValueList({"Displacements": 1, "Stresses": 2, "SupportForces": 3}, selected=["Displacements", "Stresses", "SupportForces"])  # disabled
lina = LinearAnalysis(Name="MyAnalysis", OutputSetting=list_10)  # disabled
button_2 = Button()  # disabled
amodel_3 = AnalysisModel(
    Analysis=lina,
    StructuralElements=shell_5,
    Supports=supcrv_2,
    Loads=srfload_3,
    Visualizer=visopt,
    IntersectionTolerance=0.001,
    IsCarat=True,
    IsKratos=False,
    PenaltyFac=10000000,
    ShowCouplingIDs=False,
    ShowEdgeIDs=False,
    ShowGeo=True,
    ShowPatchIDs=True,
    ShowPrePro=True,
    ShowRef=False)  # disabled
run_analysis_2 = IGASolver(AnalysisModel=amodel_3, Path=panel_7, Run=button_2, antiFreeze=False, showWindow=True)  # -> ResultModel, ErrorReport; disabled
defmod_5 = DeformedModel(Model=run_analysis_2.ResultModel, ScaleFactor=number_slider_16, FlyingNodeLimit=100000)  # -> Model, Geo, DeformedStructuralElements; disabled
kiwi_model_7 = Data(defmod_5.Model)  # disabled
shell_6 = Surface(defmod_5.Geo)  # disabled
bbox_3 = BoundingBox(Content=shell_6, Plane=PlaneXY(0, 0, 0))  # -> Box, Box_2; disabled
boxsize_3 = BoxSize(box=bbox_3.Box)  # -> X_2, Y_2, Z_2, A_2, V_2; disabled
height_m_9 = Number(height_m_8)  # disabled
division_8 = Division(A=height_m_9, B=boxsize_3.Z_2)  # disabled
panel_22 = Panel(boxsize_3.Z_2)  # disabled
panel_23 = Panel(division_8)  # disabled

# ---- group: isolines
number_slider_20 = Slider(8, range=0..10)
number_slider_21 = Slider(5, range=0..10)
number_slider_22 = Slider(7, range=0..10)
one_over_x_4 = OneOverX(Value=number_slider_20)
one_over_x_5 = OneOverX(Value=number_slider_21)
one_over_x_6 = OneOverX(Value=number_slider_22)
recgrid_2 = Rectangular(Plane=PlaneXY(0, 0, 0), SizeX=one_over_x_6, SizeY=one_over_x_5, ExtentX=number_slider_22, ExtentY=number_slider_21)  # -> Cells, Points
sqgrid_2 = Square(Plane=PlaneXY(0, 0, 0), Size=one_over_x_4, ExtentX=number_slider_20, ExtentY=number_slider_20)  # -> Cells, Points
iso_2 = IsoCurve(Surface=reparameterize(shell_4), UVPoint=sqgrid_2.Points)  # -> UIsocurve, VIsocurve

# ----
srf_7 = Surface(shell_6)  # disabled
corners_6 = Curve(corners_2)  # disabled
edges_7 = Curve(edges_2)  # disabled
corners_7 = Curve(corners_3)
edges_8 = Curve(edges_3)
srf_8 = Surface(shell_4)
project = Project(Curve=corners_7, Brep=srf_8, Direction=Vector(0, 0, 1))  # -> flatten(Curve)
project_2 = Project(Curve=edges_8, Brep=srf_8, Direction=Vector(0, 0, 1))  # -> flatten(Curve)
cull_i_3 = CullIndex(List=defmod_4.Geo, Indices="0", Wrap=True)
cpoly = ControlPolygon(Curve=cull_i_3)  # -> Polygon, Points
shell_7 = Surface(shell_4)
corners_8 = Curve(project)
edges_9 = Curve(project_2)
cpoly_2 = ControlPolygon(Curve=edges_9)  # -> Polygon, Points
cpoly_3 = ControlPolygon(Curve=corners_8)  # -> Polygon, Points
entwine_4 = Entwine(Branch00=shell_7, Branch01=corners_8, Branch02=edges_9, FlattenInputs=True)  # -> simplify(Result)
ff_membrane = Data(entwine_4)

# ----
# .15 membrane and cable prestress
# .015 load
ff_membrane_2 = Data(Tree({0}: [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], {1}: [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], {2}: [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]))

# ---- group: Form finding - Mish's values
supportcurve_2 = BooleanToggle(False)
scaledeform_2 = BooleanToggle(False)
height_m_10 = Number(height_m)
a_formfindkiwi = FormFindKiwi(
    PlanShell=a_makeshellplan.Plan,
    Corners=a_makeshellplan.Corners,
    Height=height_m_10,
    SubDiv=Slider(30, range=0..100),
    Run=Button(),
    CurveSupports=supportcurve_2,
    ScaleDeform=scaledeform_2,
    ThicknessFactor=Slider(0.1, range=0..1))  # -> FormFoundShell, KiwiErrors

# ----
scaledeform_3 = BooleanToggle(True)

# ---- group: Form finding - LoR values
supportcurve_3 = BooleanToggle(True)
height_m_11 = Number(height_m)
a_formfindkiwi_2 = FormFindKiwi(
    PlanShell=a_makeshellplan.Plan,
    Corners=a_makeshellplan.Corners,
    Height=height_m_11,
    SubDiv=Slider(10, range=0..100),
    Run=Button(),
    CurveSupports=supportcurve_3,
    ScaleDeform=scaledeform_3,
    ThicknessFactor=Slider(0.125, range=0..0.2))  # -> FormFoundShell, KiwiErrors

# ----
# integrate as outputs in FormFindKiwi
plan_corners = Geometry(a_makeshellplan.Corners)
plan_edges = Geometry(a_makeshellplan.Edges)
project_3 = Project(Curve=plan_edges, Brep=a_formfindkiwi_2.FormFoundShell, Direction=Vector(0, 0, 1))  # -> flatten(Curve)
project_4 = Project(Curve=plan_corners, Brep=a_formfindkiwi_2.FormFoundShell, Direction=Vector(0, 0, 1))  # -> flatten(Curve)

entwine_5 = Entwine(Branch00=a_formfindkiwi_2.FormFoundShell, Branch01=project_4, Branch02=project_3, FlattenInputs=True)  # -> simplify(Result)
# cable prestress 0.1
# load 0.015
_1st_ff_membrane = Data(Tree({0}: [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], {1}: [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], {2}: [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]))
# cable prestress 1.70
# load 0.015
_2nd_ff_membrane = Data(Tree({0}: [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], {1}: [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], {2}: [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]))
ff_replicated_lor = Data(Tree({0}: [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], {1}: [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], {2}: [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]))
lor_7_8x7_2_2 = Surface(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)
ff_final = Data(ff_membrane)
bang_3 = ExplodeTree(Data=ff_final)  # -> Branch0, Branch1, Branch2; disabled
shell_8 = Brep(bang_3.Branch0)
edges_10 = Geometry(bang_3.Branch2)
corners_9 = Geometry(bang_3.Branch1)
bang_4 = ExplodeTree(Data=ff_final)  # -> Branch0, Branch1, Branch2

# ---- group: Preliminary analysis
mesh_breps = MeshBrepsKaramba3D(
    Brep=shell_8,
    MeshResolution=Slider(0.095, range=0..1),
    EdgeRefinementFactor=0.67,
    PointReduction=Toggle(False),
    SmoothingStepSize=Slider(1, range=0..1),
    SmoothingIterations=Slider(1, range=0..10))  # -> Mesh, Info
thickness_m_2 = Number(thickness_m)
a_preliminaryshellanalysismodel = PreliminaryShellAnalysisModel(Mesh=mesh_breps.Mesh, Corners=corners_9, Thickness=thickness_m_2)
analyze = AnalyzeKaramba3D(Model=a_preliminaryshellanalysismodel)  # -> CalculatedModel, MaximumDisplacement_cm, ResultingForceOfGravity_kN, ElasticEnergy_kNm

# ----
thickness_m_3 = Number(thickness_m)
shell_9 = Brep(bang_4.Branch0)
edges_11 = Geometry(bang_4.Branch2)
corners_10 = Geometry(bang_4.Branch1)

# ---- group: structural model
srf_9 = Surface(shell_9)
thickness_m_4 = Number(thickness_m_3)
load_pattern = Slider(2, range=1..7)
image_2 = ImageSampler(Filter="Colour", Interpolate=False, Umax=1, Umin=0, Vmax=1, Vmin=0, Wrap=1)
srf_10 = Surface(srf_9)
edges_12 = BrepEdges(Brep=srf_10)  # -> Naked, Interior, NonManifold
load_pattern_2 = Integer(load_pattern)
mesh_breps_2 = MeshBrepsKaramba3D(
    Brep=srf_9,
    MeshResolution=Slider(0.1, range=0..1),
    EdgeRefinementFactor=Slider(0.2, range=0..1),
    PointReduction=False,
    SmoothingStepSize=Slider(1, range=0..1),
    SmoothingIterations=Slider(3, range=0..10))  # -> Mesh, Info
dead_load_kn_m2 = Slider(1, range=0..10)
culln = CullNth(List=edges_12.Naked, CullFrequency=2)
safety_factor = Slider(1.35, range=0..10)
corner_curves = Curve(corners_10)
mesh = Mesh(mesh_breps_2.Mesh)
live_load_kn_m2 = Slider(1.5, range=0..10)
safety_factor_2 = Slider(1.5, range=0..10)
multiplication_4 = Multiplication(A=safety_factor, B=dead_load_kn_m2)
Z_4 = UnitZ(Factor=safety_factor)
Z_5 = UnitZ(Factor=multiplication_4)
rev = Reverse(Vector=Z_4)
load_pattern_3 = Integer(load_pattern_2)
multiplication_5 = Multiplication(A=safety_factor_2, B=live_load_kn_m2)
rev_2 = Reverse(Vector=Z_5)
mesh_2 = Mesh(mesh)
asymmetrical_load_patterns = AsymmetricalLoadPatterns(mesh=mesh_2, int=load_pattern_3, load_kn_m2=multiplication_5)
loads = LoadsKaramba3D(Vector=rev_2, Mesh=mesh, mode="MeshLoad -Const.", menu=[buttons(off, off, on), buttons(on, on)])
loads_2 = LoadsKaramba3D(Vector=rev, mode="Gravity")
merge_4 = Merge(Data1=loads_2, Data2=loads, Data3=asymmetrical_load_patterns)  # -> flatten(Result)
matselect = MaterialSelectionKaramba3D(menu=[dropdown(3), dropdown(9)])
# Analyse whole shell
thickness_m_5 = Number(thickness_m_4)
fixes_supp = BooleanToggle(False)
a_preliminaryshellanalysismodel_2 = PreliminaryShellAnalysisModel(Mesh=mesh, Corners=corner_curves, Thickness=thickness_m_5, Material=matselect, Loads=merge_4, FixedSupport=fixes_supp)

# ---- group: Segment shell
a_stresslines = StressLines(
    Model=analyze.CalculatedModel,
    Shell=shell_8,
    Corners=corners_9,
    Edges=edges_10,
    KeystoneWidth=Slider(2, range=0..2),
    CornerstoneWidth=Slider(1.5, range=0..2),
    LengthParam1=Slider(2.7, range=0..3),
    LengthParam2=Slider(1.5, range=0..3))  # -> StressLines1, StressLines2, CableProfiles1, CableProfiles2
a_segment = Segment(Shell=shell_8, StressLines1=a_stresslines.StressLines1, StressLines2=a_stresslines.StressLines2)  # disabled

# ----
shellview = ShellViewKaramba3D(Model=analyze.CalculatedModel, IndexOfLayer=0)  # -> Model, MeshesOfRenderedShells, LegendColors, LegendTags
entwine_6 = Entwine(Branch00=a_stresslines.CableProfiles2, Branch01=a_stresslines.CableProfiles1, FlattenInputs=True)  # -> simplify(Result)
static_segmentations = StaticSegmentations()

cornerstone_width = Slider(1.5, range=0..2)
keystone_width = Slider(2, range=0..2)
get_stress_lines = GetStressLines(
    shell=shell_8,
    k3d_model=analyze.CalculatedModel,
    pour_width=Slider(1.5, range=0..3),
    pour_length=Slider(2.7, range=0..3),
    keystone_width=keystone_width,
    cornerstone_width=cornerstone_width)  # -> split_lines_4, cable_lines_4; disabled

legend = Legend(Colour=shellview.LegendColors, Tags=shellview.LegendTags, LegendType=1)

# ----
# TODO:
# adapt to actual segments (not flat)
list_11 = ValueList({"Split to edge": 0, "Split to corner": 1}, selected="Split to edge")
project_5 = Project(Geometry=a_segment, Plane=PlaneXY(0, 0, 0))  # -> Geometry, Transform
segment_subdivision_wip = SegmentSubdivisionWIP(shell=shell_8, model=analyze.CalculatedModel, proj_segments=project_5.Geometry, split_direction=list_11)  # disabled

# ----
# local optimisation of
# segment geometry
# as alternative to segment component
# 
# should in addition or be integrated
max_r = Slider(0.26, range=0..1)
genes_for_r = GenePool(
    Decimals=3,
    Maximum=1,
    Minimum=0,
    Value=[0.728, 0.278, 0.433, 0.626, 0.372, 0.386, 0.577, 0.602, 0.355, 0.402, 0.734, 0.343, 0.433, 0.4, 0.584, 0.602, 0.546, 0.339, 0.419, 0.149, 0.301, 0.008, 0.324, 0.386])
local_optimization = BooleanToggle(False)
genes_for_phi = GenePool(
    Decimals=3,
    Maximum=2,
    Minimum=0,
    Value=[0.427, 1.627, 0.784, 0.976, 1.468, 0.46, 1.011, 0.388, 0.825, 1.223, 1.146, 1.007, 0.773, 1.539, 1.505, 0.869, 0.424, 1.086, 1.514, 0.679, 1.331, 1.248, 1.135, 0.331])
entwine_7 = Entwine(Branch00=a_stresslines.StressLines1, Branch01=a_stresslines.StressLines2, FlattenInputs=True)  # disabled
get_projected_segments = GetProjectedSegments(
    shell=shell_8,
    stress_lines=entwine_7,
    maximum_deviation=max_r,
    local_optimization=local_optimization,
    phi_values=genes_for_phi,
    rho_values=genes_for_r)

s_forces = ShellForcesKaramba3D(AnalyzedModel=shellview.Model, LCase=0, mode="Principal")  # -> AnalyzedModel, FirstPrincipalNormalForce_kN_m, SecondPrincipalNormalForce_kN_m, FirstPrincipalMoment_kNm_m, SecondPrincipalMoment_kNm_m, ShearForceInLocalXDirection_kN_m, ShearForceInLocalYDirection_kN_m
shellvecresults = ResultVectorsOnShellsKaramba3D(AnalyzedModel=shellview.Model, LayerPosition=Slider(1, range=-1..1), mode="PrincStress")  # -> AnalyzedModel, Points, FirstPrincipalStressVector_kN_cm2, SecondPrincipalStressVector_kN_cm2, FirstPrincipalStressValue_kN_cm2, SecondPrincipalStressValue_kN_cm2
sort = SortList(Keys=shellvecresults.SecondPrincipalStressValue_kN_cm2, ValuesA=shellvecresults.FirstPrincipalStressValue_kN_cm2)  # -> Keys, ValuesA
panel_24 = Panel(sort.Keys)

# ---- group: # segments
geo_2 = Geometry(get_projected_segments)
lng_2 = ListLength(List=geo_2)
bbox_4 = BoundingBox(Content=geo_2, Plane=PlaneXY(0, 0, 0), UnionBox=True)  # -> Box, Box_2
volume = Volume(Geometry=bbox_4.Box)  # -> Volume, Centroid
tag = TextTag(Location=volume.Centroid, Text=lng_2)

# ----
larger = LargerThan(FirstNumber=sort.Keys, SecondNumber=sort.ValuesA)  # -> LargerThan, OrEqualTo
panel_25 = Panel(sort.ValuesA)
panel_26 = Panel(larger.LargerThan)

# ---- group: results
# Compressive strength : 20 - 40 MPa
# Tensile strength - σ : 2 - 5 MPa
# Modulus of elasticity - E : 14 - 41 GPa
# 
# (https://www.engineeringtoolbox.com/concrete-properties-d_1223.html)
model = ModelKaramba3D(a_preliminaryshellanalysismodel_2)
disassemble = DisassembleModelKaramba3D(Model=model)  # -> Model, Point, Beam, Shell, Support, Load, Line, Mesh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
analyzethii = AnalyzeThIIKaramba3D(Model=model, RTolerance=1e-07, MaxIterations=50, NoTensionalNII=False)  # -> CalculatedModel, MaximumDisplacement_cm, ResultingForceOfGravity_kN, ElasticEnergy_kNm
analyze_2 = AnalyzeKaramba3D(Model=model)  # -> CalculatedModel, MaximumDisplacement_cm, ResultingForceOfGravity_kN, ElasticEnergy_kNm
disassemble_2 = DisassembleElementKaramba3D(Element=disassemble.Shell)  # -> Element, ElementIdentifier, AxisOfElement, CrossSection, Joints, Material, LocalCoordinateSystem, ElementIsActive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
bmodes = BucklingModesKaramba3D(Model=analyzethii.CalculatedModel, FromIndex=1, NumberOfModes=1, MaximumNumberOfIterations=300, Epsilon=1e-07)  # -> ModelWithBucklingModesAsLoadCaseResults, BucklingLoadFactors
disassemble_3 = DisassembleMaterialKaramba3D(Material=disassemble_2.Material)  # -> Material, TypeOfMaterial, FamilyNameOfMaterial, NameOfMaterial, ElemIdentifiers, Color, YoungsModulusKNCm2Dir12, InPlaneShearModulus_kN_cm2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
multiplication_6 = Multiplication(A=disassemble_3.YieldStrengthKNCm2Dir12, B="10")
multiplication_7 = Multiplication(A=disassemble_3.YoungsModulusKNCm2Dir12, B="0.01")
percentile_stress = PercentileStress(model=analyze_2.CalculatedModel, include_2nd_ps=Toggle(True), percentile=Slider(99, range=90..100))  # -> max_comp_stress_mpa_3, max_comp_stress_mpa_4, max_tens_stress_mpa_4, max_tens_stress_mpa_3, extreme_stress_elements_2
modelview = ModelViewKaramba3D(Model=analyze_2.CalculatedModel, ResultFactors=1, ResultCase=-1)  # -> Model, DeformedMesh, DeformedAxes, DeformedModel
modelview_2 = ModelViewKaramba3D(Model=bmodes.ModelWithBucklingModesAsLoadCaseResults, ResultFactors=1, ResultCase=-1)  # -> Model, DeformedMesh, DeformedAxes, DeformedModel
elasticity_gpa = Number(multiplication_7)
compressive_strength_mpa = Number(multiplication_6)
max_displacement_cm = Number(analyzethii.MaximumDisplacement_cm)
buckling_safety_factors = Number(bmodes.BucklingLoadFactors)
panel_27 = Panel(elasticity_gpa)
shellview_2 = ShellViewKaramba3D(Model=modelview_2.Model, IndexOfLayer=0)  # -> Model, MeshesOfRenderedShells, LegendColors, LegendTags
shellview_3 = ShellViewKaramba3D(Model=modelview.Model, IndexOfLayer=0)  # -> Model, MeshesOfRenderedShells, LegendColors, LegendTags
panel_28 = Panel(compressive_strength_mpa)
merge_5 = Merge(
    Data1=flatten(percentile_stress.max_comp_stress_mpa_3),
    Data2=flatten(percentile_stress.max_comp_stress_mpa_4),
    Data3=flatten(percentile_stress.max_tens_stress_mpa_4),
    Data4=flatten(percentile_stress.max_tens_stress_mpa_3),
    Data5=flatten(buckling_safety_factors),
    Data6=flatten(max_displacement_cm))  # -> simplify(Result)
medges = MeshEdges(Mesh=shellview_3.MeshesOfRenderedShells)  # -> NakedEdges, InteriorEdges, NonManifoldEdges
legend_2 = Legend(Colour=shellview_3.LegendColors, Tags=shellview_3.LegendTags, LegendType=1)
medges_2 = MeshEdges(Mesh=shellview_2.MeshesOfRenderedShells)  # -> NakedEdges, InteriorEdges, NonManifoldEdges
legend_3 = Legend(Colour=shellview_2.LegendColors, Tags=shellview_2.LegendTags, LegendType=1)
panel_29 = Panel(merge_5)
crv_3 = Curve(medges.NakedEdges)
crv_4 = Curve(medges_2.NakedEdges)

# ----
# PINBED
# SIMULATION
# MISH:
# 
# CHANGED BBOX INPUT TO GRAFT TO EACH SEGMENT
# Calculate Modules
# slow due to
# Minimum Bounding Box
segments = Surface(a_segment)  # disabled
calculate_modules = CalculateModules(segments=segments)  # -> modules_2, avr_efficiency; disabled
simulate_pinbed = SimulatePinbed(segments=segments, modules=calculate_modules.modules_2)  # disabled
avr_efficiency = Number(calculate_modules.avr_efficiency)  # disabled
panel_30 = Panel(calculate_modules.avr_efficiency)  # disabled

# ----
# Visualise building
shell_bottom_height = Slider(2.6, range=0..10)
shell_bottom_height_2 = Number(shell_bottom_height)
thickness_m_6 = Number(thickness_m)  # disabled
segments_2 = Surface(a_segment)  # disabled
Z_6 = UnitZ(Factor=shell_bottom_height_2)
move_2 = Move(Geometry=segments_2, Motion=Z_6)  # -> Geometry, Transform
fillet_edges = BooleanToggle(False)
flatten_floor = FlattenFloor(segments=move_2.Geometry)
thicken_segments = ThickenSegments(segments=move_2.Geometry, thickness=thickness_m_6, fillet_edges=fillet_edges)  # -> shell_segments_2, corner_points_2
column_height = Slider(3, range=0..10)
column_radius = Slider(0.1, range=0..1)
make_columns = MakeColumns(corner_points=thicken_segments.corner_points_2, column_radius=column_radius, column_total_height=column_height)  # -> columns_2, column_tops_2
bracing = Bracing(columns=make_columns.columns_2)  # -> wall_diagonals_3, top_diagonals_3, top_edges_3
merge_6 = Merge(Data1=bracing.wall_diagonals_3, Data2=bracing.top_diagonals_3, Data3=bracing.top_edges_3)
merge_7 = Merge(Data1=thicken_segments.shell_segments_2, Data2=make_columns.columns_2, Data3=make_columns.column_tops_2)
merge_8 = Merge(Data1=merge_6, Data2=flatten_floor)
steel = Geometry(merge_8)
concrete = Geometry(merge_7)
preview = CustomPreview(Geometry=steel, Material=ColourSwatch(SwatchColor=RGB(117, 117, 117)))
preview_2 = CustomPreview(Geometry=concrete, Material=ColourSwatch(SwatchColor=RGB(207, 207, 207)))

galapagos = Galapagos(fitness=avr_efficiency, gene=[genes_for_r, genes_for_phi])
mesh_3 = Mesh(percentile_stress.extreme_stress_elements_2)
lor = Data([-12.46532366, -0.8249953181, 2.070751925, 15.54490841, 11.78721557, 0.3967481822])
merge_9 = Merge(Data1=crv_3, Data2=shellview_3.MeshesOfRenderedShells)
panel_31 = Panel(lor)
geo_vizshell = Geometry(merge_9)
mish_original = Data([-19.30257598, -0.7425017873, 2.177992639, 34.107802, 11.14650472, 0.4905725352])
panel_32 = Panel(mish_original)

# ---- group: isolines
number_slider_23 = Slider(8, range=0..10)  # disabled
number_slider_24 = Slider(5, range=0..10)  # disabled
number_slider_25 = Slider(7, range=0..10)  # disabled
one_over_x_7 = OneOverX(Value=number_slider_23)  # disabled
one_over_x_8 = OneOverX(Value=number_slider_24)  # disabled
one_over_x_9 = OneOverX(Value=number_slider_25)  # disabled
recgrid_3 = Rectangular(Plane=PlaneXY(0, 0, 0), SizeX=one_over_x_9, SizeY=one_over_x_8, ExtentX=number_slider_25, ExtentY=number_slider_24)  # -> Cells, Points; disabled
sqgrid_3 = Square(Plane=PlaneXY(0, 0, 0), Size=one_over_x_7, ExtentX=number_slider_23, ExtentY=number_slider_23)  # -> Cells, Points; disabled

# ----
number_slider_26 = Slider(1, range=0..1)  # disabled
extendsurface = CSharpScript(S=shell_2, L=number_slider_26)  # -> out, A; inputs S: Surface, L: Double; disabled
# ---------- extendsurface: C# ----------
    Surface srf = S;
    srf = srf.Extend(Rhino.Geometry.IsoStatus.West, L, true);
    srf = srf.Extend(Rhino.Geometry.IsoStatus.South, L, true);
    srf = srf.Extend(Rhino.Geometry.IsoStatus.East, L, true);
    srf = srf.Extend(Rhino.Geometry.IsoStatus.North, L, true);
    A = srf;
# ---------- end extendsurface ----------

project_6 = Project(Curve=corners_6, Brep=extendsurface.A, Direction=Vector(0, 0, 1))  # -> flatten(Curve); disabled
project_7 = Project(Curve=edges_7, Brep=extendsurface.A, Direction=Vector(0, 0, 1))  # -> flatten(Curve); disabled
merge_10 = Merge(Data1=project_6, Data2=project_7)  # -> reverse(Result); disabled
join_2 = JoinCurves(Curves=merge_10, Preserve=False)  # disabled

srfsplit_2 = SurfaceSplit(Surface=extendsurface.A, Curves=join_2)  # disabled
item_9 = ListItem(List=reverse(srfsplit_2), Index=0, Wrap=True)  # disabled
srf_11 = Surface(item_9)  # disabled

# ---- group: isolines (continued)
iso_3 = IsoCurve(Surface=reparameterize(srf_11), UVPoint=sqgrid_3.Points)  # -> UIsocurve, VIsocurve; disabled

# ----
shell_10 = Surface(srf_11)  # disabled
corners_11 = Curve(project_6)  # disabled
edges_13 = Curve(project_7)  # disabled
entwine_8 = Entwine(Branch00=shell_10, Branch01=corners_11, Branch02=edges_13, FlattenInputs=True)  # -> simplify(Result); disabled
ff_membrane_3 = Data(entwine_8)  # disabled

# ----
# Analyse segmented shell
number_slider_27 = Slider(0.01, range=0..0.1)
segments_3 = Surface(graft(a_segment))  # disabled
cables = Curve(entwine_6)  # disabled
segments_4 = Geometry(flatten(segments_3))
gap_size = Number(number_slider_27)
offset_surface_for_gap = OffsetSurfaceForGap(srf=segments_4, gap_size=gap_size)  # -> simplify(i)
cables_2 = BooleanToggle(True)
distance_between_connections = Slider(0.039, range=0..1)
segments_5 = Surface(segments_4)

wip_alternative_offset_meshing = WIPAlternativeOffsetMeshing(segments=segments_4, offset_segments=offset_surface_for_gap)

# ----
# if input cables disabled, split segments is same as input segments
cables_3 = Curve(cables)

embed_cables = EmbedCables(segments=offset_surface_for_gap, cables=cables_3)  # -> split_segments_2, split_cables_2
filter = StreamFilter(Gate=cables_2, Stream0=offset_surface_for_gap, Stream1=embed_cables.split_segments_2)
split_cables = Geometry(embed_cables.split_cables_2)
mesh_segments = MeshSegments(offset_segments=filter, mesh_resolution=Slider(0.05, range=0..0.1))
segments_mesh = Mesh(mesh_segments)
make_springs = MakeSprings(conn_dist=distance_between_connections, segments=segments_5, segments_mesh=segments_mesh)
karamba = Karamba(springs=make_springs, mesh=segments_mesh)

# ---- group: PT in mesh for Karamba
curveclosestmeshvert = CurveClosestMeshVert(segments=segments_mesh, cables=split_cables, tol=Slider(0.01, range=0..0.1))  # -> simplify(polyline_2)
posttensioning = PostTensioning(pt_force=Slider(16.618, range=0..100), cables=curveclosestmeshvert)  # -> simplify(pt_intersection_nodes_3), vec_pt_force_4, vec_end_force_2

# ==== cluster SimulatePinbed
segments = ClusterInput()
modules = ClusterInput()
modules_2 = Geometry(modules)
segments_2 = Geometry(segments)
item = ListItem(List=flatten(segments_2), Index=0, Wrap=True)
untrim = Untrim(Surface=item)
# Slow due to surface split
extend_segments = ExtendSegments(shell=untrim, modules=modules_2)
vmh = BooleanToggle(True)
ajust_module_heights = AjustModuleHeights(extended_segments=extend_segments, modules=modules_2, variable_module_height=vmh)

# ---- group: for viz
extended_segments = Surface(extend_segments)
segments_3 = Surface(segments_2)
modules_3 = Rectangle(ajust_module_heights)
merge = Merge(Data1=extended_segments, Data2=modules_3)
bbox = BoundingBox(Content=merge, Plane=modules_3, UnionBox=True)  # -> simplify(Box), Box_2
number_slider = Slider(6, range=0..10)
trim = TrimTree(Tree=extended_segments, Depth="2")
trim_2 = TrimTree(Tree=bbox.Box, Depth="2")
branch = TreeBranch(Tree=segments_3, Path=number_slider, MaintainPaths=True)
branch_2 = TreeBranch(Tree=trim, Path=number_slider, MaintainPaths=True)
branch_3 = TreeBranch(Tree=trim_2, Path=number_slider, MaintainPaths=True)
edges = BrepEdges(Brep=branch_3)  # -> Naked, Interior, NonManifold
edges_2 = BrepEdges(Brep=branch)  # -> Naked, Interior, NonManifold

# ----
calculate_pin_heights = CalculatePinHeights(extended_sub_segments=extend_segments, modules=ajust_module_heights)
visualise_pins = VisualisePins(crv=calculate_pin_heights)

# ==== cluster CalculateModules
segments = ClusterInput()
segments_2 = Surface(segments)
_3d_rotate = BooleanToggle(True)
fitbbox = FitBBox(segments=segments_2, _3d_rotate=_3d_rotate)
divide_segments = DivideSegments(bbs=fitbbox)
# OBSOLETE >>
# but it might be worth to color the modules according to configration, especially if unfeasable
calculate_efficiency = CalculateEfficiency(segments=segments_2, modules=divide_segments)
modules = Geometry(divide_segments)
modules_2 = ClusterOutput(modules)
segment_feasibility_2x2_4x1 = SegmentFeasibility2x24x1()  # disabled
avr_efficiency = ClusterOutput(calculate_efficiency)

# ==== cluster GetProjectedSegments
maximum_deviation = ClusterInput()
local_optimization = ClusterInput()
stress_lines = ClusterInput()
rho_values = ClusterInput()
phi_values = ClusterInput()
shell = ClusterInput()
shell_2 = Brep(shell)
stress_lines_2 = Curve(stress_lines)
rho_values_2 = Number(rho_values)
maximum_deviation_2 = Number(maximum_deviation)
local_optimization_2 = Boolean(local_optimization)
phi_values_2 = Number(phi_values)
shell_3 = Brep(shell_2)
edges = BrepEdges(Brep=shell_3)  # -> Naked, Interior, NonManifold

# ---- group: [OBSOLETE] intersect and polygonize
bang = ExplodeTree(Data=stress_lines_2)  # -> Branch0, Branch1; disabled
edge_cables = Curve(bang.Branch1)  # disabled
corner_cables = Curve(bang.Branch0)  # disabled
ccx = CurveCurve(CurveA=simplify(graft(corner_cables)), CurveB=edge_cables)  # -> Points, ParamsA, ParamsB; disabled
ccx_2 = CurveCurve(CurveA=corner_cables, CurveB=simplify(graft(edge_cables)))  # -> Points, ParamsA, ParamsB; disabled
trim = TrimTree(Tree=ccx.Points, Depth=1)  # disabled
trim_2 = TrimTree(Tree=ccx_2.Points, Depth=1)  # disabled
alongcrv = SortAlongCurve(Points=trim, Curve=graft(corner_cables))  # -> Points, Indices; disabled
alongcrv_2 = SortAlongCurve(Points=trim_2, Curve=graft(edge_cables))  # -> Points, Indices; disabled
pline = PolyLine(Vertices=alongcrv.Points, Closed=False)  # disabled
pline_2 = PolyLine(Vertices=alongcrv_2.Points, Closed=False)  # disabled
merge = Merge(Data1=pline, Data2=pline_2)  # -> simplify(Result); disabled
trim_3 = TrimTree(Tree=merge, Depth=1)  # disabled
poly_cables = Curve(flatten(trim_3))  # disabled

# ----
project = Project(Geometry=edges.Naked, Plane=PlaneXY(0, 0, 0))  # -> Geometry, Transform
join = JoinCurves(Curves=project.Geometry, Preserve=False)
intersect_stress_lines = IntersectStressLines(stress_lines=stress_lines_2)
surface_plan = Curve(join)
jiggle_points = JigglePoints(
    intersection_points=intersect_stress_lines,
    maximum_deviation=maximum_deviation_2,
    phi_values=phi_values_2,
    rho_values=rho_values_2,
    curves_to_snap=surface_plan)
intersection_points = Point(intersect_stress_lines)
local_optimization_3 = Boolean(local_optimization_2)
jiggled_points = Point(jiggle_points)
filter = StreamFilter(Gate=local_optimization_3, Stream0=intersection_points, Stream1=jiggled_points)
make_segments = MakeSegments(stress_lines=stress_lines_2, intersection_points=filter, tolerance=maximum_deviation_2)
make_keystone = MakeKeystone(surface_plan=surface_plan, intersection_points=filter)
merge_2 = Merge(Data1=make_keystone, Data2=make_segments)  # -> flatten(Result)
brep = Brep(surface_plan)
srfsplit = SurfaceSplit(Surface=brep, Curves=merge_2)
straight_proj_segments = Surface(srfsplit)
straight_proj_segments_2 = ClusterOutput(straight_proj_segments)

# ==== cluster StaticSegmentations
manualopt02_1_4 = Curve([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])
manualopt01 = Curve([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])
xz = XZPlane(Origin=Point(0, 0, 0))
crv = Curve(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)
_6x6_segments = Surface([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])
lor_segments = Surface([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])
geo = Geometry(manualopt02_1_4)
mirror = Mirror(Geometry=geo, Plane=xz)  # -> Geometry, Transform
edges = BrepEdges(Brep=lor_segments)  # -> Naked, Interior, NonManifold
merge = Merge(Data1=geo, Data2=mirror.Geometry)
yz = YZPlane(Origin=Point(0, 0, 0))
join = JoinCurves(Curves=edges.Naked, Preserve=False)
mirror_2 = Mirror(Geometry=merge, Plane=yz)  # -> Geometry, Transform
merge_2 = Merge(Data1=merge, Data2=mirror_2.Geometry, Data3=crv)
boundary = BoundarySurfaces(Edges=merge_2)
segments = Surface(_6x6_segments)
segments_2 = ClusterOutput(segments)

# ==== cluster SegmentSubdivisionWIP
split_direction = ClusterInput()
proj_segments = ClusterInput()
shell = ClusterInput()
model = ClusterInput()
shell_2 = Surface(shell)
model_2 = ModelKaramba3D(model)
split_direction_2 = Integer(split_direction)
proj_segments_2 = Surface(proj_segments)
split_to_corner = Slider(0.646, range=0..1)  # disabled
split_to_edge = Slider(0.5, range=0..1)
num = Number(split_to_corner)
merge = Merge(Data1="0", Data2=num, Data3="1")

srf = Surface(proj_segments_2)
bbox = BoundingBox(Content=srf, Plane=PlaneXY(0, 0, 0), UnionBox=True)  # -> Box, Box_2
area = Area(Geometry=bbox.Box)  # -> Area, Centroid
box_corners = BoxCorners(Box=bbox.Box)  # -> CornerA, CornerB, CornerC, CornerD, CornerE, CornerF, CornerG, CornerH
panel = Panel("exclude keystone + cornerstones")
merge_2 = Merge(Data1=box_corners.CornerA, Data2=box_corners.CornerB, Data3=box_corners.CornerC, Data4=box_corners.CornerD)
area_2 = Area(Geometry=srf)  # -> Area, Centroid; disabled
merge_3 = Merge(Data1=area.Centroid, Data2=merge_2)

debrep = DeconstructBrep(Brep=srf)  # -> Faces, Edges, simplify(Vertices)
join = JoinCurves(Curves=debrep.Edges, Preserve=False)  # -> simplify(Curves)
area_3 = Area(Geometry=join)  # -> Area, flatten(Centroid)

cp = ClosestPoint(Point=merge_3, Cloud=area_3.Centroid)  # -> ClosestPoint, CPIndex, Distance
cull_i = CullIndex(List=srf, Indices=cp.CPIndex, Wrap=True)

item = ListItem(List=cull_i, Index=Slider(7, range=0..10), Wrap=True)

# ----
# rebuild segment surfaces with appropriate UV space
srf_2 = Surface(simplify(graft(cull_i)))
crv = Curve(srf_2)
bbox_2 = BoundingBox(Content=flatten(crv), Plane=PlaneXY(0, 0, 0), UnionBox=True)  # -> Box, Box_2
area_4 = Area(Geometry=crv)  # -> Area, Centroid
volume = Volume(Geometry=bbox_2.Box)  # -> Volume, Centroid
vec2pt = Vector2Pt(PointA=area_4.Centroid, PointB=volume.Centroid, Unitize=False)  # -> Vector, Length
loft_opt = LoftOptions(Closed=False, Adjust=Toggle(True), Rebuild=0, Refit=0, Type=0)

simplify = SimplifyCurve(Curve=crv)  # -> Curve, Simplified

# ---- group: to which support should each segment look at
# get support points
# (temporary, only works for rectangles)
# determine edge closest to support
srf_3 = Surface(srf_2)
bbox_3 = BoundingBox(Content=flatten(srf_3), Plane=PlaneXY(0, 0, 0), UnionBox=True)  # -> Box, Box_2
box_corners_2 = BoxCorners(Box=bbox_3.Box)  # -> CornerA, CornerB, CornerC, CornerD, CornerE, CornerF, CornerG, CornerH
merge_4 = Merge(Data1=box_corners_2.CornerA, Data2=box_corners_2.CornerB, Data3=box_corners_2.CornerC, Data4=box_corners_2.CornerD)
area_5 = Area(Geometry=srf_3)  # -> Area, Centroid; disabled

# ----
debrep_2 = DeconstructBrep(Brep=srf_3)  # -> Faces, Edges, simplify(Vertices)
join_2 = JoinCurves(Curves=debrep_2.Edges, Preserve=False)  # -> simplify(Curves)
area_6 = Area(Geometry=join_2)  # -> Area, Centroid

# ---- group: to which support should each segment look at (continued)
cp_2 = ClosestPoint(Point=area_6.Centroid, Cloud=merge_4)  # -> ClosestPoint, CPIndex, Distance

# ----
vec2pt_2 = Vector2Pt(PointA=area_4.Centroid, PointB=cp_2.ClosestPoint, Unitize=False)  # -> Vector, Length
explode = Explode(Curve=simplify.Curve, Recursive=True)  # -> simplify(Segments), simplify(Vertices)
pl = ConstructPlane(Origin=area_4.Centroid, XAxis=vec2pt_2.Vector, YAxis=vec2pt.Vector)
cull_i_2 = CullIndex(List=explode.Vertices, Indices="0", Wrap=True)
cir = Circle(Plane=pl, Radius="0.2")
alongcrv = SortAlongCurve(Points=cull_i_2, Curve=cir)  # -> Points, Indices
item_2 = ListItem(List=alongcrv.Points, Index=0, Wrap=True)  # -> Item, Item1, Item2, Item3
ln = Line(StartPoint=item_2.Item3, EndPoint=item_2.Item2)
ln_2 = Line(StartPoint=item_2.Item, EndPoint=item_2.Item1)
merge_5 = Merge(Data1=ln_2, Data2=ln)  # -> simplify(Result)
loft = Loft(Curves=merge_5, Options=loft_opt)

# ---- group: number points in closed polyline
pt = Point(simplify(alongcrv.Points))
pline = PolyLine(Vertices=pt, Closed="True")
area_7 = Area(Geometry=pline)  # -> Area, simplify(Centroid)
vec2pt_3 = Vector2Pt(PointA=pt, PointB=area_7.Centroid, Unitize="True")  # -> Vector, Length
lng = ListLength(List=pt)
multiplication = Multiplication(A=vec2pt_3.Vector, B=Slider(0.312, range=0..1))
move = Move(Geometry=pt, Motion=multiplication)  # -> Geometry, Transform
series = Series(Start=0, Step=1, Count=lng)
tag = TextTag(Location=move.Geometry, Text=series)

# ---- group: split using PSlines
md_slider = MDSlider(SliderMode=0, slider_value=Point(0.5, 0.5, 0.5), x_domain=Domain(0, 1), y_domain=Domain(0, 1), z_domain=Domain(0, 1))
srf_4 = Surface(loft)
evalsrf = EvaluateSurface(Surface=reparameterize(srf_4), Point=md_slider)  # -> Point, Normal, UDirection, VDirection, Frame
Z = UnitZ(Factor=1)
shell_3 = Surface(shell_2)
project = ProjectPoint(Point=evalsrf.Point, Direction=Z, Geometry=shell_3)  # -> Point, Index
model_3 = ModelKaramba3D(model_2)
shelllineresults = LineResultsOnShellsKaramba3D(
    AnalyzedModel=model_3,
    LayerPosition=Slider(0, range=-1..1),
    ListOfSourcesOfPrincipalStressLinesLinesPoints=project.Point,
    SegmentLength_m=0.5,
    DA_deg=5,
    mode="PrincStress")  # -> AnalyzedModel, Lines1, Lines2
crv_2 = Curve(shelllineresults.Lines2)
crv_3 = Curve(shelllineresults.Lines1)
trim = TrimTree(Tree=simplify(crv_3), Depth=1)
trim_2 = TrimTree(Tree=simplify(crv_2), Depth=1)
join_3 = JoinCurves(Curves=trim, Preserve=False)
join_4 = JoinCurves(Curves=trim_2, Preserve=False)
project_2 = Project(Geometry=join_3, Plane=PlaneXY(0, 0, 0))  # -> simplify(Geometry), Transform
project_3 = Project(Geometry=join_4, Plane=PlaneXY(0, 0, 0))  # -> simplify(Geometry), Transform
split_direction_3 = Integer(split_direction_2)
merge_6 = Merge(Data1=project_2.Geometry, Data2=project_3.Geometry)
crv_4 = Curve(srf_4)
item_3 = ListItem(List=merge_6, Index=split_direction_3, Wrap=True)
ccx = CurveCurve(CurveA=crv_4, CurveB=item_3)  # -> Points, ParamsA, ParamsB
toggle = BooleanToggle(False)
pline_2 = PolyLine(Vertices=ccx.Points, Closed=False)
srfsplit = SurfaceSplit(Surface=srf_4, Curves=pline_2)

# ---- group: split to edge
srf_5 = Surface(loft)
divide = DivideDomain²(Domain=srf_5, UCount=Slider(1, range=1..2), VCount=Slider(2, range=1..2))
subsrf = Isotrim(Surface=srf_5, Domain=divide)

# ----
split_segments = Geometry(simplify(srfsplit))
split_segments_2 = ClusterOutput(split_segments)

# ---- group: split to both
num_2 = Number(split_to_edge)
srf_6 = Surface(loft)
merge_7 = Merge(Data1="0", Data2=num_2, Data3="1")
panel_2 = Panel("False")
consec = ConsecutiveDomains(Numbers=merge_7, Additive=panel_2)

# ----
consec_2 = ConsecutiveDomains(Numbers=merge, Additive=panel_2)
crossref = CrossReference(ListA=consec, ListB=consec_2, CrossMode=1)  # -> ListA, ListB

# ---- group: split to both (continued)
dom² = ConstructDomain²(DomainU=crossref.ListA, DomainV=crossref.ListB)
subsrf_2 = Isotrim(Surface=reparameterize(srf_6), Domain=dom²)

# ==== cluster FlattenFloor
segments = ClusterInput()

# ---- group: generate fl
segments_2 = Surface(segments)
item = ListItem(List=flatten(segments_2), Index=0, Wrap=True)
bbox = BoundingBox(Content=flatten(segments_2), Plane=PlaneXY(0, 0, 0), UnionBox=True)  # -> Box, Box_2
untrim = Untrim(Surface=item)
box = EvaluateBox(Box=bbox.Box, UParameter=0.5, VParameter=0.5, WParameter="1")  # -> Plane, Point, Include
sec = BrepPlane(Brep=bbox.Box, Plane=box.Plane)  # -> Curves, Points
neg = Negative(Value=Slider(0.442, range=0..1))
offset = OffsetCurve(Curve=sec.Curves, Distance=neg, Plane=PlaneXY(0, 0, 0), Corners=1)
Z = UnitZ(Factor=Slider(0.05, range=0..0.1))
boundary = BoundarySurfaces(Edges=sec.Curves)
boundary_2 = BoundarySurfaces(Edges=offset)
sdivide = DivideSurface(Surface=boundary_2, UCount=10, VCount=10)  # -> simplify(graft(Points)), Normals, Parameters
extr = Extrude(Base=boundary, Direction=Z)
project = ProjectPoint(Point=sdivide.Points, Direction=Vector(0, 0, -1), Geometry=untrim)  # -> Point, Index
number_slider = Slider(0.03, range=0..0.1)
merge = Merge(Data1=sdivide.Points, Data2=project.Point)
neg_2 = Negative(Value=number_slider)
pline = PolyLine(Vertices=merge, Closed=False)
ext = ExtendCurve(Curve=pline, Type=0, Start="0", End=neg_2)
pipe = Pipe(Curve=ext, Radius=number_slider, Caps=0)
merge_2 = Merge(Data1=extr, Data2=pipe)
flat_floor = Geometry(merge_2)

# ----
flat_floor_2 = ClusterOutput(flat_floor)

# ==== cluster ThickenSegments
fillet_edges = ClusterInput()
thickness = ClusterInput()
segments = ClusterInput()
fillet_edges_2 = Boolean(fillet_edges)
thickness_2 = Number(thickness)
segments_2 = Surface(segments)
Z = UnitZ(Factor=thickness_2)
extr = Extrude(Base=segments_2, Direction=Z)
brep = Brep(extr)
dispatch = Dispatch(List=brep, DispatchPattern=fillet_edges_2)  # -> ListA, ListB

# ---- group: enable for filleted edges
edges = BrepEdges(Brep=brep)  # -> Naked, Interior, NonManifold
lng = ListLength(List=edges.Interior)
series = Series(Start=0, Step=1, Count=lng)  # -> simplify(Series)
filedge = FilletEdge(Shape=dispatch.ListA, Blend=0, Metric=0, Edges=series, Radii=Slider(0.02, range=0..0.03))

# ----
filter = StreamFilter(Gate=fillet_edges_2, Stream0=brep, Stream1=filedge)
bbox = BoundingBox(Content=flatten(filter), Plane=PlaneXY(0, 0, 0), UnionBox=True)  # -> Box, Box_2
box_corners = BoxCorners(Box=bbox.Box)  # -> CornerA, CornerB, CornerC, CornerD, CornerE, CornerF, CornerG, CornerH
merge = Merge(Data1=box_corners.CornerA, Data2=box_corners.CornerB, Data3=box_corners.CornerC, Data4=box_corners.CornerD)
shell_segments = Brep(filter)
corner_points = Point(merge)
shell_segments_2 = ClusterOutput(shell_segments)
corner_points_2 = ClusterOutput(corner_points)

# ==== cluster Bracing
columns = ClusterInput()
columns_2 = Brep(columns)
bbox = BoundingBox(Content=columns_2, Plane=PlaneXY(0, 0, 0))  # -> Box, Box_2
boxsize = BoxSize(box=bbox.Box)  # -> X_2, Y_2, Z_2, A_2, V_2
brace_offset = Slider(0.15, range=0..0.2)
shell_bottom_height = Number(boxsize.Z_2)
subtraction = Subtraction(A=shell_bottom_height, B=brace_offset)
box = EvaluateBox(Box=bbox.Box, UParameter=0.5, VParameter=0.5, WParameter="0")  # -> Plane, Point, Include
Z = UnitZ(Factor=subtraction)
Z_2 = UnitZ(Factor=brace_offset)
pt = Point(box.Point)
move = Move(Geometry=pt, Motion=Z)  # -> Geometry, Transform
move_2 = Move(Geometry=pt, Motion=Z_2)  # -> Geometry, Transform
merge = Merge(Data1=move_2.Geometry, Data2=move.Geometry)
bbox_2 = BoundingBox(Content=merge, Plane=PlaneXY(0, 0, 0), UnionBox=True)  # -> Box, Box_2
pline = PolyLine(Vertices=move.Geometry, Closed=True)
box_corners = BoxCorners(Box=bbox_2.Box)  # -> CornerA, CornerB, CornerC, CornerD, CornerE, CornerF, CornerG, CornerH
box_corners_2 = BoxCorners(Box=bbox_2.Box)  # -> CornerA, CornerB, CornerC, CornerD, CornerE, CornerF, CornerG, CornerH
explode = Explode(Curve=pline, Recursive=True)  # -> Segments, Vertices
ln = Line(StartPoint=box_corners.CornerF, EndPoint=box_corners.CornerH)
ln_2 = Line(StartPoint=box_corners.CornerE, EndPoint=box_corners.CornerG)
ln_3 = Line(StartPoint=box_corners_2.CornerC, EndPoint=box_corners_2.CornerF)
ln_4 = Line(StartPoint=box_corners_2.CornerB, EndPoint=box_corners_2.CornerG)
ln_5 = Line(StartPoint=box_corners_2.CornerC, EndPoint=box_corners_2.CornerH)
ln_6 = Line(StartPoint=box_corners_2.CornerD, EndPoint=box_corners_2.CornerG)
merge_2 = Merge(Data1=ln_3, Data2=ln_4, Data3=ln_5, Data4=ln_6)
merge_3 = Merge(Data1=ln_2, Data2=ln)
top_edges = Geometry(explode.Segments)
wall_diagonals = Geometry(merge_2)
top_diagonals = Geometry(merge_3)
entwine = Entwine(Branch00=wall_diagonals, Branch01=top_diagonals, Branch02=top_edges, FlattenInputs=True)  # -> simplify(graft(Result))
merge_4 = Merge(Data1=wall_diagonals, Data2=top_diagonals, Data3=top_edges)  # -> flatten(Result)
number_slider = Slider(0.02, range=0..0.1)
crv = Curve(merge_4)
bcx = BrepCurve(Brep=flatten(columns_2), Curve=entwine)  # -> Curves, Points
pipe = Pipe(Curve=entwine, Radius=number_slider, Caps=0)  # -> simplify(Pipe)
multiplication = Multiplication(A=number_slider, B=Slider(1.3, range=1..2))
sph = Sphere(Base=bcx.Points, Radius=multiplication)  # -> simplify(Sphere)
trim = TrimTree(Tree=pipe, Depth=1)
trim_2 = TrimTree(Tree=sph, Depth="2")
bang = ExplodeTree(Data=trim)  # -> Branch0, Branch1, Branch2
bang_2 = ExplodeTree(Data=trim_2)  # -> Branch0, Branch1, Branch2
wall_diagonals_2 = Geometry([bang.Branch0, bang_2.Branch0])
top_diagonals_2 = Geometry([bang.Branch1, bang_2.Branch1])
top_edges_2 = Geometry([bang.Branch2, bang_2.Branch2])
top_diagonals_3 = ClusterOutput(top_diagonals_2)
wall_diagonals_3 = ClusterOutput(wall_diagonals_2)
top_edges_3 = ClusterOutput(top_edges_2)

# ==== cluster MakeColumns
corner_points = ClusterInput()
column_radius = ClusterInput()
column_total_height = ClusterInput()
corner_points_2 = Point(corner_points)
corner_points_3 = Point(corner_points_2)
column_radius_2 = Number(column_radius)
project = Project(Geometry=corner_points_3, Plane=PlaneXY(0, 0, 0))  # -> Geometry, Transform
column_total_height_2 = Number(column_total_height)
dist = Distance(PointA=simplify(graft(corner_points_3)), PointB=simplify(graft(project.Geometry)))  # -> flatten(Distance)
subtraction = Subtraction(A=column_total_height_2, B=dist)
column_height = Number(dist)
column_bottom = Point(project.Geometry)
column_top_height = Number(subtraction)
column_radius_3 = Number(column_radius_2)
Z = UnitZ(Factor=column_height)
multiplication = Multiplication(A=column_radius_3, B=Slider(2.3, range=0..10))
multiplication_2 = Multiplication(A=column_radius_3, B=Slider(4.4, range=0..10))
move = Move(Geometry=column_bottom, Motion=Z)  # -> Geometry, Transform
neg = Negative(Value=multiplication_2)
cyl = Cylinder(Base=column_bottom, Radius=column_radius_2, Length=column_height)
cyl_2 = Cylinder(Base=move.Geometry, Radius=column_radius_2, Length=column_top_height)
cone = Cone(Base=corner_points_2, Radius=multiplication, Length=neg)  # -> Cone, Tip
cyl_3 = Cylinder(Base=corner_points_2, Radius=Slider(0.2, range=0..1), Length=Slider(0.08, range=0..0.1))
cap = CapHoles(Brep=cone.Cone)
cap_2 = CapHoles(Brep=cyl_3)
cap_3 = CapHoles(Brep=cyl)
cap_4 = CapHoles(Brep=cyl_2)
merge = Merge(Data1=cap_2, Data2=cap, Data3=cap_3)
sunion = SolidUnion(Breps=merge)
column_tops = Brep(cap_4)
columns = Brep(sunion)
columns_2 = ClusterOutput(columns)
column_tops_2 = ClusterOutput(column_tops)

# ==== cluster OffsetSurfaceForGap
srf = ClusterInput()
test_surface = TestSurface()
gap_size = ClusterInput()
srf_2 = Surface(simplify(graft(srf)))
gap_size_2 = Number(gap_size)
division = Division(A=gap_size_2, B=2)
edges = BrepEdges(Brep=srf_2)  # -> simplify(Naked), Interior, NonManifold
offsets = OffsetOnSrf(Curve=edges.Naked, Distance=division, Surface=srf_2)
trim = TrimTree(Tree=offsets, Depth=1)
srfsplit = SurfaceSplit(Surface=srf_2, Curves=trim)
area = Area(Geometry=srfsplit)  # -> Area, Centroid
sort = SortList(Keys=area.Area, ValuesA=srfsplit)  # -> Keys, ValuesA
item = ListItem(List=reverse(sort.ValuesA), Index=0, Wrap=True)
i = ClusterOutput(item)

# ==== cluster MakeSprings
segments_mesh = ClusterInput()
segments = ClusterInput()
segments_2 = Surface(segments)
segments_mesh_2 = Mesh(flatten(segments_mesh))

# ---- group: determine internal edges + topology
join = BrepJoin(Breps=segments_2)  # -> Breps, Closed
debrep = DeconstructBrep(Brep=join.Breps)  # -> Faces, Edges, Vertices
topology = BrepTopology(Brep=join.Breps, PerspectiveOnly=False)  # -> FaceFaceAdjacency, FaceEdgeAdjacency, simplify(EdgeFaceAdjacency)
lng = ListLength(List=topology.EdgeFaceAdjacency)
larger = LargerThan(FirstNumber=lng, SecondNumber="2")  # -> LargerThan, OrEqualTo
dispatch = Dispatch(List=topology.EdgeFaceAdjacency, DispatchPattern=larger.OrEqualTo)  # -> ListA, ListB
clean = CleanTree(RemoveNulls=True, RemoveInvalid=True, RemoveEmpty=Toggle(True), Tree=dispatch.ListA)
tstat = TreeStatistics(Tree=clean)  # -> Paths, Length, Count
dpath = DeconstructPath(Branch=tstat.Paths)
item = ListItem(List=debrep.Edges, Index=flatten(dpath), Wrap=True)
match = MatchTree(Tree=graft(item), Guide=clean)
adjacent_faces = Integer(clean)
internal_edges = Curve(match)

# ---- group: determine gap size
segments_mesh_3 = Mesh(graft(segments_mesh_2))
segments_3 = Surface(graft(segments_2))
medges = MeshEdges(Mesh=segments_mesh_3)  # -> NakedEdges, InteriorEdges, NonManifoldEdges
debrep_2 = DeconstructBrep(Brep=segments_3)  # -> Faces, Edges, Vertices
join_2 = JoinCurves(Curves=medges.NakedEdges, Preserve=False)  # -> simplify(Curves)
join_3 = JoinCurves(Curves=debrep_2.Edges, Preserve=False)  # -> simplify(Curves)
explode = Explode(Curve=join_2, Recursive=True)  # -> Segments, Vertices
pt = Point(explode.Vertices)
crv_cp = CurveClosestPoint(Point=pt, Curve=join_3)  # -> Point, Parameter, Distance
sort = SortList(Keys=crv_cp.Distance)  # -> Keys, ValuesA
item_2 = ListItem(List=sort.Keys, Index=0, Wrap=True)
avr = Average(Input=flatten(item_2))
multiplication = Multiplication(A=avr, B=2)
gap_size = Number(multiplication)

# ----
gap_size_2 = Number(gap_size)

# ---- group: mesh vertices on curves
item_3 = ListItem(List=segments_mesh_2, Index=adjacent_faces, Wrap=True)
crv = Curve(internal_edges)
demesh = DeconstructMesh(Mesh=item_3)  # -> Vertices, Faces, Colours, Normals
repeat = RepeatData(Data=crv, Length="2")  # -> simplify(graft(Data))
pull = PullPoint(Point=demesh.Vertices, Geometry=repeat, ClosestOnly=True)  # -> ClosestPoint, Distance
smaller = SmallerThan(FirstNumber=pull.Distance, SecondNumber=gap_size_2)  # -> SmallerThan, OrEqualTo
cull = CullPattern(List=demesh.Vertices, CullPattern=smaller.SmallerThan)  # -> simplify(List)
alongcrv = SortAlongCurve(Points=cull, Curve=repeat)  # -> simplify(Points), Indices

# ----
number_slider = Slider(0.221, range=0..3)
conn_dist = ClusterInput()
conn_dist_2 = Number(conn_dist)

# ---- group: select points according to connection distance (approx.)
shatter = Shatter(Curve=reparameterize(repeat), Parameters=".5")  # -> simplify(Segments)
item_4 = ListItem(List=shatter, Index=0, Wrap=True)  # -> Item, Item1
flip = FlipCurve(Curve=item_4.Item)  # -> Curve, Flag
merge = Merge(Data1=flip.Curve, Data2=item_4.Item1)
divlength = DivideLength(Curve=merge, Length=conn_dist_2)  # -> simplify(Points), Tangents, Parameters
trim = TrimTree(Tree=divlength.Points, Depth=1)
rdpoints = RemoveDuplicatePointsKaramba3D(Point=trim, LimitDistance=0.005)  # -> OutPoint, Info, Indexes

# ----
cp = ClosestPoint(Point=rdpoints.OutPoint, Cloud=alongcrv.Points)  # -> ClosestPoint, CPIndex, Distance
rdpoints_2 = RemoveDuplicatePointsKaramba3D(Point=cp.ClosestPoint, LimitDistance=0.005)  # -> OutPoint, Info, Indexes
pt_2 = Point(simplify(graft(rdpoints_2.OutPoint)))
path_mapper = PathMapper(pt_2, source="{A;B;C}", target="{A;C;B}")
pt_3 = Point(path_mapper)
trim_2 = TrimTree(Tree=pt_3, Depth=1)
item_5 = ListItem(List=trim_2, Index=0, Wrap=True)  # -> Item, Item1
ln = Line(StartPoint=item_5.Item, EndPoint=item_5.Item1)
springs = Line(ln)
springs_2 = ClusterOutput(springs)
spring_angles = SpringAngles(crv=springs)

# ==== cluster CurveClosestMeshVert
number_slider = Slider(8, range=0..100)
segments = ClusterInput()
cables = ClusterInput()
tol = ClusterInput()
tol_2 = Number(tol)
segments_2 = Mesh(segments)
number_slider_2 = Slider(0.01, range=0..0.01)
cables_2 = Curve(cables)
branch = TreeBranch(Tree=segments_2, Path=number_slider, MaintainPaths=True)
branch_2 = TreeBranch(Tree=cables_2, Path=number_slider, MaintainPaths=True)
mesh = Mesh(segments_2)
curve = Curve(cables_2)

# ---- group: exclude segments without cables
tstat = TreeStatistics(Tree=cables_2)  # -> Paths, Length, Count
branch_3 = TreeBranch(Tree=mesh, Path=tstat.Paths, MaintainPaths=True)

# ----
deconstruct_mesh = DeconstructMesh(Mesh=branch_3)  # -> simplify(Vertices), Faces, Colours, Normals

# ---- group: "manual" cross reference
group = Group(Objects=deconstruct_mesh.Vertices)
lng = ListLength(List=curve)
repeat = RepeatData(Data=group, Length=lng)  # -> simplify(Data)
ungroup = Ungroup(Group=repeat)

# ----
curve_2 = Curve(graft(curve))
pull = PullPoint(Point=ungroup, Geometry=curve_2, ClosestOnly=True)  # -> ClosestPoint, Distance
smaller = SmallerThan(FirstNumber=pull.Distance, SecondNumber=tol_2)  # -> SmallerThan, OrEqualTo
dispatch = Dispatch(List=pull.ClosestPoint, DispatchPattern=smaller.SmallerThan)  # -> ListA, ListB
pt = Point(dispatch.ListA)
sort_along_curve = SortAlongCurve(Points=pt, Curve=curve_2)  # -> simplify(Points), Indices
cullpt = CullDuplicates(Points=sort_along_curve.Points, Tolerance=tol_2, CullMode=3)  # -> Points, Indices, Valence
polyline = PolyLine(Vertices=cullpt.Points, Closed=False)
polyline_2 = ClusterOutput(polyline)

# ==== cluster PostTensioning
cables = ClusterInput()
pt_force = ClusterInput()
cables_2 = Geometry(cables)
pt_force_2 = Number(pt_force)

# ----
# PT forces
pt_kn = Number(pt_force_2)
crv = Curve(cables_2)
flip = FlipCurve(Curve=crv)  # -> Curve, Flag
explode = Explode(Curve=crv, Recursive=True)  # -> Segments, simplify(Vertices)
crv_2 = Curve(crv)
lng = ListLength(List=explode.Vertices)
series = Series(Start=0, Step=1, Count=lng)  # -> simplify(Series)
int = Integer(series)
neg = Negative(Value=int)
eval = EvaluateCurve(Curve=graft(crv_2), Parameter=int)  # -> Point, Tangent, Angle
eval_2 = EvaluateCurve(Curve=graft(flip.Curve), Parameter=neg)  # -> Point, Tangent, Angle
pt_intersection_nodes = Point(eval.Point)

intcrv = Interpolate(Vertices=explode.Vertices, Degree=3, Periodic=False, KnotStyle=1)  # -> Curve, Length, Domain
nurbs = NurbsCurve(Vertices=explode.Vertices, Degree=3, Periodic=False)  # -> Curve, Length, Domain
crvgraph = CurvatureGraph(Curve=intcrv.Curve, Density=5, Scale=Slider(103, range=0..120))
crossref = CrossReference(ListA=graft(pt_kn), ListB=eval.Point, CrossMode=1)  # -> ListA, ListB

amp = Amplitude(Vector=eval_2.Tangent, Amplitude=simplify(crossref.ListA))
amp_2 = Amplitude(Vector=eval.Tangent, Amplitude=simplify(crossref.ListA))
addition = Addition(A=amp_2, B=amp)
vdis = VectorDisplay(Anchor=pt_intersection_nodes, Vector=amp)
vdis_2 = VectorDisplay(Anchor=pt_intersection_nodes, Vector=amp_2)
vec_pt_force = Vector(addition)
vdis_3 = VectorDisplay(Anchor=pt_intersection_nodes, Vector=vec_pt_force)

item = ListItem(List=reverse(amp_2), Index=0, Wrap=True)
item_2 = ListItem(List=reverse(eval.Point), Index=0, Wrap=True)
item_3 = ListItem(List=eval_2.Point, Index=0, Wrap=True)
item_4 = ListItem(List=amp, Index=0, Wrap=True)
vdis_endforce = VectorDisplay(Anchor=item_2, Vector=item)
vdis_endforce_2 = VectorDisplay(Anchor=item_3, Vector=item_4)
merge = Merge(Data1=item, Data2=item_4)
pt_intersection_nodes_2 = Point(pt_intersection_nodes)
vec_end_force = Vector(merge)
vec_pt_force_2 = Vector(addition)
vec_end_force_2 = ClusterOutput(vec_end_force)
move = Move(Geometry=pt_intersection_nodes_2, Motion=vec_pt_force_2)  # -> Geometry, Transform

# ---- group: pair up curve intersection points by index, returns uniques
vec_pt_force_3 = Vector(flatten(vec_pt_force))
pt = Point(flatten(pt_intersection_nodes))
rdpoints = RemoveDuplicatePointsKaramba3D(Point=pt, LimitDistance=0.005)  # -> OutPoint, Info, Indexes
item_5 = ListItem(List=pt, Index=rdpoints.Indexes, Wrap=True)
cp = ClosestPoint(Point=item_5, Cloud=pt)  # -> ClosestPoint, simplify(graft(CPIndex)), Distance
merge_2 = Merge(Data1=simplify(graft(rdpoints.Indexes)), Data2=cp.CPIndex)
item_6 = ListItem(List=vec_pt_force_3, Index=merge_2, Wrap=True)
item_7 = ListItem(List=pt, Index=merge_2, Wrap=True)
ma = MassAddition(Input=item_6)  # -> Result, PartialResults
item_8 = ListItem(List=item_7, Index=0, Wrap=True)
vdisex = VectorDisplayEx(Point=item_8, Vector=ma.Result, Colour=RGB(0, 0, 0), Width=Slider(3, range=0..10))

# ----
pline = PolyLine(Vertices=move.Geometry, Closed=False)  # disabled
curve = Curve(pline)  # disabled
pt_intersection_nodes_3 = ClusterOutput(pt_intersection_nodes_2)
vec_pt_force_4 = ClusterOutput(vec_pt_force_2)

# ==== cluster EmbedCables
segments = ClusterInput()
cables = ClusterInput()
segments_2 = Surface(simplify(segments))
cables_2 = Curve(cables)
surface_curve = SurfaceCurve(Surface=segments_2, Curve=flatten(cables_2))  # -> simplify(Curves), Points, UVPoints, Normals, Parameters, Tangents
trim = TrimTree(Tree=surface_curve.Curves, Depth=1)
srfsplit = SurfaceSplit(Surface=segments_2, Curves=trim)
trim_2 = TrimTree(Tree=srfsplit, Depth=1)
split_segments = Geometry(trim_2)
split_cables = Geometry(trim)
split_segments_2 = ClusterOutput(split_segments)
split_cables_2 = ClusterOutput(split_cables)

# ==== cluster Karamba
springs = ClusterInput()
mesh = ClusterInput()
springs_2 = Line(springs)
mesh_2 = Mesh(mesh)
number_slider = Slider(3, range=0..10)

panel = Panel("main direction")
_10º = PowerOf10(Value=Slider(-4, range=-6..10))
multiplication = Multiplication(A=Slider(1, range=1..10), B=_10º)

mesh_3 = Mesh(mesh_2)
mjoin = MeshJoin(Meshes=mesh_3)
_10º_2 = PowerOf10(Value=Slider(5, range=0..10))
_10º_3 = PowerOf10(Value=number_slider)
_10º_4 = PowerOf10(Value=Slider(5, range=0..10))
_10º_5 = PowerOf10(Value=Slider(2, range=0..10))
_10º_6 = PowerOf10(Value=Slider(5, range=0..10))
_10º_7 = PowerOf10(Value=Slider(1, range=0..10))
_10º_8 = PowerOf10(Value=Slider(5, range=0..10))
multiplication_2 = Multiplication(A=Slider(1, range=0..1), B=_10º_4)
multiplication_3 = Multiplication(A=Slider(1, range=0..1), B=_10º_2)
multiplication_4 = Multiplication(A=Slider(1, range=0..1), B=_10º_6)
multiplication_5 = Multiplication(A=Slider(1, range=0..1), B=_10º_7)
multiplication_6 = Multiplication(A=Slider(1, range=0..1), B=_10º_5)
multiplication_7 = Multiplication(A=Slider(1, range=1..10), B=_10º_3)
multiplication_8 = Multiplication(A=Slider(1, range=0..1), B=_10º_8)
vec = VectorXYZ(XComponent=multiplication_2, YComponent=multiplication_4, ZComponent=multiplication_3)  # -> Vector, Length
# spring setup
vec_2 = VectorXYZ(XComponent=multiplication_7, YComponent=multiplication_7, ZComponent=multiplication_7)  # -> Vector, Length
vec_3 = VectorXYZ(XComponent=multiplication_5, YComponent=multiplication, ZComponent=multiplication_6)  # -> Vector, Length
vec_4 = VectorXYZ(XComponent=multiplication_8, YComponent=multiplication_8, ZComponent=multiplication_8)  # -> Vector, Length
cross_section = CrossSectionKaramba3D(
    FamilyNameOfCrossSection="DefaultCroSec",
    ElementIdentifier="spring",
    CTranslation_kN_m=vec.Vector,
    CRotation_kNm_rad=vec_3.Vector,
    mode="Spring")
merge = Merge(Data2=cross_section)
crosec = CrossSectionKaramba(merge)
number_slider_2 = Slider(9.862, range=0..10)  # "kN/m2"
number_slider_3 = Slider(6.44, range=0..100)
Z = UnitZ(Factor=Slider(10, range=0..10))
rev = Reverse(Vector=Z)
cross_section_2 = CrossSectionKaramba3D(
    FamilyNameOfCrossSection="DefaultCroSec",
    Material=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,
    Height_cm=Slider(5, range=0..10),
    mode="Shell - Const")
loads = LoadsKaramba3D(Vector=rev, Mesh=mesh_2, mode="MeshLoad -Const.", menu=[buttons(off, on, off), buttons(on, on)])
bottompoints = BottomPoints(mesh=mesh_2, ltol=Slider(2, range=0..10))  # -> flatten(pt_3)
supp = SupportKaramba3D(PosInd=bottompoints, menu=[buttons(on, on, on, off, off, on)])
linetobeam = LineToBeamKaramba(Line=flatten(springs_2), Identifier="spring", New=True, Remove=True, LimitDistance_m=0.005)  # -> simplify(Element), Points, Info
loads_2 = LoadsKaramba3D(Vector=Vector(0, 0, -1), mode="Gravity")
matselect = MaterialSelectionKaramba3D(menu=[dropdown(3), dropdown(1)])
panel_2 = Panel(loads)
meshtoshell = MeshToShellKaramba3D(Mesh=mesh_2, LimitDistance_m=0.005)  # -> Element, flatten(Points), Info
merge_2 = Merge(Data1=flatten(linetobeam.Element), Data2=flatten(meshtoshell.Element))
element = ElementKaramba(merge_2)
pt = Point(meshtoshell.Points)
mag_ct = Integer(number_slider)
rec = DataRecorder(mag_ct, DataLimit=-10, RecordData=False)
quick_graphs = QuickGraphs()

# ---- group: live load patterns
mesh_4 = Mesh(simplify(graft(mesh_3)))
image = ImageSampler(Filter="Colour", Interpolate=False, Umax=1, Umin=0, Vmax=1, Vmin=0, Wrap=1)
load_pattern = Slider(7, range=1..7)
bbox = BoundingBox(Content=flatten(mesh_4), Plane=PlaneXY(0, 0, 0), UnionBox=True)  # -> Box, Box_2
faceb = FaceBoundaries(Mesh=mesh_4)  # -> simplify(Boundaries)
box = EvaluateBox(Box=bbox.Box, UParameter=0.5, VParameter=0.5, WParameter="1")  # -> Plane, simplify(Point), Include
pattern_domains = PatternDomains(G=load_pattern)
area = Area(Geometry=faceb)  # -> Area, Centroid
pt_2 = Point(simplify(graft(area.Centroid)))
sph = Sphere(Base=box.Plane, Radius=Slider(2, range=0..10))
polar = ToPolar(Point=pt_2, System=box.Plane)  # -> simplify(Phi), Theta, Radius
wh_value_for_live_load = Panel("3.5")
pt_3 = Point(simplify(area.Centroid))

# ----
data = Data(flatten(pattern_domains))
face_area_m2 = Number(area.Area)
mesh_5 = Mesh(mesh_4)

# ---- group: live load patterns (continued)
dom² = ConstructDomain²(DomainU=data, DomainV="0 To Pi")
subsrf = Isotrim(Surface=sph, Domain=dom²)
inc = Includes(Value=polar.Phi, Domain=data)  # -> Includes, Deviation
ma = MassAddition(Input=inc.Includes)  # -> Result, PartialResults
bool = Boolean(ma.Result)
multiplication_9 = Multiplication(A=number_slider_2, C=bool)
dispatch = Dispatch(List=pt_2, DispatchPattern=bool)  # -> ListA, ListB
live_load_kn_m2_per_face = Number(multiplication_9)
outside = Point(dispatch.ListB)
inside = Point(dispatch.ListA)
Z_2 = UnitZ(Factor=live_load_kn_m2_per_face)
rev_2 = Reverse(Vector=Z_2)

# ----
multiplication_10 = Multiplication(A=live_load_kn_m2_per_face, B=face_area_m2)  # disabled
trim = TrimTree(Tree=rev_2, Depth=1)

# ---- group: live load patterns (continued)
vdis = VectorDisplay(Anchor=pt_3, Vector=trim)
loads_3 = LoadsKaramba3D(Vectors=trim, Mesh=mesh_5, mode="MeshLoad -Variable", menu=[buttons(off, on, off), buttons(on, on)])

# ----
load = LoadKaramba3D(flatten(loads_3))
panel_3 = Panel(load)

# ----
# Karamba analysis
# and results
assemble = AssembleModelKaramba3D(Point=pt, Elem=element, Support=supp, Load=load, CrossSection=crosec, Material=matselect, LimitDistance_m=0.005)  # -> Model, Info, Mass_kg, CenterOfGravity
analyze = AnalyzeKaramba3D(Model=assemble.Model)  # -> CalculatedModel, MaximumDisplacement_cm, ResultingForceOfGravity_kN, ElasticEnergy_kNm
modelview = ModelViewKaramba3D(Model=analyze.CalculatedModel, ResultFactors=1, ResultCase=-1)  # -> Model, DeformedMesh, DeformedAxes, DeformedModel
medges = MeshEdges(Mesh=modelview.DeformedMesh)  # -> NakedEdges, InteriorEdges, NonManifoldEdges
crv = Curve(medges.NakedEdges)

analyzethii = AnalyzeThIIKaramba3D(Model=assemble.Model, RTolerance=1e-07, MaxIterations=50, NoTensionalNII=False)  # -> CalculatedModel, MaximumDisplacement_cm, ResultingForceOfGravity_kN, ElasticEnergy_kNm; disabled
bmodes = BucklingModesKaramba3D(
    Model=analyzethii.CalculatedModel,
    FromIndex=1,
    NumberOfModes=Slider(3, range=0..10),
    MaximumNumberOfIterations=300,
    Epsilon=1e-07)  # -> ModelWithBucklingModesAsLoadCaseResults, BucklingLoadFactors
beamview = BeamViewKaramba3D(Model=modelview.Model)  # -> Model, MeshesOfRenderedBeams, DeformedBeamAxes, LegendColors, LegendTags; disabled
model = ModelKaramba3D(modelview.Model)
panel_4 = Panel(bmodes.BucklingLoadFactors)
shellview = ShellViewKaramba3D(Model=modelview.Model, IndexOfLayer=0)  # -> Model, MeshesOfRenderedShells, LegendColors, LegendTags
crv_2 = Curve(modelview.DeformedAxes)
explode = Explode(Curve=simplify(crv_2), Recursive=True)  # -> Segments, Vertices
mesh_6 = Mesh(modelview.DeformedMesh)
legend = Legend(Colour=shellview.LegendColors, Tags=shellview.LegendTags, LegendType=1)
item = ListItem(List=explode.Segments, Index=Slider(0, range=0..1), Wrap=True)
item_2 = ListItem(List=reverse(shellview.LegendTags), Index=0, Wrap=True)  # -> Item, Item1
item_3 = ListItem(List=shellview.LegendTags, Index=0, Wrap=True)  # -> Item, Item1
panel_5 = Panel(item_3.Item1)
panel_6 = Panel(item_2.Item1)
max_stress_comp = Number(item_3.Item1)
max_stress_tens = Number(item_2.Item1)
max_disp = Number(analyze.MaximumDisplacement_cm)
rec_2 = DataRecorder(max_stress_tens, DataLimit=-10, RecordData=False)
rec_3 = DataRecorder(max_stress_comp, DataLimit=-10, RecordData=False)
rec_4 = DataRecorder(max_disp, DataLimit=-10, RecordData=False)

# ==== cluster MeshSegments
offset_segments = ClusterInput()
mesh_resolution = ClusterInput()
mesh_resolution_2 = Number(mesh_resolution)
offset_segments_2 = Surface(simplify(offset_segments))
# IPts not working on trimmed surface
number_slider = Slider(3, range=0..10)
smooth = SettingsQuality()
mesh_breps = MeshBrepsKaramba3D(
    Brep=offset_segments_2,
    MeshResolution=mesh_resolution_2,
    EdgeRefinementFactor=0.67,
    PointReduction=False,
    SmoothingStepSize=Slider(1, range=0..1),
    SmoothingIterations=number_slider)  # -> simplify(Mesh), Info
custom_mesh_settings = SettingsCustom(
    StitchSeams=True,
    SimplePlanes=False,
    Refine=True,
    MinCount=16,
    MaxCount=400,
    AspectRatio=20,
    MaxDistance=0,
    MaxAngle=20,
    MinEdge=0,
    MaxEdge=0)
medges = MeshEdges(Mesh=mesh_breps.Mesh)  # -> NakedEdges, InteriorEdges, NonManifoldEdges
mesh = MeshBrep(Brep=offset_segments_2, Settings=custom_mesh_settings)
mjoin = MeshJoin(Meshes=mesh_breps.Mesh)
panel = Panel(offset_segments_2)
crv = Curve(medges.NakedEdges)
mesh_2 = Mesh(mjoin)
mesh_3 = ClusterOutput(mesh_2)

# ==== cluster WIPAlternativeOffsetMeshing
segments = ClusterInput()

# ---- group: determine internal edges + topology
segments_2 = Surface(segments)
join = BrepJoin(Breps=segments_2)  # -> Breps, Closed
debrep = DeconstructBrep(Brep=join.Breps)  # -> Faces, Edges, Vertices
topology = BrepTopology(Brep=join.Breps, PerspectiveOnly=False)  # -> FaceFaceAdjacency, simplify(FaceEdgeAdjacency), simplify(EdgeFaceAdjacency)
lng = ListLength(List=topology.EdgeFaceAdjacency)
larger = LargerThan(FirstNumber=lng, SecondNumber="1")  # -> LargerThan, OrEqualTo
dispatch = Dispatch(List=topology.EdgeFaceAdjacency, DispatchPattern=larger.LargerThan)  # -> ListA, ListB
clean = CleanTree(RemoveNulls=True, RemoveInvalid=True, RemoveEmpty=Toggle(True), Tree=dispatch.ListA)
tstat = TreeStatistics(Tree=clean)  # -> Paths, Length, Count
dpath = DeconstructPath(Branch=tstat.Paths)
item = ListItem(List=debrep.Edges, Index=flatten(dpath), Wrap=True)
match = MatchTree(Tree=graft(item), Guide=clean)
adjacent_faces = Integer(clean)
internal_edges = Curve(match)

# ----
offset_segments = ClusterInput()
number_slider = Slider(18, range=0..100)
offset_segments_2 = Surface(simplify(offset_segments))
debrep_2 = DeconstructBrep(Brep=offset_segments_2)  # -> Faces, Edges, Vertices
item_2 = ListItem(List=debrep.Edges, Index=number_slider, Wrap=True)
divint = DivInt(crv=debrep_2.Edges, num=Slider(0.322, range=0..1))  # -> pts_2, midpts_2
branch = TreeBranch(Tree=internal_edges, Path=number_slider, MaintainPaths=True)
int = Integer(simplify(graft(topology.FaceEdgeAdjacency)))
number_slider_2 = Slider(5, range=0..10)
divint_2 = DivInt(crv=debrep.Edges, num=Slider(0.322, range=0..1))  # -> pts_2, midpts_2
debrep_3 = DeconstructBrep(Brep=offset_segments_2)  # -> Faces, Edges, Vertices
nullrep = ReplaceNulls(Items=divint_2.pts_2)  # -> Items, Count
join_2 = JoinCurves(Curves=debrep_3.Edges, Preserve=False)  # -> simplify(Curves)
group = Group(Objects=divint_2.pts_2)
branch_2 = TreeBranch(Tree=offset_segments_2, Path=number_slider_2, MaintainPaths=True)
item_3 = ListItem(List=flatten(group), Index=int, Wrap=True)
ungroup = Ungroup(Group=item_3)  # -> simplify(Objects)
panel = Panel(int)
trim = TrimTree(Tree=ungroup, Depth=1)
branch_3 = TreeBranch(Tree=trim, Path=number_slider_2, MaintainPaths=True)
crv_cp = CurveClosestPoint(Point=trim, Curve=join_2)  # -> Point, Parameter, Distance
srf_cp = SurfaceClosestPoint(Point=trim, Surface=offset_segments_2)  # -> Point, UVPoint, Distance

# ==== cluster AsymmetricalLoadPatterns
mesh = ClusterInput()
load_kn_m2 = ClusterInput()
int = ClusterInput()
mjoin = MeshJoin(Meshes=mesh)
mesh_2 = Mesh(simplify(graft(mesh)))
load_kn_m2_2 = Number(load_kn_m2)
int_2 = Integer(int)
bbox = BoundingBox(Content=flatten(mesh_2), Plane=PlaneXY(0, 0, 0), UnionBox=True)  # -> Box, Box_2
image = ImageSampler(Filter="Colour", Interpolate=False, Umax=1, Umin=0, Vmax=1, Vmin=0, Wrap=1)
faceb = FaceBoundaries(Mesh=mesh_2)  # -> simplify(Boundaries)
box = EvaluateBox(Box=bbox.Box, UParameter=0.5, VParameter=0.5, WParameter="1")  # -> Plane, simplify(Point), Include
pattern_domains = PatternDomains_2(G=int_2)
area = Area(Geometry=faceb)  # -> Area, Centroid
sph = Sphere(Base=box.Plane, Radius=Slider(2, range=0..10))
data = Data(flatten(pattern_domains))
dom² = ConstructDomain²(DomainU=data, DomainV="0 To Pi")
pt = Point(simplify(graft(area.Centroid)))
subsrf = Isotrim(Surface=sph, Domain=dom²)
polar = ToPolar(Point=pt, System=box.Plane)  # -> simplify(Phi), Theta, Radius
inc = Includes(Value=polar.Phi, Domain=data)  # -> Includes, Deviation
wh_value_for_live_load = Panel("3.5")
ma = MassAddition(Input=inc.Includes)  # -> Result, PartialResults
bool = Boolean(ma.Result)
multiplication = Multiplication(A=load_kn_m2_2, C=bool)
dispatch = Dispatch(List=pt, DispatchPattern=bool)  # -> ListA, ListB
live_load_kn_m2_per_face = Number(multiplication)
outside = Point(dispatch.ListB)
inside = Point(dispatch.ListA)
Z = UnitZ(Factor=live_load_kn_m2_per_face)
pt_2 = Point(simplify(area.Centroid))
mesh_3 = Mesh(mesh_2)
rev = Reverse(Vector=Z)  # -> flatten(Vector)
vdis = VectorDisplay(Anchor=pt_2, Vector=rev)
loads = LoadsKaramba3D(Vectors=rev, Mesh=mesh_3, mode="MeshLoad -Variable", menu=[buttons(off, off, on), buttons(on, on)])
load = LoadKaramba3D(flatten(loads))
load_2 = ClusterOutput(load)

# ==== cluster GetStressLines
k3d_model = ClusterInput()
cornerstone_width = ClusterInput()
keystone_width = ClusterInput()
shell = ClusterInput()
pour_length = ClusterInput()
pour_width = ClusterInput()
k3d_model_2 = ModelKaramba3D(k3d_model)
shell_2 = Brep(shell)
edges = BrepEdges(Brep=shell_2)  # -> Naked, Interior, NonManifold
project = Project(Geometry=edges.Naked, Plane=PlaneXY(0, 0, 0))  # -> Geometry, Transform
keystone_width_2 = Number(keystone_width)
cornerstone_width_2 = Number(cornerstone_width)
join = JoinCurves(Curves=project.Geometry, Preserve=False)
pour_length_2 = Number(pour_length)
pour_width_2 = Number(pour_width)
surface_plan = Curve(join)
crv = Curve(surface_plan)
crv_2 = Curve(surface_plan)
area = Area(Geometry=crv)  # -> Area, Centroid
explode = Explode(Curve=crv, Recursive=True)  # -> Segments, Vertices
area_2 = Area(Geometry=crv_2)  # -> Area, Centroid
explode_2 = Explode(Curve=crv_2, Recursive=True)  # -> Segments, Vertices
# using input shape, use geodesics on brep instead?
culln = CullNth(List=reverse(explode.Segments), CullFrequency=2)
# using input shape, use geodesics on brep instead?
culln_2 = CullNth(List=explode_2.Segments, CullFrequency=2)
keystone_width_3 = Number(keystone_width_2)
midpt = CurveMiddle(Curve=culln)
midpt_2 = CurveMiddle(Curve=culln_2)
ln = Line(StartPoint=area.Centroid, EndPoint=midpt)
cornerstone_width_3 = Number(cornerstone_width_2)
division = Division(A=keystone_width_3, B=2)
ln_2 = Line(StartPoint=area_2.Centroid, EndPoint=midpt_2)
sqrt = SquareRoot(Value=keystone_width_3)
neg = Negative(Value=division)
crv_3 = Curve(ln)
neg_2 = Negative(Value=cornerstone_width_3)
neg_3 = Negative(Value=sqrt)
crv_4 = Curve(ln_2)
pour_width_3 = Number(pour_width_2)
ext = ExtendCurve(Curve=crv_3, Type=0, Start=neg_3, End="0")
pour_length_3 = Number(pour_length_2)
ext_2 = ExtendCurve(Curve=crv_4, Type=0, Start=neg, End=neg_2)
divint = DivInt_2(crv=ext, num=pour_width_3)  # -> pts_2, midpts_2, perp_2
divint_2 = DivInt_2(crv=ext_2, num=pour_length_3)  # -> pts_2, midpts_2, perp_2
cull_i = CullIndex(List=reverse(divint.pts_2), Indices="0", Wrap=True)  # -> simplify(List)
cull_i_2 = CullIndex(List=divint_2.pts_2, Indices="0", Wrap=True)  # -> simplify(List)
entwine = Entwine(Branch0X=cull_i, Branch1X=divint.midpts_2, FlattenInputs=False)
Z = UnitZ(Factor=1)
shell_3 = Brep(shell_2)
entwine_2 = Entwine(Branch0X=cull_i_2, Branch1X=divint_2.midpts_2, FlattenInputs=False)
Z_2 = UnitZ(Factor=1)
project_2 = ProjectPoint(Point=entwine, Direction=Z, Geometry=shell_3)  # -> simplify(Point), Index
project_3 = ProjectPoint(Point=entwine_2, Direction=Z_2, Geometry=shell_3)  # -> simplify(Point), Index
match = MatchTree(Tree=project_2.Point, Guide=entwine)
match_2 = MatchTree(Tree=project_3.Point, Guide=entwine_2)
number_slider = Slider(0, range=-1..1)
surface_plan_2 = Curve(surface_plan)
k3d_model_3 = ModelKaramba3D(k3d_model_2)
trim = TrimTree(Tree=match_2, Depth=1)
X = UnitX(Factor=1)
Y = UnitY(Factor=1)
subtraction = Subtraction(A=Y, B=X)
addition = Addition(A=Y, B=X)
shelllineresults = LineResultsOnShellsKaramba3D(
    AnalyzedModel=k3d_model_3,
    LayerPosition=number_slider,
    ListOfSourcesOfPrincipalStressLinesLinesPoints=match,
    SegmentLength_m=0.5,
    DA_deg=5,
    mode="PrincStress")  # -> AnalyzedModel, Lines1, simplify(Lines2)
crv_5 = Curve(surface_plan_2)
shelllineresults_2 = LineResultsOnShellsKaramba3D(
    AnalyzedModel=k3d_model_3,
    LayerPosition=number_slider,
    ListOfSourcesOfPrincipalStressLinesLinesPoints=match_2,
    SegmentLength_m=0.5,
    DA_deg=5,
    mode="PrincStress")  # -> AnalyzedModel, simplify(Lines1), Lines2
shelllineresults_3 = LineResultsOnShellsKaramba3D(
    AnalyzedModel=k3d_model_3,
    LayerPosition=number_slider,
    GlobalForceDirections=[subtraction, addition],
    ListOfSourcesOfForceFlowLinesLinesPoints=trim,
    SegmentLength_m=0.5,
    DA_deg=5,
    Theta_deg=0,
    mode="ForceFlow")  # -> AnalyzedModel, Lines
area_3 = Area(Geometry=crv_5)  # -> Area, Centroid
explode_3 = Explode(Curve=crv_5, Recursive=True)  # -> Segments, Vertices
crv_6 = Curve(shelllineresults.Lines2)
crv_7 = Curve(shelllineresults_2.Lines1)
# using input shape, use geodesics on brep instead?
culln_3 = CullNth(List=explode_3.Segments, CullFrequency=2)
crv_8 = Curve(shelllineresults_3.Lines)
trim_2 = TrimTree(Tree=simplify(crv_6), Depth=1)
trim_3 = TrimTree(Tree=simplify(crv_7), Depth=1)
midpt_3 = CurveMiddle(Curve=culln_3)
crv_9 = Curve(surface_plan_2)
join_2 = JoinCurves(Curves=trim_2, Preserve=False)
ln_3 = Line(StartPoint=area_3.Centroid, EndPoint=midpt_3)
join_3 = JoinCurves(Curves=trim_3, Preserve=False)
shell_4 = Brep(shell_3)
culln_4 = CullNth(List=reverse(midpt_3), CullFrequency=2)
area_4 = Area(Geometry=crv_9)  # -> Area, Centroid
explode_4 = Explode(Curve=crv_9, Recursive=True)  # -> Segments, Vertices
culln_5 = CullNth(List=midpt_3, CullFrequency=2)
split = SplitTree(Data=simplify(join_2), Masks=flatten("{0;*}"))  # -> Positive, Negative
split_2 = SplitTree(Data=simplify(join_3), Masks=flatten("{0;*}"))  # -> Positive, Negative
pline = PolyLine(Vertices=culln_5, Closed=False)
pline_2 = PolyLine(Vertices=culln_4, Closed=False)
# using input shape, use geodesics on brep instead?
culln_6 = CullNth(List=reverse(explode_4.Segments), CullFrequency=2)
crv_10 = Curve(surface_plan_2)
project_4 = Project(Geometry=split.Positive, Plane=PlaneXY(0, 0, 0))  # -> Geometry, Transform
merge = Merge(Data1=pline, Data2=pline_2)
project_5 = Project(Geometry=split_2.Positive, Plane=PlaneXY(0, 0, 0))  # -> Geometry, Transform
explode_5 = Explode(Curve=crv_10, Recursive=True)  # -> Segments, Vertices
midpt_4 = CurveMiddle(Curve=culln_6)
cable_lines = Curve(split.Negative)
split_lines = Curve(simplify(project_4.Geometry))
split_lines_2 = Curve(simplify(project_5.Geometry))
culln_7 = CullNth(List=reverse(explode_5.Segments), CullFrequency=2)
cable_lines_2 = Curve(split_2.Negative)
project_6 = Project(Curve=merge, Brep=shell_4, Direction=Vector(0, 0, 1))  # -> flatten(Curve)
ln_4 = Line(StartPoint=area_4.Centroid, EndPoint=midpt_4)
merge_2 = Merge(Data1=cable_lines, Data2=project_6)
merge_3 = Merge(Data1=culln_7, Data2=split_lines)
merge_4 = Merge(Data1=split_lines_2, Data2=ln_4)
entwine_3 = Entwine(Branch00=merge_3, Branch01=merge_4, FlattenInputs=True)  # -> simplify(Result)
entwine_4 = Entwine(Branch00=merge_2, Branch01=cable_lines_2, FlattenInputs=True)  # -> simplify(Result)
panel = Panel(entwine_4)
cable_lines_3 = Curve(entwine_4)
split_lines_3 = Curve(entwine_3)
split_lines_4 = ClusterOutput(split_lines_3)
cable_lines_4 = ClusterOutput(cable_lines_3)

# ==== cluster PercentileStress
model = ClusterInput()
percentile = ClusterInput()
include_2nd_ps = ClusterInput()
model_2 = ModelKaramba3D(model)
shellvecresults = ResultVectorsOnShellsKaramba3D(AnalyzedModel=model_2, LayerPosition="1", mode="PrincStress")  # -> AnalyzedModel, Points, FirstPrincipalStressVector_kN_cm2, SecondPrincipalStressVector_kN_cm2, FirstPrincipalStressValue_kN_cm2, SecondPrincipalStressValue_kN_cm2
shellvecresults_2 = ResultVectorsOnShellsKaramba3D(AnalyzedModel=model_2, LayerPosition="-1", mode="PrincStress")  # -> AnalyzedModel, Points, FirstPrincipalStressVector_kN_cm2, SecondPrincipalStressVector_kN_cm2, FirstPrincipalStressValue_kN_cm2, SecondPrincipalStressValue_kN_cm2
include_2nd_ps_2 = Boolean(include_2nd_ps)
panel = Panel("""Index
Stress [kN/cm2]""")
lng = ListLength(List=shellvecresults_2.FirstPrincipalStressValue_kN_cm2)
series = Series(Start=0, Step=1, Count=lng)  # -> simplify(Series)
entwine = Entwine(
    Branch00=shellvecresults_2.FirstPrincipalStressValue_kN_cm2,
    Branch01=shellvecresults_2.SecondPrincipalStressValue_kN_cm2,
    Branch02=shellvecresults.FirstPrincipalStressValue_kN_cm2,
    Branch03=shellvecresults.SecondPrincipalStressValue_kN_cm2,
    FlattenInputs=True)  # -> simplify(Result)
sort = SortList(Keys=entwine, ValuesA=series)  # -> Keys, ValuesA
entwine_2 = Entwine(Branch0X=sort.ValuesA, Branch1X=sort.Keys, FlattenInputs=False)
subset = SubList(List=entwine_2, Domain=Slider(5, range=0..10), Wrap=True)  # -> simplify(List), Index
item = ListItem(List=entwine_2, Index=0, Wrap=True)
panel_2 = Panel(subset.List)
merge = Merge(
    Data1=shellvecresults_2.FirstPrincipalStressValue_kN_cm2,
    Data2=shellvecresults.FirstPrincipalStressValue_kN_cm2,
    Data3=shellvecresults_2.SecondPrincipalStressValue_kN_cm2,
    Data4=shellvecresults.SecondPrincipalStressValue_kN_cm2)
merge_2 = Merge(Data1=shellvecresults_2.FirstPrincipalStressValue_kN_cm2, Data2=shellvecresults.FirstPrincipalStressValue_kN_cm2)
filter = StreamFilter(Gate=include_2nd_ps_2, Stream0=merge_2, Stream1=merge)
stress_values = Number(filter)
lng_2 = ListLength(List=shellvecresults_2.FirstPrincipalStressValue_kN_cm2)
panel_3 = Panel("4")
item_2 = ListItem(List=reverse(sort.Keys), Index=0, Wrap=True)
item_3 = ListItem(List=reverse(sort.ValuesA), Index=0, Wrap=True)
item_4 = ListItem(List=sort.ValuesA, Index=0, Wrap=True)
item_5 = ListItem(List=sort.Keys, Index=0, Wrap=True)
series_2 = Series(Start=0, Step=1, Count=lng_2)  # -> simplify(Series)
lng_3 = ListLength(List=stress_values)
percentile_2 = Number(percentile)
flatten = FlattenTree(Tree=item_4, Path="{0}")
repeat = RepeatData(Data=series_2, Length=lng_3)
# Bottom Sig1
# Bottom Sig2
# Top Sig1
# Top Sig2
number_slider = Slider(0, range=0..3)
max_compression_stress = Panel(item_4)
max_tension_stress_element = Panel(item_3)
max_compression_stress_2 = Panel(item_5)
sort_2 = SortList(Keys=stress_values, ValuesA=repeat)  # -> Keys, ValuesA
max_tension_stress_value = Panel(item_2)
item_6 = ListItem(List=flatten(item_3), Index=number_slider, Wrap=True)
division = Division(A=percentile_2, B=100)
shellview = ShellViewKaramba3D(Model=shellvecresults_2.AnalyzedModel, IndexOfLayer=0)  # -> Model, MeshesOfRenderedShells, LegendColors, LegendTags
panel_4 = Panel(item_6)
subtraction = Subtraction(A="1", B=division)
int = Integer(item_6)
demesh = DeconstructMesh(Mesh=shellview.MeshesOfRenderedShells)  # -> Vertices, Faces, Colours, Normals
lng_4 = ListLength(List=sort_2.Keys)
graph = QuickGraph(sort_2.Keys, SortOrder=0)
remap = RemapNumbers(Value=subtraction, Source=Domain(0, 1), Target=lng_4)  # -> Mapped, Clipped
sorted_element_s = Integer(sort_2.ValuesA)
panel_5 = Panel(sort_2.Keys)
item_7 = ListItem(List=entwine, Index=int, Wrap=True)
item_8 = ListItem(List=demesh.Faces, Index=int, Wrap=True)
elements_top_1 = Integer(remap.Mapped)
conmesh = ConstructMesh(Vertices=demesh.Vertices, Faces=item_8, Colours=ColourSwatch(SwatchColor=RGB(0, 0, 0)))
# Bottom Sig1
# Bottom Sig2
# Top Sig1
# Top Sig2
panel_6 = Panel(item_7)
area = Area(Geometry=conmesh)  # -> Area, Centroid
subtraction_2 = Subtraction(A=lng_4, B=elements_top_1)
dom = ConstructDomain(DomainStart=elements_top_1, DomainEnd=subtraction_2)
dom_2 = ConstructDomain(DomainStart="0", DomainEnd=elements_top_1)
cir = Circle(Plane=area.Centroid, Radius=1)
Z = UnitZ(Factor=1)
subset_2 = SubList(List=sort_2.Keys, Domain=dom, Wrap=True)  # -> List, Index
move = Move(Geometry=cir, Motion=Z)  # -> Geometry, Transform
subset_3 = SubList(List=reverse(sorted_element_s), Domain=dom_2, Wrap=True)  # -> List, Index
subset_4 = SubList(List=sorted_element_s, Domain=dom_2, Wrap=True)  # -> List, Index
shellview_2 = ShellViewKaramba3D(Model=shellvecresults_2.AnalyzedModel, IndexOfLayer=0)  # -> Model, MeshesOfRenderedShells, LegendColors, LegendTags
element_s_for_top_tension = Integer(subset_3.List)
element_s_for_top_comp = Integer(subset_4.List)
graph_2 = QuickGraph(subset_2.List, SortOrder=0)
demesh_2 = DeconstructMesh(Mesh=shellview_2.MeshesOfRenderedShells)  # -> Vertices, Faces, Colours, Normals
item_9 = ListItem(List=reverse(sort_2.Keys), Index="0", Wrap=True)
item_10 = ListItem(List=sort_2.Keys, Index="0", Wrap=True)
item_11 = ListItem(List=reverse(subset_2.List), Index=0, Wrap=True)
item_12 = ListItem(List=subset_2.List, Index=0, Wrap=True)
panel_7 = Panel(element_s_for_top_comp)
item_13 = ListItem(List=demesh_2.Faces, Index=element_s_for_top_tension, Wrap=True)
item_14 = ListItem(List=demesh_2.Faces, Index=element_s_for_top_comp, Wrap=True)
panel_8 = Panel(item_10)
panel_9 = Panel(item_9)
panel_10 = Panel(item_11)
panel_11 = Panel(item_12)
max_comp_stress_kn_cm2 = Number(item_10)
max_comp_stress_kn_cm2_2 = Number(item_12)
max_tens_stress_kn_cm2 = Number(item_11)
max_tens_stress_kn_cm2_2 = Number(item_9)
conmesh_2 = ConstructMesh(Vertices=demesh_2.Vertices, Faces=item_14, Colours=ColourSwatch(SwatchColor=RGB(255, 0, 0)))
conmesh_3 = ConstructMesh(Vertices=demesh_2.Vertices, Faces=item_13, Colours=ColourSwatch(SwatchColor=RGB(0, 102, 255)))
multiplication = Multiplication(A=max_comp_stress_kn_cm2, B="10")
multiplication_2 = Multiplication(A=max_tens_stress_kn_cm2, B="10")
multiplication_3 = Multiplication(A=max_tens_stress_kn_cm2_2, B="10")
merge_3 = Merge(Data1=conmesh_2, Data2=conmesh_3)
multiplication_4 = Multiplication(A=max_comp_stress_kn_cm2_2, B="10")
max_comp_stress_mpa = Number(multiplication)
max_tens_stress_mpa = Number(multiplication_2)
max_tens_stress_mpa_2 = Number(multiplication_3)
extreme_stress_elements = Mesh(merge_3)
max_comp_stress_mpa_2 = Number(multiplication_4)
max_comp_stress_mpa_3 = ClusterOutput(max_comp_stress_mpa)
max_tens_stress_mpa_3 = ClusterOutput(max_tens_stress_mpa_2)
extreme_stress_elements_2 = ClusterOutput(extreme_stress_elements)
max_tens_stress_mpa_4 = ClusterOutput(max_tens_stress_mpa)
max_comp_stress_mpa_4 = ClusterOutput(max_comp_stress_mpa_2)

# ==== cluster VisualisePins
crv = ClusterInput()
crv_2 = Curve(crv)
trim = TrimTree(Tree=crv_2, Depth=Slider(3, range=0..10))
geo = Geometry(trim)
len = Length(Curve=geo)
max_pin_height = Number(".40")
larger = LargerThan(FirstNumber=len, SecondNumber=max_pin_height)  # -> LargerThan, OrEqualTo
dispatch = Dispatch(List=geo, DispatchPattern=larger.LargerThan)  # -> ListA, ListB
flatten = FlattenTree(Tree=geo, Path="{0}")
geo_2 = Geometry(dispatch.ListA)
geo_3 = Geometry(dispatch.ListB)
len_2 = Length(Curve=flatten)
entwine = Entwine(Branch00=geo_2, Branch01=geo_3, FlattenInputs=True)  # -> simplify(Result)
sort = SortList(Keys=len_2, ValuesA=flatten)  # -> Keys, ValuesA
number_slider = Slider(0.02, range=0..0.1)
item = ListItem(List=reverse(sort.Keys), Index=0, Wrap=True)
item_2 = ListItem(List=reverse(sort.ValuesA), Index=0, Wrap=True)
num = Number(number_slider)
longest_height_m = Number(item)
longest_traveller = Geometry(item_2)
neg = Negative(Value=num)
ext = ExtendCurve(Curve=entwine, Type=0, Start=num, End=neg)
bang = ExplodeTree(Data=ext)  # -> Branch0, Branch1
longest_height_m_2 = ClusterOutput(longest_height_m)
end = EndPoints(Curve=bang.Branch1)  # -> Start, End
end_2 = EndPoints(Curve=bang.Branch0)  # -> Start, End
pt = Point(end.End)
pt_2 = Point(end_2.End)
panel = Panel(longest_height_m)
pipe = Pipe(Curve=bang.Branch0, Radius=number_slider, Caps=2)  # disabled
pipe_2 = Pipe(Curve=bang.Branch1, Radius=number_slider, Caps=2)  # disabled
len_3 = Length(Curve=bang.Branch1)
entwine_2 = Entwine(Branch00=pt, Branch01=pipe_2, FlattenInputs=True)  # -> simplify(Result)
merge = Merge(Data2=pt_2, Data3=pipe)
gradient = Gradient(
    LowerLimit="0",
    UpperLimit=max_pin_height,
    Parameter=len_3,
    stops=[0: RGB(0, 98, 0), 0.25: RGB(81, 175, 17), 0.5: RGB(159, 198, 146), 0.746: RGB(170, 235, 41), 1: RGB(221, 255, 53)])
preview = CustomPreview(Geometry=merge, Material=ColourSwatch(SwatchColor=RGB(255, 0, 0)))
preview_2 = CustomPreview(Geometry=entwine_2, Material=gradient)

# ==== cluster CalculatePinHeights
extended_sub_segments = ClusterInput()
modules = ClusterInput()
number_slider = Slider(3, range=0..10)
extended_sub_segments_2 = Surface(extended_sub_segments)
modules_2 = Rectangle(modules)
dividerect = DivideRect(rec=modules_2, divu=number_slider, divv=number_slider)  # -> simplify(rec_4)
vec = Vector(modules_2)
area = Area(Geometry=dividerect)  # -> Area, Centroid
project = ProjectPoint(Point=area.Centroid, Direction=vec, Geometry=extended_sub_segments_2)  # -> Point, Index
merge = Merge(Data1=graft(area.Centroid), Data2=graft(project.Point))
pline = PolyLine(Vertices=merge, Closed=False)
pin_axes = Curve(pline)
pin_axes_2 = ClusterOutput(pin_axes)

# ==== cluster AjustModuleHeights
extended_segments = ClusterInput()
variable_module_height = ClusterInput()
modules = ClusterInput()
variable_module_height_2 = Boolean(simplify(variable_module_height))
extended_segments_2 = Surface(extended_segments)
modules_2 = Rectangle(modules)
pln = Plane(modules_2)
trim = TrimTree(Tree=pln, Depth="1")
trim_2 = TrimTree(Tree=extended_segments_2, Depth="2")
item = ListItem(List=trim, Index=0, Wrap=True)
bbox = BoundingBox(Content=trim_2, Plane=item)  # -> simplify(Box), Box_2
bbox_2 = BoundingBox(Content=trim_2, Plane=item, UnionBox=True)  # -> Box, Box_2
filter = StreamFilter(Gate=variable_module_height_2, Stream0=bbox_2.Box, Stream1=bbox.Box)  # -> simplify(Stream)
debox = DeconstructBox(Box=filter)  # -> Plane, X, Y, Z
lng = ListLength(List=bbox.Box_2)
deplane = DeconstructPlane(Plane=debox.Plane)  # -> Origin, XAxis, YAxis, ZAxis
dedomain = DeconstructDomain(Domain=debox.Z)  # -> Start, End
amp = Amplitude(Vector=deplane.ZAxis, Amplitude=dedomain.Start)
vec = Vector(amp)
repeat = RepeatData(Data=vec, Length=lng)
# in ROTATED mode, this only readjusts modules height to consider extended segments
# 
# ROTATED mode is so efficient, it might not really need independent heights
filter_2 = StreamFilter(Gate=variable_module_height_2, Stream0=repeat, Stream1=vec)
unflatten = UnflattenTree(Tree=filter_2, Guide=modules_2)
move = Move(Geometry=modules_2, Motion=unflatten)  # -> Geometry, Transform
adjusted_modules = Rectangle(graft(move.Geometry))
boundary = BoundarySurfaces(Edges=move.Geometry)
adjusted_modules_2 = ClusterOutput(adjusted_modules)

# ==== cluster ExtendSegments
modules = ClusterInput()
shell = ClusterInput()
modules_2 = Rectangle(modules)
shell_2 = Surface(shell)
project = Project(Curve=modules_2, Brep=shell_2, Direction=modules_2)
trim = TrimTree(Tree=project, Depth=1)
crossref = CrossReference(ListA=shell_2, ListB=trim, CrossMode=1)  # -> ListA, ListB
bbox = BoundingBox(Content=crossref.ListB, Plane=PlaneXY(0, 0, 0))  # -> simplify(graft(Box)), Box_2
srfsplit = SurfaceSplit(Surface=crossref.ListA, Curves=crossref.ListB)  # -> simplify(Fragments)

# ---- group: quick centroid
bbox_2 = BoundingBox(Content=srfsplit, Plane=PlaneXY(0, 0, 0))  # -> Box, Box_2
box = EvaluateBox(Box=bbox_2.Box_2, UParameter=0.5, VParameter=0.5, WParameter=0.5)  # -> Plane, simplify(Point), Include

# ----
area = Area(Geometry=bbox.Box)  # -> Area, Centroid
dist = Distance(PointA=box.Point, PointB=area.Centroid)
# segments are extended for
# covering whole pinbed module,
# for shape continuity
sort = SortList(Keys=dist, ValuesA=srfsplit)  # -> Keys, ValuesA
item = ListItem(List=sort.ValuesA, Index=0, Wrap=True)
extended_sub_segments = Surface(item)
extended_sub_segments_2 = ClusterOutput(extended_sub_segments)

# ==== cluster DivideSegments
bbs = ClusterInput()
bbs_2 = Box(simplify(bbs))

# ---- group: tolerance for input integer numbers
lot = Integer(Slider(10, range=0..10))
neg = Negative(Value=lot)
_10º = PowerOf10(Value=neg)

# ----
boxsize = BoxSize(box=bbs_2)  # -> X_2, Y_2, Z_2, A_2, V_2
subtraction = Subtraction(A=boxsize.Y_2, B=_10º)
subtraction_2 = Subtraction(A=boxsize.X_2, B=_10º)
pln = Plane(bbs_2)
round = Round(Number=subtraction_2)  # -> Nearest, Floor, Ceiling
round_2 = Round(Number=subtraction)  # -> Nearest, Floor, Ceiling
sqgrid = Square(Plane=pln, Size="1", ExtentX=round.Ceiling, ExtentY=round_2.Ceiling)  # -> Cells, Points
trim = TrimTree(Tree=sqgrid.Cells, Depth=Slider(1, range=0..1))  # -> simplify(Tree)
box = EvaluateBox(Box=bbs_2, UParameter=0.5, VParameter=0.5, WParameter="0")  # -> Plane, Point, Include
bbox = BoundingBox(Content=trim, Plane=pln, UnionBox=True)  # -> Box, Box_2
volume = Volume(Geometry=bbox.Box)  # -> Volume, Centroid
vec2pt = Vector2Pt(PointA=volume.Centroid, PointB=box.Point, Unitize=False)  # -> Vector, Length
modulesiny = Integer(round_2.Ceiling)
modulesinx = Integer(round.Ceiling)
move = Move(Geometry=trim, Motion=vec2pt.Vector)  # -> Geometry, Transform
modules = Rectangle(move.Geometry)
unflatten = UnflattenTree(Tree=move.Geometry, Guide=sqgrid.Cells)  # -> simplify(Tree)
modules_2 = Rectangle(unflatten)
modules_3 = ClusterOutput(modules_2)

# ==== cluster FitBBox
segments = ClusterInput()
_3d_rotate = ClusterInput()
segments_2 = Geometry(segments)
_3d_rotate_2 = Boolean(_3d_rotate)
gate = StreamGate(Stream=segments_2, Gate=_3d_rotate_2)  # -> Target0, Target1
segments_3 = Geometry(gate.Target0)
segments_4 = Geometry(gate.Target1)

# ----
# minimum bounding box IN 3D
# 
# https://discourse.mcneel.com/t/minimum-oriented-bounding-box-implementation-in-grasshopper-python-script-node/64344/61
rotations = Slider(300, range=1..360)
# downloaded algorithm is a black box!
# use something from compas or my own...
iterations = Slider(1, range=1..10)
minbb_c = CSharpScript(G=segments_4, D=rotations, I=iterations)  # -> out, MinBB; inputs G: GeometryBase, D: Int32, I: Int32
# ---------- minbb_c: C# ----------
    /* ==============================================*
    | Min Bounding Box Calculation                   |
    | Original Author Ilja Asanovic (Python)         |
    |                                                |
    | Parallel C# version, code refactored           |
    | RIL, R3                                        |
    ================================================= */

    RhinoApp.ClearCommandHistoryWindow();

    var version = "R6";
    Component.Message = "Parallel " + version;

    // --------------------------------------
    // INPUT
    // --------------------------------------
    var geo = (GeometryBase) G; // Geometry to align the bbox about
    m_rotations = D;            // Rotate Degrees. Default = 90º
    var iterations = I;

    // --------------------------------------
    // Modify the rotation step size to less than 1 (degree) if input
    // is greater than 180 rotation steps. This increases the number of
    // steps AND reduces the angle. Conversion from degrees to radians
    // is done in the respective functions since the angle is depending
    // on a integer loop-variable (i).
    // --------------------------------------
    m_rotation_factor = 1;
    if (m_rotations > 180)
    {
      // reduce whole degrees to a fraction of a degree
      m_rotation_factor = 180.0 / m_rotations;
      // increase the rotation steps needed to cover 180 degrees
      m_rotations = (int) (D / m_rotation_factor);
    }

    // --------------------------------------
    // Prepare initial plane
    // --------------------------------------
    // Start the rotation attempts from WorldXY plane, and then get to work
    var init_plane = Plane.WorldXY; // default
    System.Object obj = P;
    if (obj != null)
      init_plane = (Plane) obj; // custom user-defined start plane

    // --------------------------------------
    // Output
    // --------------------------------------
    var plane = init_plane;
    for (int i = 0; i < iterations; i++)
    {
      plane = RotateAllCombinationsOfPlane(geo, plane);
    }

    // --------------------------------------
    // Output
    // --------------------------------------
    var bb = Box.Unset; geo.GetBoundingBox(plane, out bb);
    MinBB = bb;
# ---------- minbb_c: C# additional code ----------
  private int m_rotations = 90; // default
  private double m_rotation_factor;
  const double TO_RADIANS = Math.PI / 180;

  private Plane RotateAllCombinationsOfPlane(GeometryBase geo, Plane initial_plane)
  {
    // --------------------------------------
    // Rotate about X axis of initial plane
    // --------------------------------------
    var rotation_axis = initial_plane.XAxis;
    var rotation = GetRotationAtMinimumVolume(geo, initial_plane, rotation_axis);
    var plane_x = initial_plane;
    plane_x.Rotate(rotation, rotation_axis);

    // --------------------------------------
    // Rotate about Y axis of rotated plane_x
    // --------------------------------------
    rotation_axis = plane_x.YAxis;
    rotation = GetRotationAtMinimumVolume(geo, plane_x, rotation_axis);
    var plane_y = plane_x;
    plane_y.Rotate(rotation, rotation_axis);

    // --------------------------------------
    // Rotate about Z axis of rotated plane_y
    // --------------------------------------
    rotation_axis = plane_y.ZAxis;
    rotation = GetRotationAtMinimumVolume(geo, plane_y, rotation_axis);
    var plane_z = plane_y;
    plane_z.Rotate(rotation, rotation_axis);

    // =====================================
    // Another round of rotations starting
    // from the 3 axes of the last plane_z
    // =====================================

    // --------------------------------------
    // Rotate about X axis of rotated plane_z
    // --------------------------------------
    rotation_axis = plane_z.XAxis;
    rotation = GetRotationAtMinimumVolume(geo, plane_z, rotation_axis);
    var plane_x_refined = plane_z;
    plane_x_refined.Rotate(rotation, rotation_axis);

    // --------------------------------------
    // Rotate about Y axis of refined plane_z
    // --------------------------------------
    rotation_axis = plane_x_refined.YAxis;
    rotation = GetRotationAtMinimumVolume(geo, plane_x_refined, rotation_axis);
    var plane_y_refined = plane_x_refined;
    plane_y_refined.Rotate(rotation, rotation_axis);

    // --------------------------------------
    // Rotate about Z axis of refined plane_y
    // --------------------------------------
    rotation_axis = plane_y_refined.ZAxis;
    rotation = GetRotationAtMinimumVolume(geo, plane_y_refined, rotation_axis);
    var plane_z_refined = plane_y_refined;
    plane_z_refined.Rotate(rotation, rotation_axis);
    
    return plane_z_refined; // the lastly rotated plane
  }

  /// <summary>
  /// Returns the rotation (in radians) of the smallest volume. The parallel loop
  /// performs m_rotations rotations of 1º each (90 rotations is default)
  /// </summary>
  private double GetRotationAtMinimumVolume(GeometryBase geo, Plane start_plane, Vector3d rotation_axis)
  {
    var rotated_volumes = new double[m_rotations];
    var rad_angle_factor = m_rotation_factor * TO_RADIANS; // calculate once
    
    // Let the .NET platform take care of spreading out the for-loop iterations
    // on  different threads. To avoid data races we use local block variables
    // inside the for-loop, and results are put into array slots, each result into
    // its own index in the array, which prevents "collisions" (meaning, different
    // threads overwriting each others values).
    System.Threading.Tasks.Parallel.For(0, m_rotations, i =>
    {
      // Make a fresh new rotation starting from the original plane on each try.
      // A local variable (_plane) is required here in order to "isolate" it from 
      // other threads operating simultaneously on other indexes (i), so they will 
      // have their own copy of _plane, and therefore we don't overwrite each other.
      // Take this as  a general rule for Parallel.For-blocks
      var _plane = start_plane;
      
      // The rad_angle_factor is converting the integer ("degrees") into radians AND
      // transforms it into a fraction of a degree if the input (D) is greater than 180
      _plane.Rotate(i * rad_angle_factor, rotation_axis);
      
      // Since each thread works with different indexes (i), and when done, assigning
      // each result value into "its own array index", then no conflict can occur be-
      // tween threads so that any one thread would overwrite the result produced by
      // another thread, and therefore no data-races will occur. This is a red-neck
      // approach which ALWAYS works if the size of the array can be known in advance
      rotated_volumes[i] = geo.GetBoundingBox(_plane).Volume;
    });
    
    // now find that index (degree of rotation) at which we had the smallest BoundingBox
    var rotation = IndexOfMinimumVolume(ref rotated_volumes);
    // Convert Degrees to Radians before returning the angle
    return rotation * rad_angle_factor;
  }

  /// <summary>
  /// Returns the index of the smallest volume recorded in the array
  /// </summary>
  /// <returns>Returns the index of the smalles volume, which also is
  /// equal to the degree at which this volume was achieved.</returns>
  private double IndexOfMinimumVolume(ref double[] recorded_volumes)
  {
    var min_index = -1;
    var min_value = Double.MaxValue;
    for (var i = 0; i < recorded_volumes.Length; i++)
    {
      if (recorded_volumes[i] < min_value)
      {
        min_index = i;
        min_value = recorded_volumes[i];
      }
    }
    return min_index; // Index is the same as the degree
  }
# ---------- end minbb_c ----------

rotating_caliper_3d = RotatingCaliper3D(geo=segments_4)  # -> horizontal_box_2, area_4, rotated_box_2; disabled
geo = Geometry(rotating_caliper_3d.horizontal_box_2)  # disabled
geo_2 = Geometry(rotating_caliper_3d.rotated_box_2)  # disabled
rotating_caliper = RotatingCaliper(geo=segments_3)  # -> box_2, area_4
_3d_rotate_3 = Boolean(_3d_rotate_2)

# ---- group: assign box plane to lowest largest face
# normalize plane normal directions
box = Box(simplify(minbb_c.MinBB))
debrep = DeconstructBrep(Brep=box)  # -> simplify(Faces), Edges, Vertices
area = Area(Geometry=debrep.Faces)  # -> Area, Centroid
sort = SortList(Keys=area.Area, ValuesA=debrep.Faces)  # -> Keys, reverse(ValuesA)
item = ListItem(List=sort.ValuesA, Index=0, Wrap=True)  # -> Item, Item1

# ----
merge = Merge(Data1=item.Item, Data2=item.Item1)

# ---- group: assign box plane to lowest largest face (continued)
area_2 = Area(Geometry=merge)  # -> Area, Centroid
pdecon = Deconstruct(Point=area_2.Centroid)  # -> XComponent, YComponent, ZComponent
sort_2 = SortList(Keys=pdecon.ZComponent, ValuesA=merge)  # -> Keys, ValuesA
item_2 = ListItem(List=sort_2.ValuesA, Index=0, Wrap=True)
pln = Plane(item_2)
deplane = DeconstructPlane(Plane=pln)  # -> Origin, XAxis, YAxis, ZAxis
pl_origin = PlaneOrigin(Base=pln, Origin="0,0,0")
devec = DeconstructVector(Vector=deplane.ZAxis)  # -> XComponent, YComponent, ZComponent
larger = LargerThan(FirstNumber=devec.ZComponent, SecondNumber=0)  # -> LargerThan, OrEqualTo
dispatch = Dispatch(List=pln, DispatchPattern=larger.LargerThan)  # -> ListA, ListB
pflip = FlipPlane(Plane=dispatch.ListB, ReverseX=False, ReverseY=False, SwapAxes=True)
merge_2 = Merge(Data1=dispatch.ListA, Data2=pflip)
bbox = BoundingBox(Content=graft(box), Plane=merge_2, UnionBox=False)  # -> simplify(Box), Box_2

# ----
bbs = Box(simplify(bbox.Box))
filter = StreamFilter(Gate=_3d_rotate_3, Stream0=rotating_caliper.box_2, Stream1=bbs)
bbs_2 = Box(simplify(filter))
bbs_3 = ClusterOutput(bbs_2)

# ==== cluster CalculateEfficiency
segments = ClusterInput()
modules = ClusterInput()
segments_2 = Surface(segments)
modules_2 = Data(modules)
trim = TrimTree(Tree=modules_2, Depth=1)

# ----
# direct connection segments>>area was causing problems
debrep = DeconstructBrep(Brep=segments_2)  # -> Faces, Edges, Vertices
join = JoinCurves(Curves=debrep.Edges, Preserve=False)

lng = ListLength(List=trim)
runion = RegionUnion(Curves=trim)  # -> simplify(Result)
project = Project(Geometry=join, Plane=runion)  # -> Geometry, Transform
area = Area(Geometry=project.Geometry)  # -> Area, Centroid
area_2 = Area(Geometry=runion)  # -> Area, Centroid
modules_segment = Integer(lng)
division = Division(A=area.Area, B=area_2.Area)
area_efficiency = Number(simplify(division))
panel = Panel(modules_segment)
avr = Average(Input=flatten(area_efficiency))
avr_efficiency = Number(avr)
panel_2 = Panel(avr_efficiency)
avr_efficiency_2 = ClusterOutput(avr_efficiency)

# ==== cluster SegmentFeasibility2x24x1
srf = ClusterInput()
panel = Panel("""0
2
3
4""")
srf_2 = Surface(srf)
item = ListItem(List=srf_2, Index=panel, Wrap=True)
crv = Curve(srf_2)
rotating_caliper = RotatingCaliper_2(crv=crv)  # -> box_2, area_4
segments = Curve(simplify(graft(crv)))
boundary = BoundarySurfaces(Edges=segments)

# ---- group: sort segments per pinbed configuration
box = Box(simplify(rotating_caliper.box_2))
number_slider = Slider(0.354, range=0..1)
boxfit = BoxFit(box=box, dim_1="2", dim_2="2")  # -> fit_2, unfit_2
boxfit_2 = BoxFit(box=boxfit.unfit_2, dim_1="4", dim_2="1")  # -> fit_2, unfit_2
box_2x2s = Box(boxfit.fit_2)
box_4x1s = Box(boxfit_2.fit_2)
unfeasible = Box(boxfit_2.unfit_2)
tstat = TreeStatistics(Tree=box_2x2s)  # -> Paths, Length, Count
ahsl = SplitAHSL(Colour=ColourSwatch(SwatchColor=RGB(65, 156, 0)))  # -> Alpha, Hue, Saturation, Luminance
tstat_2 = TreeStatistics(Tree=box_4x1s)  # -> Paths, Length, Count
ahsl_2 = SplitAHSL(Colour=ColourSwatch(SwatchColor=RGB(255, 183, 0)))  # -> Alpha, Hue, Saturation, Luminance
ahsl_3 = SplitAHSL(Colour=ColourSwatch(SwatchColor=RGB(255, 69, 69)))  # -> Alpha, Hue, Saturation, Luminance
tstat_3 = TreeStatistics(Tree=unfeasible)  # -> Paths, Length, Count
branch = TreeBranch(Tree=simplify(boundary), Path=tstat.Paths, MaintainPaths=True)
hsl = ColourHSL(Alpha=number_slider, Hue=ahsl.Hue, Saturation=ahsl.Saturation, Luminance=ahsl.Luminance)
branch_2 = TreeBranch(Tree=simplify(boundary), Path=tstat_2.Paths, MaintainPaths=True)
branch_3 = TreeBranch(Tree=simplify(boundary), Path=tstat_3.Paths, MaintainPaths=True)
hsl_2 = ColourHSL(Alpha=number_slider, Hue=ahsl_2.Hue, Saturation=ahsl_2.Saturation, Luminance=ahsl_2.Luminance)
hsl_3 = ColourHSL(Alpha=number_slider, Hue=ahsl_3.Hue, Saturation=ahsl_3.Saturation, Luminance=ahsl_3.Luminance)
preview = CustomPreview(Geometry=branch, Material=hsl)
preview_2 = CustomPreview(Geometry=branch_3, Material=hsl_3)
preview_3 = CustomPreview(Geometry=branch_2, Material=hsl_2)
boxdim = BoxDim(B=unfeasible, S=1)

# ==== cluster IntersectStressLines
stress_lines = ClusterInput()
stress_lines_2 = Curve(stress_lines)
bang = ExplodeTree(Data=stress_lines_2)  # -> Branch0, Branch1
edge_cables = Curve(bang.Branch1)
corner_cables = Curve(bang.Branch0)
crossref = CrossReference(ListA=corner_cables, ListB=edge_cables, CrossMode=1)  # -> ListA, ListB
ccx = CurveCurve(CurveA=crossref.ListA, CurveB=crossref.ListB)  # -> Points, ParamsA, ParamsB
intersection_points = Point(ccx.Points)
intersection_points_2 = ClusterOutput(intersection_points)

# ==== cluster JigglePoints
maximum_deviation = ClusterInput()
intersection_points = ClusterInput()
curves_to_snap = ClusterInput()
rho_values = ClusterInput()
phi_values = ClusterInput()
intersection_points_2 = Point(flatten(intersection_points))
curves_to_snap_2 = Curve(curves_to_snap)
phi_values_2 = Number(phi_values)
maximum_deviation_2 = Number(maximum_deviation)
rho_values_2 = Number(rho_values)
pt = Point(simplify(graft(intersection_points_2)))
lot = Integer(Slider(2, range=0..10))
neg = Negative(Value=lot)
crv_cp = CurveClosestPoint(Point=pt, Curve=curves_to_snap_2)  # -> Point, Parameter, Distance
_10º = PowerOf10(Value=neg)
smaller = SmallerThan(FirstNumber=crv_cp.Distance, SecondNumber=_10º)  # -> SmallerThan, OrEqualTo
pt_2 = Point(pt)
dispatch = Dispatch(List=pt, DispatchPattern=smaller.SmallerThan)  # -> simplify(ListA), simplify(ListB)
bbox = BoundingBox(Content=flatten(pt_2), Plane=PlaneXY(0, 0, 0), UnionBox=True)  # -> Box, Box_2
edges = BrepEdges(Brep=bbox.Box)  # -> Naked, Interior, NonManifold
pt_on_curve = Point(dispatch.ListA)
pt_off_curve = Point(dispatch.ListB)
end = EndPoints(Curve=edges.Naked)  # -> Start, End
phi = Number(graft(phi_values_2))
toggle = BooleanToggle(False)
cp = ClosestPoint(Point=pt_2, Cloud=end.Start)  # -> ClosestPoint, CPIndex, Distance
max_phi = Slider(1, range=1..2)
round = Round(Number=phi)  # -> Nearest, Floor, Ceiling
Z = UnitZ(Factor=1)
vec2pt = Vector2Pt(PointA=pt_2, PointB=cp.ClosestPoint, Unitize=toggle)  # -> Vector, Length
cir = Circle(Plane=pt, Radius=maximum_deviation_2)
crossref = CrossReference(ListA=pt_off_curve, ListB=round.Nearest, CrossMode=3)  # -> ListA, ListB
crossref_2 = CrossReference(ListA=pt_on_curve, ListB=phi, CrossMode=3)  # -> ListA, ListB
radius = Number(graft(rho_values_2))
xprod = CrossProduct(VectorA=vec2pt.Vector, VectorB=Z, Unitize=toggle)  # -> Vector, Length
merge = Merge(Data1=crossref_2.ListB, Data2=crossref.ListB)
pi = Pi(Factor=max_phi)
pl = ConstructPlane(Origin=pt_2, XAxis=vec2pt.Vector, YAxis=xprod.Vector)
remap = RemapNumbers(Value=merge, Source=Domain(0, 1), Target=pi)  # -> Mapped, Clipped
remap_2 = RemapNumbers(Value=radius, Source=Domain(0, 1), Target=maximum_deviation_2)  # -> Mapped, Clipped
deviation_spaces = Curve(cir)
pt_3 = PointPolar(BasePlane=pl, XYAngle=remap.Mapped, ZAngle=0, Offset=remap_2.Mapped)
jiggled_points = Point(pt_3)
jiggled_points_2 = ClusterOutput(jiggled_points)

# ==== cluster MakeSegments
tolerance = ClusterInput()
stress_lines = ClusterInput()
tolerance_2 = Number(tolerance)
stress_lines_2 = Curve(stress_lines)
bang = ExplodeTree(Data=stress_lines_2)  # -> Branch0, Branch1
intersection_points = ClusterInput()
lot = Integer(Slider(0, range=0..10))
neg = Negative(Value=lot)
intersection_points_2 = Point(flatten(intersection_points))
corner_lines = Curve(bang.Branch0)
edge_lines = Curve(bang.Branch1)
_10º = PowerOf10(Value=neg)
# tolerance same as max deviation because maxDev is being set do that circles do not intersect - needs improvement
tolerance_3 = Number(tolerance_2)
crv_cp = CurveClosestPoint(Point=intersection_points_2, Curve=graft(corner_lines))  # -> Point, Parameter, Distance
crv_cp_2 = CurveClosestPoint(Point=intersection_points_2, Curve=graft(edge_lines))  # -> Point, Parameter, Distance
smaller = SmallerThan(FirstNumber=crv_cp.Distance, SecondNumber=tolerance_3)  # -> SmallerThan, OrEqualTo
smaller_2 = SmallerThan(FirstNumber=crv_cp_2.Distance, SecondNumber=tolerance_3)  # -> SmallerThan, OrEqualTo
dispatch = Dispatch(List=intersection_points_2, DispatchPattern=smaller_2.SmallerThan)  # -> ListA, ListB
dispatch_2 = Dispatch(List=intersection_points_2, DispatchPattern=simplify(smaller.SmallerThan))  # -> ListA, ListB
pt_on_curve = Point(simplify(dispatch_2.ListA))
pt_on_curve_2 = Point(simplify(dispatch.ListA))
alongcrv = SortAlongCurve(Points=pt_on_curve, Curve=simplify(graft(corner_lines)))  # -> simplify(Points), Indices
alongcrv_2 = SortAlongCurve(Points=pt_on_curve_2, Curve=simplify(graft(edge_lines)))  # -> simplify(Points), Indices
pline = PolyLine(Vertices=alongcrv.Points, Closed=False)
pline_2 = PolyLine(Vertices=alongcrv_2.Points, Closed=False)
entwine = Entwine(Branch00=pline, Branch01=pline_2, FlattenInputs=True)  # -> simplify(Result)
segment_plans = Curve(entwine)
segment_plans_2 = ClusterOutput(segment_plans)

# ==== cluster MakeKeystone
surface_plan = ClusterInput()
intersection_points = ClusterInput()
surface_plan_2 = Curve(surface_plan)
intersection_points_2 = Point(intersection_points)
explode = Explode(Curve=surface_plan_2, Recursive=True)  # -> Segments, Vertices
lng = ListLength(List=explode.Segments)
division = Division(A=lng, B=2)
area = Area(Geometry=surface_plan_2)  # -> Area, Centroid
center = Point(area.Centroid)
cps = ClosestPoints(Point=center, Cloud=flatten(intersection_points_2), Count=division)  # -> ClosestPoint, CPIndex, Distance
cir = Circle(Plane=center, Radius=1)
alongcrv = SortAlongCurve(Points=cps.ClosestPoint, Curve=cir)  # -> Points, Indices
pline = PolyLine(Vertices=alongcrv.Points, Closed=Toggle(True))
keystone_plan = Curve(pline)
keystone_plan_2 = ClusterOutput(keystone_plan)

# ==== cluster TestSurface
number_slider = Slider(3, range=0..10)
srf = Surface(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)
scale_nu = ScaleNU(Geometry=srf, Plane=PlaneXY(0, 0, 0), ScaleX=1, ScaleY=1, ScaleZ=Slider(1.042, range=0..5))  # -> Geometry, Transform
panel = Panel("1")
srf_2 = Surface(scale_nu.Geometry)
divide = DivideDomain²(Domain=srf_2, UCount=number_slider, VCount=number_slider)
subsrf = Isotrim(Surface=reparameterize(srf_2), Domain=divide)
S = ClusterOutput(subsrf)

# ==== cluster SpringAngles
crv = ClusterInput()
crv_2 = Curve(crv)
end = EndPoints(Curve=crv_2)  # -> Start, End
xy = XYPlane(Origin=end.Start)
project = Project(Geometry=crv_2, Plane=xy)  # -> Geometry, Transform
end_2 = EndPoints(Curve=project.Geometry)  # -> Start, End
vec2pt = Vector2Pt(PointA=end_2.Start, PointB=end_2.End, Unitize=False)  # -> Vector, Length
vec2pt_2 = Vector2Pt(PointA=end.Start, PointB=end.End, Unitize=False)  # -> Vector, Length
angle = Angle(VectorA=vec2pt_2.Vector, VectorB=vec2pt.Vector)  # -> Angle, Reflex
deg = Degrees(Radians=angle.Angle)
panel = Panel(deg)
sort = SortList(Keys=flatten(deg))  # -> Keys, ValuesA
bnd = Bounds(Numbers=sort.Keys)
panel_2 = Panel(bnd)

# ==== cluster BottomPoints
ltol = ClusterInput()
mesh = ClusterInput()
mesh_2 = Mesh(mesh)
ltol_2 = Integer(ltol)
demesh = DeconstructMesh(Mesh=mesh_2)  # -> Vertices, Faces, Colours, Normals
pt = Point(flatten(demesh.Vertices))
bbox = BoundingBox(Content=pt, Plane=PlaneXY(0, 0, 0), UnionBox=True)  # -> Box, Box_2
box = EvaluateBox(Box=bbox.Box, UParameter="0", VParameter="0", WParameter="0")  # -> Plane, Point, Include
neg = Negative(Value=ltol_2)
_10º = PowerOf10(Value=neg)
cp = PlaneClosestPoint(Point=pt, Plane=box.Plane)  # -> Point, UVPoint, Distance
panel = Panel("1e-10")
smaller = SmallerThan(FirstNumber=cp.Distance, SecondNumber=_10º)  # -> SmallerThan, OrEqualTo
boxdims = BoxDims(box=bbox.Box)  # -> dx_2, dy_2, dz_2
dispatch = Dispatch(List=pt, DispatchPattern=smaller.SmallerThan)  # -> ListA, ListB
duppt = RemoveDuplicatePts(Points=dispatch.ListA, Tolerance=0.01)  # -> simplify(UniquePoints)
division = Division(A=boxdims.dx_2, B="2")
pgroups = PointGroups(Points=duppt, Distance=division)  # -> simplify(Groups), Indices
pt_2 = Point(pgroups.Groups)
pt_3 = ClusterOutput(pt_2)

# ==== cluster PatternDomains

# ---- group: pattern 5
number_slider = Slider(0, range=0..10)
number_slider_2 = Slider(2, range=0..10)
addition = Addition(A=number_slider, B="2")
series = Series(Start=addition, Step="4", Count=number_slider_2)
series_2 = Series(Start=number_slider, Step="4", Count=number_slider_2)
multiplication = Multiplication(A=series_2, B=".25")
multiplication_2 = Multiplication(A=series, B=".25")
pi = Pi(Factor=multiplication_2)
pi_2 = Pi(Factor=multiplication)
panel = Panel(pi_2)
panel_2 = Panel(pi)
dom = ConstructDomain(DomainStart=panel, DomainEnd=panel_2)  # -> graft(Domain)

# ---- group: pattern 6
number_slider_3 = Slider(0, range=0..10)
number_slider_4 = Slider(4, range=0..10)
addition_2 = Addition(A=number_slider_3, B="1")
series_3 = Series(Start=addition_2, Step="2", Count=number_slider_4)
series_4 = Series(Start=number_slider_3, Step="2", Count=number_slider_4)
multiplication_3 = Multiplication(A=series_4, B=".25")
multiplication_4 = Multiplication(A=series_3, B=".25")
pi_3 = Pi(Factor=multiplication_4)
pi_4 = Pi(Factor=multiplication_3)
panel_3 = Panel(pi_4)
panel_4 = Panel(pi_3)
dom_2 = ConstructDomain(DomainStart=panel_3, DomainEnd=panel_4)  # -> graft(Domain)

# ---- group: pattern 4
number_slider_5 = Slider(1, range=0..10)
number_slider_6 = Slider(2, range=0..10)
addition_3 = Addition(A=number_slider_5, B="2")
series_5 = Series(Start=addition_3, Step="4", Count=number_slider_6)
series_6 = Series(Start=number_slider_5, Step="4", Count=number_slider_6)
multiplication_5 = Multiplication(A=series_6, B=".25")
multiplication_6 = Multiplication(A=series_5, B=".25")
pi_5 = Pi(Factor=multiplication_6)
pi_6 = Pi(Factor=multiplication_5)
panel_5 = Panel(pi_6)
panel_6 = Panel(pi_5)
dom_3 = ConstructDomain(DomainStart=panel_5, DomainEnd=panel_6)  # -> graft(Domain)

# ---- group: pattern 1
multiplication_7 = Multiplication(A=Slider(0, range=0..10), B=".25")
multiplication_8 = Multiplication(A=Slider(0, range=0..10), B=".25")
pi_7 = Pi(Factor=multiplication_7)
pi_8 = Pi(Factor=multiplication_8)
panel_7 = Panel(pi_7)
panel_8 = Panel(pi_8)
dom_4 = ConstructDomain(DomainStart=panel_7, DomainEnd=panel_8)

# ---- group: pattern 2
multiplication_9 = Multiplication(A=Slider(2, range=0..10), B=".25")
multiplication_10 = Multiplication(A=Slider(6, range=0..10), B=".25")
pi_9 = Pi(Factor=multiplication_9)
pi_10 = Pi(Factor=multiplication_10)
panel_9 = Panel(pi_9)
panel_10 = Panel(pi_10)
dom_5 = ConstructDomain(DomainStart=panel_9, DomainEnd=panel_10)

# ---- group: pattern 3
multiplication_11 = Multiplication(A=Slider(1, range=0..10), B=".25")
multiplication_12 = Multiplication(A=Slider(5, range=0..10), B=".25")
pi_11 = Pi(Factor=multiplication_11)
pi_12 = Pi(Factor=multiplication_12)
panel_11 = Panel(pi_11)
panel_12 = Panel(pi_12)
dom_6 = ConstructDomain(DomainStart=panel_11, DomainEnd=panel_12)

# ---- group: pattern 7
multiplication_13 = Multiplication(A=Slider(0, range=0..10), B=".25")
multiplication_14 = Multiplication(A=Slider(8, range=0..10), B=".25")
pi_13 = Pi(Factor=multiplication_13)
pi_14 = Pi(Factor=multiplication_14)
panel_13 = Panel(pi_13)
panel_14 = Panel(pi_14)
dom_7 = ConstructDomain(DomainStart=panel_13, DomainEnd=panel_14)

# ----
G = ClusterInput()
filter = StreamFilter(Gate=G, Stream1=dom_4, Stream2=dom_5, Stream3=dom_6, Stream4=dom, Stream5=dom_3, Stream6=dom_2, Stream7=dom_7)
s_7 = ClusterOutput(filter)

# ==== cluster QuickGraphs

# ---- group: whole shell
max_stress_comp = Number(-0.146)
max_stress_tens = Number(0.186)
max_disp = Number(0.03259199848)

# ----
max_stress_comp_2 = Number([-0.736, -0.51, -0.109, -0.151, -0.157, -0.148, -0.147, -0.147, -0.147, -0.147, -0.147])
max_stress_tens_2 = Number([4.69, 3.24, 0.333, 0.164, 0.224, 0.191, 0.184, 0.183, 0.183, 0.183, 0.183])
max_disp_2 = Number([1.58279036, 1.182691614, 0.3778172142, 0.1103610701, 0.05740937502, 0.03608507293, 0.032556884, 0.03216712047, 0.03212689201, 0.03212284776, 0.03212244312])
mag_ct = Integer([0, 1, 2, 3, 4, 5, 6, 7, 8, 9, 10])
merge = Merge(Data1=graft(max_stress_comp_2), Data2=graft(max_stress_tens_2), Data3=graft(max_disp_2))  # -> simplify(Result)
panel = Panel("""max stress comp
max stress tens
max disp""")
merge_2 = Merge(Data1=graft(max_stress_comp), Data2=graft(max_stress_tens), Data3=graft(max_disp))  # -> simplify(Result)
panel_2 = Panel(merge_2)
flip = FlipMatrix(Data=merge)
panel_3 = Panel(flip)
chart = CreateChart(
    ChartName="My Chart",
    ChartSeries=panel,
    ChartXAxisLabels=mag_ct,
    ValueTree=flip,
    Chart_Theme="Bright Pastel",
    Chart_Type="Line")

# ==== cluster DivInt
crv = ClusterInput()
num = ClusterInput()

# ---- group: divide curve integer
crv_2 = Curve(crv)
len = Length(Curve=crv_2)
num_2 = Number(num)
division = Division(A=len, B=num_2)
round = Round(Number=division)  # -> Nearest, Floor, Ceiling
divide = DivideCurve(Curve=crv_2, Count=round.Ceiling, Kinks=False)  # -> simplify(Points), Tangents, Parameters

# ----
pline = PolyLine(Vertices=divide.Points, Closed=False)
explode = Explode(Curve=pline, Recursive=True)  # -> Segments, Vertices
eval = EvaluateCurve(Curve=reparameterize(explode.Segments), Parameter=".5")  # -> Point, Tangent, Angle
midpts = Point(simplify(eval.Point))
pts = Point(divide.Points)
pts_2 = ClusterOutput(pts)
midpts_2 = ClusterOutput(midpts)

# ==== cluster PatternDomains_2

# ---- group: pattern 5
number_slider = Slider(0, range=0..10)
number_slider_2 = Slider(2, range=0..10)
addition = Addition(A=number_slider, B="2")
series = Series(Start=addition, Step="4", Count=number_slider_2)
series_2 = Series(Start=number_slider, Step="4", Count=number_slider_2)
multiplication = Multiplication(A=series_2, B=".25")
multiplication_2 = Multiplication(A=series, B=".25")
pi = Pi(Factor=multiplication_2)
pi_2 = Pi(Factor=multiplication)
panel = Panel(pi_2)
panel_2 = Panel(pi)
dom = ConstructDomain(DomainStart=panel, DomainEnd=panel_2)  # -> graft(Domain)

# ---- group: pattern 6
number_slider_3 = Slider(0, range=0..10)
number_slider_4 = Slider(4, range=0..10)
addition_2 = Addition(A=number_slider_3, B="1")
series_3 = Series(Start=addition_2, Step="2", Count=number_slider_4)
series_4 = Series(Start=number_slider_3, Step="2", Count=number_slider_4)
multiplication_3 = Multiplication(A=series_4, B=".25")
multiplication_4 = Multiplication(A=series_3, B=".25")
pi_3 = Pi(Factor=multiplication_4)
pi_4 = Pi(Factor=multiplication_3)
panel_3 = Panel(pi_4)
panel_4 = Panel(pi_3)
dom_2 = ConstructDomain(DomainStart=panel_3, DomainEnd=panel_4)  # -> graft(Domain)

# ---- group: pattern 4
number_slider_5 = Slider(1, range=0..10)
number_slider_6 = Slider(2, range=0..10)
addition_3 = Addition(A=number_slider_5, B="2")
series_5 = Series(Start=addition_3, Step="4", Count=number_slider_6)
series_6 = Series(Start=number_slider_5, Step="4", Count=number_slider_6)
multiplication_5 = Multiplication(A=series_6, B=".25")
multiplication_6 = Multiplication(A=series_5, B=".25")
pi_5 = Pi(Factor=multiplication_6)
pi_6 = Pi(Factor=multiplication_5)
panel_5 = Panel(pi_6)
panel_6 = Panel(pi_5)
dom_3 = ConstructDomain(DomainStart=panel_5, DomainEnd=panel_6)  # -> graft(Domain)

# ---- group: pattern 1
multiplication_7 = Multiplication(A=Slider(0, range=0..10), B=".25")
multiplication_8 = Multiplication(A=Slider(0, range=0..10), B=".25")
pi_7 = Pi(Factor=multiplication_7)
pi_8 = Pi(Factor=multiplication_8)
panel_7 = Panel(pi_7)
panel_8 = Panel(pi_8)
dom_4 = ConstructDomain(DomainStart=panel_7, DomainEnd=panel_8)

# ---- group: pattern 2
multiplication_9 = Multiplication(A=Slider(2, range=0..10), B=".25")
multiplication_10 = Multiplication(A=Slider(6, range=0..10), B=".25")
pi_9 = Pi(Factor=multiplication_9)
pi_10 = Pi(Factor=multiplication_10)
panel_9 = Panel(pi_9)
panel_10 = Panel(pi_10)
dom_5 = ConstructDomain(DomainStart=panel_9, DomainEnd=panel_10)

# ---- group: pattern 3
multiplication_11 = Multiplication(A=Slider(1, range=0..10), B=".25")
multiplication_12 = Multiplication(A=Slider(5, range=0..10), B=".25")
pi_11 = Pi(Factor=multiplication_11)
pi_12 = Pi(Factor=multiplication_12)
panel_11 = Panel(pi_11)
panel_12 = Panel(pi_12)
dom_6 = ConstructDomain(DomainStart=panel_11, DomainEnd=panel_12)

# ---- group: pattern 7
multiplication_13 = Multiplication(A=Slider(0, range=0..10), B=".25")
multiplication_14 = Multiplication(A=Slider(8, range=0..10), B=".25")
pi_13 = Pi(Factor=multiplication_13)
pi_14 = Pi(Factor=multiplication_14)
panel_13 = Panel(pi_13)
panel_14 = Panel(pi_14)
dom_7 = ConstructDomain(DomainStart=panel_13, DomainEnd=panel_14)

# ----
G = ClusterInput()
filter = StreamFilter(Gate=G, Stream1=dom_4, Stream2=dom_5, Stream3=dom_6, Stream4=dom, Stream5=dom_3, Stream6=dom_2, Stream7=dom_7)
s_2 = ClusterOutput(filter)

# ==== cluster DivInt_2
crv = ClusterInput()
num = ClusterInput()

# ---- group: divide curve integer
crv_2 = Curve(crv)
len = Length(Curve=crv_2)
num_2 = Number(num)
division = Division(A=len, B=num_2)
round = Round(Number=division)  # -> Nearest, Floor, Ceiling
divide = DivideCurve(Curve=crv_2, Count=round.Ceiling, Kinks=False)  # -> simplify(Points), Tangents, Parameters

# ----
pline = PolyLine(Vertices=divide.Points, Closed=False)
explode = Explode(Curve=pline, Recursive=True)  # -> Segments, Vertices
eval = EvaluateCurve(Curve=reparameterize(explode.Segments), Parameter=".5")  # -> Point, Tangent, Angle
Z = UnitZ(Factor=1)
midpts = Point(simplify(eval.Point))
pts = Point(divide.Points)
xprod = CrossProduct(VectorA=eval.Tangent, VectorB=Z, Unitize=False)  # -> Vector, Length
perp = Vector(xprod.Vector)
pts_2 = ClusterOutput(pts)
midpts_2 = ClusterOutput(midpts)
perp_2 = ClusterOutput(perp)

# ==== cluster DivideRect
rec = ClusterInput()
divv = ClusterInput()
divu = ClusterInput()
rec_2 = Rectangle(rec)
divv_2 = Integer(divv)
divu_2 = Integer(divu)
drec = DeconstuctRectangle(Rectangle=rec_2)  # -> BasePlane, XInterval, YInterval
dom² = ConstructDomain²(DomainU=drec.XInterval, DomainV=drec.YInterval)
divide = DivideDomain²(Domain=dom², UCount=divu_2, VCount=divv_2)
dedom2 = DeconstructDomain²(Domain=divide)  # -> UComponent, VComponent
graft = GraftTree(Tree=drec.BasePlane, IncludeEmptyLists=True, IncludeNullItems=True)
rectangle = Rectangle(Plane=graft, XSize=dedom2.UComponent, YSize=dedom2.VComponent, Radius=0)  # -> Rectangle, Length
rec_3 = Rectangle(rectangle.Rectangle)
rec_4 = ClusterOutput(rec_3)

# ==== cluster BoxSize
box = ClusterInput()
box_2 = Box(box)
debox = DeconstructBox(Box=box_2)  # -> Plane, X, Y, Z
dedomain = DeconstructDomain(Domain=debox.X)  # -> Start, End
dedomain_2 = DeconstructDomain(Domain=debox.Y)  # -> Start, End
dedomain_3 = DeconstructDomain(Domain=debox.Z)  # -> Start, End
subtraction = Subtraction(A=dedomain_2.End, B=dedomain_2.Start)
subtraction_2 = Subtraction(A=dedomain.End, B=dedomain.Start)
subtraction_3 = Subtraction(A=dedomain_3.End, B=dedomain_3.Start)
Y = Number(subtraction)
X = Number(subtraction_2)
Z = Number(subtraction_3)
multiplication = Multiplication(A=X, B=Y)
multiplication_2 = Multiplication(A=multiplication, B=Z)
V = Number(multiplication_2)
A = Number(multiplication)
Y_2 = ClusterOutput(Y)
X_2 = ClusterOutput(X)
Z_2 = ClusterOutput(Z)
V_2 = ClusterOutput(V)
A_2 = ClusterOutput(A)

# ==== cluster RotatingCaliper
pi = Pi(Factor=1)
geo = ClusterInput()
range = Range(Domain=pi, Steps=Slider(100, range=0..100))
xy = XYPlane(Origin=Point(0, 0, 0))
geo_2 = Geometry(geo)
prot = RotatePlane(Plane=xy, Angle=range)
bbox = BoundingBox(Content=graft(geo_2), Plane=prot)  # -> Box, Box_2
trim = TrimTree(Tree=simplify(bbox.Box), Depth=1)
geo_3 = Geometry(simplify(trim))
area = Area(Geometry=geo_3)  # -> Area, Centroid
sort = SortList(Keys=area.Area, ValuesA=geo_3)  # -> Keys, ValuesA
item = ListItem(List=sort.ValuesA, Index=0, Wrap=True)
area_2 = Area(Geometry=item)  # -> Area, Centroid
box = Box(item)
area_3 = Number(area_2.Area)
box_2 = ClusterOutput(box)
area_4 = ClusterOutput(area_3)

# ==== cluster RotatingCaliper3D
pi = Pi(Factor=Slider(0.5, range=0..0.5))
pi_2 = Pi(Factor=Slider(0.5, range=0..0.5))
number_slider = Slider(5, range=0..10)
geo = ClusterInput()
range = Range(Domain=pi, Steps=Slider(61, range=0..100))
range_2 = Range(Domain=pi_2, Steps=Slider(20, range=0..100))
cull_i = CullIndex(List=range_2, Indices="0", Wrap=True)
item = ListItem(List=geo, Index=number_slider, Wrap=True)
xy = XYPlane(Origin=Point(0, 0, 0))
phi = Number(range)
theta = Number(cull_i)
geo_2 = Geometry(simplify(graft(geo)))
prot = RotatePlane(Plane=xy, Angle=theta)
bbox = BoundingBox(Content=geo_2, Plane=prot)  # -> Box, Box_2
trim = TrimTree(Tree=simplify(bbox.Box), Depth=1)
geo_3 = Geometry(simplify(trim))
area = Area(Geometry=geo_3)  # -> Area, Centroid
sort = SortList(Keys=area.Area, ValuesA=prot)  # -> Keys, simplify(ValuesA)
item_2 = ListItem(List=sort.ValuesA, Index=0, Wrap=True)
geo_4 = Geometry(geo_2)
# switch to transformations instead of planes!
best_horizontal_rotation_plane = Plane(item_2)
rotate = Rotate(Angle=1.570796327, Plane=PlaneXY(0, 0, 0))  # -> Geometry, Transform
neg = Negative(Value=phi)
deplane = DeconstructPlane(Plane=best_horizontal_rotation_plane)  # -> Origin, XAxis, YAxis, ZAxis
rot3d = Rotate3D(Geometry=best_horizontal_rotation_plane, Angle=neg, Center=deplane.Origin, Axis=deplane.YAxis)  # -> simplify(Geometry), Transform
bbox_2 = BoundingBox(Content=geo_4, Plane=rot3d.Geometry)  # -> Box, Box_2
trim_2 = TrimTree(Tree=simplify(bbox_2.Box), Depth=1)
geo_5 = Geometry(simplify(trim_2))
volume = Volume(Geometry=geo_5)  # -> Volume, Centroid
sort_2 = SortList(Keys=volume.Volume, ValuesA=geo_5)  # -> Keys, ValuesA
sort_3 = SortList(Keys=area.Area, ValuesA=geo_3)  # -> Keys, ValuesA
item_3 = ListItem(List=sort_2.ValuesA, Index=0, Wrap=True)
item_4 = ListItem(List=sort_3.ValuesA, Index=0, Wrap=True)
area_2 = Area(Geometry=item_4)  # -> Area, Centroid
horizontal_box = Box(item_4)
rotated_box = Box(item_3)
branch = TreeBranch(Tree=[item_3, item_4], Path=number_slider, MaintainPaths=True)
area_3 = Number(area_2.Area)
horizontal_box_2 = ClusterOutput(horizontal_box)
area_4 = ClusterOutput(area_3)
rotated_box_2 = ClusterOutput(rotated_box)
boxsize = BoxSize(box=horizontal_box)  # -> X_2, Y_2, Z_2, A_2, V_2
boxsize_2 = BoxSize(box=item_3)  # -> X_2, Y_2, Z_2, A_2, V_2
panel = Panel(boxsize.Z_2)
panel_2 = Panel(boxsize_2.Z_2)

# ==== cluster BoxFit
box = ClusterInput()
box_2 = Box(box)
dim_1 = ClusterInput()
dim_2 = ClusterInput()
dim_1_2 = Number(dim_1)
dim_2_2 = Number(dim_2)
boxsize = BoxSize(box=box_2)  # -> X_2, Y_2, Z_2, A_2, V_2
smaller = SmallerThan(FirstNumber=boxsize.X_2, SecondNumber=dim_1_2)  # -> SmallerThan, OrEqualTo
smaller_2 = SmallerThan(FirstNumber=boxsize.Y_2, SecondNumber=dim_2_2)  # -> SmallerThan, OrEqualTo
smaller_3 = SmallerThan(FirstNumber=boxsize.X_2, SecondNumber=dim_2_2)  # -> SmallerThan, OrEqualTo
smaller_4 = SmallerThan(FirstNumber=boxsize.Y_2, SecondNumber=dim_1_2)  # -> SmallerThan, OrEqualTo
and = GateAnd(A=smaller.OrEqualTo, B=smaller_2.OrEqualTo)
and_2 = GateAnd(A=smaller_3.OrEqualTo, B=smaller_4.OrEqualTo)
or = GateOr(A=and, B=and_2)
toggle = BooleanToggle(True)
dispatch = Dispatch(List=box_2, DispatchPattern=or)  # -> ListA, ListB
clean = CleanTree(RemoveNulls=True, RemoveInvalid=True, RemoveEmpty=toggle, Tree=dispatch.ListB)
clean_2 = CleanTree(RemoveNulls=True, RemoveInvalid=True, RemoveEmpty=toggle, Tree=dispatch.ListA)
fit = Box(clean_2)
unfit = Box(clean)
unfit_2 = ClusterOutput(unfit)
fit_2 = ClusterOutput(fit)

# ==== cluster BoxDim
B = ClusterInput()
edges = BrepEdges(Brep=B)  # -> Naked, Interior, NonManifold
split = SplitList(List=edges.Naked, Index=Slider(2, range=0..10))  # -> ListA, ListB
S = ClusterInput()
end = EndPoints(Curve=split.ListA)  # -> Start, End
neg = Negative(Value=Slider(0.593, range=0..1))
aligndim = AlignedDimension(Plane=PlaneXY(0, 0, 0), PointA=end.Start, PointB=end.End, Offset=neg, Text="{0:0.00}", Size=S)

# ==== cluster RotatingCaliper_2
crv = ClusterInput()
pi = Pi(Factor=1)
crv_2 = Curve(crv)
range = Range(Domain=pi, Steps=Slider(100, range=0..100))
xy = XYPlane(Origin=Point(0, 0, 0))
prot = RotatePlane(Plane=xy, Angle=range)
bbox = BoundingBox(Content=graft(crv_2), Plane=prot)  # -> Box, Box_2
trim = TrimTree(Tree=simplify(bbox.Box), Depth=1)
geo = Geometry(simplify(trim))
area = Area(Geometry=geo)  # -> Area, Centroid
sort = SortList(Keys=area.Area, ValuesA=geo)  # -> Keys, ValuesA
item = ListItem(List=sort.ValuesA, Index=0, Wrap=True)
area_2 = Area(Geometry=item)  # -> Area, Centroid
box = Box(item)
area_3 = Number(area_2.Area)
box_2 = ClusterOutput(box)
area_4 = ClusterOutput(area_3)

# ==== cluster BoxDims
box = ClusterInput()
box_2 = Box(box)
debox = DeconstructBox(Box=box_2)  # -> Plane, X, Y, Z
dedomain = DeconstructDomain(Domain=debox.X)  # -> Start, End
dedomain_2 = DeconstructDomain(Domain=debox.Y)  # -> Start, End
dedomain_3 = DeconstructDomain(Domain=debox.Z)  # -> Start, End
subtraction = Subtraction(A=dedomain.End, B=dedomain.Start)
subtraction_2 = Subtraction(A=dedomain_2.End, B=dedomain_2.Start)
subtraction_3 = Subtraction(A=dedomain_3.End, B=dedomain_3.Start)
dx = Number(subtraction)
dy = Number(subtraction_2)
dz = Number(subtraction_3)
dx_2 = ClusterOutput(dx)
dy_2 = ClusterOutput(dy)
dz_2 = ClusterOutput(dz)
