# Grasshopper definition analyseWholeShell_2021.gh (Grasshopper 1.0.7)
# plug-ins: karambaGH

image = ImageSampler(Filter="Colour", Interpolate=False, Umax=1, Umin=0, Vmax=1, Vmin=0, Wrap=1)
thickness_m = Slider(0.047, range=0.04..0.1)
load_pattern = Slider(2, range=1..7)
shell = Slider(2, range=1..2)
merge = Merge(Data1=shell, Data2=load_pattern, Data3=thickness_m)

# ---- group: ACORN sampler
# difference from DSE:
# DSE subdivides slider domain into N subdomain and samples mid point;
# ACORN includes end points of sliders, subdivides into N-1 subdomains and samples all start points plus last endpoint
c_script = CSharpScript()  # -> out, name, min, max; disabled
# ---------- c_script: C# ----------
    decimal _max, _min;
    System.Guid _name;


    IGH_Param tempPara = this.Component.Params.Input[0].Sources[0];
    //if (tempPara.GetType() == typeof(Grasshopper.Kernel.Special.GH_NumberSlider))
    //{
    Grasshopper.Kernel.Special.GH_NumberSlider NumSlider = tempPara as Grasshopper.Kernel.Special.GH_NumberSlider;
    _max = NumSlider.Slider.Maximum;
    _min = NumSlider.Slider.Minimum;
    _name = NumSlider.InstanceGuid;
    //}
    
    name = _name;
    min = _min;
    max = _max;
# ---------- end c_script ----------
readsliders = CSharpScript(S=merge)  # -> out, N, D; inputs S: list
# ---------- readsliders: C# ----------
    IGH_Param mergeOutputParam = this.Component.Params.Input[0].Sources[0];
    var mergeComp = mergeOutputParam.Attributes.GetTopLevel.DocObject as IGH_Component;
    var sliders = mergeComp.Params.Input;

    List<string> nicknames = new List<string>();
    List<Interval> domains = new List<Interval>();

    foreach (var slider in sliders)
    {
      var sliderSource = slider.Sources[0];
      nicknames.Add(sliderSource.NickName);

      Grasshopper.Kernel.Special.GH_NumberSlider NumSlider = sliderSource as Grasshopper.Kernel.Special.GH_NumberSlider;
      //var _max = NumSlider.Slider.Maximum;
      Interval sliderDomain = new Interval ((double) NumSlider.Slider.Minimum, (double) NumSlider.Slider.Maximum);
      //_min = NumSlider.Slider.Minimum;
      domains.Add(sliderDomain);
    }


    N = nicknames;
    D = domains;
# ---------- end readsliders ----------
item = ListItem(List=readsliders.D, Index=0, Wrap=True)  # -> Item, Item1, Item2
range = Range(Domain=item.Item, Steps=Slider(1, range=1..10))  # -> simplify(Range)
range_2 = Range(Domain=item.Item1, Steps=Slider(6, range=1..10))  # -> simplify(Range)
range_3 = Range(Domain=item.Item2, Steps=Slider(6, range=1..12))  # -> simplify(Range)
crossref = CrossReference(ListC=range, ListA=range_2, ListB=range_3, CrossMode=1)  # -> ListC, ListA, ListB
entwine = Entwine(Branch0X=crossref.ListC, Branch1X=crossref.ListA, Branch2X=crossref.ListB, FlattenInputs=False)  # -> simplify(Result)
flip = FlipMatrix(Data=entwine)
panel = Panel(flip)
design_map = Number(flip)
labels = Text(readsliders.N)

# ----
panel_2 = Panel(readsliders.out)
shell_5x5 = Surface(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)
shell_4x4 = Surface(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)
shell_6x6 = Surface(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)
shell_7x7 = Surface(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)
shell_8x8 = Surface(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)
lor_7_8x7_2 = Surface(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)
_6x6 = Surface(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)

# ---- group: for generating catalog
number_slider = Slider(97, range=0..97)
branch = TreeBranch(Tree=design_map, Path=number_slider, MaintainPaths=True)

# ----
merge_2 = Merge(Data1=lor_7_8x7_2, Data2=_6x6)
merge_3 = Merge(Data1=shell_4x4, Data2=shell_5x5, Data3=shell_6x6, Data4=shell_7x7, Data5=shell_8x8)
subtraction = Subtraction(B=4)
current_solution = Integer(number_slider)
item_2 = ListItem(List=merge_3, Index=subtraction, Wrap=True)
item_3 = ListItem(List=branch, Index=0, Wrap=True)  # -> Item, Item1, Item2
thickness_m_2 = Number(item_3.Item2)
load_pattern_2 = Integer(item_3.Item1)
shell_2 = Integer(item_3.Item)
subtraction_2 = Subtraction(A=shell_2, B=1)
item_4 = ListItem(List=merge_2, Index=subtraction_2, Wrap=True)
srf = Surface(item_4)
panel_3 = Panel(shell_2)
mesh_breps = MeshBrepsKaramba3D(
    Brep=srf,
    MeshResolution=Slider(0.1, range=0..1),
    EdgeRefinementFactor=Slider(0.2, range=0..1),
    PointReduction=False,
    SmoothingStepSize=Slider(1, range=0..1),
    SmoothingIterations=Slider(3, range=0..10))  # -> Mesh, Info
mesh = Mesh(mesh_breps.Mesh)

# ---- group: non horizontally planar support points
lot = Integer(Slider(2, range=0..10))
mesh_2 = Mesh(mesh)
srf_2 = Surface(srf)
edges = BrepEdges(Brep=srf_2)  # -> Naked, Interior, NonManifold
culln = CullNth(List=edges.Naked, CullFrequency=2)
neg = Negative(Value=lot)
demesh = DeconstructMesh(Mesh=mesh_2)  # -> Vertices, Faces, Colours, Normals
corners = Curve(culln)
pull = PullPoint(Point=demesh.Vertices, Geometry=corners, ClosestOnly=True)  # -> ClosestPoint, Distance
_10º = PowerOf10(Value=neg)
smaller = SmallerThan(FirstNumber=pull.Distance, SecondNumber=_10º)  # -> SmallerThan, OrEqualTo
dispatch = Dispatch(List=pull.ClosestPoint, DispatchPattern=smaller.SmallerThan)  # -> ListA, ListB
pt = Point(dispatch.ListA)

# ----
dead_load_kn_m2 = Slider(1, range=0..10)
safety_factor = Slider(1.35, range=0..10)
live_load_kn_m2 = Slider(1.5, range=0..10)
safety_factor_2 = Slider(1.5, range=0..10)
mesh_3 = Mesh(mesh)
bbox = BoundingBox(Content=mesh_3, Plane=PlaneXY(0, 0, 0), UnionBox=True)  # -> Box, Box_2
multiplication = Multiplication(A=safety_factor, B=dead_load_kn_m2)
multiplication_2 = Multiplication(A=safety_factor_2, B=live_load_kn_m2)
bottompoints = BottomPoints(mesh=mesh, ltol=Slider(1, range=0..10))
box = EvaluateBox(Box=bbox.Box, UParameter=0.5, VParameter=0.5, WParameter="1")  # -> Plane, Point, Include
demesh_2 = DeconstructMesh(Mesh=mesh_3)  # -> Vertices, Faces, Colours, Normals
Z = UnitZ(Factor=safety_factor)
thickness_m_3 = Number(thickness_m_2)
Z_2 = UnitZ(Factor=multiplication)
rev = Reverse(Vector=Z)
cp = ClosestPoint(Point=box.Point, Cloud=demesh_2.Vertices)  # -> ClosestPoint, CPIndex, Distance
load_pattern_3 = Integer(load_pattern_2)
rev_2 = Reverse(Vector=Z_2)
mesh_4 = Mesh(mesh)
multiplication_3 = Multiplication(A=thickness_m_3, B=100)
supp = SupportKaramba3D(PosInd=cp.ClosestPoint, menu=[buttons(off, off, off, off, off, on)])
asymmetrical_load_patterns = AsymmetricalLoadPatterns(mesh=mesh_4, int=load_pattern_3, load_kn_m2=multiplication_2)
supp_2 = SupportKaramba3D(PosInd=flatten(pt), menu=[buttons(on, on, on, off, off, off)])
cross_section = CrossSectionKaramba3D(
    FamilyNameOfCrossSection="DefaultCroSec",
    Material=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,
    Height_cm=multiplication_3,
    mode="Shell - Const")
loads = LoadsKaramba3D(Vector=rev_2, Mesh=mesh, mode="MeshLoad -Const.", menu=[buttons(off, off, on), buttons(on, on)])
loads_2 = LoadsKaramba3D(Vector=rev, mode="Gravity")
meshtoshell = MeshToShellKaramba3D(Mesh=mesh, CrossSection=cross_section, LimitDistance_m=0.005)  # -> Element, Points, Info
matselect = MaterialSelectionKaramba3D(menu=[dropdown(3), dropdown(9)])
merge_4 = Merge(Data1=loads_2, Data2=loads, Data3=asymmetrical_load_patterns)  # -> flatten(Result)
merge_5 = Merge(Data1=supp_2, Data2=supp)  # -> flatten(Result)
assemble = AssembleModelKaramba3D(Elem=meshtoshell.Element, Support=merge_5, Load=merge_4, Material=matselect, LimitDistance_m=0.005)  # -> Model, Info, Mass_kg, CenterOfGravity
number_slider_2 = Slider(6, range=0..10)
multiplication_4 = Multiplication(A=Slider(7.2, range=0..10), B=Slider(7.8, range=0..10))
analyzethii = AnalyzeThIIKaramba3D(Model=assemble.Model, RTolerance=1e-07, MaxIterations=50, NoTensionalNII=False)  # -> CalculatedModel, MaximumDisplacement_cm, ResultingForceOfGravity_kN, ElasticEnergy_kNm
division = Division(A=assemble.Mass_kg, B=multiplication_4)
panel_4 = Panel(division)
analyze = AnalyzeKaramba3D(Model=assemble.Model)  # -> CalculatedModel, MaximumDisplacement_cm, ResultingForceOfGravity_kN, ElasticEnergy_kNm
modelview = ModelViewKaramba3D(Model=analyze.CalculatedModel, ResultFactors=1, ResultCase=-1)  # -> Model, DeformedMesh, DeformedAxes, DeformedModel
bmodes = BucklingModesKaramba3D(Model=analyzethii.CalculatedModel, FromIndex=1, NumberOfModes=1, MaximumNumberOfIterations=300, Epsilon=1e-07)  # -> ModelWithBucklingModesAsLoadCaseResults, BucklingLoadFactors
shellview = ShellViewKaramba3D(Model=modelview.Model, IndexOfLayer=0)  # -> Model, MeshesOfRenderedShells, LegendColors, LegendTags
medges = MeshEdges(Mesh=shellview.MeshesOfRenderedShells)  # -> NakedEdges, InteriorEdges, NonManifoldEdges
crv = Curve(medges.NakedEdges)
percentile_stress = PercentileStress(model=modelview.Model, percentile=Slider(99, range=90..100))  # -> max_comp_stress_kn_cm2_3, max_tens_stress_kn_cm2_3, max_comp_stress_kn_cm2_4, max_tens_stress_kn_cm2_4
legend = Legend(Colour=shellview.LegendColors, Tags=shellview.LegendTags, LegendType=1)
disassemble = DisassembleMaterialKaramba3D(Material=matselect)  # -> Material, TypeOfMaterial, FamilyNameOfMaterial, NameOfMaterial, ElemIdentifiers, Color, YoungsModulusKNCm2Dir12, InPlaneShearModulus_kN_cm2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
modelview_2 = ModelViewKaramba3D(Model=bmodes.ModelWithBucklingModesAsLoadCaseResults, ResultFactors=1, ResultCase=-1)  # -> Model, DeformedMesh, DeformedAxes, DeformedModel
item_5 = ListItem(List=reverse(shellview.LegendTags), Index="1", Wrap=True)
item_6 = ListItem(List=shellview.LegendTags, Index="1", Wrap=True)
compressive_strength_kn_cm2 = Number(disassemble.YieldStrengthKNCm2Dir12)
max_comp_stress_xx_kn_cm2 = Number(percentile_stress.max_comp_stress_kn_cm2_4)
max_tens_stress_xx_kn_cm2 = Number(percentile_stress.max_tens_stress_kn_cm2_4)
max_displacement_cm = Number(analyzethii.MaximumDisplacement_cm)
buckling_safety_factors = Number(bmodes.BucklingLoadFactors)
# Compressive strength : 20 - 40 MPa
# Tensile strength - σ : 2 - 5 MPa
# Modulus of elasticity - E : 14 - 41 GPa
# 
# (https://www.engineeringtoolbox.com/concrete-properties-d_1223.html)
young_s_moduli_elasticity_kn_cm2 = Number(disassemble.YoungsModulusKNCm2Dir12)
max_comp_stress_kn_cm2 = Number(percentile_stress.max_comp_stress_kn_cm2_3)
max_tens_stress_kn_cm2 = Number(percentile_stress.max_tens_stress_kn_cm2_3)
max_comp_stress_kn_cm2_2 = Number(item_6)
max_tens_stress_kn_cm2_2 = Number(item_5)
shellview_2 = ShellViewKaramba3D(Model=modelview_2.Model, IndexOfLayer=0)  # -> Model, MeshesOfRenderedShells, LegendColors, LegendTags
panel_5 = Panel(compressive_strength_kn_cm2)
panel_6 = Panel(max_comp_stress_kn_cm2)
panel_7 = Panel(max_tens_stress_kn_cm2)
panel_8 = Panel(max_comp_stress_kn_cm2_2)
panel_9 = Panel(max_tens_stress_kn_cm2_2)
multiplication_5 = Multiplication(A=young_s_moduli_elasticity_kn_cm2, B="0.01")
medges_2 = MeshEdges(Mesh=shellview_2.MeshesOfRenderedShells)  # -> NakedEdges, InteriorEdges, NonManifoldEdges
panel_10 = Panel(young_s_moduli_elasticity_kn_cm2)
legend_2 = Legend(Colour=shellview_2.LegendColors, Tags=shellview_2.LegendTags, LegendType=1)
elasticity_gpa = Number(multiplication_5)
crv_2 = Curve(medges_2.NakedEdges)
panel_11 = Panel(elasticity_gpa)
multiplication_6 = Multiplication(A=compressive_strength_kn_cm2, B="10")
multiplication_7 = Multiplication(A=max_comp_stress_kn_cm2, B="10")
multiplication_8 = Multiplication(A=max_tens_stress_kn_cm2, B="10")
multiplication_9 = Multiplication(A=max_comp_stress_xx_kn_cm2, B="10")
multiplication_10 = Multiplication(A=max_tens_stress_xx_kn_cm2, B="10")
compressive_strength_mpa = Number(multiplication_6)
max_comp_stress_mpa = Number(multiplication_7)
max_tens_stress_mpa = Number(multiplication_8)
panel_12 = Panel(buckling_safety_factors)
panel_13 = Panel(max_displacement_cm)
max_tens_stress_mpa_2 = Number(multiplication_10)
max_comp_stress_mpa_2 = Number(multiplication_9)
panel_14 = Panel(max_comp_stress_mpa)
panel_15 = Panel(compressive_strength_mpa)
panel_16 = Panel(max_tens_stress_mpa)
panel_17 = Panel(max_comp_stress_mpa_2)
panel_18 = Panel(max_tens_stress_mpa_2)
merge_6 = Merge(
    Data1=flatten(max_comp_stress_kn_cm2),
    Data2=flatten(max_comp_stress_xx_kn_cm2),
    Data3=flatten(max_tens_stress_xx_kn_cm2),
    Data4=flatten(max_tens_stress_kn_cm2),
    Data5=flatten(buckling_safety_factors),
    Data6=flatten(max_displacement_cm))  # -> simplify(Result)
current_solution_2 = Integer(current_solution)
results = Number(merge_6)
flatten = FlattenTree(Tree=results, Path=current_solution_2)
rec = DataRecorder(flatten, DataLimit=-10, RecordData=True)

# ----
# 2021 Jan 26
# DL 2
# LL 1.5
data = Data(Tree({0}: [-1.06, -0.08616580399, 0.06288124031, 0.68, 4.089947379, 0.2493632788], {1}: [-0.547, -0.05612223444, 0.03831871864, 0.299, 10.44832567, 0.09415340161], {2}: [-2.4, -0.1390502391, 0.4516670872, 3.07, 3.159595325, 1.337569032], {3}: [-1.06, -0.1051933727, 0.2659790555, 1.24, 7.939231621, 0.3842129882], {4}: [-1.8, -0.1399940487, 0.09743764851, 1.47, 3.095861695, 0.5261917897], {5}: [-0.851, -0.08937575841, 0.05443078684, 0.494, 7.896964322, 0.1545590825]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))

# ----
# 2021 Jan 26
# DL 1
# LL 1.5
data_2 = Data(Tree({0}: [-0.712, -0.05740965605, 0.04156523063, 0.461, 6.125786307, 0.1634439236], {1}: [-0.371, -0.03741059832, 0.0250998994, 0.205, 15.62309875, 0.06205409255], {2}: [-2.12, -0.1155539763, 0.4853574482, 3.01, 4.223264786, 1.218560048], {3}: [-0.912, -0.08464881185, 0.2930554782, 1.26, 10.4634501, 0.3660970918], {4}: [-1.52, -0.1107373433, 0.1007741425, 1.36, 4.085739827, 0.4609670322], {5}: [-0.74, -0.07118329186, 0.05559320694, 0.481, 10.38619177, 0.1306089132]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))

# ----
# 2021 Jan 27
# DL 1
# LL 2.5
data_3 = Data(Tree({0}: [-0.712, -0.05740965605, 0.04156523063, 0.461, 6.125786307, 0.1634439236], {1}: [-0.371, -0.03741059832, 0.0250998994, 0.205, 15.62309875, 0.06205409255], {2}: [-3.15, -0.1519949237, 0.8813239711, 4.95, 3.413610182, 2.084202502], {3}: [-1.37, -0.1032764422, 0.5237747503, 2.11, 8.391506545, 0.6058989612], {4}: [-2.08, -0.1459586581, 0.1954112336, 2.11, 3.262677753, 0.7554949274], {5}: [-1, -0.09606691057, 0.1088376379, 0.774, 8.299974902, 0.1947510783]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))

# ----
# 2021 Jan 26
# DL 2
# LL 3.0
data_4 = Data(Tree({0}: [-1.06, -0.08616580399, 0.06288124031, 0.68, 4.089947379, 0.2493632788], {1}: [-0.547, -0.05612223444, 0.03831871864, 0.299, 10.44832567, 0.09415340161], {2}: [-3.95, -0.1992241808, 1.025565752, 5.95, 2.509602459, 2.803424958], {3}: [-1.71, -0.1351731826, 0.6127371316, 2.52, 6.210868248, 0.7557314152], {4}: [-2.7, -0.1922920796, 0.2197880437, 2.59, 2.410575653, 1.012118675], {5}: [-1.31, -0.1245065532, 0.121969887, 0.933, 6.15505123, 0.2481742511]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))

# ----
# 2021 Jan 26
# DL 2
# LL 2.5
data_5 = Data(Tree({0}: [-1.06, -0.08616580399, 0.06288124031, 0.68, 4.089947379, 0.2493632788], {1}: [-0.547, -0.05612223444, 0.03831871864, 0.299, 10.44832567, 0.09415340161], {2}: [-3.43, -0.1814780154, 0.8297052652, 4.98, 2.707314277, 2.289016667], {3}: [-1.48, -0.1285441314, 0.497546425, 2.09, 6.704326004, 0.6298135707], {4}: [-2.41, -0.1750256756, 0.1729980066, 2.21, 2.608435902, 0.8360248136], {5}: [-1.17, -0.1130040556, 0.09596122661, 0.787, 6.652153351, 0.2151280185]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))

# ----
# 2021 Feb 04
# DL 1
# LL 1.5
# 1st + 2nd PS
data_6 = Data(Tree({0}: [-2.012133174, -0.5627663812, 0.03824528255, 0.4707387891, 6.125786381, 0.1634439236], {1}: [-1.021924412, -0.3739094374, 0.02307734993, 0.2095996311, 15.62309875, 0.06205409255], {2}: [-6.13438097, -0.8735035212, 0.3660800936, 3.126497159, 4.223264791, 1.218560048], {3}: [-2.911566165, -0.5536055166, 0.2106970897, 1.325884296, 10.46344994, 0.3660970918], {4}: [-4.007909765, -0.8136769522, 0.08016394604, 1.385380548, 4.085739851, 0.4609670322], {5}: [-1.76562929, -0.5299434168, 0.04367628839, 0.4910101272, 10.38619179, 0.1306089132]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))

data_1res_dl1_ll1_5_99 = Data(Tree({0}: [-0.371, -0.03741059832, 0.0250998994, 0.205, 15.62309875, 0.06205409255], {1}: [-0.712, -0.05740965605, 0.04156523063, 0.461, 6.125786307, 0.1634439236], {2}: [-0.912, -0.08464881185, 0.2930554782, 1.26, 10.4634501, 0.3660970918], {3}: [-2.12, -0.1155539763, 0.4853574482, 3.01, 4.223264786, 1.218560048], {4}: [-0.74, -0.07118329186, 0.05559320694, 0.481, 10.38619177, 0.1306089132], {5}: [-1.52, -0.1107373433, 0.1007741425, 1.36, 4.085739827, 0.4609670322]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))  # disabled
design_map_2 = Number(design_map)
results_2 = Data(data_6)
panel_19 = Panel(results_2)

item_7 = ListItem(List=design_map_2, Index=0, Wrap=True)  # -> Item, Item1, Item2
# convert stress:
# 1 kN/cm² = 10 Megapascal [MPa]
panel_20 = Panel("1000")
panel_21 = Panel("""convert thickness:
1 m = 1000 mm""")
multiplication_11 = Multiplication(A=item_7.Item2, B=panel_20)
merge_7 = Merge(Data1=item_7.Item, Data2=item_7.Item1, Data3=multiplication_11)

model = ModelKaramba3D(modelview.Model)
item_8 = ListItem(List=results_2, Index=0, Wrap=True)  # -> Item, Item1, Item2, Item3, Item4, Item5
# convert stress:
# 1 kN/cm² = 10 Megapascal [MPa]
panel_22 = Panel("10")
shellview_3 = ShellViewKaramba3D(Model=model, IndexOfLayer=0)  # -> Model, MeshesOfRenderedShells, LegendColors, LegendTags
multiplication_12 = Multiplication(A=item_8.Item, B=panel_22)
multiplication_13 = Multiplication(A=item_8.Item1, B=panel_22)
multiplication_14 = Multiplication(A=item_8.Item2, B=panel_22)
multiplication_15 = Multiplication(A=item_8.Item3, B=panel_22)
shellview_4 = ShellViewKaramba3D(Model=model, IndexOfLayer=0)  # -> Model, MeshesOfRenderedShells, LegendColors, LegendTags
range_4 = Range(Domain="-1 To 1", Steps=Slider(3, range=1..11))  # -> simplify(graft(Range))
merge_8 = Merge(
    Data1=multiplication_12,
    Data2=multiplication_13,
    Data3=multiplication_14,
    Data4=multiplication_15,
    Data5=item_8.Item4,
    Data6=item_8.Item5)
layers = Number(range_4)
shellview_5 = ShellViewKaramba3D(Model=model, IndexOfLayer=0)  # -> Model, MeshesOfRenderedShells, LegendColors, LegendTags
thickness_mm = Slider(50, range=40..100)
load_pattern_4 = Slider(2, range=1..7)
shell_3 = Slider(1, range=1..2)
shellvecresults = ResultVectorsOnShellsKaramba3D(AnalyzedModel=model, LayerPosition=layers, mode="PrincStress")  # -> simplify(AnalyzedModel), Points, FirstPrincipalStressVector_kN_cm2, SecondPrincipalStressVector_kN_cm2, FirstPrincipalStressValue_kN_cm2, SecondPrincipalStressValue_kN_cm2
multiplication_16 = Multiplication(A=Slider(5, range=0..10), B=range_4)
merge_9 = Merge(
    Data1=shellview_5.MeshesOfRenderedShells,
    Data2=shellview_4.MeshesOfRenderedShells,
    Data3=shellview_3.MeshesOfRenderedShells)  # -> simplify(graft(Result))
Z_3 = UnitZ(Factor=multiplication_16)
range_5 = Range(Domain=Domain(0, 1), Steps=Slider(6, range=0..10))
bbox_2 = BoundingBox(Content=merge_9, Plane=PlaneXY(0, 0, 0))  # -> Box, Box_2
bnd = Bounds(Numbers=shellvecresults.SecondPrincipalStressValue_kN_cm2)
crossref_2 = CrossReference(ListA=range_5, ListB=range_5, CrossMode=1)  # -> ListA, ListB
merge_10 = Merge(Data1=shell_3, Data2=load_pattern_4, Data3=thickness_mm)
range_6 = Range(Domain=bnd, Steps=Slider(50, range=0..100))
box_2 = EvaluateBox(Box=simplify(bbox_2.Box), UParameter=crossref_2.ListA, VParameter=crossref_2.ListB, WParameter=0.5)  # -> Plane, simplify(Point), Include
dimensions = Panel("""shell #
loading pattern
thickness [mm]""")
params = Number(simplify(graft(merge_10)))
shelllineresults = LineResultsOnShellsKaramba3D(
    AnalyzedModel=shellvecresults.AnalyzedModel,
    LayerPosition=layers,
    ListOfIsoValuesValsOrSourcesOfForceFlowLinesLinesPoints=range_6,
    SegmentLength_m=0,
    Smoothing=False,
    mode="IsoLines",
    menu=[buttons(off, on, off, off, off, off, off)])  # -> AnalyzedModel, simplify(Lines), Value; disabled
results_3 = Data(merge_8)
shelllineresults_2 = LineResultsOnShellsKaramba3D(
    AnalyzedModel=model,
    LayerPosition=range_4,
    ListOfSourcesOfPrincipalStressLinesLinesPoints=box_2.Point,
    SegmentLength_m=0.5,
    DA_deg=5,
    mode="PrincStress")  # -> AnalyzedModel, Lines1, Lines2
panel_23 = Panel(params)
abs = Absolute(Value=results_3)
ds_coords = Data(merge_7)
crv_3 = Curve(shelllineresults_2.Lines2)
list = ValueList({"maximum compression stress [kN/cm2]": 0, "top 99% compression stress [kN/cm2]": 1, "top 99% tension stress [kN/cm2]": 2, "maximum tension stress [kN/cm2]": 3, "buckling safety factors": 4, "maximum deflection 2nd order [cm]": 5}, selected="maximum compression stress [kN/cm2]")
results_4 = Number(abs)
# maximum compression stress [kN/cm2]
# top 99% compression stress [kN/cm2]
# top 99% tension stress [kN/cm2]
# maximum tension stress [kN/cm2]
# buckling safety factors
# maximum deflection 2nd order [cm]
panel_24 = Panel("""maximum compression stress [MPa]
top 99% compression stress [MPa]
top 99% tension stress [MPa]
maximum tension stress [MPa]
buckling safety factors
maximum deflection 2nd order [cm] """)
data_7 = Data(Tree({0;0;0}: [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], {0;0;1}: [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], {0;1;0}: [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], {0;1;1}: [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], {0;1;2}: [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], {0;1;3}: [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]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))
medges_3 = MeshEdges(Mesh=merge_9)  # -> NakedEdges, InteriorEdges, NonManifoldEdges
list_2 = ValueList({"shell #": 0, "loading pattern": 1, "thickness [m]": 2}, selected="thickness [m]")
closest_solution = ClosestSolution(params_current_solution=params, ds_coords=ds_coords)  # -> index_curr_vector_2, design_vector_2
panel_25 = Panel("""20.000
20.000
20.000
20.000
10
10""")
trim = TrimTree(Tree=crv_3, Depth="2")
trim_2 = TrimTree(Tree=data_7, Depth="2")
crv_4 = Curve(simplify(medges_3.NakedEdges))
vec = Vector(Z_3)
item_9 = ListItem(List=dimensions, Index=list_2, Wrap=True)
move = Move(Geometry=trim_2, Motion=vec)  # -> simplify(Geometry), Transform
move_2 = Move(Geometry=trim, Motion=vec)  # -> simplify(Geometry), Transform
move_3 = Move(Geometry=merge_9, Motion=vec)  # -> simplify(Geometry), Transform
move_4 = Move(Geometry=crv_4, Motion=vec)  # -> simplify(Geometry), Transform
item_10 = ListItem(List=panel_25, Index=list, Wrap=True)
item_11 = ListItem(List=panel_24, Index=list, Wrap=True)
preview = CustomPreview(Geometry=move_2.Geometry, Material=ColourSwatch(SwatchColor=RGB(212, 212, 212)))
preview_2 = CustomPreview(Geometry=move_4.Geometry, Material=ColourSwatch(SwatchColor=RGB(0, 0, 0)))
preview_3 = CustomPreview(Geometry=move.Geometry, Material=ColourSwatch(SwatchColor=RGB(135, 135, 135)))
section_ds = SectionDS(design_vector=closest_solution.design_vector_2, design_space=ds_coords, dims=list_2)
tstat = TreeStatistics(Tree=section_ds)  # -> Paths, Length, Count
branch_2 = TreeBranch(Tree=results_4, Path=tstat.Paths, MaintainPaths=True)
panel_26 = Panel(section_ds)
transform_points_to_landscape = TransformPointsToLandscape(
    dim_labels=dimensions,
    dimensons_for_variation=list_2,
    sectioned_data=section_ds,
    results=results_4,
    result_label=item_11,
    result_int=list)  # -> fixed_2, labels_2, transformed_points_2
ref_value = Number(item_10)
panel_27 = Panel(branch_2)
int_curr_solution = Integer(closest_solution.index_curr_vector_2)
number_slider_3 = Slider(0.5, range=0..1)
number_slider_4 = Slider(6, range=0..20)
_2d_graph = _2DGraph(
    labels=transform_points_to_landscape.labels_2,
    fixed=transform_points_to_landscape.fixed_2,
    ref_value=ref_value,
    original_points=transform_points_to_landscape.transformed_points_2,
    grid_spacing="2.5")  # -> mesh_2, transformed_points_2
pt_2 = Point(transform_points_to_landscape.transformed_points_2)
pt_3 = Point(_2d_graph.transformed_points_2)
min_point = MinPoint(transformed_points=_2d_graph.transformed_points_2)  # -> min_point_2, min_id_2
curr_point = CurrPoint(transformed_points=_2d_graph.transformed_points_2, int_curr_solution=int_curr_solution)
panel_28 = Panel("C:\Users\ec977\Documents\_Rhino Frames\20200602-SIMPLEcull20\Frame_00")
vector_value = VectorValue(curr_point=curr_point, original_points=pt_2, int_curr_solution=int_curr_solution, above=Toggle(False))
curr_thumbnail = CurrThumbnail(folder_file=panel_28, curr_point=curr_point, int_curr_solution=int_curr_solution)
min_value = MinValue(curr_point=min_point.min_point_2, original_points=pt_2, int_curr_solution=min_point.min_id_2)

# ==== cluster BottomPoints
ltol = ClusterInput()
mesh = ClusterInput()
mesh_2 = Mesh(mesh)
ltol_2 = Integer(ltol)
demesh = DeconstructMesh(Mesh=mesh_2)  # -> Vertices, Faces, Colours, Normals
pt = Point(demesh.Vertices)
bbox = BoundingBox(Content=pt, Plane=PlaneXY(0, 0, 0), UnionBox=True)  # -> Box, Box_2
box = EvaluateBox(Box=bbox.Box, UParameter="0", VParameter="0", WParameter="0")  # -> Plane, Point, Include
neg = Negative(Value=ltol_2)
_10º = PowerOf10(Value=neg)
cp = PlaneClosestPoint(Point=pt, Plane=box.Plane)  # -> Point, UVPoint, Distance
panel = Panel("1e-10")
smaller = SmallerThan(FirstNumber=cp.Distance, SecondNumber=_10º)  # -> SmallerThan, OrEqualTo
boxdims = BoxDims(box=bbox.Box)  # -> dx_2, dy_2, dz_2
dispatch = Dispatch(List=pt, DispatchPattern=smaller.SmallerThan)  # -> ListA, ListB
duppt = RemoveDuplicatePts(Points=dispatch.ListA, Tolerance=0.01)  # -> simplify(UniquePoints)
division = Division(A=boxdims.dx_2, B="2")
pgroups = PointGroups(Points=duppt, Distance=division)  # -> simplify(Groups), Indices
pt_2 = Point(pgroups.Groups)
pt_3 = ClusterOutput(pt_2)

# ==== cluster AsymmetricalLoadPatterns
mesh = ClusterInput()
load_kn_m2 = ClusterInput()
int = ClusterInput()
mjoin = MeshJoin(Meshes=mesh)
mesh_2 = Mesh(simplify(graft(mesh)))
load_kn_m2_2 = Number(load_kn_m2)
int_2 = Integer(int)
bbox = BoundingBox(Content=flatten(mesh_2), Plane=PlaneXY(0, 0, 0), UnionBox=True)  # -> Box, Box_2
image = ImageSampler(Filter="Colour", Interpolate=False, Umax=1, Umin=0, Vmax=1, Vmin=0, Wrap=1)
faceb = FaceBoundaries(Mesh=mesh_2)  # -> simplify(Boundaries)
box = EvaluateBox(Box=bbox.Box, UParameter=0.5, VParameter=0.5, WParameter="1")  # -> Plane, simplify(Point), Include
pattern_domains = PatternDomains(G=int_2)
area = Area(Geometry=faceb)  # -> Area, Centroid
sph = Sphere(Base=box.Plane, Radius=Slider(2, range=0..10))
data = Data(flatten(pattern_domains))
dom² = ConstructDomain²(DomainU=data, DomainV="0 To Pi")
pt = Point(simplify(graft(area.Centroid)))
subsrf = Isotrim(Surface=sph, Domain=dom²)
polar = ToPolar(Point=pt, System=box.Plane)  # -> simplify(Phi), Theta, Radius
inc = Includes(Value=polar.Phi, Domain=data)  # -> Includes, Deviation
wh_value_for_live_load = Panel("3.5")
ma = MassAddition(Input=inc.Includes)  # -> Result, PartialResults
bool = Boolean(ma.Result)
multiplication = Multiplication(A=load_kn_m2_2, C=bool)
dispatch = Dispatch(List=pt, DispatchPattern=bool)  # -> ListA, ListB
live_load_kn_m2_per_face = Number(multiplication)
outside = Point(dispatch.ListB)
inside = Point(dispatch.ListA)
Z = UnitZ(Factor=live_load_kn_m2_per_face)
pt_2 = Point(simplify(area.Centroid))
mesh_3 = Mesh(mesh_2)
rev = Reverse(Vector=Z)  # -> flatten(Vector)
vdis = VectorDisplay(Anchor=pt_2, Vector=rev)
loads = LoadsKaramba3D(Vectors=rev, Mesh=mesh_3, mode="MeshLoad -Variable", menu=[buttons(off, off, on), buttons(on, on)])
load = LoadKaramba3D(flatten(loads))
load_2 = ClusterOutput(load)

# ==== cluster CurrPoint
transformed_points = ClusterInput()
int_curr_solution = ClusterInput()
transformed_points_2 = Point(transformed_points)
int_curr_solution_2 = Integer(int_curr_solution)
branch = TreeBranch(Tree=transformed_points_2, Path=int_curr_solution_2, MaintainPaths=True)
curr_point = Point(branch)
curr_point_2 = ClusterOutput(curr_point)

# ==== cluster VectorValue
int_curr_solution = ClusterInput()
original_points = ClusterInput()
curr_point = ClusterInput()
above = ClusterInput()
original_points_2 = Point(original_points)
curr_point_2 = Point(curr_point)
int_curr_solution_2 = Integer(int_curr_solution)
number_slider = Slider(0.222, range=0..1)
above_2 = Boolean(above)
branch = TreeBranch(Tree=original_points_2, Path=int_curr_solution_2, MaintainPaths=True)
pdecon = Deconstruct(Point=branch)  # -> XComponent, YComponent, ZComponent
neg = Negative(Value=number_slider)
expression = Expression(x=pdecon.ZComponent, Expression="Format(\"{0:0.00}\", x)")
filter = StreamFilter(Gate=above_2, Stream0=neg, Stream1=number_slider)
Z = UnitZ(Factor=filter)
concat = Concatenate(FragmentA="curr: ", FragmentB=expression)
move = Move(Geometry=curr_point_2, Motion=Z)  # -> Geometry, Transform
tag = TextTag(Location=move.Geometry, Text=concat)

# ==== cluster ClosestSolution
params_current_solution = ClusterInput()
ds_coords = ClusterInput()
params_current_solution_2 = Number(params_current_solution)
ds_coords_2 = Data(simplify(ds_coords))
flip = FlipMatrix(Data=ds_coords_2)
cset = CreateSet(List=flip)  # -> Set, Map
fsim = FindSimilarMember(Data=params_current_solution_2, Set=cset.Set)  # -> Hit, Index
equals = Equality(FirstNumber=flatten(fsim.Hit), SecondNumber=ds_coords_2)  # -> Equality, Inequality
panel = Panel(equals.Equality)
mass_and = MassAND(bool=equals.Equality)
dispatch = Dispatch(List=ds_coords_2, DispatchPattern=mass_and)  # -> ListA, ListB
clean = CleanTree(RemoveNulls=True, RemoveInvalid=True, RemoveEmpty=Toggle(True), Tree=dispatch.ListA)
item = ListItem(List=clean, Index=0, Wrap=True)  # -> Item, Item1, Item2, Item3
tstat = TreeStatistics(Tree=clean)  # -> Paths, Length, Count
pt = ConstructPoint(XCoordinate=item.Item1, YCoordinate=item.Item2, ZCoordinate=item.Item3)
dpath = DeconstructPath(Branch=tstat.Paths)
sph = Sphere(Base=pt, Radius=Slider(0.018, range=0..0.1))
index_curr_vector = Integer(dpath)
design_vector = Data(clean)
index_curr_vector_2 = ClusterOutput(index_curr_vector)
design_vector_2 = ClusterOutput(design_vector)

# ==== cluster _2DGraph
grid_spacing = ClusterInput()
# make grid spacing adaptable
_10º = PowerOf10(Value=Slider(-1, range=-5..5))
original_points = ClusterInput()
ref_value = ClusterInput()
scale = Slider(5, range=0..10)
multiplication = Multiplication(A=_10º, B=Slider(5, range=1..9))
grid_spacing_2 = Number(grid_spacing)
pt = ConstructPoint(XCoordinate="-10", YCoordinate="-40", ZCoordinate=0)
yz = YZPlane(Origin=pt)
pflip = FlipPlane(Plane=yz, ReverseX=Toggle(True), ReverseY=False, SwapAxes=True)
original_points_2 = Point(original_points)
ref_value_2 = Number(ref_value)
neg = Negative(Value=scale)
planesrf = PlaneSurface(Plane=pflip, XSize=scale, YSize=neg)
planesrf_2 = PlaneSurface(Plane=yz, XSize=scale, YSize=scale)
bbox = BoundingBox(Content=flatten(original_points_2), Plane=PlaneXY(0, 0, 0), UnionBox=True)  # -> Box, Box_2
merge = Merge(Data1=planesrf_2, Data2=planesrf)
pdecon = Deconstruct(Point=flatten(original_points_2))  # -> XComponent, YComponent, ZComponent
cset = CreateSet(List=pdecon.XComponent)  # -> Set, Map
cset_2 = CreateSet(List=pdecon.YComponent)  # -> Set, Map
cset_3 = CreateSet(List=pdecon.ZComponent)  # -> Set, Map
bnd = Bounds(Numbers=cset_3.Set)
domain = Domain(bnd)
dedomain = DeconstructDomain(Domain=domain)  # -> Start, End
mod = Modulus(A=dedomain.Start, B=grid_spacing_2)
subtraction = Subtraction(A=dedomain.End, B=dedomain.Start)
subtraction_2 = Subtraction(A=dedomain.Start, B=mod)
addition = Addition(A=subtraction_2, B=grid_spacing_2)
division = Division(A=subtraction, B=grid_spacing_2)
dedomain_2 = DeconstructDomain(Domain=domain)  # -> Start, End
series = Series(Start=addition, Step=grid_spacing_2, Count=division)  # -> flatten(Series)
merge_2 = Merge(Data1=dedomain.Start, Data2=series, Data3=dedomain.End)
panel = Panel(merge_2)
sporph = Sporph(G=original_points_2, S0=bbox.Box, P0="0,0", S1=planesrf_2, P1="0,0", R=False)
transformed_points = Point(sporph)
debox = DeconstructBox(Box=bbox.Box)  # -> Plane, X, Y, Z
entwine = Entwine(Branch00=debox.X, Branch01=debox.Z, FlattenInputs=True)  # -> simplify(Result)
panel_2 = Panel(entwine)
transformed_points_2 = ClusterOutput(transformed_points)
labels = ClusterInput()
dom = ConstructDomain(DomainStart=0, DomainEnd=1)
fixed = ClusterInput()
graph_surface = Surface(simplify(graft(merge)))
labels_2 = Text(labels)
fixed_2 = Text(fixed)
join = TextJoin(Text=flatten(fixed_2), Join="  /  ")
graph_surface_2 = Surface(merge)
transformed_points_3 = Point(transformed_points)
panel_3 = Panel(join)
md_slider = MDSlider(
    SliderMode=0,
    slider_value=Point(0.4988090701, 0, 0.5),
    x_domain=Domain(0, 1),
    y_domain=Domain(0, 1),
    z_domain=Domain(0, 1))
md_slider_2 = MDSlider(
    SliderMode=0,
    slider_value=Point(0.5026438643, 1, 0.5),
    x_domain=Domain(0, 1),
    y_domain=Domain(0, 1),
    z_domain=Domain(0, 1))
md_slider_3 = MDSlider(
    SliderMode=0,
    slider_value=Point(0.4988090701, 1, 0.5),
    x_domain=Domain(0, 1),
    y_domain=Domain(0, 1),
    z_domain=Domain(0, 1))
flip = FlipMatrix(Data=transformed_points_3)
shift = ShiftList(List=graph_surface_2, Shift=Slider(0, range=0..10), Wrap=True)  # -> simplify(graft(List))
bang = ExplodeTree(Data=shift)  # -> Branch0, Branch1
rdpoints = RemoveDuplicatePointsKaramba3D(Point=flip, LimitDistance=0.005)  # -> OutPoint, Info, Indexes
evalsrf = EvaluateSurface(Surface=reparameterize(bang.Branch1), Point=md_slider_2)  # -> Point, Normal, UDirection, VDirection, Frame
evalsrf_2 = EvaluateSurface(Surface=reparameterize(bang.Branch0), Point=md_slider)  # -> Point, Normal, UDirection, VDirection, Frame
evalsrf_3 = EvaluateSurface(Surface=reparameterize(bang.Branch0), Point=md_slider_3)  # -> Point, Normal, UDirection, VDirection, Frame
ref_value_3 = Number(ref_value_2)
deplane = DeconstructPlane(Plane=evalsrf.Frame)  # -> Origin, XAxis, YAxis, ZAxis
pt_2 = Point(rdpoints.OutPoint)
number_slider = Slider(0.187, range=0..1)
number_slider_2 = Slider(0.331, range=0..1)
deplane_2 = DeconstructPlane(Plane=evalsrf_2.Frame)  # -> Origin, XAxis, YAxis, ZAxis
expression = Expression(x=ref_value_3, Expression="Format(\"{0:0.00}\", x)")
deplane_3 = DeconstructPlane(Plane=evalsrf_3.Frame)  # -> Origin, XAxis, YAxis, ZAxis
project = Project(Geometry=pt_2, Plane=PlaneXY(0, 0, 0))  # -> Geometry, Transform
amp = Amplitude(Vector=deplane.YAxis, Amplitude=Slider(0.875, range=0..1))
swatch = ColourSwatch(SwatchColor=RGB(255, 0, 0))
amp_2 = Amplitude(Vector=deplane_2.YAxis, Amplitude=Slider(0.449, range=0..1))
rev = Reverse(Vector=amp)
amp_3 = Amplitude(Vector=deplane_3.YAxis, Amplitude=Slider(0.525, range=0..1))
rev_2 = Reverse(Vector=amp_2)
rev_3 = Reverse(Vector=amp_3)
merge_3 = Merge(Data1=pt_2, Data2=project.Geometry)
lng = ListLength(List=project.Geometry)
Z = UnitZ(Factor=Slider(0.154, range=0..1))
move = Move(Geometry=evalsrf_2.Frame, Motion=rev_2)  # -> flatten(Geometry), Transform
swatch_2 = ColourSwatch(SwatchColor=RGB(128, 128, 128))
move_2 = Move(Geometry=evalsrf.Frame, Motion=amp)  # -> flatten(Geometry), Transform
move_3 = Move(Geometry=evalsrf_3.Frame, Motion=amp_3)  # -> flatten(Geometry), Transform
number_slider_3 = Slider(0.178, range=0..1)
frompoints = MeshFromPoints(Points=merge_3, UDirection="2", VDirection=lng)
concat = Concatenate(FragmentA="ref. value = ", FragmentB=expression)
merge_4 = Merge(Data1=move.Geometry, Data2=move_2.Geometry)
unifynormals = MeshUnifyNormals(Mesh=frompoints)
item = ListItem(List=move.Geometry, Index=0, Wrap=True)
item_2 = ListItem(List=move_3.Geometry, Index=0, Wrap=True)
tag = TextTag3D(Location=item_2, Text=join, Size=number_slider_3, Justification=5)

# ----
# if ref value is out of bounds, don't add (or just add lower bound, which is indiferent)
ref_value_4 = Number(ref_value_2)
inc = Includes(Value=ref_value_4, Domain=domain)  # -> Includes, Deviation
sort = SortList(Keys=merge_2)  # -> Keys, ValuesA
item_3 = ListItem(List=reverse(sort.Keys), Index=0, Wrap=True)
item_4 = ListItem(List=sort.Keys, Index=0, Wrap=True)

c_script = CSharpScript(reference=ref_value_4, domain=domain)  # -> out, A; inputs reference: Double
# ---------- c_script: C# ----------
    A = 1;
    if (reference < domain.Min) A = 0;
    if (reference > domain.Max) A = 2;
# ---------- end c_script ----------

filter = StreamFilter(Gate=c_script.A, Stream0=item_4, Stream1=ref_value_4, Stream2=item_3)

merge_5 = Merge(Data1=filter, Data2=merge_2)
entwine_2 = Entwine(Branch00=cset.Set, Branch01=merge_5, FlattenInputs=True)  # -> simplify(Result)
remap = RemapNumbers(Value=entwine_2, Source=entwine, Target=dom)  # -> Mapped, Clipped
pt_3 = ConstructPoint(XCoordinate=remap.Mapped, YCoordinate=0, ZCoordinate=0)
evalsrf_4 = EvaluateSurface(Surface=reparameterize(graph_surface), Point=pt_3)  # -> Point, Normal, UDirection, VDirection, Frame
pl = ConstructPlane(Origin=evalsrf_4.Point, XAxis=evalsrf_4.VDirection, YAxis=evalsrf_4.Normal)
sec = BrepPlane(Brep=graph_surface, Plane=pl)  # -> Curves, Points
grid_lines = Curve(sec.Curves)
join_2 = JoinCurves(Curves=grid_lines, Preserve=False)
trim = TrimTree(Tree=simplify(join_2), Depth=1)
trim_2 = TrimTree(Tree=grid_lines, Depth=1)
explode = Explode(Curve=trim, Recursive=True)  # -> Segments, Vertices
item_5 = ListItem(List=trim, Index="1", Wrap=True)
lng_2 = ListLength(List=trim)
bang_2 = ExplodeTree(Data=trim_2)  # -> Branch0, Branch1
repeat = RepeatData(Data=item_5, Length=lng_2)  # -> simplify(graft(Data))
horizontal_grid_lines = Curve(bang_2.Branch1)
vertical_grid_lines = Curve(bang_2.Branch0)
alongcrv = SortAlongCurve(Points=explode.Vertices, Curve=repeat)  # -> Points, Indices
adaptable_decimal_places = AdaptableDecimalPlaces(num=entwine_2)
bang_3 = ExplodeTree(Data=entwine_2)  # -> Branch0, Branch1
pline = PolyLine(Vertices=alongcrv.Points, Closed=False)  # -> simplify(Polyline)
item_6 = ListItem(List=horizontal_grid_lines, Index="0", Wrap=True)
cull_i = CullIndex(List=horizontal_grid_lines, Indices="0", Wrap=True)
expression_2 = Expression(x=bang_3.Branch1, Expression="Format(\"{0:0.00}\", x)")
trim_3 = TrimTree(Tree=pline, Depth=1)
expression_3 = Expression(x=bang_3.Branch0, Expression="Format(\"{0:0}\", x)")
ref_grid_line = Curve(item_6)
merge_6 = Merge(Data1=vertical_grid_lines, Data2=cull_i)
bang_4 = ExplodeTree(Data=trim_3)  # -> Branch0, Branch1
midpt = CurveMiddle(Curve=ref_grid_line)
entwine_3 = Entwine(Branch00=expression_3, Branch01=expression_2, FlattenInputs=True)  # -> simplify(Result)
ext = ExtendCurve(Curve=bang_4.Branch0, Type=0, Start=number_slider, End=number_slider)
ext_2 = ExtendCurve(Curve=bang_4.Branch1, Type=0, Start=number_slider_2, End=number_slider_2)
dash = DashPattern(Curve=simplify(ref_grid_line), Pattern=Slider(0.1, range=0..1))  # -> Dashes, Gaps
move_4 = Move(Geometry=midpt, Motion=Z)  # -> Geometry, Transform
end = EndPoints(Curve=ext_2)  # -> Start, End
end_2 = EndPoints(Curve=ext)  # -> Start, End
merge_7 = Merge(Data1=end_2.End, Data2=end.Start)
labels_3 = Text(entwine_3)
preview = CustomPreview(Geometry=dash.Dashes, Material=swatch)
preview_2 = CustomPreview(Geometry=merge_6, Material=swatch_2)

mesh = Mesh(unifynormals)
tag_2 = TextTag(Location=move_4.Geometry, Text=concat, Colour=swatch)
tag_3 = TextTag3D(Location=merge_4, Text=labels_2, Size=number_slider_3, Justification=5)
tag_4 = TextTag(Location=merge_7, Text=labels_3, Colour=swatch_2)

mesh_2 = ClusterOutput(mesh)

# ==== cluster TransformPointsToLandscape
dimensons_for_variation = ClusterInput()
sectioned_data = ClusterInput()
result_label = ClusterInput()
results = ClusterInput()
result_int = ClusterInput()
dimensons_for_variation_2 = Integer(dimensons_for_variation)
sectioned_data_2 = Data(sectioned_data)
panel = Panel(sectioned_data_2)
dim_labels = ClusterInput()
result_label_2 = Text(result_label)
results_2 = Number(results)
result_int_2 = Integer(result_int)
tstat = TreeStatistics(Tree=sectioned_data_2)  # -> Paths, Length, Count
item = ListItem(List=sectioned_data_2, Index=dimensons_for_variation_2, Wrap=True)
lng = ListLength(List=dimensons_for_variation_2)
dim_labels_2 = Text(dim_labels)
gate = StreamGate(Stream=item, Gate=lng)  # -> Target0, Target1, Target2
item_2 = ListItem(List=dim_labels_2, Index=dimensons_for_variation_2, Wrap=True)
num2pt = NumbersToPoints(Numbers=gate.Target1, Mask=1)
num2pt_2 = NumbersToPoints(Numbers=gate.Target2, Mask=2)
branch = TreeBranch(Tree=results_2, Path=tstat.Paths, MaintainPaths=True)
merge = Merge(Data1=num2pt, Data2=num2pt_2)  # -> simplify(Result)
merge_2 = Merge(Data1=item_2, Data2=result_label_2)
panel_2 = Panel(merge_2)
pdecon = Deconstruct(Point=merge)  # -> XComponent, YComponent, ZComponent
item_3 = ListItem(List=branch, Index=result_int_2, Wrap=True)
pt = ConstructPoint(XCoordinate=pdecon.XComponent, YCoordinate=pdecon.YComponent, ZCoordinate=item_3)
transformed_points = Point(pt)
labels = Text(merge_2)
labels_2 = ClusterOutput(labels)
transformed_points_2 = ClusterOutput(transformed_points)

# ---- group: find fixed variable
panel_3 = Panel("""0
1
2""")
fsim = FindSimilarMember(Data=dimensons_for_variation_2, Set=panel_3)  # -> Hit, Index
cull_i = CullIndex(List=panel_3, Indices=fsim.Index, Wrap=True)
item_4 = ListItem(List=sectioned_data_2, Index=cull_i, Wrap=True)
item_5 = ListItem(List=dim_labels_2, Index=cull_i, Wrap=True)

# ----
branch_2 = TreeBranch(Tree=simplify(item_4), Path="0", MaintainPaths=True)

# ---- group: find fixed variable (continued)
item_6 = ListItem(List=branch_2, Index=0, Wrap=True)
expression = Expression(x=branch_2, Expression="Format(\"{0:0}\", x)")
concat = Concatenate(FragmentA=item_5, FragmentB=" = ", FragmentC=expression)
panel_4 = Panel(concat)

# ----
fixed = Text(concat)
fixed_2 = ClusterOutput(fixed)

# ==== cluster SectionDS
dims = ClusterInput()
design_space = ClusterInput()
design_vector = ClusterInput()
design_space_2 = Data(simplify(design_space))
dims_2 = Integer(dims)
design_vector_2 = Data(graft(design_vector))
item = ListItem(List=design_space_2, Index=0, Wrap=True)  # -> Item, Item1, Item2, Item3
flip = FlipMatrix(Data=design_space_2)
pt = ConstructPoint(XCoordinate=item.Item1, YCoordinate=item.Item2, ZCoordinate=item.Item3)
cset = CreateSet(List=flip)  # -> Set, Map
fsim = FindSimilarMember(Data=design_vector_2, Set=cset.Set)  # -> Hit, Index
trim = TrimTree(Tree=fsim.Hit, Depth=1)
equals = Equality(FirstNumber=trim, SecondNumber=design_space_2)  # -> Equality, Inequality
bool = Boolean(equals.Equality)
cull_i = CullIndex(List=bool, Indices=simplify(dims_2), Wrap=True)  # -> simplify(List)

# ---- group: check for what?
null = NullItem(Item=dims_2)  # -> NullFlags, InvalidFlags, Description
item_2 = ListItem(List=null.NullFlags, Index=0, Wrap=True)
filter = StreamFilter(Gate=item_2, Stream0=cull_i, Stream1=bool)

# ----
mass_or = MassOR(A=filter)
dispatch = Dispatch(List=design_space_2, DispatchPattern=mass_or)  # -> ListA, ListB
clean = CleanTree(RemoveNulls=True, RemoveInvalid=True, RemoveEmpty=Toggle(True), Tree=dispatch.ListA)
item_3 = ListItem(List=clean, Index=0, Wrap=True)  # -> Item, Item1, Item2, Item3
pt_2 = ConstructPoint(XCoordinate=item_3.Item1, YCoordinate=item_3.Item2, ZCoordinate=item_3.Item3)
T = ClusterOutput(clean)

# ==== cluster MinPoint
transformed_points = ClusterInput()
transformed_points_2 = Point(transformed_points)
pt = Point(transformed_points_2)
pdecon = Deconstruct(Point=pt)  # -> XComponent, YComponent, flatten(ZComponent)
tstat = TreeStatistics(Tree=pt)  # -> Paths, Length, Count
sort = SortList(Keys=pdecon.ZComponent, ValuesA=tstat.Paths)  # -> Keys, ValuesA
item = ListItem(List=sort.ValuesA, Index=0, Wrap=True)
path = DataPath(item)
branch = TreeBranch(Tree=pt, Path=path, MaintainPaths=True)
dpath = DeconstructPath(Branch=path)
min_point = Point(branch)
min_id = Integer(dpath)
min_id_2 = ClusterOutput(min_id)
min_point_2 = ClusterOutput(min_point)

# ==== cluster MinValue
int_curr_solution = ClusterInput()
original_points = ClusterInput()
curr_point = ClusterInput()
original_points_2 = Point(original_points)
curr_point_2 = Point(curr_point)
int_curr_solution_2 = Integer(int_curr_solution)
branch = TreeBranch(Tree=original_points_2, Path=int_curr_solution_2, MaintainPaths=True)
pdecon = Deconstruct(Point=branch)  # -> XComponent, YComponent, ZComponent
expression = Expression(x=pdecon.ZComponent, Expression="Format(\"{0:0.000000}\", x)")
Z = UnitZ(Factor=Slider(0.222, range=0..1))
concat = Concatenate(FragmentA="min: ", FragmentB=expression)
move = Move(Geometry=curr_point_2, Motion=Z)  # -> Geometry, Transform
tag = TextTag(Location=move.Geometry, Text=concat)

# ==== cluster CurrThumbnail
int_curr_solution = ClusterInput()
int_curr_solution_2 = Integer(int_curr_solution)
folder_file = ClusterInput()
expression = Expression(i=int_curr_solution_2, mid=Slider(90, range=0..100), Expression="If (i<mid,i,i+1)")
resolution = ClusterInput()
curr_point = ClusterInput()
folder_file_2 = Text(folder_file)
curr_point_2 = Point(curr_point)
pt = Point(curr_point_2)
yz = YZPlane(Origin=pt)
expression_2 = Expression(x=expression, Expression="Format(\"{0:000}\", x)")
xy = XYPlane(Origin=pt)
md_slider = MDSlider(SliderMode=0, slider_value=Point(0.5, 0, 0.5), x_domain=Domain(0, 1), y_domain=Domain(0, 1), z_domain=Domain(0, 1))
rotate = Rotate(Geometry=xy, Angle=1.570796327, Plane=pt)  # -> Geometry, Transform
panel = Panel("1 to 2")
resolution_2 = Integer(resolution)
rectangle = Rectangle(Plane=rotate.Geometry, XSize="-.5 to .5", YSize="-.5 to .5", Radius=0)  # -> Rectangle, Length
concat = Concatenate(FragmentA=folder_file_2, FragmentB=expression_2, FragmentC=".bmp")
evalsrf = EvaluateSurface(Surface=reparameterize(rectangle.Rectangle), Point=md_slider)  # -> Point, Normal, UDirection, VDirection, Frame
panel_2 = Panel(concat)
panel_3 = Panel(rectangle.Rectangle)

img = ImportImage(File=concat, Rectangle=rectangle.Rectangle, XSamples=resolution_2, YSamples=resolution_2)
crv = Curve(rectangle.Rectangle)

# ==== cluster PercentileStress
model = ClusterInput()
percentile = ClusterInput()
model_2 = ModelKaramba3D(model)
percentile_2 = Number(percentile)
shellvecresults = ResultVectorsOnShellsKaramba3D(AnalyzedModel=model_2, LayerPosition="1", mode="PrincStress")  # -> AnalyzedModel, Points, FirstPrincipalStressVector_kN_cm2, SecondPrincipalStressVector_kN_cm2, FirstPrincipalStressValue_kN_cm2, SecondPrincipalStressValue_kN_cm2
shellvecresults_2 = ResultVectorsOnShellsKaramba3D(AnalyzedModel=model_2, LayerPosition="-1", mode="PrincStress")  # -> AnalyzedModel, Points, FirstPrincipalStressVector_kN_cm2, SecondPrincipalStressVector_kN_cm2, FirstPrincipalStressValue_kN_cm2, SecondPrincipalStressValue_kN_cm2
merge = Merge(
    Data1=shellvecresults_2.FirstPrincipalStressValue_kN_cm2,
    Data2=shellvecresults.FirstPrincipalStressValue_kN_cm2,
    Data3=shellvecresults_2.SecondPrincipalStressValue_kN_cm2,
    Data4=shellvecresults.SecondPrincipalStressValue_kN_cm2)
sort = SortList(Keys=merge)  # -> Keys, ValuesA
division = Division(A=percentile_2, B=100)
panel = Panel(sort.Keys)
lng = ListLength(List=sort.Keys)
subtraction = Subtraction(A="1", B=division)
subtraction_2 = Subtraction(A=lng, B=1)
remap = RemapNumbers(Value=division, Source=Domain(0, 1), Target=subtraction_2)  # -> Mapped, Clipped
remap_2 = RemapNumbers(Value=subtraction, Source=Domain(0, 1), Target=subtraction_2)  # -> Mapped, Clipped
graph = QuickGraph(sort.Keys, SortOrder=0)
int = Integer(remap_2.Mapped)
int_2 = Integer(remap.Mapped)
dom = ConstructDomain(DomainStart=int, DomainEnd=int_2)
subset = SubList(List=sort.Keys, Domain=dom, Wrap=True)  # -> List, Index
graph_2 = QuickGraph(subset.List, SortOrder=0)
item = ListItem(List=reverse(sort.Keys), Index="0", Wrap=True)
item_2 = ListItem(List=sort.Keys, Index="0", Wrap=True)
item_3 = ListItem(List=reverse(subset.List), Index=0, Wrap=True)
item_4 = ListItem(List=subset.List, Index=0, Wrap=True)
panel_2 = Panel(item)
panel_3 = Panel(item_2)
panel_4 = Panel(item_3)
panel_5 = Panel(item_4)
max_comp_stress_kn_cm2 = Number(item_2)
max_tens_stress_kn_cm2 = Number(item)
max_comp_stress_kn_cm2_2 = Number(item_4)
max_tens_stress_kn_cm2_2 = Number(item_3)
max_tens_stress_kn_cm2_3 = ClusterOutput(max_tens_stress_kn_cm2)
max_comp_stress_kn_cm2_3 = ClusterOutput(max_comp_stress_kn_cm2)
max_tens_stress_kn_cm2_4 = ClusterOutput(max_tens_stress_kn_cm2_2)
max_comp_stress_kn_cm2_4 = ClusterOutput(max_comp_stress_kn_cm2_2)

# ==== cluster BoxDims
box = ClusterInput()
box_2 = Box(box)
debox = DeconstructBox(Box=box_2)  # -> Plane, X, Y, Z
dedomain = DeconstructDomain(Domain=debox.X)  # -> Start, End
dedomain_2 = DeconstructDomain(Domain=debox.Y)  # -> Start, End
dedomain_3 = DeconstructDomain(Domain=debox.Z)  # -> Start, End
subtraction = Subtraction(A=dedomain.End, B=dedomain.Start)
subtraction_2 = Subtraction(A=dedomain_2.End, B=dedomain_2.Start)
subtraction_3 = Subtraction(A=dedomain_3.End, B=dedomain_3.Start)
dx = Number(subtraction)
dy = Number(subtraction_2)
dz = Number(subtraction_3)
dx_2 = ClusterOutput(dx)
dy_2 = ClusterOutput(dy)
dz_2 = ClusterOutput(dz)

# ==== cluster PatternDomains

# ---- group: pattern 5
number_slider = Slider(0, range=0..10)
number_slider_2 = Slider(2, range=0..10)
addition = Addition(A=number_slider, B="2")
series = Series(Start=addition, Step="4", Count=number_slider_2)
series_2 = Series(Start=number_slider, Step="4", Count=number_slider_2)
multiplication = Multiplication(A=series_2, B=".25")
multiplication_2 = Multiplication(A=series, B=".25")
pi = Pi(Factor=multiplication_2)
pi_2 = Pi(Factor=multiplication)
panel = Panel(pi_2)
panel_2 = Panel(pi)
dom = ConstructDomain(DomainStart=panel, DomainEnd=panel_2)  # -> graft(Domain)

# ---- group: pattern 6
number_slider_3 = Slider(0, range=0..10)
number_slider_4 = Slider(4, range=0..10)
addition_2 = Addition(A=number_slider_3, B="1")
series_3 = Series(Start=addition_2, Step="2", Count=number_slider_4)
series_4 = Series(Start=number_slider_3, Step="2", Count=number_slider_4)
multiplication_3 = Multiplication(A=series_4, B=".25")
multiplication_4 = Multiplication(A=series_3, B=".25")
pi_3 = Pi(Factor=multiplication_4)
pi_4 = Pi(Factor=multiplication_3)
panel_3 = Panel(pi_4)
panel_4 = Panel(pi_3)
dom_2 = ConstructDomain(DomainStart=panel_3, DomainEnd=panel_4)  # -> graft(Domain)

# ---- group: pattern 4
number_slider_5 = Slider(1, range=0..10)
number_slider_6 = Slider(2, range=0..10)
addition_3 = Addition(A=number_slider_5, B="2")
series_5 = Series(Start=addition_3, Step="4", Count=number_slider_6)
series_6 = Series(Start=number_slider_5, Step="4", Count=number_slider_6)
multiplication_5 = Multiplication(A=series_6, B=".25")
multiplication_6 = Multiplication(A=series_5, B=".25")
pi_5 = Pi(Factor=multiplication_6)
pi_6 = Pi(Factor=multiplication_5)
panel_5 = Panel(pi_6)
panel_6 = Panel(pi_5)
dom_3 = ConstructDomain(DomainStart=panel_5, DomainEnd=panel_6)  # -> graft(Domain)

# ---- group: pattern 1
multiplication_7 = Multiplication(A=Slider(0, range=0..10), B=".25")
multiplication_8 = Multiplication(A=Slider(0, range=0..10), B=".25")
pi_7 = Pi(Factor=multiplication_7)
pi_8 = Pi(Factor=multiplication_8)
panel_7 = Panel(pi_7)
panel_8 = Panel(pi_8)
dom_4 = ConstructDomain(DomainStart=panel_7, DomainEnd=panel_8)

# ---- group: pattern 2
multiplication_9 = Multiplication(A=Slider(2, range=0..10), B=".25")
multiplication_10 = Multiplication(A=Slider(6, range=0..10), B=".25")
pi_9 = Pi(Factor=multiplication_9)
pi_10 = Pi(Factor=multiplication_10)
panel_9 = Panel(pi_9)
panel_10 = Panel(pi_10)
dom_5 = ConstructDomain(DomainStart=panel_9, DomainEnd=panel_10)

# ---- group: pattern 3
multiplication_11 = Multiplication(A=Slider(1, range=0..10), B=".25")
multiplication_12 = Multiplication(A=Slider(5, range=0..10), B=".25")
pi_11 = Pi(Factor=multiplication_11)
pi_12 = Pi(Factor=multiplication_12)
panel_11 = Panel(pi_11)
panel_12 = Panel(pi_12)
dom_6 = ConstructDomain(DomainStart=panel_11, DomainEnd=panel_12)

# ---- group: pattern 7
multiplication_13 = Multiplication(A=Slider(0, range=0..10), B=".25")
multiplication_14 = Multiplication(A=Slider(8, range=0..10), B=".25")
pi_13 = Pi(Factor=multiplication_13)
pi_14 = Pi(Factor=multiplication_14)
panel_13 = Panel(pi_13)
panel_14 = Panel(pi_14)
dom_7 = ConstructDomain(DomainStart=panel_13, DomainEnd=panel_14)

# ----
G = ClusterInput()
filter = StreamFilter(Gate=G, Stream1=dom_4, Stream2=dom_5, Stream3=dom_6, Stream4=dom, Stream5=dom_3, Stream6=dom_2, Stream7=dom_7)
s_7 = ClusterOutput(filter)

# ==== cluster MassAND
bool = ClusterInput()
bool_2 = Boolean(bool)
lng = ListLength(List=bool_2)
ma = MassAddition(Input=bool_2)  # -> Result, PartialResults
larger = LargerThan(FirstNumber=ma.Result, SecondNumber=lng)  # -> LargerThan, OrEqualTo
bool_3 = Boolean(larger.OrEqualTo)
bool_4 = ClusterOutput(bool_3)

# ==== cluster AdaptableDecimalPlaces
num = ClusterInput()
num_2 = Number(num)
reldif = RelativeDifferences(Values=num_2)
item = ListItem(List=reverse(reldif), Index=0, Wrap=True)
split = TextSplit(Text=item, Separators=".")
item_2 = ListItem(List=reverse(split), Index=0, Wrap=True)
chars = Characters(Text=item_2)  # -> Result, Unicode
lng = ListLength(List=chars.Result)  # -> simplify(Length)
panel = Panel(chars.Result)
repeat = RepeatData(Data="0", Length=lng)
join = TextJoin(Text=repeat)
concat = Concatenate(FragmentA="{0:0.", FragmentB=join, FragmentC="}")
format = Format(Format=concat, Culture=127, Data0=num_2)
txt = Text(format)
panel_2 = Panel(format)
txt_2 = ClusterOutput(txt)

# ==== cluster MassOR
A = ClusterInput()
not = GateNot(A=A)
ma = MassAddition(Input=not)  # -> Result, PartialResults
not_2 = GateNot(A=ma.Result)
R = ClusterOutput(not_2)
