# Grasshopper definition WIP_example_segmentedShellAnalysis.gh (Grasshopper 1.0.7)
# plug-ins: ACORNshells, karambaGH

# ----
# test surfaces
number_slider = Slider(6, range=0..10)
rectangle = Rectangle(Plane=PlaneXY(0, 0, 0), XSize=number_slider, YSize=number_slider, Radius=0)  # -> Rectangle, Length
pop2d = Populate2D(Region=rectangle.Rectangle, Count=100, Seed=1)
del = DelaunayMesh(Points=pop2d, Plane=PlaneXY(0, 0, 0))
demesh = DeconstructMesh(Mesh=del)  # -> Vertices, Faces, Colours, Normals
conmesh = ConstructMesh(Vertices=demesh.Vertices, Faces=graft(demesh.Faces))  # -> simplify(Mesh)
medges = MeshEdges(Mesh=conmesh)  # -> NakedEdges, InteriorEdges, NonManifoldEdges
boundary = BoundarySurfaces(Edges=medges.NakedEdges)  # -> simplify(flatten(Surfaces))
test_surface = TestSurface()
segments = Surface(boundary)

spring_spacing = Number(Slider(0.5, range=0..1))
segments_2 = Surface([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])
gap_size = Number(Slider(0.1, range=0..0.1))
a_springs = MakeSprings(ShellSegments=test_surface, SpringDistance=spring_spacing, GapSize=gap_size)  # -> OffsetSegments, SegmentSpringLocations, EdgeSpringLocations, SpringLines, GapSize
number_slider_2 = Slider(33, range=0..100)

panel = Panel("main direction")
_10º = PowerOf10(Value=Slider(10, range=-6..10))
multiplication = Multiplication(A=Slider(1, range=1..10), B=_10º)

_10º_2 = PowerOf10(Value=Slider(5, range=0..10))
_10º_3 = PowerOf10(Value=Slider(2, range=0..10))
_10º_4 = PowerOf10(Value=Slider(5, range=0..10))
_10º_5 = PowerOf10(Value=Slider(2, range=0..10))
_10º_6 = PowerOf10(Value=Slider(5, range=0..10))
_10º_7 = PowerOf10(Value=Slider(1, range=0..10))
_10º_8 = PowerOf10(Value=Slider(5, range=0..10))
multiplication_2 = Multiplication(A=Slider(1, range=0..1), B=_10º_4)
multiplication_3 = Multiplication(A=Slider(1, range=0..1), B=_10º_2)
multiplication_4 = Multiplication(A=Slider(1, range=0..1), B=_10º_6)
multiplication_5 = Multiplication(A=Slider(1, range=0..1), B=_10º_7)
multiplication_6 = Multiplication(A=Slider(1, range=0..1), B=_10º_5)
multiplication_7 = Multiplication(A=Slider(6.012, range=1..10), B=_10º_3)
multiplication_8 = Multiplication(A=Slider(1, range=0..1), B=_10º_8)
segments_3 = Surface([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])
spring_spacing_2 = Number(Slider(0.5, range=0..1))
vec = VectorXYZ(XComponent=multiplication_2, YComponent=multiplication_4, ZComponent=multiplication_3)  # -> Vector, Length
# spring setup
vec_2 = VectorXYZ(XComponent=multiplication_7, YComponent=multiplication_7, ZComponent=multiplication_7)  # -> Vector, Length
vec_3 = VectorXYZ(XComponent=multiplication_5, YComponent=multiplication, ZComponent=multiplication_6)  # -> Vector, Length
vec_4 = VectorXYZ(XComponent=multiplication_8, YComponent=multiplication_8, ZComponent=multiplication_8)  # -> Vector, Length
panel_2 = Panel("""2
30
33
34""")
gap_size_2 = Number(Slider(0.1, range=0..0.1))
shell = Geometry(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)
join = BrepJoin(Breps=segments_3)  # -> Breps, Closed
c_script = CSharpScript(x=segments_3)  # -> out, A; inputs x: list of Brep
# ---------- c_script: C# ----------
    double tol = Rhino.RhinoDoc.ActiveDoc.ModelAbsoluteTolerance; 
    Brep segmentedShell = Brep.JoinBreps(x, tol)[0];
    A = segmentedShell;
# ---------- end c_script ----------
debrep = DeconstructBrep(Brep=join.Breps)  # -> Faces, Edges, Vertices
topology = BrepTopology(Brep=c_script.A, PerspectiveOnly=False)  # -> FaceFaceAdjacency, simplify(FaceEdgeAdjacency), simplify(EdgeFaceAdjacency)
int = Integer(panel_2)
a_springs_2 = MakeSprings(ShellSegments=segments_3, SpringDistance=spring_spacing_2, GapSize=gap_size_2)  # -> OffsetSegments, SegmentSpringLocations, EdgeSpringLocations, SpringLines, GapSize
cross_section = CrossSectionKaramba3D(
    FamilyNameOfCrossSection="DefaultCroSec",
    ElementIdentifier="spring",
    CTranslation_kN_m=vec_2.Vector,
    CRotation_kNm_rad=vec_3.Vector,
    mode="Spring")
item = ListItem(List=debrep.Faces, Index=Slider(6, range=0..100), Wrap=True)
branch = TreeBranch(Tree=topology.EdgeFaceAdjacency, Path=int, MaintainPaths=True)
panel_3 = Panel(topology.FaceEdgeAdjacency)
item_2 = ListItem(List=debrep.Edges, Index=int, Wrap=True)
segmentspringlocations = Geometry(a_springs_2.SegmentSpringLocations)
edgespringlocations = Geometry(a_springs_2.EdgeSpringLocations)
offsetsegments = Geometry(a_springs_2.OffsetSegments)
springlines = Geometry(a_springs_2.SpringLines)
viewer = ParamViewer(topology.FaceEdgeAdjacency)
panel_4 = Panel(branch)
merge = Merge(Data2=cross_section)
crosec = CrossSectionKaramba(merge)
springs = Line(springlines)
linetobeam = LineToBeamKaramba(Line=flatten(springs), Identifier="spring", CrossSection=crosec, New=True, Remove=True, LimitDistance_m=0.005)  # -> simplify(Element), Points, Info
mesh_segments = MeshSegments(offset_segments=offsetsegments, ipts=segmentspringlocations, mesh_resolution=Slider(0.2, range=0..0.3))
segments_mesh = Mesh(mesh_segments)
mesh = Mesh(segments_mesh)
gapsize = Number(a_springs_2.GapSize)
image = ImageSampler(Filter="Colour", Interpolate=False, Umax=1, Umin=0, Vmax=1, Vmin=0, Wrap=1)
load_pattern = Slider(2, range=1..7)
dead_load_kn_m2 = Slider(1, range=0..10)
live_load_kn_m2 = Slider(1.5, range=0..10)
segments_mesh_2 = Mesh(flatten(segments_mesh))
load_pattern_2 = Integer(load_pattern)
a_shellloads = ShellLoads(Mesh=segments_mesh_2, DeadLoadValue=dead_load_kn_m2, LiveLoadValue=live_load_kn_m2, LiveLoadPattern=load_pattern_2)  # -> Loads, CheckPoints
cross_section_2 = CrossSectionKaramba3D(
    FamilyNameOfCrossSection="DefaultCroSec",
    Material=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,
    Height_cm=Slider(6, range=0..10),
    mode="Shell - Const")
bottompoints = BottomPoints(mesh=mesh, ltol=Slider(2, range=0..10))  # -> flatten(pt_3)
geo = Geometry(a_shellloads.CheckPoints)
supp = SupportKaramba3D(PosInd=bottompoints, menu=[buttons(on, on, on, off, off, on)])
thickness_m = Number(Slider(0.06, range=0..0.1))
a_makeshell = MakeKarambaShellElement(ShellSurface=shell, Meshes=flatten(mesh), Thickness=thickness_m)  # -> ShellElements, ShellSupports
load = LoadKaramba3D(flatten(a_shellloads.Loads))
panel_5 = Panel(load)
load_pattern_3 = Slider(2, range=1..7)
image_2 = ImageSampler(Filter="Colour", Interpolate=False, Umax=1, Umin=0, Vmax=1, Vmin=0, Wrap=1)
dead_load_kn_m2_2 = Slider(1, range=0..10)
live_load_kn_m2_2 = Slider(1.5, range=0..10)
meshtoshell = MeshToShellKaramba3D(Mesh=mesh, CrossSection=cross_section_2, LimitDistance_m=0.005)  # -> Element, flatten(Points), Info
merge_2 = Merge(Data1=flatten(linetobeam.Element), Data2=flatten(a_makeshell.ShellElements))
fixes_supp = BooleanToggle(False)
element = ElementKaramba(merge_2)
matselect = MaterialSelectionKaramba3D(menu=[dropdown(3), dropdown(1)])

# ----
# Karamba analysis
# and results
assemble = AssembleModelKaramba3D(Elem=element, Support=supp, Load=load, Material=matselect, LimitDistance_m=0.005)  # -> Model, Info, Mass_kg, CenterOfGravity
analyze = AnalyzeKaramba3D(Model=assemble.Model)  # -> CalculatedModel, MaximumDisplacement_cm, ResultingForceOfGravity_kN, ElasticEnergy_kNm
modelview = ModelViewKaramba3D(Model=analyze.CalculatedModel, ResultFactors=1, ResultCase=-1)  # -> Model, DeformedMesh, DeformedAxes, DeformedModel
medges_2 = MeshEdges(Mesh=modelview.DeformedMesh)  # -> NakedEdges, InteriorEdges, NonManifoldEdges

analyzethii = AnalyzeThIIKaramba3D(Model=assemble.Model, RTolerance=1e-07, MaxIterations=50, NoTensionalNII=False)  # -> CalculatedModel, MaximumDisplacement_cm, ResultingForceOfGravity_kN, ElasticEnergy_kNm; disabled
bmodes = BucklingModesKaramba3D(
    Model=analyzethii.CalculatedModel,
    FromIndex=1,
    NumberOfModes=Slider(3, range=0..10),
    MaximumNumberOfIterations=300,
    Epsilon=1e-07)  # -> ModelWithBucklingModesAsLoadCaseResults, BucklingLoadFactors
beamview = BeamViewKaramba3D(Model=modelview.Model)  # -> Model, MeshesOfRenderedBeams, DeformedBeamAxes, LegendColors, LegendTags; disabled
crv = Curve(modelview.DeformedAxes)
explode = Explode(Curve=simplify(crv), Recursive=True)  # -> Segments, Vertices
panel_6 = Panel(bmodes.BucklingLoadFactors)
shellview = ShellViewKaramba3D(Model=modelview.Model, IndexOfLayer=0)  # -> Model, MeshesOfRenderedShells, LegendColors, LegendTags
number_slider_3 = Slider(0.02, range=0..0.1)
legend = Legend(Colour=shellview.LegendColors, Tags=shellview.LegendTags, LegendType=1)
item_3 = ListItem(List=explode.Segments, Index=Slider(0, range=0..1), Wrap=True)
mesh_2 = Mesh(shellview.MeshesOfRenderedShells)
end = EndPoints(Curve=item_3)  # -> Start, End
model = ModelKaramba3D(modelview.Model)
item_4 = ListItem(List=reverse(shellview.LegendTags), Index=0, Wrap=True)  # -> Item, Item1
item_5 = ListItem(List=shellview.LegendTags, Index=0, Wrap=True)  # -> Item, Item1
gapsize_2 = Number(gapsize)
panel_7 = Panel(item_5.Item1)
panel_8 = Panel(item_4.Item1)
multiplication_9 = Multiplication(A=gapsize_2, B="2")
scale = Scale(Geometry=item_3, Center=end.Start, Factor=multiplication_9)  # -> Geometry, Transform
model_2 = ModelKaramba3D(modelview.Model)
crv_2 = Curve(medges_2.NakedEdges)
mesh_3 = Mesh(modelview.DeformedMesh)
merge_viz = Merge(Data1=crv_2, Data2=model_2, Data3=mesh_3, Data4=scale.Geometry)
viz_springs = VizSprings(spring_line=scale.Geometry, scale=Slider(0.5, range=0..1))
max_stress_comp = Number(item_5.Item1)
max_stress_tens = Number(item_4.Item1)
max_disp = Number(analyze.MaximumDisplacement_cm)
mag_ct = Integer()
geo_2 = Geometry(viz_springs)
rec = DataRecorder(max_stress_tens, DataLimit=-10, RecordData=False)
rec_2 = DataRecorder(max_stress_comp, DataLimit=-10, RecordData=False)
rec_3 = DataRecorder(mag_ct, DataLimit=-10, RecordData=False)
rec_4 = DataRecorder(max_disp, DataLimit=-10, RecordData=False)
quick_graphs = QuickGraphs()

cables = Curve()  # disabled
offsetsegments_2 = Geometry(offsetsegments)  # disabled
cables_2 = BooleanToggle(False)  # disabled

# ----
# if input cables disabled, split segments is same as input segments
cables_3 = Curve(cables)  # disabled

embed_cables = EmbedCables(segments=offsetsegments_2, cables=cables_3)  # -> split_segments_2, split_cables_2; disabled
split_cables = Geometry(embed_cables.split_cables_2)  # disabled
filter = StreamFilter(Gate=cables_2, Stream0=offsetsegments_2, Stream1=embed_cables.split_segments_2)  # disabled

# ---- group: PT in mesh for Karamba
number_slider_4 = Slider(0.01, range=0..0.1)  # disabled
curveclosestmeshvert = CurveClosestMeshVert(segments=segments_mesh, cables=split_cables, tol=number_slider_4)  # -> simplify(polyline_2); disabled
number_slider_5 = Slider(16.618, range=0..100)  # disabled
posttensioning = PostTensioning(pt_force=number_slider_5, cables=curveclosestmeshvert)  # -> simplify(pt_intersection_nodes_3), vec_pt_force_4, vec_end_force_2; disabled

# ---- group: Preliminary analysis
mesh_breps = MeshBrepsKaramba3D(
    MeshResolution=Slider(0.1, range=0..1),
    EdgeRefinementFactor=0.67,
    PointReduction=Toggle(False),
    SmoothingStepSize=Slider(1, range=0..1),
    SmoothingIterations=Slider(1, range=0..10))  # -> Mesh, Info
thickness_m_2 = Number(thickness_m)

# ----
a_shellloads_2 = ShellLoads(Mesh=mesh_breps.Mesh, DeadLoadValue=dead_load_kn_m2_2, LiveLoadValue=live_load_kn_m2_2, LiveLoadPattern=load_pattern_3)  # -> Loads, CheckPoints; disabled

# ---- group: Preliminary analysis (continued)
a_preliminaryshellanalysismodel = PreliminaryShellAnalysisModel(Mesh=mesh_breps.Mesh, Thickness=thickness_m_2, Loads=a_shellloads_2.Loads, FixedSupport=fixes_supp)
analyze_2 = AnalyzeKaramba3D(Model=a_preliminaryshellanalysismodel)  # -> CalculatedModel, MaximumDisplacement_cm, ResultingForceOfGravity_kN, ElasticEnergy_kNm

# ==== cluster CurveClosestMeshVert
number_slider = Slider(8, range=0..100)
segments = ClusterInput()
cables = ClusterInput()
tol = ClusterInput()
tol_2 = Number(tol)
segments_2 = Mesh(segments)
number_slider_2 = Slider(0.01, range=0..0.01)
cables_2 = Curve(cables)
branch = TreeBranch(Tree=segments_2, Path=number_slider, MaintainPaths=True)
branch_2 = TreeBranch(Tree=cables_2, Path=number_slider, MaintainPaths=True)
mesh = Mesh(segments_2)
curve = Curve(cables_2)

# ---- group: exclude segments without cables
tstat = TreeStatistics(Tree=cables_2)  # -> Paths, Length, Count
branch_3 = TreeBranch(Tree=mesh, Path=tstat.Paths, MaintainPaths=True)

# ----
deconstruct_mesh = DeconstructMesh(Mesh=branch_3)  # -> simplify(Vertices), Faces, Colours, Normals

# ---- group: "manual" cross reference
group = Group(Objects=deconstruct_mesh.Vertices)
lng = ListLength(List=curve)
repeat = RepeatData(Data=group, Length=lng)  # -> simplify(Data)
ungroup = Ungroup(Group=repeat)

# ----
curve_2 = Curve(graft(curve))
pull = PullPoint(Point=ungroup, Geometry=curve_2, ClosestOnly=True)  # -> ClosestPoint, Distance
smaller = SmallerThan(FirstNumber=pull.Distance, SecondNumber=tol_2)  # -> SmallerThan, OrEqualTo
dispatch = Dispatch(List=pull.ClosestPoint, DispatchPattern=smaller.SmallerThan)  # -> ListA, ListB
pt = Point(dispatch.ListA)
sort_along_curve = SortAlongCurve(Points=pt, Curve=curve_2)  # -> simplify(Points), Indices
cullpt = CullDuplicates(Points=sort_along_curve.Points, Tolerance=tol_2, CullMode=3)  # -> Points, Indices, Valence
polyline = PolyLine(Vertices=cullpt.Points, Closed=False)
polyline_2 = ClusterOutput(polyline)

# ==== cluster PostTensioning
cables = ClusterInput()
pt_force = ClusterInput()
cables_2 = Geometry(cables)
pt_force_2 = Number(pt_force)

# ----
# PT forces
pt_kn = Number(pt_force_2)
crv = Curve(cables_2)
flip = FlipCurve(Curve=crv)  # -> Curve, Flag
explode = Explode(Curve=crv, Recursive=True)  # -> Segments, simplify(Vertices)
crv_2 = Curve(crv)
lng = ListLength(List=explode.Vertices)
series = Series(Start=0, Step=1, Count=lng)  # -> simplify(Series)
int = Integer(series)
neg = Negative(Value=int)
eval = EvaluateCurve(Curve=graft(crv_2), Parameter=int)  # -> Point, Tangent, Angle
eval_2 = EvaluateCurve(Curve=graft(flip.Curve), Parameter=neg)  # -> Point, Tangent, Angle
pt_intersection_nodes = Point(eval.Point)

intcrv = Interpolate(Vertices=explode.Vertices, Degree=3, Periodic=False, KnotStyle=1)  # -> Curve, Length, Domain
nurbs = NurbsCurve(Vertices=explode.Vertices, Degree=3, Periodic=False)  # -> Curve, Length, Domain
crvgraph = CurvatureGraph(Curve=intcrv.Curve, Density=5, Scale=Slider(103, range=0..120))
crossref = CrossReference(ListA=graft(pt_kn), ListB=eval.Point, CrossMode=1)  # -> ListA, ListB

amp = Amplitude(Vector=eval_2.Tangent, Amplitude=simplify(crossref.ListA))
amp_2 = Amplitude(Vector=eval.Tangent, Amplitude=simplify(crossref.ListA))
addition = Addition(A=amp_2, B=amp)
vdis = VectorDisplay(Anchor=pt_intersection_nodes, Vector=amp)
vdis_2 = VectorDisplay(Anchor=pt_intersection_nodes, Vector=amp_2)
vec_pt_force = Vector(addition)
vdis_3 = VectorDisplay(Anchor=pt_intersection_nodes, Vector=vec_pt_force)

item = ListItem(List=reverse(amp_2), Index=0, Wrap=True)
item_2 = ListItem(List=reverse(eval.Point), Index=0, Wrap=True)
item_3 = ListItem(List=eval_2.Point, Index=0, Wrap=True)
item_4 = ListItem(List=amp, Index=0, Wrap=True)
vdis_endforce = VectorDisplay(Anchor=item_2, Vector=item)
vdis_endforce_2 = VectorDisplay(Anchor=item_3, Vector=item_4)
merge = Merge(Data1=item, Data2=item_4)
pt_intersection_nodes_2 = Point(pt_intersection_nodes)
vec_end_force = Vector(merge)
vec_pt_force_2 = Vector(addition)
vec_end_force_2 = ClusterOutput(vec_end_force)
move = Move(Geometry=pt_intersection_nodes_2, Motion=vec_pt_force_2)  # -> Geometry, Transform

# ---- group: pair up curve intersection points by index, returns uniques
vec_pt_force_3 = Vector(flatten(vec_pt_force))
pt = Point(flatten(pt_intersection_nodes))
rdpoints = RemoveDuplicatePointsKaramba3D(Point=pt, LimitDistance=0.005)  # -> OutPoint, Info, Indexes
item_5 = ListItem(List=pt, Index=rdpoints.Indexes, Wrap=True)
cp = ClosestPoint(Point=item_5, Cloud=pt)  # -> ClosestPoint, simplify(graft(CPIndex)), Distance
merge_2 = Merge(Data1=simplify(graft(rdpoints.Indexes)), Data2=cp.CPIndex)
item_6 = ListItem(List=vec_pt_force_3, Index=merge_2, Wrap=True)
item_7 = ListItem(List=pt, Index=merge_2, Wrap=True)
ma = MassAddition(Input=item_6)  # -> Result, PartialResults
item_8 = ListItem(List=item_7, Index=0, Wrap=True)
vdisex = VectorDisplayEx(Point=item_8, Vector=ma.Result, Colour=RGB(0, 0, 0), Width=Slider(3, range=0..10))

# ----
pline = PolyLine(Vertices=move.Geometry, Closed=False)  # disabled
curve = Curve(pline)  # disabled
pt_intersection_nodes_3 = ClusterOutput(pt_intersection_nodes_2)
vec_pt_force_4 = ClusterOutput(vec_pt_force_2)

# ==== cluster EmbedCables
segments = ClusterInput()
cables = ClusterInput()
segments_2 = Surface(simplify(segments))
cables_2 = Curve(cables)
surface_curve = SurfaceCurve(Surface=segments_2, Curve=flatten(cables_2))  # -> simplify(Curves), Points, UVPoints, Normals, Parameters, Tangents
trim = TrimTree(Tree=surface_curve.Curves, Depth=1)
srfsplit = SurfaceSplit(Surface=segments_2, Curves=trim)
trim_2 = TrimTree(Tree=srfsplit, Depth=1)
split_segments = Geometry(trim_2)
split_cables = Geometry(trim)
split_segments_2 = ClusterOutput(split_segments)
split_cables_2 = ClusterOutput(split_cables)

# ==== cluster MeshSegments
mesh_resolution = ClusterInput()
offset_segments = ClusterInput()
ipts = ClusterInput()
ipts_2 = Point(ipts)
offset_segments_2 = Surface(simplify(offset_segments))
mesh_resolution_2 = Number(mesh_resolution)
mesh_breps = MeshBrepsKaramba3D(
    Brep=offset_segments_2,
    InclusionPoints=ipts_2,
    MeshResolution=mesh_resolution_2,
    EdgeRefinementFactor=0.67,
    PointReduction=False,
    SmoothingStepSize=Slider(1, range=0..1),
    SmoothingIterations=Slider(3, range=0..10))  # -> simplify(Mesh), Info
mjoin = MeshJoin(Meshes=mesh_breps.Mesh)
mesh = Mesh(mjoin)
mesh_2 = ClusterOutput(mesh)

# ==== cluster TestSurface
number_slider = Slider(3, range=0..10)
srf = Surface(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)
scale_nu = ScaleNU(Geometry=srf, Plane=PlaneXY(0, 0, 0), ScaleX=1, ScaleY=1, ScaleZ=Slider(1.042, range=0..5))  # -> Geometry, Transform
panel = Panel("1")
srf_2 = Surface(scale_nu.Geometry)
divide = DivideDomain²(Domain=srf_2, UCount=number_slider, VCount=number_slider)
subsrf = Isotrim(Surface=reparameterize(srf_2), Domain=divide)
S = ClusterOutput(subsrf)

# ==== cluster BottomPoints
ltol = ClusterInput()
mesh = ClusterInput()
mesh_2 = Mesh(mesh)
ltol_2 = Integer(ltol)
demesh = DeconstructMesh(Mesh=mesh_2)  # -> Vertices, Faces, Colours, Normals
pt = Point(flatten(demesh.Vertices))
bbox = BoundingBox(Content=pt, Plane=PlaneXY(0, 0, 0), UnionBox=True)  # -> Box, Box_2
box = EvaluateBox(Box=bbox.Box, UParameter="0", VParameter="0", WParameter="0")  # -> Plane, Point, Include
neg = Negative(Value=ltol_2)
_10º = PowerOf10(Value=neg)
cp = PlaneClosestPoint(Point=pt, Plane=box.Plane)  # -> Point, UVPoint, Distance
panel = Panel("1e-10")
smaller = SmallerThan(FirstNumber=cp.Distance, SecondNumber=_10º)  # -> SmallerThan, OrEqualTo
boxdims = BoxDims(box=bbox.Box)  # -> dx_2, dy_2, dz_2
dispatch = Dispatch(List=pt, DispatchPattern=smaller.SmallerThan)  # -> ListA, ListB
duppt = RemoveDuplicatePts(Points=dispatch.ListA, Tolerance=0.01)  # -> simplify(UniquePoints)
division = Division(A=boxdims.dx_2, B="2")
pgroups = PointGroups(Points=duppt, Distance=division)  # -> simplify(Groups), Indices
pt_2 = Point(pgroups.Groups)
pt_3 = ClusterOutput(pt_2)

# ==== cluster QuickGraphs

# ---- group: whole shell
max_stress_comp = Number(-0.146)
max_stress_tens = Number(0.186)
max_disp = Number(0.03259199848)

# ----
max_stress_comp_2 = Number([-0.736, -0.51, -0.109, -0.151, -0.157, -0.148, -0.147, -0.147, -0.147, -0.147, -0.147])
max_stress_tens_2 = Number([4.69, 3.24, 0.333, 0.164, 0.224, 0.191, 0.184, 0.183, 0.183, 0.183, 0.183])
max_disp_2 = Number([1.58279036, 1.182691614, 0.3778172142, 0.1103610701, 0.05740937502, 0.03608507293, 0.032556884, 0.03216712047, 0.03212689201, 0.03212284776, 0.03212244312])
mag_ct = Integer([0, 1, 2, 3, 4, 5, 6, 7, 8, 9, 10])
merge = Merge(Data1=graft(max_stress_comp_2), Data2=graft(max_stress_tens_2), Data3=graft(max_disp_2))  # -> simplify(Result)
panel = Panel("""max stress comp
max stress tens
max disp""")
merge_2 = Merge(Data1=graft(max_stress_comp), Data2=graft(max_stress_tens), Data3=graft(max_disp))  # -> simplify(Result)
panel_2 = Panel(merge_2)
flip = FlipMatrix(Data=merge)
panel_3 = Panel(flip)
chart = CreateChart(
    ChartName="My Chart",
    ChartSeries=panel,
    ChartXAxisLabels=mag_ct,
    ValueTree=flip,
    Chart_Theme="Bright Pastel",
    Chart_Type="Line")

# ==== cluster VizSprings
spring_line = ClusterInput()
scale = ClusterInput()
spring_line_2 = Geometry(spring_line)
scale_2 = Number(scale)
len = Length(Curve=spring_line_2)
multiplication = Multiplication(A=len, B=scale_2)
division = Division(A=multiplication, B="2")
eval = EvaluateCurve(Curve=reparameterize(spring_line_2), Parameter=".5")  # -> Point, Tangent, Angle
number_slider = Slider(5, range=0..10)
pl = PlaneNormal(Origin=eval.Point, ZAxis=eval.Tangent)
sph = Sphere(Base=pl, Radius=division)
range = Range(Domain=number_slider, Steps=Slider(100, range=0..100))
division_2 = Division(A=range, B=number_slider)
pt = ConstructPoint(XCoordinate=range, YCoordinate=division_2, ZCoordinate=0)
crvsrf = CurveOnSurface(Surface=reparameterize(sph), UVCoordinates=pt, Closed=False)  # -> Curve, Length, Domain
C = ClusterOutput(crvsrf.Curve)

# ==== cluster BoxDims
box = ClusterInput()
box_2 = Box(box)
debox = DeconstructBox(Box=box_2)  # -> Plane, X, Y, Z
dedomain = DeconstructDomain(Domain=debox.X)  # -> Start, End
dedomain_2 = DeconstructDomain(Domain=debox.Y)  # -> Start, End
dedomain_3 = DeconstructDomain(Domain=debox.Z)  # -> Start, End
subtraction = Subtraction(A=dedomain.End, B=dedomain.Start)
subtraction_2 = Subtraction(A=dedomain_2.End, B=dedomain_2.Start)
subtraction_3 = Subtraction(A=dedomain_3.End, B=dedomain_3.Start)
dx = Number(subtraction)
dy = Number(subtraction_2)
dz = Number(subtraction_3)
dx_2 = ClusterOutput(dx)
dy_2 = ClusterOutput(dy)
dz_2 = ClusterOutput(dz)
