# Grasshopper definition example_GEOMETRY.gh (Grasshopper 1.0.7)
# plug-ins: HAL for Grasshopper, ACORNshells, karambaGH

sessionsettings = SessionSettings()
bay_geometry = Geometry(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)
sin = Sine(Value="pi/4")
multiplication = Multiplication(A=Slider(0.3, range=0..1), B=sin)
corner_radius = Number(multiplication)
a_makeshellplan = MakeShellPlan(Outline=bay_geometry, CornerRadius=corner_radius, CurvedCorner=Toggle(False))
membrane_prestress = Slider(0.335, range=0..1)
cable_prestress = Slider(0.915, range=0..1)
shell_height = Slider(0.5625, range=0..1)
srf = Surface(a_makeshellplan)
a_formfindmembrane = FormFindMembrane(
    PlanShell=srf,
    Height=shell_height,
    SubDiv=Slider(15, range=0..100),
    MembranePrestress=membrane_prestress,
    CablePrestress=cable_prestress,
    Run=Button())  # -> KiwiErrors, FormFoundShell
demo = Geometry(a_formfindmembrane.FormFoundShell)
mesh_breps = MeshBrepsKaramba3D(
    Brep=demo,
    MeshResolution=Slider(0.1, range=0..1),
    EdgeRefinementFactor=Slider(0.333, range=0..1),
    PointReduction=Toggle(False),
    SmoothingStepSize=Slider(1, range=0..1),
    SmoothingIterations=Slider(1, range=0..10))  # -> Mesh, Info
a_preliminarymodel = PreliminaryModel(ShellSurface=demo, Mesh=mesh_breps.Mesh)
number_slider = Slider(1, range=0..10)
analyze = AnalyzeKaramba3D(Model=a_preliminarymodel)  # -> CalculatedModel, MaximumDisplacement_cm, ResultingForceOfGravity_kN, ElasticEnergy_kNm
a_stresslines = StressLines(
    Model=analyze.CalculatedModel,
    Shell=demo,
    KeystoneWidth=number_slider,
    CornerstoneWidth=number_slider,
    LengthParam1=number_slider,
    LengthParam2=number_slider)  # -> StressLines1, StressLines2, CableProfiles1, CableProfiles2
geo = Geometry([a_stresslines.CableProfiles1, a_stresslines.CableProfiles2])
geo_2 = Geometry([a_stresslines.StressLines1, a_stresslines.StressLines2])
a_segment = Segment(Shell=demo, StressLines1=a_stresslines.StressLines1, StressLines2=a_stresslines.StressLines2)
image = ImageSampler(Filter="Colour", Interpolate=False, Umax=1, Umin=0, Vmax=1, Vmin=0, Wrap=1)
