# Grasshopper definition example_pinbedSimulation.gh (Grasshopper 1.0.7)
# plug-ins: ACORNshells

# ----
# internalized
# data for shell segments
segments = Surface([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])

segments_2 = Surface(simplify(graft(segments)))
# MISH:
# 
# CHANGED BBOX INPUT TO GRAFT TO EACH SEGMENT
number_slider = Slider(3, range=0..10)
number_slider_2 = Slider(1, range=0..1)
a_fitbbox = FitBoundingBox(Segment=segments_2, AngularResolution=Slider(2, range=0..10), Rotate3D=Toggle(False))
a_fitmods = FitPinbedModules(Box=flatten(a_fitbbox), Width=number_slider_2, Depth=number_slider_2, ToleranceLevel=number_slider)  # -> simplify(ModuleRectangles)
item = ListItem(List=flatten(segments_2), Index=0, Wrap=True)
a_areaeff = GetAreaEfficiency(Segment=segments_2, Modules=a_fitmods)
untrim = Untrim(Surface=item)
avr = Average(Input=flatten(a_areaeff))
panel = Panel("""5
6
7""")
a_simpinbed = SimulatePinbed(
    ShellSegments=segments_2,
    Modules=a_fitmods,
    VH=Toggle(True),
    SelectedSegments=panel,
    MaximumPinLength=Slider(0.4, range=0..1))  # -> ShellSegments, ExtendedSegments, Modules, Boxes, PinAxes, PinHeights, PinColors
adjusted_modules = Geometry(a_simpinbed.Modules)
original_segments = Geometry(a_simpinbed.ShellSegments)
extended_segments = Geometry(a_simpinbed.ExtendedSegments)
pins = Geometry(a_simpinbed.PinAxes)
preview = CustomPreview(Geometry=a_simpinbed.PinAxes, Material=a_simpinbed.PinColors)
end = EndPoints(Curve=pins)  # -> Start, End
lng = ListLength(List=end.Start)
series = Series(Start=0, Step=1, Count=lng)
tag = TextTag(Location=end.Start, Text=series)
