# Grasshopper definition example_wholeShellAnalysis.gh (Grasshopper 1.0.7)
# plug-ins: ACORNshells, karambaGH

thickness_m = Number(0.061)
shell = Surface(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)
mesh_breps = MeshBrepsKaramba3D(
    Brep=shell,
    MeshResolution=Slider(0.1, range=0..1),
    EdgeRefinementFactor=Slider(0.2, range=0..1),
    PointReduction=False,
    SmoothingStepSize=Slider(1, range=0..1),
    SmoothingIterations=Slider(3, range=0..10))  # -> Mesh, Info
thickness_m_2 = Number(thickness_m)
load_pattern = Slider(1, range=1..7)
image = ImageSampler(Filter="Colour", Interpolate=False, Umax=1, Umin=0, Vmax=1, Vmin=0, Wrap=1)
dead_load_kn_m2 = Slider(1, range=0..10)
live_load_kn_m2 = Slider(5, range=0..10)
fixes_supp = BooleanToggle(False)
matselect = MaterialSelectionKaramba3D(menu=[dropdown(3), dropdown(9)])
thickness_m_3 = Number(thickness_m_2)
load_pattern_2 = Integer(load_pattern)
mesh = Mesh(mesh_breps.Mesh)
a_shellloads = ShellLoads(Mesh=mesh, DeadLoadValue=dead_load_kn_m2, LiveLoadValue=live_load_kn_m2, LiveLoadPattern=load_pattern_2)  # -> Loads, CheckPoints
a_makeshell = MakeKarambaShellElement(ShellSurface=shell, Meshes=mesh, Thickness=thickness_m_3, Material=matselect, FixedSupport=fixes_supp)  # -> ShellElements, ShellSupports
assemble = AssembleModelKaramba3D(Elem=a_makeshell.ShellElements, Support=a_makeshell.ShellSupports, Load=a_shellloads.Loads, LimitDistance_m=0.005)  # -> Model, Info, Mass_kg, CenterOfGravity
model = ModelKaramba3D(assemble.Model)
modelview = ModelViewKaramba3D(Model=model, ResultFactors=1, ResultCase=-1)  # -> Model, DeformedMesh, DeformedAxes, DeformedModel
a_results = AnalysisResults(KarambaModel=model, Percentile=Slider(99, range=90..100), Buckling=Toggle(True))  # -> MaxComp, MaxComp_2, MaxCompMeshEs, MaxTens, MaxTens_2, MaxTensMesh, MaximumDisplacement, BucklingFactor, AnalysedModelThI, AnalysedModelThII
modelview_2 = ModelViewKaramba3D(Model=a_results.AnalysedModelThII, ResultFactors=1, ResultCase=-1)  # -> Model, DeformedMesh, DeformedAxes, DeformedModel
merge = Merge(
    Data1=a_results.MaxComp,
    Data2=a_results.MaxComp_2,
    Data3=a_results.MaxTens,
    Data4=a_results.MaxTens_2,
    Data5=a_results.BucklingFactor,
    Data6=a_results.MaximumDisplacement)
mesh_2 = Mesh(a_results.MaxCompMeshEs)
mesh_3 = Mesh(a_results.MaxTensMesh)
panel = Panel(merge)
shellview = ShellViewKaramba3D(Model=modelview_2.Model, IndexOfLayer=0)  # -> Model, MeshesOfRenderedShells, LegendColors, LegendTags
medges = MeshEdges(Mesh=shellview.MeshesOfRenderedShells)  # -> NakedEdges, InteriorEdges, NonManifoldEdges
merge_2 = Merge(Data1=medges.NakedEdges, Data2=shellview.MeshesOfRenderedShells)
legend = Legend(Colour=shellview.LegendColors, Tags=shellview.LegendTags, LegendType=1)
crv = Curve(medges.NakedEdges)
geo_vizshell = Geometry(merge_2)
